# Grasshopper definition 2_imageSampler.gh (Grasshopper 0.9.76)

pt = ConstructPoint(XCoordinate=0, YCoordinate=0, ZCoordinate=0)
series = Series(Start=0, Step=Slider(0.5, range=0..1), Count=Slider(200, range=0..1000))

# ---- group: create grid
X = UnitX(Factor=series)
Y = UnitY(Factor=series)
move = Move(Geometry=pt, Motion=X)  # -> Geometry, Transform
move_2 = Move(Geometry=move.Geometry, Motion=graft(Y))  # -> Geometry, Transform

# ---- group: remap to 0..1 domain
item = ListItem(List=reverse(series), Index=0, Wrap=True)
one_over_x = OneOverX(Value=item)
multiplication = Multiplication(A=move_2.Geometry, B=one_over_x)

# ----
percentagemap = Data(multiplication)
realmap = Data(move_2.Geometry)
percentagemap_2 = Data(percentagemap)
realmap_2 = Data(realmap)

# ---- group: get heights from image
image = ImageSampler(
    percentagemap_2,
    FilePath="C:\Users\Chris\Desktop\tiling-perlin-noise.png",
    Filter="Value",
    Interpolate=False,
    Umax=1,
    Umin=0,
    Vmax=1,
    Vmin=0,
    Wrap=1)
multiplication_2 = Multiplication(A=image, B=Slider(7.442, range=0..10))
Z = UnitZ(Factor=multiplication_2)

# ----
move_3 = Move(Geometry=realmap, Motion=Z)  # -> Geometry, Transform
pline = PolyLine(Vertices=move_3.Geometry, Closed=False)
