# Grasshopper definition 3_imageSamplerExtended.gh (Grasshopper 0.9.76)

pt = ConstructPoint(XCoordinate=0, YCoordinate=0, ZCoordinate=0)
series = Series(Start=0, Step=Slider(0.5, range=0..1), Count=Slider(200, range=0..1000))

# ---- group: create grid
X = UnitX(Factor=series)
Y = UnitY(Factor=series)
move = Move(Geometry=pt, Motion=X)  # -> Geometry, Transform
move_2 = Move(Geometry=move.Geometry, Motion=graft(Y))  # -> Geometry, Transform

# ---- group: remap to 0..1 domain
item = ListItem(List=reverse(series), Index=0, Wrap=True)
one_over_x = OneOverX(Value=item)
multiplication = Multiplication(A=move_2.Geometry, B=one_over_x)

# ----
percentagemap = Data(multiplication)
realmap = Data(move_2.Geometry)
percentagemap_2 = Data(percentagemap)
percentagemap_3 = Data(percentagemap)

# ---- group: create vector
number_slider = Slider(1, range=0..1)
image = ImageSampler(
    percentagemap_3,
    FilePath="C:\Users\Chris\Desktop\1a9eaee2.jpg",
    Filter="Colour",
    Interpolate=False,
    Umax=1,
    Umin=0,
    Vmax=1,
    Vmin=0,
    Wrap=1)
neg = Negative(Value=number_slider)
dom = ConstructDomain(DomainStart=neg, DomainEnd=number_slider)
argb = SplitARGB(Colour=image)  # -> Alpha, Red, Green, Blue
remap = RemapNumbers(Value=argb.Red, Source=Domain(0, 1), Target=dom)  # -> Mapped, Clipped
remap_2 = RemapNumbers(Value=argb.Green, Source=Domain(0, 1), Target=dom)  # -> Mapped, Clipped
vec = VectorXYZ(XComponent=remap.Mapped, YComponent=remap_2.Mapped, ZComponent=argb.Blue)  # -> Vector, Length
unit = UnitVector(Vector=vec.Vector)

# ----
realmap_2 = Data(realmap)
image_2 = ImageSampler(
    percentagemap_2,
    FilePath="C:\Users\Chris\Desktop\tiling-perlin-noise.png",
    Filter="Value",
    Interpolate=False,
    Umax=1,
    Umin=0,
    Vmax=1,
    Vmin=0,
    Wrap=1)
multiplication_2 = Multiplication(A=image_2, B=Slider(5.7345, range=0..10))
multiplication_3 = Multiplication(A=multiplication_2, B=unit)
move_3 = Move(Geometry=realmap_2, Motion=multiplication_3)  # -> Geometry, Transform
ln = Line(StartPoint=realmap_2, EndPoint=move_3.Geometry)
