# Grasshopper definition 4_simpleAnemone.gh (Grasshopper 0.9.76)
# plug-ins: Anemone

number_slider = Slider(410, range=0..1000)
random = Random(Range=Domain(0, 1), Number=number_slider, Seed=2)
random_2 = Random(Range=Domain(0, 1), Number=number_slider, Seed=Slider(5, range=0..10))
pt = ConstructPoint(XCoordinate=random, YCoordinate=random_2, ZCoordinate=0)
loop_start = LoopStart(Repeat=Slider(100, range=0..100), Trigger=Toggle(False), Data=pt)  # -> port, Counter, Data
voronoi = Voronoi(Points=loop_start.Data, Radius=Slider(0.25, range=0..1), BruteForceOverride=False)
area = Area(Geometry=voronoi)  # -> Area, Centroid
loop_end = LoopEnd(port=loop_start.port, Exit=False, Data=area.Centroid, pausedState=False, state="Constant output", TimeOutVal=0)
