# Grasshopper definition MeshTile2.gh (Grasshopper 0.9.76)
# plug-ins: HDTReference, Noise 4D

number_slider = Slider(50, range=0..100)
rectangle = Rectangle(Plane=PlaneXY(0, 0, 0), XSize=number_slider, YSize=number_slider, Radius=0)  # -> Rectangle, Length
number_slider_2 = Slider(22, range=0..100)
explode = Explode(Curve=rectangle.Rectangle, Recursive=True)  # -> Segments, Vertices
item = ListItem(List=explode.Segments, Index=0, Wrap=True)  # -> Item, Item1, Item2, Item3
item_2 = ListItem(List=explode.Segments, Index=0, Wrap=True)  # -> Item, Item1, Item2, Item3
number_slider_3 = Slider(0.3175, range=0..1)
flip = FlipCurve(Curve=item_2.Item1)  # -> Curve, Flag
series = Series(Start=0, Step=Slider(0.05, range=0..1), Count=number_slider_2)
pt = ConstructPoint(XCoordinate=series, YCoordinate=0, ZCoordinate=0)
merge = Merge(Data2=flip.Curve, Data4=item_2.Item3)
merge_2 = Merge(Data2=item.Item, Data4=item.Item2)
perlin = PerlinNoise(Values=pt, Time=Slider(1, range=0..1), Scale=Slider(3.98, range=0..10))
divide = DivideCurve(Curve=merge_2, Count=number_slider_2, Kinks=False)  # -> Points, Tangents, Parameters
perlin_2 = PerlinNoise(Values=pt, Time=0, Scale=1)
divide_2 = DivideCurve(Curve=merge, Count=number_slider_2, Kinks=False)  # -> Points, Tangents, Parameters
number_slider_4 = Slider(6, range=0..100)
addition = Addition(A=perlin_2, B=perlin)
multiplication = Multiplication(A=addition, B=number_slider_4)
amp = Amplitude(Vector=Vector(8.559363638, 0, 0), Amplitude=multiplication)
move = Move(Geometry=divide_2.Points, Motion=amp)  # -> Geometry, Transform
item_3 = ListItem(List=amp, Index=0, Wrap=True)  # -> Item1, Item
merge_3 = Merge(Data1=graft(item_3.Item1), Data2=graft(item_3.Item))
move_2 = Move(Geometry=divide.Points, Motion=graft(merge_3))  # -> Geometry, Transform
bang = ExplodeTree(Data=move_2.Geometry)  # -> _00000, _00001
rev = ReverseList(List=bang._00001)
number_slider_5 = Slider(0.05, range=0..1)
merge_4 = Merge(Data1=rev, Data2=bang._00000)
series_2 = Series(Start=0, Step=Slider(0.0816691, range=0..1), Count=number_slider_2)
number_slider_6 = Slider(0.3175, range=0..1)
number_slider_7 = Slider(73, range=0..100)
pt_2 = ConstructPoint(XCoordinate=series_2, YCoordinate=0, ZCoordinate=0)
perlin_3 = PerlinNoise(Values=pt_2, Time=Slider(70.408, range=0..1000), Scale=Slider(4.622, range=0..10))
perlin_4 = PerlinNoise(Values=pt_2, Time=Slider(584.641, range=0..1000), Scale=1)
addition_2 = Addition(A=perlin_4, B=perlin_3)
multiplication_2 = Multiplication(A=addition_2, B=number_slider_4)
amp_2 = Amplitude(Vector=Vector(0, 22.22531406, 0), Amplitude=multiplication_2)
move_3 = Move(Geometry=merge_4, Motion=amp_2)  # -> Geometry, Transform
item_4 = ListItem(List=amp_2, Index=0, Wrap=True)  # -> Item1, Item
merge_5 = Merge(Data1=graft(item_4.Item1), Data2=graft(item_4.Item))
move_4 = Move(Geometry=move.Geometry, Motion=graft(merge_5))  # -> Geometry, Transform
pline = PolyLine(Vertices=move_3.Geometry, Closed=False)
pline_2 = PolyLine(Vertices=move_4.Geometry, Closed=False)
end = EndPoints(Curve=pline)  # -> flatten(Start), flatten(End)
item_5 = ListItem(List=end.End, Index=0, Wrap=True)  # -> Item, Item1
join = JoinCurves(Curves=flatten([pline, pline_2]), Preserve=False)
neg = Negative(Value=Slider(0.98, range=0..10))
item_6 = ListItem(List=end.Start, Index=0, Wrap=True)  # -> Item, Item1
number_slider_8 = Slider(714, range=0..1000)
offset = Offset(Curve=join, Distance=neg, Plane=PlaneXY(0, 0, 0), Corners=1)
vec2pt = Vector2Pt(PointA=item_6.Item, PointB=item_6.Item1, Unitize=False)  # -> Vector, Length
vec2pt_2 = Vector2Pt(PointA=item_6.Item1, PointB=item_5.Item1, Unitize=False)  # -> Vector, Length
srf = Surface(offset)
vec = Vector(vec2pt.Vector)
vec_2 = Vector(vec2pt_2.Vector)
series_3 = Series(Start=0, Step=1, Count=Slider(3, range=0..10))
pt_3 = Point(Point(21, 32, 0))
explode_2 = Explode(Curve=join, Recursive=True)  # -> Segments, Vertices
popgeo = PopulateGeometry(Geometry=srf, Count=Slider(1000, range=0..10000), Seed=1)
number_slider_9 = Slider(1, range=0..1)
P = Plane(pt_3)
multiplication_3 = Multiplication(A=vec_2, B=series_3)
addition_3 = Addition(A=vec, B=vec_2)
multiplication_4 = Multiplication(A=vec, B=series_3)
merge_6 = Merge(Data1=explode_2.Vertices, Data2=popgeo)  # -> flatten(Result)
item_7 = ListItem(List=flatten(move_3.Geometry), Index=0, Wrap=True)
multiplication_5 = Multiplication(A=vec, B=series_3)
number_slider_10 = Slider(50, range=0..100)
del = DelaunayMesh(Points=merge_6, Plane=PlaneXY(0, 0, 0))
rectangle_2 = Rectangle(Plane=P, XSize=number_slider_9, YSize=number_slider_9, Radius=0)  # -> Rectangle, Length
vdis = VectorDisplay(Anchor=item_7, Vector=addition_3)
facen = FaceNormals(Mesh=del)  # -> Centers, Normals
incurve = PointInCurve(Point=facen.Centers, Curve=join)  # -> Relationship, Point
rectangle_3 = Rectangle(Plane=item_7, XSize=number_slider_10, YSize=number_slider_10, Radius=0)  # -> Rectangle, Length
multiplication_6 = Multiplication()
addition_4 = Addition(A=multiplication_5, B=graft(multiplication_3))
number_slider_11 = Slider(51, range=0..100)
demesh = DeconstructMesh(Mesh=del)  # -> Vertices, Faces, Colours, Normals
number_slider_12 = Slider(2, range=0..10)
vlen = VectorLength(Vector=addition_4)
panel = Panel(vlen)
pdecon = Deconstruct(Point=addition_3)  # -> XComponent, YComponent, ZComponent
dispatch = Dispatch(List=demesh.Faces, DispatchPattern=incurve.Relationship)  # -> ListA, ListB
move_5 = Move(Geometry=rectangle_3.Rectangle, Motion=addition_3)  # -> Geometry, Transform
division = Division(A=number_slider_11, B=number_slider_12)
division_2 = Division(A=number_slider_11, B=number_slider_12)
conmesh = ConstructMesh(Vertices=demesh.Vertices, Faces=dispatch.ListA)
xy = XYPlane(Origin=Point(0, 0, 0))
one_over_x = OneOverX(Value=number_slider_12)
drec = DeconstuctRectangle(Rectangle=move_5.Geometry)  # -> BasePlane, XInterval, YInterval
number_slider_13 = Slider(2, range=0..10)
series_4 = Series(Start=0, Step=division_2, Count=number_slider_12)
series_5 = Series(Start=0, Step=division, Count=number_slider_12)
number_slider_14 = Slider(1, range=0..1)
number_slider_15 = Slider(2, range=0..10)
number_slider_16 = Slider(0.0653, range=0..10)
move_6 = Move(Geometry=conmesh, Motion=addition_4)  # -> Geometry, Transform
faceb = FaceBoundaries(Mesh=move_6.Geometry)
random = Random(Range=Domain(0, 1000), Number=4, Seed=2)
vec_3 = VectorXYZ(XComponent=series_4, YComponent=graft(series_5), ZComponent=0)  # -> Vector, Length
facen_2 = FaceNormals(Mesh=move_6.Geometry)  # -> Centers, Normals
incurve_2 = PointInCurve(Point=facen_2.Centers, Curve=move_5.Geometry)  # -> Relationship, Point
item_8 = ListItem(List=random, Index=0, Wrap=True)  # -> Item, Item1, Item2, Item3
division_3 = Division(A=number_slider_16, B=number_slider_13)
division_4 = Division(A=division_3, B=number_slider_13)
division_5 = Division(A=division_4, B=number_slider_13)
multiplication_7 = Multiplication(A=number_slider_14, B=number_slider_15)
demesh_2 = DeconstructMesh(Mesh=move_6.Geometry)  # -> Vertices, Faces, Colours, Normals; disabled
dispatch_2 = Dispatch(List=faceb, DispatchPattern=incurve_2.Relationship)  # -> ListA, ListB
multiplication_8 = Multiplication(A=multiplication_7, B=number_slider_15)
multiplication_9 = Multiplication(A=multiplication_8, B=number_slider_15)
panel_2 = Panel(vec_3.Vector)
data = Data(flatten(dispatch_2.ListA))
orient = Orient(Geometry=data, Source=drec.BasePlane, Target=xy)  # -> Geometry, Transform
scale = Scale(Geometry=orient.Geometry, Center=Point(0, 0, 0), Factor=one_over_x)  # -> Geometry, Transform
move_7 = Move(Geometry=orient.Geometry, Motion=Vector(0.9381908366, 50.01342006, 0))  # -> Geometry, Transform
group = Group(Objects=scale.Geometry)
simplex = SimplexNoise(Values=demesh_2.Vertices, Time=item_8.Item, Scale=division_3)
simplex_2 = SimplexNoise(Values=demesh_2.Vertices, Time=item_8.Item1, Scale=division_4)
simplex_3 = SimplexNoise(Values=demesh_2.Vertices, Time=item_8.Item2, Scale=division_5)
simplex_4 = SimplexNoise(Values=demesh_2.Vertices, Time=item_8.Item3, Scale=number_slider_16)
planarmap = PlanarMapping()  # -> MappedMesh, MappingPlane
move_8 = Move(Geometry=group, Motion=vec_3.Vector)  # -> Geometry, Transform
group_2 = Group(Objects=data)
multiplication_10 = Multiplication(A=simplex_4, B=number_slider_14)
multiplication_11 = Multiplication(A=simplex, B=multiplication_7)
multiplication_12 = Multiplication(A=simplex_2, B=multiplication_8)
multiplication_13 = Multiplication(A=simplex_3, B=multiplication_9)
move_9 = Move(Geometry=group_2, Motion=addition_4)  # -> Geometry, Transform
addition_5 = Addition(A=multiplication_10, B=multiplication_11, C=multiplication_12, D=multiplication_13)
multiplication_14 = Multiplication(A=addition_5, B=Slider(5, range=0..100))
Z = UnitZ(Factor=multiplication_14)
number_slider_17 = Slider(0, range=0..1)
move_10 = Move(Geometry=demesh_2.Vertices, Motion=Z)  # -> Geometry, Transform
bake = BakeGeometry(Bake=False)
conmesh_2 = ConstructMesh(Vertices=move_10.Geometry, Faces=demesh_2.Faces)
surfacemap = SurfaceMapping()
preview = CustomPreview(
    Geometry=conmesh_2,
    Shader={ambient=RGB(0, 0, 0), diffuse=RGB(255, 105, 180), emission=RGB(76, 32, 54), shine=0.5, specular=RGB(255, 255, 255), transparency=0})
