# Grasshopper definition MeshTile3.gh (Grasshopper 0.9.76)
# plug-ins: Noise 4D

number_slider = Slider(50, range=0..100)
number_slider_2 = Slider(50, range=0..100)
rectangle = Rectangle(Plane=PlaneXY(0, 0, 0), XSize=number_slider, YSize=number_slider, Radius=0)  # -> Rectangle, Length
rectangle_2 = Rectangle(Plane=PlaneXY(0, 0, 0), XSize=number_slider_2, YSize=number_slider_2, Radius=0)  # -> Rectangle, Length
number_slider_3 = Slider(13, range=0..100)
number_slider_4 = Slider(23, range=0..100)
explode = Explode(Curve=rectangle.Rectangle, Recursive=True)  # -> Segments, Vertices
explode_2 = Explode(Curve=rectangle_2.Rectangle, Recursive=True)  # -> Segments, Vertices
item = ListItem(List=explode.Segments, Index=0, Wrap=True)  # -> Item, Item1, Item2, Item3
item_2 = ListItem(List=explode.Segments, Index=0, Wrap=True)  # -> Item, Item1, Item2, Item3
item_3 = ListItem(List=explode_2.Segments, Index=0, Wrap=True)  # -> Item, Item1, Item2, Item3
item_4 = ListItem(List=explode_2.Segments, Index=0, Wrap=True)  # -> Item, Item1, Item2, Item3
number_slider_5 = Slider(0.3175, range=0..1)
number_slider_6 = Slider(0.3175, range=0..1)
flip = FlipCurve(Curve=item_2.Item1)  # -> Curve, Flag
series = Series(Start=0, Step=Slider(0.05, range=0..1), Count=number_slider_3)
flip_2 = FlipCurve(Curve=item_4.Item1)  # -> Curve, Flag
series_2 = Series(Start=0, Step=Slider(0.05, range=0..1), Count=number_slider_4)
pt = ConstructPoint(XCoordinate=series, YCoordinate=0, ZCoordinate=0)
merge = Merge(Data2=flip.Curve, Data4=item_2.Item3)
merge_2 = Merge(Data2=item.Item, Data4=item.Item2)
pt_2 = ConstructPoint(XCoordinate=series_2, YCoordinate=0, ZCoordinate=0)
merge_3 = Merge(Data2=flip_2.Curve, Data4=item_4.Item3)
merge_4 = Merge(Data2=item_3.Item, Data4=item_3.Item2)
perlin = PerlinNoise(Values=pt, Time=Slider(1, range=0..1), Scale=Slider(3.98, range=0..10))
divide = DivideCurve(Curve=merge_2, Count=number_slider_3, Kinks=False)  # -> Points, Tangents, Parameters
perlin_2 = PerlinNoise(Values=pt, Time=0, Scale=1)
divide_2 = DivideCurve(Curve=merge, Count=number_slider_3, Kinks=False)  # -> Points, Tangents, Parameters
perlin_3 = PerlinNoise(Values=pt_2, Time=Slider(1, range=0..1), Scale=Slider(3.98, range=0..10))
divide_3 = DivideCurve(Curve=merge_4, Count=number_slider_4, Kinks=False)  # -> Points, Tangents, Parameters
perlin_4 = PerlinNoise(Values=pt_2, Time=0, Scale=1)
divide_4 = DivideCurve(Curve=merge_3, Count=number_slider_4, Kinks=False)  # -> Points, Tangents, Parameters
number_slider_7 = Slider(6, range=0..100)
addition = Addition(A=perlin_2, B=perlin)
number_slider_8 = Slider(6, range=0..100)
addition_2 = Addition(A=perlin_4, B=perlin_3)
multiplication = Multiplication(A=addition, B=number_slider_7)
amp = Amplitude(Vector=Vector(8.559363638, 0, 0), Amplitude=multiplication)
multiplication_2 = Multiplication(A=addition_2, B=number_slider_8)
amp_2 = Amplitude(Vector=Vector(8.559363638, 0, 0), Amplitude=multiplication_2)
move = Move(Geometry=divide_2.Points, Motion=amp)  # -> Geometry, Transform
item_5 = ListItem(List=amp, Index=0, Wrap=True)  # -> Item1, Item
move_2 = Move(Geometry=divide_4.Points, Motion=amp_2)  # -> Geometry, Transform
item_6 = ListItem(List=amp_2, Index=0, Wrap=True)  # -> Item1, Item
merge_5 = Merge(Data1=graft(item_5.Item1), Data2=graft(item_5.Item))
merge_6 = Merge(Data1=graft(item_6.Item1), Data2=graft(item_6.Item))
move_3 = Move(Geometry=divide.Points, Motion=graft(merge_5))  # -> Geometry, Transform
move_4 = Move(Geometry=divide_3.Points, Motion=graft(merge_6))  # -> Geometry, Transform
bang = ExplodeTree(Data=move_3.Geometry)  # -> _00000, _00001
bang_2 = ExplodeTree(Data=move_4.Geometry)  # -> _00000, _00001
rev = ReverseList(List=bang._00001)
rev_2 = ReverseList(List=bang_2._00001)
number_slider_9 = Slider(0.05, range=0..1)
number_slider_10 = Slider(0.05, range=0..1)
merge_7 = Merge(Data1=rev, Data2=bang._00000)
merge_8 = Merge(Data1=rev_2, Data2=bang_2._00000)
series_3 = Series(Start=0, Step=Slider(0.0816691, range=0..1), Count=number_slider_3)
series_4 = Series(Start=0, Step=Slider(0.0816691, range=0..1), Count=number_slider_4)
number_slider_11 = Slider(0.3175, range=0..1)
number_slider_12 = Slider(73, range=0..100)
number_slider_13 = Slider(0.3175, range=0..1)
pt_3 = ConstructPoint(XCoordinate=series_3, YCoordinate=0, ZCoordinate=0)
number_slider_14 = Slider(73, range=0..100)
pt_4 = ConstructPoint(XCoordinate=series_4, YCoordinate=0, ZCoordinate=0)
perlin_5 = PerlinNoise(Values=pt_3, Time=Slider(70.408, range=0..1000), Scale=Slider(4.622, range=0..10))
perlin_6 = PerlinNoise(Values=pt_3, Time=Slider(544.872, range=0..1000), Scale=1)
perlin_7 = PerlinNoise(Values=pt_4, Time=Slider(70.408, range=0..1000), Scale=Slider(4.622, range=0..10))
perlin_8 = PerlinNoise(Values=pt_4, Time=Slider(544.872, range=0..1000), Scale=1)
addition_3 = Addition(A=perlin_6, B=perlin_5)
multiplication_3 = Multiplication(A=addition_3, B=number_slider_7)
amp_3 = Amplitude(Vector=Vector(0, 22.22531406, 0), Amplitude=multiplication_3)
addition_4 = Addition(A=perlin_8, B=perlin_7)
multiplication_4 = Multiplication(A=addition_4, B=number_slider_8)
amp_4 = Amplitude(Vector=Vector(0, 22.22531406, 0), Amplitude=multiplication_4)
move_5 = Move(Geometry=merge_7, Motion=amp_3)  # -> Geometry, Transform
item_7 = ListItem(List=amp_3, Index=0, Wrap=True)  # -> Item1, Item
move_6 = Move(Geometry=merge_8, Motion=amp_4)  # -> Geometry, Transform
item_8 = ListItem(List=amp_4, Index=0, Wrap=True)  # -> Item1, Item
merge_9 = Merge(Data1=graft(item_7.Item1), Data2=graft(item_7.Item))
merge_10 = Merge(Data1=graft(item_8.Item1), Data2=graft(item_8.Item))
pline = PolyLine(Vertices=move_5.Geometry, Closed=False)
pline_2 = PolyLine(Vertices=move_6.Geometry, Closed=False)
move_7 = Move(Geometry=move.Geometry, Motion=graft(merge_9))  # -> Geometry, Transform
move_8 = Move(Geometry=move_2.Geometry, Motion=graft(merge_10))  # -> Geometry, Transform
pline_3 = PolyLine(Vertices=move_7.Geometry, Closed=False)
end = EndPoints(Curve=pline)  # -> flatten(Start), flatten(End)
pline_4 = PolyLine(Vertices=move_8.Geometry, Closed=False)
end_2 = EndPoints(Curve=pline_2)  # -> flatten(Start), flatten(End)
item_9 = ListItem(List=end.End, Index=0, Wrap=True)  # -> Item, Item1
neg = Negative(Value=Slider(1.77, range=0..10))
join = JoinCurves(Curves=flatten([pline, pline_3]), Preserve=False)
item_10 = ListItem(List=end_2.End, Index=0, Wrap=True)  # -> Item, Item1
item_11 = ListItem(List=end.Start, Index=0, Wrap=True)  # -> Item, Item1
neg_2 = Negative(Value=Slider(0.85, range=0..10))
join_2 = JoinCurves(Curves=flatten([pline_2, pline_4]), Preserve=False)
item_12 = ListItem(List=end_2.Start, Index=0, Wrap=True)  # -> Item, Item1
number_slider_15 = Slider(714, range=0..1000)
offset = Offset(Curve=join, Distance=neg, Plane=PlaneXY(0, 0, 0), Corners=1)
number_slider_16 = Slider(714, range=0..1000)
offset_2 = Offset(Curve=join_2, Distance=neg_2, Plane=PlaneXY(0, 0, 0), Corners=1)
vec2pt = Vector2Pt(PointA=item_11.Item, PointB=item_11.Item1, Unitize=False)  # -> Vector, Length
vec2pt_2 = Vector2Pt(PointA=item_11.Item1, PointB=item_9.Item1, Unitize=False)  # -> Vector, Length
vec2pt_3 = Vector2Pt(PointA=item_12.Item, PointB=item_12.Item1, Unitize=False)  # -> Vector, Length
vec2pt_4 = Vector2Pt(PointA=item_12.Item1, PointB=item_10.Item1, Unitize=False)  # -> Vector, Length
srf = Surface(offset)
vec = Vector(vec2pt.Vector)
vec_2 = Vector(vec2pt_2.Vector)
srf_2 = Surface(offset_2)
series_5 = Series(Start=0, Step=1, Count=10)
vec_3 = Vector(vec2pt_3.Vector)
vec_4 = Vector(vec2pt_4.Vector)
pt_5 = Point(Point(21, 32, 0))
explode_3 = Explode(Curve=join, Recursive=True)  # -> Segments, Vertices
popgeo = PopulateGeometry(Geometry=srf, Count=Slider(300, range=0..10000), Seed=Slider(38, range=0..100))
series_6 = Series(Start=0, Step=1, Count=10)
pt_6 = Point(Point(21, 32, 0))
explode_4 = Explode(Curve=join_2, Recursive=True)  # -> Segments, Vertices
popgeo_2 = PopulateGeometry(Geometry=srf_2, Count=Slider(1200, range=0..10000), Seed=Slider(38, range=0..100))
number_slider_17 = Slider(1, range=0..1)
number_slider_18 = Slider(1, range=0..1)
multiplication_5 = Multiplication(A=vec, B=series_5)
P = Plane(pt_5)
multiplication_6 = Multiplication(A=vec_2, B=series_5)
merge_11 = Merge(Data1=explode_3.Vertices, Data2=popgeo)  # -> flatten(Result)
multiplication_7 = Multiplication(A=vec_3, B=series_6)
P_2 = Plane(pt_6)
multiplication_8 = Multiplication(A=vec_4, B=series_6)
merge_12 = Merge(Data1=explode_4.Vertices, Data2=popgeo_2)  # -> flatten(Result)
del = DelaunayMesh(Points=merge_11, Plane=PlaneXY(0, 0, 0))
addition_5 = Addition(A=multiplication_5, B=graft(multiplication_6))
rectangle_3 = Rectangle(Plane=P, XSize=number_slider_17, YSize=number_slider_17, Radius=0)  # -> Rectangle, Length
del_2 = DelaunayMesh(Points=merge_12, Plane=PlaneXY(0, 0, 0))
addition_6 = Addition(A=multiplication_7, B=graft(multiplication_8))
rectangle_4 = Rectangle(Plane=P_2, XSize=number_slider_18, YSize=number_slider_18, Radius=0)  # -> Rectangle, Length
facen = FaceNormals(Mesh=del)  # -> Centers, Normals
facen_2 = FaceNormals(Mesh=del_2)  # -> Centers, Normals
incurve = PointInCurve(Point=facen.Centers, Curve=join)  # -> Relationship, Point
incurve_2 = PointInCurve(Point=facen_2.Centers, Curve=join_2)  # -> Relationship, Point
demesh = DeconstructMesh(Mesh=del)  # -> Vertices, Faces, Colours, Normals
demesh_2 = DeconstructMesh(Mesh=del_2)  # -> Vertices, Faces, Colours, Normals
dispatch = Dispatch(List=demesh.Faces, DispatchPattern=incurve.Relationship)  # -> ListA, ListB
dispatch_2 = Dispatch(List=demesh_2.Faces, DispatchPattern=incurve_2.Relationship)  # -> ListA, ListB
conmesh = ConstructMesh(Vertices=demesh.Vertices, Faces=dispatch.ListA)
conmesh_2 = ConstructMesh(Vertices=demesh_2.Vertices, Faces=dispatch_2.ListA)
move_9 = Move(Geometry=conmesh, Motion=addition_5)  # -> Geometry, Transform
move_10 = Move(Geometry=conmesh_2, Motion=addition_6)  # -> Geometry, Transform
split = SplitList(List=move_9.Geometry, Index=3)  # -> ListA, ListB
split_2 = SplitList(List=move_10.Geometry, Index=3)  # -> ListA, ListB
flip_3 = FlipMatrix(Data=split.ListA)
flip_4 = FlipMatrix(Data=split_2.ListA)
split_3 = SplitList(List=flip_3, Index=3)  # -> ListA, ListB
split_4 = SplitList(List=flip_4, Index=3)  # -> ListA, ListB
data = Data(split_3.ListA)
item_13 = ListItem(List=flatten(data), Index=Slider(4, range=0..100), Wrap=True)
data_2 = Data(split_4.ListA)
item_14 = ListItem(List=flatten(data_2), Index=Slider(4, range=0..100), Wrap=True)
medges = MeshEdges(Mesh=data)  # -> NakedEdges, InteriorEdges, NonManifoldEdges
data_3 = Data(medges.NonManifoldEdges)
join_3 = JoinCurves(Curves=[medges.NakedEdges, data_3], Preserve=False)
demesh_3 = DeconstructMesh(Mesh=item_14)  # -> Vertices, Faces, Colours, Normals
lng = ListLength(List=demesh_3.Vertices)
incurve_3 = PointInCurve(Point=demesh_3.Vertices, Curve=join_3)  # -> Relationship, Point
series_7 = Series(Start=0, Step=1, Count=lng)
data_4 = Data(graft(data))
int = Integer(series_7)
dispatch_3 = Dispatch(List=demesh_3.Vertices, DispatchPattern=incurve_3.Relationship)  # -> ListA, ListB
dispatch_4 = Dispatch(List=int, DispatchPattern=incurve_3.Relationship)  # -> ListA, ListB
data_5 = Data(dispatch_3.ListA)
meshcp = MeshClosestPoint(Point=data_5, Mesh=data_4)  # -> Point, Index, flatten(Parameter)
data_6 = Data(flatten(dispatch_4.ListA))
sort = SortList(Keys=data_6, ValuesA=meshcp.Parameter)  # -> Keys, ValuesA
