# Grasshopper definition WriteBullshit.gh (Grasshopper 0.9.76)
# plug-ins: Google Drive for GH 

number_slider = Slider(7, range=0..10)
path = FilePath("C:\Users\Chris\Desktop\Dunk.txt")
file = ReadFile(File=path, PerLineParse=True)
split = SplitList(List=reverse(file), Index=1)  # -> ListA, reverse(ListB)
partition = PartitionList(List=split.ListB, Size=Slider(10, range=0..100))
split_2 = SplitList()  # -> ListA, ListB
item = ListItem(List=partition, Index=0, Wrap=True)  # -> Item, Item1, Item2, Item3, Item4, Item5, Item6, Item7, Item8
name_and_code = Data(item.Item1)
project_1b = Data(item.Item5)
project_1c = Data(item.Item6)
project_1a = Data(item.Item4)
quizes = Data(item.Item7)
final = Data(item.Item8)
chars = Characters(Text=name_and_code)  # -> Result, Unicode
split_3 = SplitList(List=chars.Result, Index=Slider(10, range=0..100))  # -> ListA, ListB
split_4 = SplitList(List=reverse(split_3.ListB), Index=Slider(14, range=0..100))  # -> reverse(ListA), reverse(ListB)
cluster = Cluster_2(T=quizes)
cluster_2 = Cluster(T=final)
cluster_3 = Cluster(T=project_1b)
cluster_4 = Cluster(T=project_1a)
cluster_5 = Cluster(T=project_1c)
split_5 = SplitList(List=reverse(split_4.ListA), Index=Slider(2, range=0..10))  # -> reverse(ListA), reverse(ListB)
split_6 = SplitList(List=split_5.ListB, Index=Slider(3, range=0..10))  # -> ListA, ListB
trim = TrimTree(Tree=cluster, Depth=1)
join = TextJoin(Text=split_4.ListB)
join_2 = TextJoin(Text=split_6.ListB)
student_id = Data(join_2)
_1a = Data(cluster_4)
name = Data(join)
split_7 = TextSplit(Text=name, Separators=" ")
trim_2 = TrimTree(Tree=student_id, Depth=3)
trim_3 = TrimTree(Tree=split_7, Depth=3)
split_8 = SplitList(List=trim_3, Index=Slider(1, range=0..1))  # -> ListA, ListB
join_3 = TextJoin(Text=split_8.ListB, Join=" ")
merge = Merge(
    Data1=trim_2,
    Data2=split_8.ListA,
    Data3=join_3,
    Data4=_1a,
    Data5=cluster_3,
    Data6=cluster_5,
    Data7=trim,
    Data8=cluster_2)
gauth = GoogleAuthenticator(Authenticate=Toggle(True), ClearCredentials=Toggle(False))
nullrep = ReplaceNulls(Items=merge, Replacements=" ")  # -> Items, Count
writespreadsheet = WriteToSpreadsheet(
    Token=gauth,
    Name="RawData",
    OrganizeByRowsOrColumns=True,
    Address="A1",
    Data=nullrep.Items,
    Write=Toggle(True),
    createNewSpreadsheets=False)

# ==== cluster Cluster
T = ClusterInput()
split = TextSplit(Text=T, Separators="(")
item = ListItem(List=split, Index=0, Wrap=True)  # -> Item, Item1
chars = Characters(Text=item.Item1)  # -> Result, Unicode
split_2 = SplitList(List=reverse(chars.Result), Index=Slider(2, range=0..10))  # -> ListA, reverse(ListB)
join = TextJoin(Text=split_2.ListB)
trim = TrimTree(Tree=join, Depth=1)
T_2 = ClusterOutput(trim)

# ==== cluster Cluster_2
T = ClusterInput()
split = TextSplit(Text=T, Separators="s")
item = ListItem(List=split, Index=0, Wrap=True)  # -> Item, Item1
chars = Characters(Text=item.Item1)  # -> Result, Unicode
split_2 = SplitList(List=reverse(chars.Result), Index=Slider(1, range=0..10))  # -> ListA, reverse(ListB)
join = TextJoin(Text=split_2.ListB)
panel = Panel(split)
R = ClusterOutput(join)
