# Grasshopper definition attemptedVoronoiRefocus-11.gh (Grasshopper 1.0.7)
# plug-ins: MeshEdit Components, Kangaroo Components, PlanktonGh, TT Toolbox, AureconGrasshopper

size = Slider(50, range=0..100)
gridsize = Data(size)

gridsize_2 = Data(gridsize)
rectangle = Rectangle(Plane=PlaneXY(0, 0, 0), XSize=gridsize_2, YSize=gridsize_2, Radius=0)  # -> Rectangle, Length
explode = Explode(Curve=rectangle.Rectangle, Recursive=True)  # -> Segments, Vertices
item = ListItem(List=explode.Segments, Index=0, Wrap=True)  # -> Item, Item1, Item2, Item3
number_slider = Slider(20, range=0..100)
flip = FlipCurve(Curve=item.Item)  # -> Curve, Flag
flip_2 = FlipCurve(Curve=item.Item1)  # -> Curve, Flag
merge = Merge(Data1=flip.Curve, Data2=item.Item2)
merge_2 = Merge(Data1=flip_2.Curve, Data2=item.Item3)
divide = DivideCurve(Curve=reparameterize(merge_2), Count=number_slider, Kinks=False)  # -> Points, Tangents, Parameters
pi = Pi(Factor=Slider(3, range=0..10))
pi_2 = Pi(Factor=Slider(4, range=0..10))
divide_2 = DivideCurve(Curve=reparameterize(merge), Count=number_slider, Kinks=False)  # -> Points, Tangents, Parameters
multiplication = Multiplication(A=divide.Parameters, B=pi_2)
multiplication_2 = Multiplication(A=divide.Parameters, B=pi)
pi_3 = Pi(Factor=Slider(4, range=0..10))
pi_4 = Pi(Factor=Slider(1, range=0..10))
sin = Sine(Value=multiplication)
sin_2 = Sine(Value=multiplication_2)
multiplication_3 = Multiplication(A=divide_2.Parameters, B=pi_4)
multiplication_4 = Multiplication(A=divide_2.Parameters, B=pi_3)
multiplication_5 = Multiplication(A=sin, B=Slider(2, range=0..10))
multiplication_6 = Multiplication(A=sin_2, B=Slider(3, range=0..10))
sin_3 = Sine(Value=multiplication_4)
sin_4 = Sine(Value=multiplication_3)
addition = Addition(A=multiplication_6, B=multiplication_5)
X = UnitX(Factor=addition)
multiplication_7 = Multiplication(A=sin_3, B=Slider(2, range=0..10))
multiplication_8 = Multiplication(A=sin_4, B=Slider(6, range=0..10))
move = Move(Geometry=divide.Points, Motion=X)  # -> Geometry, Transform
addition_2 = Addition(A=multiplication_8, B=multiplication_7)
Y = UnitY(Factor=addition_2)
move_2 = Move(Geometry=divide_2.Points, Motion=Y)  # -> Geometry, Transform
pline = PolyLine(Vertices=move.Geometry, Closed=False)  # -> flatten(Polyline)
pline_2 = PolyLine(Vertices=move_2.Geometry, Closed=False)  # -> flatten(Polyline)
data = Data(pline)
data_2 = Data(pline_2)

size_2 = Data(gridsize)

data_3 = Data(data_2)  # disabled
data_4 = Data(data)  # disabled
merge_3 = Merge(Data1=data_3, Data2=data_4)
data_5 = Data(merge_3)
join = JoinCurves(Curves=data_5, Preserve=False)
explode_2 = Explode(Curve=join, Recursive=True)  # -> Segments, Vertices
srf = Surface(join)
data_6 = Data(data_5)
split = SplitList(List=reverse(explode_2.Vertices), Index=1)  # -> ListA, reverse(ListB)
timer = Timer(TimerInterval=2, Target=meshmachine)  # disabled
meshmachine = MeshMachine(
    Geometry=srf,
    Length=Slider(1, range=0..1),
    FixCurves=data_6,
    FixVertices=split.ListB,
    Flip=1,
    PullStrength=0.8,
    CurvatureAdaptivity=0,
    BoundaryScale=1,
    BoundaryDistance=5,
    Exponent=2,
    Background=0.5,
    Iterations=1,
    Reset=Toggle(False))
pmesh = PlanktonMesh(meshmachine)
demesh = DeconstructMesh(Mesh=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)  # -> Vertices, Faces, Colours, Normals
conmesh = ConstructMesh(Vertices=demesh.Vertices, Faces=demesh.Faces)
weldvertices = MeshWeldVertices(Mesh=conmesh, Tolerance=0.01)  # -> RuntimeMessage, Mesh
mesh = Mesh(weldvertices.Mesh)

data_7 = Data(data_2)
data_8 = Data(data)
item_2 = ListItem(List=data_7, Index=0, Wrap=True)  # -> Item1, Item
item_3 = ListItem(List=data_8, Index=0, Wrap=True)  # -> Item1, Item
data_9 = Data(item_2.Item1)
data_10 = Data(item_3.Item)
explode_3 = Explode(Curve=data_10, Recursive=True)  # -> Segments, Vertices
explode_4 = Explode(Curve=data_9, Recursive=True)  # -> Segments, Vertices
split_2 = SplitList(List=explode_3.Vertices, Index=1)  # -> ListA, ListB
split_3 = SplitList(List=explode_4.Vertices, Index=1)  # -> ListA, ListB
data_11 = Data(split_2.ListB)
data_12 = Data(split_2.ListA)
data_13 = Data(split_3.ListB)

size_3 = Data(size_2)

data_14 = Data(data)
data_15 = Data(data_2)
item_4 = ListItem(List=data_15, Index=0, Wrap=True)  # -> Item1, Item
item_5 = ListItem(List=data_14, Index=0, Wrap=True)  # -> Item1, Item
data_16 = Data(item_4.Item)
data_17 = Data(item_5.Item1)
explode_5 = Explode(Curve=data_16, Recursive=True)  # -> Segments, Vertices
explode_6 = Explode(Curve=data_17, Recursive=True)  # -> Segments, Vertices
split_4 = SplitList(List=explode_6.Vertices, Index=1)  # -> ListA, ListB
split_5 = SplitList(List=explode_5.Vertices, Index=1)  # -> ListA, ListB
split_6 = SplitList(List=reverse(split_4.ListB), Index=1)  # -> ListA, reverse(ListB)
data_18 = Data(split_6.ListA)
data_19 = Data(split_4.ListB)
data_20 = Data(data_18)
data_21 = Data(split_5.ListB)

mesh_2 = Mesh(mesh)
data_22 = Data(data_11)
data_23 = Data(data_12)
data_24 = Data(data_13)
demesh_2 = DeconstructMesh(Mesh=mesh_2)  # -> Vertices, Faces, Colours, Normals
lng = ListLength(List=demesh_2.Vertices)
series = Series(Start=0, Step=1, Count=lng)
data_25 = Data(data_19)
data_26 = Data(data_20)
data_27 = Data(data_21)
data_28 = Data(data_27)
data_29 = Data(data_25)
data_30 = Data(data_26)
int = Integer(series)
data_31 = Data(data_24)
data_32 = Data(data_22)
data_33 = Data(data_23)
cp = ClosestPoint(Point=data_33, Cloud=demesh_2.Vertices)  # -> ClosestPoint, CPIndex, Distance
cp_2 = ClosestPoint(Point=data_32, Cloud=demesh_2.Vertices)  # -> ClosestPoint, CPIndex, Distance
cp_3 = ClosestPoint(Point=data_31, Cloud=demesh_2.Vertices)  # -> ClosestPoint, CPIndex, Distance
cp_4 = ClosestPoint(Point=data_30, Cloud=demesh_2.Vertices)  # -> ClosestPoint, CPIndex, Distance
cp_5 = ClosestPoint(Point=data_29, Cloud=demesh_2.Vertices)  # -> ClosestPoint, CPIndex, Distance
cp_6 = ClosestPoint(Point=data_28, Cloud=demesh_2.Vertices)  # -> ClosestPoint, CPIndex, Distance
c_script = CSharpScript(x=cp.CPIndex, y=cp_4.CPIndex, z="1", u="1")  # -> out, A; inputs x: Int32, y: Int32, z: Int32, u: Int32
# ---------- c_script: C# ----------
    A = "{" + x + "," + y + "," + z +"," + u + "}";
# ---------- end c_script ----------
c_script_2 = CSharpScript(x=cp_2.CPIndex, y=cp_5.CPIndex, z="1", u="0")  # -> out, A; inputs x: Int32, y: Int32, z: Int32, u: Int32; same code as c_script
c_script_3 = CSharpScript(x=cp_3.CPIndex, y=cp_6.CPIndex, z="0", u="1")  # -> out, A; inputs x: Int32, y: Int32, z: Int32, u: Int32; same code as c_script
merge_4 = Merge(Data1=c_script.A, Data2=c_script_2.A, Data3=c_script_3.A)
data_34 = Data(mesh)
demesh_3 = DeconstructMesh(Mesh=data_34)  # -> Vertices, Faces, Colours, Normals
c_script_4 = CSharpScript(x=data_34, y=merge_4)  # -> out, A, B; inputs x: Mesh, y: list of String
# ---------- c_script_4: C# usings ----------
using System.Linq;
# ---------- c_script_4: C# ----------
    var verts = x.Vertices;
    var tris = x.Faces;

    var topology = x.TopologyVertices;

    var topoDataTree = new DataTree<System.Object>();
    var offsetDataTree = new DataTree<System.Object>();

    var topoRemap = new int[x.Vertices.Count];
    var offsetRemap = new Vector3d[x.Vertices.Count];

    var datastruct = y.Select(str => {
      str = str.Substring(1);
      str = str.Substring(0, str.Length - 1);
      var array = str.Split(',');

      return new int[]{int.Parse(array[0]),int.Parse(array[1]),int.Parse(array[2]),int.Parse(array[3])};
      }).ToArray();

    for (int i = 0; i < topoRemap.Length; i++)
    {
      topoRemap[i] = i;
      offsetRemap[i] = new Vector3d(0, 0, 0);
    }

    for (int i = 0; i < datastruct.Length; i++)
    {
      var data = datastruct[i];
      topoRemap[data[0]] = data[1];
      offsetRemap[data[0]].X = data[2];
      offsetRemap[data[0]].Y = data[3];
    }

    //var output = new List<List<int>>();

    for (int i = 0; i < verts.Count; i++)
    {
      var data = topology.ConnectedTopologyVertices(i);
      var path = new GH_Path(i);

      for (int u = 0; u < data.Length; u++)
      {
        topoDataTree.Add(topoRemap[data[u]], path);
        offsetDataTree.Add(offsetRemap[data[u]], path);
      }
    }

    A = topoDataTree;
    B = offsetDataTree;
# ---------- end c_script_4 ----------
multiplication_9 = Multiplication(A=c_script_4.B, B=Slider(50, range=0..100))
item_6 = ListItem(List=demesh_3.Vertices, Index=c_script_4.A, Wrap=True)
number_slider_2 = Slider(24, range=0..100)
move_3 = Move(Geometry=item_6, Motion=multiplication_9)  # -> Geometry, Transform
panel = Panel(c_script_4.B)
tbi = TreeBranchIndex(DataTree=graft(demesh_3.Vertices), BranchIndex=number_slider_2)
tbi_2 = TreeBranchIndex(DataTree=move_3.Geometry, BranchIndex=number_slider_2)
ln = Line(StartPoint=tbi, EndPoint=tbi_2)
merge_5 = Merge(Data1=cp.CPIndex, Data2=cp_2.CPIndex, Data3=cp_3.CPIndex)  # -> flatten(Result)
merge_6 = Merge(Data1=cp_4.CPIndex, Data2=cp_5.CPIndex, Data3=cp_6.CPIndex)
deface = DeconstructFace(Face=demesh_2.Faces)  # -> CornerA, CornerB, CornerC, CornerD
merge_7 = Merge(Data1=graft(deface.CornerA), Data2=graft(deface.CornerB), Data3=graft(deface.CornerC))  # -> flatten(Result)
replace = ReplaceItems(List=demesh_2.Vertices, Indices=merge_5, Wrap=False)
size_4 = Data(size_3)
replace_2 = ReplaceMembers(Set=merge_7, Find=flatten(merge_5), Replace=flatten(merge_6))
cset = CreateSet(List=replace_2)  # -> Set, Map
lng_2 = ListLength(List=merge_7)
vec = VectorXYZ(XComponent=0, YComponent=0, ZComponent=0)  # -> Vector, Length
clean = CleanTree(RemoveNulls=True, RemoveInvalid=True, RemoveEmpty=False, Tree=replace)
X_2 = UnitX(Factor=1)
Y_2 = UnitY(Factor=1)
mindex = MemberIndex(Set=merge_7, Member=cp_3.CPIndex)  # -> flatten(Index), Count
mindex_2 = MemberIndex(Set=merge_7, Member=cp.CPIndex)  # -> flatten(Index), Count
mindex_3 = MemberIndex(Set=merge_7, Member=cp_2.CPIndex)  # -> flatten(Index), Count
lng_3 = ListLength(List=cset.Set)
repeat = RepeatData(Data=vec.Vector, Length=lng_2)
sort = SortList(Keys=flatten(cset.Set), ValuesA=flatten(cset.Set))  # -> Keys, ValuesA
series_2 = Series(Start=0, Step=1, Count=lng_3)
addition_3 = Addition(A=Y_2, B=X_2)
mindex_4 = MemberIndex(Set=replace_2, Member=sort.ValuesA)  # -> Index, Count
number_slider_3 = Slider(50, range=0..100)
replace_3 = ReplaceItems(List=repeat, Item=addition_3, Indices=mindex_2.Index, Wrap=False)
repeat_2 = RepeatData(Data=graft(series_2), Length=graft(mindex_4.Count))  # -> flatten(Data)
X_3 = UnitX(Factor=1)
replace_4 = ReplaceItems(List=replace_3, Item=X_3, Indices=mindex_3.Index, Wrap=False)
Y_3 = UnitY(Factor=1)
sort_2 = SortList(Keys=flatten(mindex_4.Index), ValuesA=flatten(repeat_2))  # -> Keys, ValuesA
replace_5 = ReplaceItems(List=replace_4, Item=Y_3, Indices=mindex.Index, Wrap=False)
facen = FaceNormals(Mesh=mesh)  # -> Centers, Normals
triangleindexes = Integer(sort_2.ValuesA)
triangleoffsets = Vector(replace_5)
uniquepoints = Point(clean)

uniquepoints_2 = Point(uniquepoints)
size_5 = Data(size_4)
panel_2 = Panel("""{-1,-1,0}
{-1,0,0}
{-1,+1,0}
{+1,-1,0}
{+1,0,0}
{+1,+1,0}
{0,+1,0}
{0,-1,0}
{0,0,0}""")
pt = Point(panel_2)
multiplication_10 = Multiplication(A=pt, B=size_5)
move_4 = Move(Geometry=uniquepoints_2, Motion=graft(multiplication_10))  # -> flatten(Geometry), Transform
vcell = VoronoiCell(Point=graft(uniquepoints_2), Neighbours=move_4.Geometry)  # -> flatten(Cell)
circle = CircleCNR(Center=uniquepoints_2, Normal=Vector(0, 0, 1), Radius=1)
debrep = DeconstructBrep(Brep=vcell)  # -> Faces, Edges, Vertices
alongcrv = SortAlongCurve(Points=debrep.Vertices, Curve=graft(circle))  # -> Points, Indices
cells = Data(alongcrv.Points)

item_7 = ListItem(List=vcell, Index=c_script_4.A, Wrap=True)
size_6 = Data(size_4)
panel_3 = Panel(triangleindexes)
trim = TrimTree(Tree=cells, Depth=1)
trim_2 = TrimTree(Tree=cells, Depth=1)
merge_8 = Merge(Data1=graft(uniquepoints_2), Data2=trim)
pshift = ShiftPaths(Data=trim_2, Offset=6)
lng_4 = ListLength(List=merge_8)
series_3 = Series(Start=1, Step=1, Count=expr("x-2", lng_4))
shift = ShiftList(List=series_3, Shift=1, Wrap=True)
triangle = MeshTriangle(CornerA=series_3, CornerB=shift, CornerC=0)
conmesh_2 = ConstructMesh(Vertices=merge_8, Faces=triangle)
triangles = Integer(triangleindexes)
gridsize_3 = Data(size_6)
offsets = Vector(triangleoffsets)
centers = Data(facen.Centers)
cells_2 = Data(pshift)
points = Point(uniquepoints)
dam = DataDam(
    DataA=triangles,
    DataB=offsets,
    DataC=points,
    DataD=centers,
    DataF=cells_2,
    DataE=gridsize_3,
    BufferDelay=10000000,
    BufferMode=0)  # -> DataA, DataB, DataC, DataD, DataF, DataE
triangles_2 = Integer(dam.DataA)
cells_3 = Data(dam.DataF)
gridsize_4 = Data(dam.DataE)
offsets_2 = Vector(dam.DataB)
centers_2 = Data(dam.DataD)
points_2 = Point(dam.DataC)
triangles_3 = Integer(triangles_2)
gridsize_5 = Data(gridsize_4)
cells_4 = Data(cells_3)
offsets_3 = Vector(offsets_2)
centers_3 = Data(centers_2)
points_3 = Point(points_2)
triangleindexes_2 = Integer(triangleindexes)
triangleoffsets_2 = Vector(triangleoffsets)
uniquepoints_3 = Point(uniquepoints)
nestedsubdivisions = Data(Slider(5, range=0..10))
triangles_4 = Integer(triangles_3)
gridsize_6 = Data(gridsize_5)
centers_4 = Data(centers_3)
offsets_4 = Vector(offsets_3)
points_4 = Point(points_3)
cells_5 = Data(cells_4)

# ----
# Base Mesh
item_8 = ListItem(List=uniquepoints_3, Index=triangleindexes_2, Wrap=True)
multiplication_11 = Multiplication(A=triangleoffsets_2, B=Slider(50, range=0..100))
move_5 = Move(Geometry=item_8, Motion=multiplication_11)  # -> Geometry, Transform
partition = PartitionList(List=move_5.Geometry, Size=3)
pline_3 = PolyLine(Vertices=partition, Closed=True)

pline_4 = PolyLine(Vertices=cells_5, Closed=True)
nestedsubdivisions_2 = Data(nestedsubdivisions)
gridsize_7 = Data(gridsize_6)

triangles_5 = Integer(triangles_4)
offsets_5 = Vector(offsets_4)
points_5 = Point(points_4)
centers_5 = Data(centers_4)

nestingamount = Data(nestedsubdivisions_2)

triangles_6 = Integer(triangles_4)
points_6 = Point(points_4)
offsets_6 = Vector(offsets_4)

data_35 = Data(cells_5)
nestingamount_2 = Data(nestedsubdivisions_2)

nestingamount_3 = Data(nestingamount)
gridsize_8 = Data(gridsize_7)
# InnerMeshScaleInfo
one_over_x = OneOverX(Value=nestingamount_3)
addition_4 = Addition(A=nestingamount_3, B=2)
multiplication_12 = Multiplication(A=gridsize_8, B=one_over_x)
series_4 = Series(Start=0, Step=gridsize_8, Count=addition_4)
vec_2 = VectorXYZ(XComponent=multiplication_12, YComponent=multiplication_12, ZComponent=0)  # -> Vector, Length
vec_3 = VectorXYZ(XComponent=series_4, YComponent=graft(series_4), ZComponent=0)  # -> flatten(Vector), Length
series_5 = Series(Start=0, Step=Slider(1, range=0..100), Count=addition_4)
neg = Negative(Value=vec_2.Vector)
int_2 = Integer(series_5)
concat = Concatenate(FragmentA=int_2, FragmentB=",", FragmentC=graft(int_2))  # -> flatten(Result)
secondlayeroffset = Data(neg)
celloffsets = Data(vec_3.Vector)
cellids = Data(concat)

gridsize_9 = Data(gridsize_7)
# Triangles
triangles_7 = Integer(triangles_6)
data_36 = Data(flatten(pline_4))

nestingamount_4 = Data(nestingamount)
centers_6 = Data(centers_4)
celloffsets_2 = Data(vec_3.Vector)
move_6 = Move(Geometry=centers_6, Motion=graft(celloffsets_2))  # -> Geometry, Transform
move_7 = Move(Geometry=points_4, Motion=graft(celloffsets_2))  # -> Geometry, Transform
one_over_x_2 = OneOverX(Value=nestingamount_4)
scale = Scale(Geometry=move_6.Geometry, Center=Point(0, 0, 0), Factor=one_over_x_2)  # -> Geometry, Transform
scale_2 = Scale(Geometry=move_7.Geometry, Center=Point(0, 0, 0), Factor=one_over_x_2)  # -> Geometry, Transform
move_8 = Move(Geometry=scale_2.Geometry, Motion=secondlayeroffset)  # -> flatten(Geometry), Transform
move_9 = Move(Geometry=scale.Geometry, Motion=secondlayeroffset)  # -> flatten(Geometry), Transform
movedpoints = Data(move_8.Geometry)
movedcenters = Data(move_9.Geometry)

nestingamount_5 = Data(nestingamount)
centers_7 = Data(centers_4)
celloffsets_3 = Data(vec_3.Vector)
move_10 = Move(Geometry=centers_7, Motion=graft(celloffsets_3))  # -> Geometry, Transform
move_11 = Move(Geometry=data_36, Motion=graft(celloffsets_3))  # -> Geometry, Transform
one_over_x_3 = OneOverX(Value=nestingamount_5)
scale_3 = Scale(Geometry=move_10.Geometry, Center=Point(0, 0, 0), Factor=one_over_x_3)  # -> Geometry, Transform
scale_4 = Scale(Geometry=move_11.Geometry, Center=Point(0, 0, 0), Factor=one_over_x_3)  # -> Geometry, Transform
move_12 = Move(Geometry=scale_4.Geometry, Motion=secondlayeroffset)  # -> flatten(Geometry), Transform
move_13 = Move(Geometry=scale_3.Geometry, Motion=secondlayeroffset)  # -> flatten(Geometry), Transform
movedpoints_2 = Data(move_12.Geometry)
movedcenters_2 = Data(move_13.Geometry)

offsets_7 = Vector(offsets_6)
triangles_8 = Integer(triangles_6)
# PointIndexes
points_7 = Point(points_6)
multiplication_13 = Multiplication(A=offsets_7, B=Slider(50, range=0..100))
item_9 = ListItem(List=points_7, Index=triangles_8, Wrap=True)
move_14 = Move(Geometry=data_35, Motion=multiplication_13)  # -> Geometry, Transform
partition_2 = PartitionList(List=move_14.Geometry, Size=3)
triangles_9 = Data(partition_2)

lng_5 = ListLength(List=points_6)
series_6 = Series(Start=0, Step=1, Count=lng_5)
pointindexes = Integer(series_6)

celloffsets_4 = Data(celloffsets)
cellids_2 = Data(cellids)
movedpoints_3 = Data(movedpoints)
movedcenters_3 = Data(movedcenters)

# ----
# AllTriangleIndexes
triangles_10 = Integer(triangles_7)
movedcenters_4 = Data(movedcenters_3)
lng_6 = ListLength(List=triangles_10)
division = Division(A=lng_6, B=3)
lng_7 = ListLength(List=movedcenters_4)
int_3 = Integer(division)
series_7 = Series(Start=0, Step=1, Count=int_3)
int_4 = Integer(series_7)
repeat_3 = RepeatData(Data=int_4, Length=lng_7)
triangleindexes_3 = Data(repeat_3)

# ----
# All Points Indexes
pointindexes_2 = Integer(pointindexes)
celloffsets_5 = Data(celloffsets_4)
lng_8 = ListLength(List=flatten(celloffsets_5))
lng_9 = ListLength(List=pointindexes_2)
multiplication_14 = Multiplication(A=lng_9, B=lng_8)
repeat_4 = RepeatData(Data=pointindexes_2, Length=multiplication_14)  # -> flatten(Data)
nestedpointindexes = Data(repeat_4)

# ----
# TriangleMesh
quad = MeshQuad(CornerA=0, CornerB=1, CornerC=2, CornerD=2)
conmesh_3 = ConstructMesh(Vertices=triangles_9, Faces=quad)

nestingamount_6 = Data(nestingamount_2)
gridsize_10 = Data(gridsize_9)

data_37 = Data(conmesh_3)
# BarycentricHubs
demesh_4 = DeconstructMesh(Mesh=data_37)  # -> Vertices, Faces, Colours, Normals
item_10 = ListItem(List=demesh_4.Vertices, Index=0, Wrap=True)  # -> Item, Item1, Item2
facen_2 = FaceNormals(Mesh=data_37)  # -> Centers, Normals
merge_9 = Merge(Data1=item_10.Item2, Data2=item_10.Item)
merge_10 = Merge(Data1=item_10.Item1, Data2=item_10.Item2)
merge_11 = Merge(Data1=item_10.Item, Data2=item_10.Item1)
avr = Average(Input=merge_10)
avr_2 = Average(Input=merge_11)
avr_3 = Average(Input=merge_9)
series_8 = Series(Start=0, Step=1, Count=6)
shift_2 = ShiftList(List=series_8, Shift=1, Wrap=True)
merge_12 = Merge(Data1=item_10.Item, Data2=avr_2, Data3=item_10.Item1, Data4=avr, Data5=item_10.Item2, Data6=avr_3, Data7=facen_2.Centers)
triangle_2 = MeshTriangle(CornerA=series_8, CornerB=shift_2, CornerC=Slider(6, range=0..10))
conmesh_4 = ConstructMesh(Vertices=merge_12, Faces=triangle_2)

movedcenters_5 = Data(movedcenters)
movedpoints_4 = Data(movedpoints)

triangles_11 = Integer(triangles_5)
offsets_8 = Vector(offsets_5)
points_8 = Point(points_5)
centers_8 = Data(centers_5)

nestingamount_7 = Data(nestingamount_6)
gridsize_11 = Data(gridsize_10)

# ----
# All Centers Offsets
points_9 = Point(centers_8)
_2doffsets = Data(cellids_2)
lng_10 = ListLength(List=points_9)
repeat_5 = RepeatData(Data=graft(_2doffsets), Length=lng_10)  # -> flatten(Data)
_2doffsets_2 = Data(repeat_5)

# ----
# All Points Offsets
points_10 = Point(points_8)
_2doffsets_3 = Data(cellids_2)
lng_11 = ListLength(List=points_10)
repeat_6 = RepeatData(Data=graft(_2doffsets_3), Length=lng_11)  # -> flatten(Data)
_2doffsets_4 = Data(repeat_6)

item_11 = ListItem(List=points_9, Index=0, Wrap=True)

nestingamount_8 = Data(nestingamount_7)
gridsize_12 = Data(gridsize_11)

triangles_12 = Integer(triangles_11)
offsets_9 = Vector(offsets_8)
points_11 = Point(points_8)
centers_9 = Data(centers_8)

movedpoints_5 = Data(movedpoints_4)
_2doffsets_5 = Data(_2doffsets_4)
nestedpointindexes_2 = Data(nestedpointindexes)
movedpoints_6 = Data(movedpoints_2)
points_12 = Point(graft(points_6))
data_38 = Data(data_35)
pshift_2 = ShiftPaths(Data=points_12, Offset=6)
pshift_3 = ShiftPaths(Data=points_4, Offset=-6)
merge_13 = Merge(Data1=pshift_2, Data2=data_38)
del = DelaunayMesh(Points=merge_13, Plane=PlaneXY(0, 0, 0))

triangles_13 = Integer(triangles_12)
offsets_10 = Vector(offsets_9)
points_13 = Point(points_11)
centers_10 = Data(centers_9)

nestingamount_9 = Data(nestingamount_8)
gridsize_13 = Data(gridsize_12)

# ----
# TriangleCenterOffsets
pt_2 = Point(Point(0, 0, 0))
trianglecenters = Data(centers_10)
lng_12 = ListLength(List=trianglecenters)
repeat_7 = RepeatData(Data=pt_2, Length=lng_12)
data_39 = Data(repeat_7)
trianglecenteroffsets = Data(data_39)

triangles_14 = Data(triangles_13)  # disabled
offsets_11 = Data(offsets_10)  # disabled

positions = Data(points_13)  # disabled

trianglecenters_2 = Data(centers_10)  # disabled
trianglecenteroffsets_2 = Data(trianglecenteroffsets)  # disabled

nestingamount_10 = Data(nestingamount_9)  # disabled
gridsize_14 = Data(gridsize_13)  # disabled

trianglecenteroffsets_3 = Data(trianglecenteroffsets_2)
trianglecenters_3 = Data(trianglecenters_2)

nestingamount_11 = Data(nestingamount_10)
gridsize_15 = Data(gridsize_14)

positions_2 = Data(positions)

triangles_15 = Data(triangles_14)
offsets_12 = Data(offsets_11)

triangles_16 = Data(triangles_15)
offsets_13 = Data(offsets_12)

gridsize_16 = Data(gridsize_15)
nestingamount_12 = Data(nestingamount_11)

positions_3 = Data(positions_2)

trianglecenters_4 = Data(trianglecenters_3)
trianglecenteroffsets_4 = Data(trianglecenteroffsets_3)

triangles_17 = Data(triangles_15)
offsets_14 = Data(offsets_12)
positions_4 = Data(positions_2)

triangles_18 = Data(triangles_17)
offsets_15 = Data(offsets_14)
points_14 = Data(positions_4)

offsets_16 = Data(offsets_14)
positions_5 = Data(positions_4)
triangles_19 = Data(triangles_17)

# ----
# Base Mesh
number_slider_4 = Slider(50, range=0..100)
triangleoffsets_3 = Vector(offsets_16)
triangleindexes_4 = Integer(triangles_19)
uniquepoints_4 = Point(positions_5)
item_12 = ListItem(List=uniquepoints_4, Index=triangleindexes_4, Wrap=True)
multiplication_15 = Multiplication(A=triangleoffsets_3, B=number_slider_4)
move_15 = Move(Geometry=item_12, Motion=multiplication_15)  # -> Geometry, Transform
partition_3 = PartitionList(List=move_15.Geometry, Size=3)
quad_2 = MeshQuad(CornerA=0, CornerB=1, CornerC=2, CornerD=2)
conmesh_5 = ConstructMesh(Vertices=partition_3, Faces=quad_2)  # -> flatten(Mesh)

gridsize_17 = Data(gridsize_16)
nestingamount_13 = Data(nestingamount_12)

triangles_20 = Data(triangles_16)
offsets_17 = Data(offsets_13)

positions_6 = Data(positions_3)

trianglecenters_5 = Data(trianglecenters_4)
trianglecenteroffsets_5 = Data(trianglecenteroffsets_4)

number_slider_5 = Slider(10, range=0..10)
one_over_x_4 = OneOverX(Value=Slider(5, range=0..10))
vec_4 = VectorXYZ(XComponent=number_slider_5, YComponent=number_slider_5, ZComponent=0)  # -> Vector, Length
neg_2 = Negative(Value=vec_4.Vector)
data_40 = Data(conmesh_5)
demesh_5 = DeconstructMesh(Mesh=data_40)  # -> Vertices, Faces, Colours, Normals
vec_5 = Vector(demesh_5.Vertices)
item_13 = ListItem(List=vec_5, Index=0, Wrap=True)  # -> Item, Item1, Item2

trianglecenteroffsets_6 = Data(trianglecenteroffsets_5)
trianglecenters_6 = Data(trianglecenters_5)

nestingamount_14 = Data(nestingamount_13)
gridsize_18 = Data(gridsize_17)

positions_7 = Data(positions_6)

triangles_21 = Data(triangles_20)
offsets_18 = Data(offsets_17)

concat_2 = Concatenate(FragmentA="E:\User Files\Projects\Building Generator\Assets\Import\", FragmentB="data.meshTile.JSON")

# ----
# Points And Centers Within Cells
triangles_22 = Data(data_35)
movedpoints_7 = Data(movedpoints_3)
movedcenters_6 = Data(movedcenters_3)
number_slider_6 = Slider(1000, range=0..1000)
pline_5 = PolyLine(Vertices=triangles_22, Closed=True)  # -> flatten(Polyline)

# ---- group: scaleForAccuracy
scale_5 = Scale(Geometry=pline_5, Center=Point(0, 0, 0), Factor=number_slider_6)  # -> Geometry, Transform
scale_6 = Scale(Geometry=movedpoints_7, Center=Point(0, 0, 0), Factor=number_slider_6)  # -> Geometry, Transform
scale_7 = Scale(Geometry=movedcenters_6, Center=Point(0, 0, 0), Factor=number_slider_6)  # -> Geometry, Transform

# ----
lng_13 = ListLength(List=scale_5.Geometry)
incurves = PointInCurves(Point=scale_6.Geometry, Curves=scale_5.Geometry)  # -> Relationship, Index, Point
incurves_2 = PointInCurves(Point=scale_7.Geometry, Curves=scale_5.Geometry)  # -> Relationship, Index, Point; disabled
series_9 = Series(Start=0, Step=1, Count=lng_13)
int_5 = Integer(series_9)
mindex_5 = MemberIndex(Set=incurves.Index, Member=int_5)  # -> Index, Count
mindex_6 = MemberIndex(Set=incurves_2.Index, Member=int_5)  # -> Index, Count
centerswithincells = Data(mindex_6.Index)  # disabled
pointswithincells = Data(mindex_5.Index)

# ----
# Nested Offsets And Points
mappedpoints = Data(pointswithincells)

nestedtriangleindexes = Data(triangleindexes_3)
movedcenters_7 = Data(movedcenters_5)
# Nested Offsets And Triangles
mappedcells = Data(centerswithincells)
_2doffsets_6 = Data(_2doffsets_2)
item_14 = ListItem(List=_2doffsets_6, Index=mappedcells, Wrap=True)
item_15 = ListItem(List=nestedtriangleindexes, Index=mappedcells, Wrap=True)
item_16 = ListItem(List=movedcenters_7, Index=mappedcells, Wrap=True)
culled2doffsets = Data(item_14)
culledindexes = Data(item_15)
culledcenters = Data(item_16)

tstat = TreeStatistics(Tree=mappedpoints)  # -> Paths, Length, Count
lng_14 = ListLength(List=tstat.Paths)
random = Random(Range=Domain(0, 10000), Number=lng_14, Seed=2)
random_2 = Random(Range=Domain(0, 1), Number=3, Seed=random)
item_17 = ListItem(List=random_2, Index=0, Wrap=True)  # -> Item, Item1, Item2
item_18 = ListItem(List=nestedpointindexes_2, Index=mappedpoints, Wrap=True)
item_19 = ListItem(List=_2doffsets_5, Index=mappedpoints, Wrap=True)
item_20 = ListItem(List=movedpoints_5, Index=mappedpoints, Wrap=True)
item_21 = ListItem(List=movedpoints_6, Index=mappedpoints, Wrap=True)
pline_6 = PolyLine(Vertices=triangles_22, Closed=True)  # -> flatten(Polyline)
frgb = ColourRGBF(Alpha=1, Red=item_17.Item, Green=item_17.Item1, Blue=item_17.Item2)
culledpoints = Data(item_21)
culled2doffsets_2 = Data(item_19)
culledindexes_2 = Data(item_18)
culledpoints_2 = Data(item_20)
explode_7 = Explode(Curve=pline_6, Recursive=True)  # -> Segments, Vertices
explode_8 = Explode(Curve=culledpoints, Recursive=True)  # -> Segments, Vertices
merge_14 = Merge(Data1=graft(pshift_3), Data2=explode_7.Vertices)
lng_15 = ListLength(List=merge_14)
series_10 = Series(Start=1, Step=1, Count=expr("x-2", lng_15))
shift_3 = ShiftList(List=series_10, Shift=1, Wrap=True)
triangle_3 = MeshTriangle(CornerA=series_10, CornerB=shift_3, CornerC=0)
conmesh_6 = ConstructMesh(Vertices=merge_14, Faces=triangle_3)
trim_3 = TrimTree(Tree=conmesh_6, Depth=2)

# ----
# InnerBarycenters
meshtriangles = Data(conmesh_4)  # disabled
culledpoints_3 = Data(culledpoints_2)  # disabled
meshcp = MeshClosestPoint(Point=culledpoints_3, Mesh=meshtriangles)  # -> Point, Index, Parameter; disabled
split_7 = TextSplit(Text=meshcp.Parameter, Separators="[];")  # disabled
item_22 = ListItem(List=split_7, Index=0, Wrap=True)  # -> Item, Item1, Item2, Item3, Item4; disabled
pt_3 = ConstructPoint(XCoordinate=item_22.Item3, YCoordinate=item_22.Item2, ZCoordinate=item_22.Item1)  # disabled
trim_4 = TrimTree(Tree=pt_3, Depth=1)  # disabled
trim_5 = TrimTree(Tree=item_22.Item, Depth=1)  # disabled
internalbarycentricindices = Data(trim_5)  # disabled
internalbarycenters = Data(trim_4)  # disabled

culledpointindexes = Data(culledindexes_2)  # disabled
culled2dpointoffsets = Data(culled2doffsets_2)  # disabled

culled2dtriangleoffsets = Data(culled2doffsets)  # disabled
culledtriangleindexes = Data(culledindexes)  # disabled

culled2dtriangleoffsets_2 = Data(culled2dtriangleoffsets)
culledtriangleindexes_2 = Data(culledtriangleindexes)

culled2dpointoffsets_2 = Data(culled2dpointoffsets)
culledpointindexes_2 = Data(culledpointindexes)

culled2dtriangleoffsets_3 = Data(culled2dtriangleoffsets_2)
split_8 = TextSplit(Text=culled2dtriangleoffsets_3, Separators=",")  # -> flatten(Result)
split_9 = TextSplit(Text=culled2dpointoffsets_2, Separators=",")  # -> flatten(Result)

culled2dtriangleoffsets_4 = Data(flatten(split_8))
culledtriangleindexes_3 = Data(flatten(culledtriangleindexes_2))
culled2dpointoffsets_3 = Data(flatten(split_9))
culledpointindexes_3 = Data(flatten(culledpointindexes_2))

culled2dtriangleoffsets_5 = Data(culled2dtriangleoffsets_2)
lng_16 = ListLength(List=culled2dtriangleoffsets_3)  # -> flatten(Length)
data_41 = Data(culledtriangleindexes_3)
data_42 = Data(lng_16)
partition_4 = PartitionList(List=data_41, Size=data_42)
culled2dtriangleoffsets_6 = Data(culled2dtriangleoffsets_5)
culledtriangleindexes_4 = Data(partition_4)
data_43 = Data(lng_16)

culled2dtriangleoffsets_7 = Data(flatten(culled2dtriangleoffsets_4))
culledtriangleindexes_5 = Data(flatten(culledtriangleindexes_3))
culled2dpointoffsets_4 = Data(flatten(culled2dpointoffsets_3))
culledpointindexes_4 = Data(flatten(culledpointindexes_3))

culled2dtriangleoffsets_8 = Data(culled2dtriangleoffsets_7)
culledtriangleindexes_6 = Data(culledtriangleindexes_5)
culled2dpointoffsets_5 = Data(culled2dpointoffsets_4)
culledpointindexes_5 = Data(culledpointindexes_4)

data_44 = Data(data_43)

# ----
# Barycenters!
meshtriangles_2 = Data(trim_3)
culledpoints_4 = Data(culledpoints_2)
meshcp_2 = MeshClosestPoint(Point=culledpoints_4, Mesh=meshtriangles_2)  # -> Point, Index, Parameter
data_45 = Data(meshcp_2.Parameter)
split_10 = TextSplit(Text=data_45, Separators="[];")
item_23 = ListItem(List=split_10, Index=0, Wrap=True)  # -> Item, Item1, Item2, Item3, Item4
pt_4 = ConstructPoint(XCoordinate=item_23.Item3, YCoordinate=item_23.Item2, ZCoordinate=item_23.Item1)

trim_6 = TrimTree(Tree=item_23.Item3, Depth=1)
num = Number(trim_6)
neg_3 = Negative(Value=num)
addition_5 = Addition(A=neg_3, B=Slider(1, range=0..1))
frgb_2 = ColourRGBF(Alpha=1, Red=num, Green=addition_5, Blue=0)
trim_7 = TrimTree(Tree=pt_4, Depth=1)  # disabled
panel_4 = Panel(pt_4)

barycenters = Point(trim_7)  # disabled

preview = CustomPreview(Geometry=culledpoints_4, Material=frgb_2)

# ----
# Center Barycenters!
meshtriangles_3 = Data(conmesh_3)  # disabled
culledpoints_5 = Data(culledcenters)  # disabled
meshcp_3 = MeshClosestPoint(Point=culledpoints_5, Mesh=meshtriangles_3)  # -> Point, Index, Parameter; disabled
data_46 = Data(meshcp_3.Parameter)  # disabled
split_11 = TextSplit(Text=data_46, Separators="[];")  # disabled
item_24 = ListItem(List=split_11, Index=0, Wrap=True)  # -> Item, Item1, Item2, Item3, Item4; disabled
pt_5 = ConstructPoint(XCoordinate=item_24.Item3, YCoordinate=item_24.Item2, ZCoordinate=item_24.Item1)  # disabled

trim_8 = TrimTree(Tree=pt_5, Depth=1)  # disabled

centerbarycenters = Point(trim_8)  # disabled

centerbarycenters_2 = Point(centerbarycenters)  # disabled
centerbarycenters_3 = Point(centerbarycenters_2)
centerbarycenters_4 = Point(centerbarycenters_3)

pdecon = Deconstruct(Point=centerbarycenters_4)  # -> XComponent, YComponent, ZComponent
merge_15 = Merge(Data1=graft(pdecon.XComponent), Data2=graft(pdecon.YComponent), Data3=graft(pdecon.ZComponent))  # -> flatten(Result)

centerbarycenters_5 = Number(merge_15)
centerbarycenters_6 = Number(centerbarycenters_5)
centerbarycenters_7 = Number(centerbarycenters_6)

# ----
# Barycenters!
meshtriangles_4 = Data(conmesh_3)  # disabled
culledpoints_6 = Data(culledpoints_2)  # disabled
meshcp_4 = MeshClosestPoint(Point=culledpoints_6, Mesh=meshtriangles_4)  # -> Point, Index, Parameter; disabled
data_47 = Data(meshcp_4.Parameter)  # disabled
split_12 = TextSplit(Text=data_47, Separators="[];")  # disabled
item_25 = ListItem(List=split_12, Index=0, Wrap=True)  # -> Item, Item1, Item2, Item3, Item4; disabled
pt_6 = ConstructPoint(XCoordinate=item_25.Item3, YCoordinate=item_25.Item2, ZCoordinate=item_25.Item1)  # disabled

trim_9 = TrimTree(Tree=pt_6, Depth=1)  # disabled

barycenters_2 = Point(trim_9)  # disabled

internalbarycenters_2 = Data(internalbarycenters)  # disabled
barycentriccoordinates = Data(barycenters_2)  # disabled
internalbarycentricindices_2 = Data(internalbarycentricindices)  # disabled

innerbarycentriccoordinates = Point(internalbarycenters_2)
internalbarycentricindices_3 = Data(internalbarycentricindices_2)
barycentriccoordinates_2 = Data(barycentriccoordinates)

barycentriccoordinates_3 = Data(barycentriccoordinates_2)
lng_17 = ListLength(List=barycentriccoordinates_3)  # -> flatten(Length)

pdecon_2 = Deconstruct(Point=innerbarycentriccoordinates)  # -> XComponent, YComponent, ZComponent
merge_16 = Merge(Data1=graft(pdecon_2.XComponent), Data2=graft(pdecon_2.YComponent), Data3=graft(pdecon_2.ZComponent))  # -> flatten(Result)

pdecon_3 = Deconstruct(Point=barycentriccoordinates_2)  # -> XComponent, YComponent, ZComponent
merge_17 = Merge(Data1=graft(pdecon_3.XComponent), Data2=graft(pdecon_3.YComponent), Data3=graft(pdecon_3.ZComponent))  # -> flatten(Result)

internalbarycentricindices_4 = Data(flatten(internalbarycentricindices_3))
innerbarycentriccoordinates_2 = Data(merge_16)
internalbarycentricindices_5 = Data(internalbarycentricindices_4)
barycentriccoordinates_4 = Data(merge_17)

internalbarycentricindices_6 = Data(internalbarycentricindices_5)
barycentriccoordinates_5 = Data(barycentriccoordinates_4)
innerbarycentriccoordinates_3 = Data(innerbarycentriccoordinates_2)

data_48 = Data(lng_17)

innerbarycentriccoordinates_4 = Data(innerbarycentriccoordinates_3)
internalbarycentricindices_7 = Data(internalbarycentricindices_6)
barycentriccoordinates_6 = Data(barycentriccoordinates_5)

barycentercount = Data(data_48)

# ----
# Nested Triangles Working Proof
culled2dtriangleoffsets_9 = Data(culled2dtriangleoffsets_6)
triangles_23 = Data(triangles_18)
points_15 = Data(points_14)
culledtriangleindexes_7 = Data(culledtriangleindexes_4)
offsets_19 = Data(offsets_15)
split_13 = TextSplit(Text=culled2dtriangleoffsets_9, Separators=",")
multiplication_16 = Multiplication(A=culledtriangleindexes_7, B=3)
multiplication_17 = Multiplication(A=culledtriangleindexes_7, B=3)
item_26 = ListItem(List=split_13, Index=0, Wrap=True)  # -> Item, Item1
item_27 = ListItem(List=offsets_19, Index=multiplication_16, Wrap=True)  # -> Item, Item1, Item2
item_28 = ListItem(List=triangles_23, Index=multiplication_17, Wrap=True)  # -> Item, Item1, Item2
int_6 = Integer(item_26.Item1)
int_7 = Integer(item_26.Item)
merge_18 = Merge(Data1=graft(item_27.Item), Data2=graft(item_27.Item1), Data3=graft(item_27.Item2))
merge_19 = Merge(Data1=graft(item_28.Item), Data2=graft(item_28.Item1), Data3=graft(item_28.Item2))
vec_6 = VectorXYZ(XComponent=int_7, YComponent=int_6, ZComponent=0)  # -> Vector, Length
item_29 = ListItem(List=points_15, Index=merge_19, Wrap=True)
triangle_4 = MeshTriangle(CornerA=0, CornerB=1, CornerC=2)

addition_6 = Addition(A=vec_6.Vector, B=merge_18)
panel_5 = Panel(merge_19)

multiplication_18 = Multiplication(A=addition_6, B=Slider(50, range=0..100))
move_16 = Move(Geometry=item_29, Motion=multiplication_18)  # -> Geometry, Transform
conmesh_7 = ConstructMesh(Vertices=move_16.Geometry, Faces=triangle_4)
trim_10 = TrimTree(Tree=conmesh_7, Depth=1)

mjoin = MeshJoin(Meshes=trim_10)
scale_8 = Scale(Geometry=mjoin, Center=Point(0, 0, 0), Factor=one_over_x_4)  # -> Geometry, Transform
move_17 = Move(Geometry=scale_8.Geometry, Motion=neg_2)  # -> flatten(Geometry), Transform
demesh_6 = DeconstructMesh(Mesh=move_17.Geometry)  # -> Vertices, Faces, Colours, Normals
vec_7 = Vector(demesh_6.Vertices)
pt_7 = Point(demesh_6.Vertices)

# ---- group: Barycenters for triangles
c_script_5 = CSharpScript(a=item_13.Item, b=item_13.Item1, c=item_13.Item2, p=vec_7)  # -> out, A; inputs a: Vector3d, b: Vector3d, c: Vector3d, p: Vector3d
# ---------- c_script_5: C# ----------
    Vector3d v0 = b - a, v1 = c - a, v2 = p - a;

    double d00 = Dot(v0, v0);
    double d01 = Dot(v0, v1);
    double d11 = Dot(v1, v1);
    double d20 = Dot(v2, v0);
    double d21 = Dot(v2, v1);
    double denom = d00 * d11 - d01 * d01;
    var v = (d11 * d20 - d01 * d21) / denom;
    var w = (d00 * d21 - d01 * d20) / denom;
    var u = 1.0f - v - w;

    Console.WriteLine("v");

    A = new Vector3d(u, v, w);
# ---------- c_script_5: C# additional code ----------
  private double Dot(Vector3d v0, Vector3d v1){

    return (v0.X * v1.X) + (v0.Y * v1.Y) + (v0.Z * v1.Z);

  }
# ---------- end c_script_5 ----------

# ----
lng_18 = ListLength(List=demesh_6.Vertices)  # -> flatten(Length)
devec = DeconstructVector(Vector=graft(c_script_5.A))  # -> XComponent, YComponent, ZComponent
merge_20 = Merge(Data1=devec.ZComponent, Data2=devec.YComponent, Data3=devec.XComponent)
larger = LargerThan(FirstNumber=merge_20, SecondNumber=0)  # -> LargerThan, OrEqualTo
data_49 = Data(flatten(merge_20))
ma = MassAddition(Input=larger.LargerThan)  # -> Result, PartialResults
equals = Equality(FirstNumber=ma.Result, SecondNumber=3)  # -> Equality, Inequality
trim_11 = TrimTree(Tree=equals.Equality, Depth=1)
dispatch = Dispatch(List=pt_7, DispatchPattern=trim_11)  # -> ListA, ListB
data_50 = Data(data_49)
data_51 = Data(lng_18)
data_52 = Data(trim_11)

triangleaccessbarycenters = Data(data_50)
triangleaccessbarcenticlistlength = Data(data_51)
triangleaccessbarcenticinternalmask = Data(flatten(data_52))

triangleaccessbarcenticinternalmask_2 = Data(triangleaccessbarcenticinternalmask)
triangleaccessbarcenticlistlength_2 = Data(triangleaccessbarcenticlistlength)
triangleaccessbarycenters_2 = Data(triangleaccessbarycenters)

data_53 = Data(mjoin)
medges = MeshEdges(Mesh=data_53)  # -> NakedEdges, InteriorEdges, NonManifoldEdges
demesh_7 = DeconstructMesh(Mesh=data_53)  # -> Vertices, Faces, Colours, Normals
end = EndPoints(Curve=medges.NakedEdges)  # -> Start, End
merge_21 = Merge(Data1=end.Start, Data2=end.End)
cp_7 = ClosestPoint(Point=demesh_7.Vertices, Cloud=merge_21)  # -> ClosestPoint, CPIndex, Distance

# ---- group: tolerance
one_over_x_5 = OneOverX(Value=Slider(100, range=0..100))

# ----
smaller = SmallerThan(FirstNumber=cp_7.Distance, SecondNumber=one_over_x_5)  # -> SmallerThan, OrEqualTo
dispatch_2 = Dispatch(List=demesh_7.Vertices, DispatchPattern=smaller.OrEqualTo)  # -> ListA, ListB

data_54 = Data(smaller.OrEqualTo)
triangleaccessedgemask = Data(flatten(data_54))
triangleaccessedgemask_2 = Data(triangleaccessedgemask)
mesh_tile_data = CSharpScript(
    gridScale=gridsize_18,
    nestingScale=nestingamount_14,
    triangles=triangles_21,
    offsets=offsets_18,
    positions=positions_7,
    triangleCenters=trianglecenters_6,
    triangleCenterOffsets=trianglecenteroffsets_6,
    innerTrianglePointIndexList=data_44,
    culled2dTriangleOffsets=culled2dtriangleoffsets_8,
    culledTriangleIndexes=culledtriangleindexes_6,
    culled2dPointOffsets=culled2dpointoffsets_5,
    culledPointIndexes=culledpointindexes_5,
    innerPointIndexList=barycentercount,
    barycentricCoordinates=barycentriccoordinates_6,
    innerBarycentricCoordinates=innerbarycentriccoordinates_4,
    innerBarycentricIndices=internalbarycentricindices_7,
    triangleCenterBarycenters=centerbarycenters_7,
    triangleAccessBarcenticListLength=triangleaccessbarcenticlistlength_2,
    triangleAccessBarycenters=triangleaccessbarycenters_2,
    triangleAccessBarcenticInternalMask=triangleaccessbarcenticinternalmask_2,
    triangleAccessEdgeMask=triangleaccessedgemask_2)  # -> A; inputs gridScale: Int32, nestingScale: Int32, triangles: list of Int32, offsets: list of Point3d, positions: list of Point3d, triangleCenters: list of Point3d, triangleCenterOffsets: list of Point3d, innerTrianglePointIndexList: list of Int32, culled2dTriangleOffsets: list of String, culledTriangleIndexes: list of String, culled2dPointOffsets: list of String, culledPointIndexes: list of String, innerPointIndexList: list, barycentricCoordinates: list of Double, innerBarycentricCoordinates: list of Double, innerBarycentricIndices: list of Int32, triangleCenterBarycenters: list of Double, triangleAccessBarcenticListLength: list of Int32, triangleAccessBarycenters: list of Double, triangleAccessBarcenticInternalMask: list of Boolean, triangleAccessEdgeMask: list of Boolean; disabled
# ---------- mesh_tile_data: C# ----------
  var dataStructure = new{
  gridScale = gridScale,
  nestingScale = nestingScale,
  triangles = triangles,
  offsets = FlattenPointListToInt(offsets),
  positions = FlattenPointListToFloat(positions),
  triangleCenters = FlattenPointListToFloat(triangleCenters),
  triangleCenterOffsets = FlattenPointListToInt(triangleCenterOffsets),
  innerTrianglePointIndexList = innerTrianglePointIndexList,
  innerPointIndexList = innerPointIndexList,
  culled2dTriangleOffsets = culled2dTriangleOffsets,
  culledTriangleIndexes = culledTriangleIndexes,
  culled2dPointOffsets = culled2dPointOffsets,
  culledPointIndexes = culledPointIndexes,
  barycentricCoordinates = barycentricCoordinates,
  innerBarycentricCoordinates = innerBarycentricCoordinates,
  innerBarycentricIndices = innerBarycentricIndices,
  triangleCenterBarycenters = triangleCenterBarycenters,
  triangleAccessBarcenticListLength = triangleAccessBarcenticListLength,
  triangleAccessBarycenters = triangleAccessBarycenters,
  triangleAccessBarcenticInternalMask = triangleAccessBarcenticInternalMask,
  triangleAccessEdgeMask = triangleAccessEdgeMask
  };

  //var serializer = new System.Runtime.Serialization.Json.DataContractJsonSerializer();
  //var output = serializer.Serialize(dataStructure);

  A = dataStructure;
# ---------- mesh_tile_data: C# additional code ----------
  List<int> FlattenPointListToInt(List<Point3d> list){

    var offsetsFlat = new List<int>();

    for (int i = 0; i < list.Count; i++)
    {
      offsetsFlat.Add((int) list[i].X);
      offsetsFlat.Add((int) list[i].Y);

    }
    return     offsetsFlat;
  }

  List<float> FlattenPointListToFloat(List<Point3d> list){

    var offsetsFlat = new List<float>();

    for (int i = 0; i < list.Count; i++)
    {
      offsetsFlat.Add((float) list[i].X);
      offsetsFlat.Add((float) list[i].Y);

    }
    return     offsetsFlat;
  }
# ---------- end mesh_tile_data ----------
serialise = SerialiseToJSON(Object=mesh_tile_data)
writetext = WriteToFile(Path=concat_2, Text=serialise, Write=Toggle(False))
