# Grasshopper definition attemptedVoronoiRefocus-15.gh (Grasshopper 1.0.7)
# plug-ins: MeshEdit Components, Kangaroo Components, PlanktonGh, AureconGrasshopper

size = Slider(50, range=0..100)
gridsize = Data(size)

# ----
# Create Tiling Boundary Curves
gridsize_2 = Data(gridsize)
rectangle = Rectangle(Plane=PlaneXY(0, 0, 0), XSize=gridsize_2, YSize=gridsize_2, Radius=0)  # -> Rectangle, Length
explode = Explode(Curve=rectangle.Rectangle, Recursive=True)  # -> Segments, Vertices
item = ListItem(List=explode.Segments, Index=0, Wrap=True)  # -> Item, Item1, Item2, Item3
number_slider = Slider(20, range=0..100)
flip = FlipCurve(Curve=item.Item)  # -> Curve, Flag
flip_2 = FlipCurve(Curve=item.Item1)  # -> Curve, Flag
merge = Merge(Data1=flip.Curve, Data2=item.Item2)
merge_2 = Merge(Data1=flip_2.Curve, Data2=item.Item3)
divide = DivideCurve(Curve=reparameterize(merge_2), Count=number_slider, Kinks=False)  # -> Points, Tangents, Parameters
pi = Pi(Factor=Slider(3, range=0..10))
pi_2 = Pi(Factor=Slider(4, range=0..10))
divide_2 = DivideCurve(Curve=reparameterize(merge), Count=number_slider, Kinks=False)  # -> Points, Tangents, Parameters
multiplication = Multiplication(A=divide.Parameters, B=pi_2)
multiplication_2 = Multiplication(A=divide.Parameters, B=pi)
pi_3 = Pi(Factor=Slider(4, range=0..10))
pi_4 = Pi(Factor=Slider(1, range=0..10))
sin = Sine(Value=multiplication)
sin_2 = Sine(Value=multiplication_2)
multiplication_3 = Multiplication(A=divide_2.Parameters, B=pi_4)
multiplication_4 = Multiplication(A=divide_2.Parameters, B=pi_3)
multiplication_5 = Multiplication(A=sin, B=Slider(2, range=0..10))
multiplication_6 = Multiplication(A=sin_2, B=Slider(3, range=0..10))
sin_3 = Sine(Value=multiplication_4)
sin_4 = Sine(Value=multiplication_3)
addition = Addition(A=multiplication_6, B=multiplication_5)
X = UnitX(Factor=addition)
multiplication_7 = Multiplication(A=sin_3, B=Slider(2, range=0..10))
multiplication_8 = Multiplication(A=sin_4, B=Slider(6, range=0..10))
move = Move(Geometry=divide.Points, Motion=X)  # -> Geometry, Transform
addition_2 = Addition(A=multiplication_8, B=multiplication_7)
Y = UnitY(Factor=addition_2)
move_2 = Move(Geometry=divide_2.Points, Motion=Y)  # -> Geometry, Transform
pline = PolyLine(Vertices=move.Geometry, Closed=False)  # -> flatten(Polyline)
pline_2 = PolyLine(Vertices=move_2.Geometry, Closed=False)  # -> flatten(Polyline)
bottomcurves = Data(pline)
topcurves = Data(pline_2)

size_2 = Data(gridsize)

# ----
# Create Mesh
# (Currently Baked)
bottomcurves_2 = Data(bottomcurves)  # disabled
topcurves_2 = Data(topcurves)  # disabled
merge_3 = Merge(Data1=topcurves_2, Data2=bottomcurves_2)
data = Data(merge_3)
join = JoinCurves(Curves=data, Preserve=False)
explode_2 = Explode(Curve=join, Recursive=True)  # -> Segments, Vertices
srf = Surface(join)
data_2 = Data(data)
split = SplitList(List=reverse(explode_2.Vertices), Index=1)  # -> ListA, reverse(ListB)
timer = Timer(TimerInterval=2, Target=meshmachine)  # disabled
meshmachine = MeshMachine(
    Geometry=srf,
    Length=Slider(1, range=0..1),
    FixCurves=data_2,
    FixVertices=split.ListB,
    Flip=1,
    PullStrength=0.8,
    CurvatureAdaptivity=0,
    BoundaryScale=1,
    BoundaryDistance=5,
    Exponent=2,
    Background=0.5,
    Iterations=1,
    Reset=Toggle(False))
pmesh = PlanktonMesh(meshmachine)
demesh = DeconstructMesh(Mesh=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)  # -> Vertices, Faces, Colours, Normals
conmesh = ConstructMesh(Vertices=demesh.Vertices, Faces=demesh.Faces)
weldvertices = MeshWeldVertices(Mesh=conmesh, Tolerance=0.01)  # -> RuntimeMessage, Mesh
mesh = Mesh(weldvertices.Mesh)

# ----
# Get Nodes to Loop From
topcurves_3 = Data(topcurves)
bottomcurves_3 = Data(bottomcurves)
item_2 = ListItem(List=topcurves_3, Index=0, Wrap=True)  # -> Item1, Item
item_3 = ListItem(List=bottomcurves_3, Index=0, Wrap=True)  # -> Item1, Item
data_3 = Data(item_2.Item1)
data_4 = Data(item_3.Item)
explode_3 = Explode(Curve=data_4, Recursive=True)  # -> Segments, Vertices
explode_4 = Explode(Curve=data_3, Recursive=True)  # -> Segments, Vertices
split_2 = SplitList(List=explode_3.Vertices, Index=1)  # -> ListA, ListB
split_3 = SplitList(List=explode_4.Vertices, Index=1)  # -> ListA, ListB
toprightnode = Data(split_2.ListA)
rightnodes = Data(split_2.ListB)
topnodes = Data(split_3.ListB)

size_3 = Data(size_2)

# ----
# Get Nodes to Loop To
topcurves_4 = Data(topcurves)
bottomcurves_4 = Data(bottomcurves)
item_4 = ListItem(List=topcurves_4, Index=0, Wrap=True)  # -> Item1, Item
item_5 = ListItem(List=bottomcurves_4, Index=0, Wrap=True)  # -> Item1, Item
data_5 = Data(item_4.Item)
data_6 = Data(item_5.Item1)
explode_5 = Explode(Curve=data_5, Recursive=True)  # -> Segments, Vertices
explode_6 = Explode(Curve=data_6, Recursive=True)  # -> Segments, Vertices
split_4 = SplitList(List=explode_6.Vertices, Index=1)  # -> ListA, ListB
split_5 = SplitList(List=explode_5.Vertices, Index=1)  # -> ListA, ListB
split_6 = SplitList(List=reverse(split_4.ListB), Index=1)  # -> ListA, reverse(ListB)
data_7 = Data(split_6.ListA)
bottomnodes = Data(split_5.ListB)
bottomleft = Data(data_7)
leftnodes = Data(split_4.ListB)

bottomnodes_2 = Data(bottomnodes)
mesh_2 = Mesh(mesh)
bottomleft_2 = Data(bottomleft)
leftnodes_2 = Data(leftnodes)
toprightnode_2 = Data(toprightnode)
rightnodes_2 = Data(rightnodes)
topnodes_2 = Data(topnodes)
demesh_2 = DeconstructMesh(Mesh=mesh_2)  # -> Vertices, Faces, Colours, Normals
data_8 = Data(bottomnodes_2)
data_9 = Data(leftnodes_2)
data_10 = Data(bottomleft_2)
data_11 = Data(topnodes_2)
data_12 = Data(rightnodes_2)
data_13 = Data(toprightnode_2)
cp = ClosestPoint(Point=data_13, Cloud=demesh_2.Vertices)  # -> ClosestPoint, CPIndex, Distance
cp_2 = ClosestPoint(Point=data_12, Cloud=demesh_2.Vertices)  # -> ClosestPoint, CPIndex, Distance
cp_3 = ClosestPoint(Point=data_11, Cloud=demesh_2.Vertices)  # -> ClosestPoint, CPIndex, Distance
cp_4 = ClosestPoint(Point=data_10, Cloud=demesh_2.Vertices)  # -> ClosestPoint, CPIndex, Distance
cp_5 = ClosestPoint(Point=data_9, Cloud=demesh_2.Vertices)  # -> ClosestPoint, CPIndex, Distance
cp_6 = ClosestPoint(Point=data_8, Cloud=demesh_2.Vertices)  # -> ClosestPoint, CPIndex, Distance
c_script = CSharpScript(x=cp.CPIndex, y=cp_4.CPIndex, z="1", u="1")  # -> out, A; inputs x: Int32, y: Int32, z: Int32, u: Int32
# ---------- c_script: C# ----------
    A = "{" + x + "," + y + "," + z +"," + u + "}";
# ---------- end c_script ----------
c_script_2 = CSharpScript(x=cp_2.CPIndex, y=cp_5.CPIndex, z="1", u="0")  # -> out, A; inputs x: Int32, y: Int32, z: Int32, u: Int32; same code as c_script
c_script_3 = CSharpScript(x=cp_3.CPIndex, y=cp_6.CPIndex, z="0", u="1")  # -> out, A; inputs x: Int32, y: Int32, z: Int32, u: Int32; same code as c_script
merge_4 = Merge(Data1=c_script.A, Data2=c_script_2.A, Data3=c_script_3.A)
data_14 = Data(merge_4)

size_4 = Data(size_3)
mesh_3 = Mesh(mesh)

offsetdata = Data(data_14)
mesh_4 = Mesh(mesh_3)
c_script_4 = CSharpScript(mesh=mesh_4, offsetList=offsetdata)  # -> out, C, A, B, D, E, F, AA; inputs mesh: Mesh, offsetList: list of String
# ---------- c_script_4: C# usings ----------
using System.Linq;
# ---------- c_script_4: C# ----------
    var verts = mesh.Vertices;
    var tris = mesh.Faces;
    var topology = mesh.TopologyVertices;
    var topoDataTree = new DataTree<System.Object>();
    var offsetDataTree = new DataTree<System.Object>();
    var topoRemap = new int[mesh.Vertices.Count];
    var offsetRemap = new Vector3d[mesh.Vertices.Count];

    //Get old index, replacement index, x offset and y offset from datastruct
    var datastruct = offsetList.Select(str => {
      str = str.Substring(1);
      str = str.Substring(0, str.Length - 1);
      var array = str.Split(',');
      return new int[]{int.Parse(array[0]),int.Parse(array[1]),int.Parse(array[2]),int.Parse(array[3])};
      }).ToArray();

    //Init offset array and topo array
    for (int i = 0; i < topoRemap.Length; i++)
    {
      topoRemap[i] = i;
      offsetRemap[i] = new Vector3d(0, 0, 0);
    }

    //Populate topoRemap and offsetRemap from datastruct.
    for (int i = 0; i < datastruct.Length; i++)
    {
      var data = datastruct[i];
      topoRemap[data[0]] = data[1];
      offsetRemap[data[0]].X = data[2];
      offsetRemap[data[0]].Y = data[3];
    }

    //Get the topos of the points about to be replaced
    var storedTopos = new List<List<int>>();
    var storedOffsets = new List<List<Vector3d>>();
    var storedTriangles = new List<int[]>();
    var searchableDatastruct = datastruct.ToList();

    for (int i = 0; i < datastruct.Length; i++)
    {
      var data = datastruct[i];
      var topo = topology.ConnectedTopologyVertices(data[0]);
      var topoTris = topology.ConnectedFaces(data[0]);

      var leftOutTopos = new List<int>();
      var leftOutOffsets = new List<Vector3d>();

      for (int u = 0; u < topo.Length; u++)
      {
        var index = searchableDatastruct.FindIndex(ind => {return ind[0] == topo[u];});
        if(index == -1){
          leftOutTopos.Add(topo[u]);
          leftOutOffsets.Add(new Vector3d(-datastruct[i][2], -datastruct[i][3], 0));
        }
      }
      storedTopos.Add(leftOutTopos);
      storedOffsets.Add(leftOutOffsets);
      storedTriangles.Add(topoTris);
      //todo, manage triangle offsets
    }

    ///Create a map of all distinct values and an
    ///associated remapping from the original set to
    ///the new set.
    var distinctMap = new List<int>();
    var distinctRemap = new int[topoRemap.Length];

    //Iterate through the existing data and populate the above two maps.

    var distinctTotal = 0;

    for (int i = 0; i < distinctRemap.Length; i++)
    {
      var testIndex = topoRemap[i];

      var index = distinctMap.FindIndex(ind => {return ind == testIndex;});

      if(index == -1){
        distinctMap.Add(testIndex);
        distinctRemap[i] = distinctTotal;
        distinctTotal++;
      } else{
        distinctRemap[i] = index;
      }
    }

    //Iterate through the distinct indexes and find the connected verts using the original mesh topo
    for (int i = 0; i < distinctMap.Count; i++)
    {
      var data = topology.ConnectedTopologyVertices(distinctMap[i]);
      var path = new GH_Path(i);

      for (int u = 0; u < data.Length; u++)
      {
        //Perform a remap of the topology using the looping edge, and then to the distinct values
        topoDataTree.Add(distinctRemap[topoRemap[data[u]]], path);
        offsetDataTree.Add(offsetRemap[data[u]], path);
      }

      var additionalToposIndex = searchableDatastruct.FindIndex(ind => {return ind[1] == distinctMap[i];});

      //Finally, manage the other side of the grid so the whole thing wraps around nicely
      if(additionalToposIndex != -1){
        var storedTopo = storedTopos[additionalToposIndex];
        var storedOffset = storedOffsets[additionalToposIndex];

        for (int u = 0; u < storedTopo.Count; u++)
        {
          topoDataTree.Add(distinctRemap[topoRemap[storedTopo[u]]], path);
          offsetDataTree.Add(storedOffset[u], path);
        }
      }
    }

    var triangleIndexList = new List<int>();
    var triangleRemapList = new List<Vector3d>();

    //Iterate through the triangles and remap to the offsets
    for (int i = 0; i < tris.Count; i++)
    {
      var tri = tris[i];
      triangleIndexList.Add(distinctRemap[topoRemap[tri.A]]);
      triangleRemapList.Add(offsetRemap[tri.A]);

      triangleIndexList.Add(distinctRemap[topoRemap[tri.B]]);
      triangleRemapList.Add(offsetRemap[tri.B]);

      triangleIndexList.Add(distinctRemap[topoRemap[tri.C]]);
      triangleRemapList.Add(offsetRemap[tri.C]);
    }

    //Iterate through replaced indexes...



    C = distinctMap;
    A = topoDataTree;
    B = offsetDataTree;
    D = triangleIndexList;
    E = triangleRemapList;
# ---------- end c_script_4 ----------
demesh_3 = DeconstructMesh(Mesh=mesh_4)  # -> Vertices, Faces, Colours, Normals
item_6 = ListItem(List=demesh_3.Vertices, Index=c_script_4.C, Wrap=True)
verttopologydata = Data(c_script_4.A)
triangleindexes = Integer(c_script_4.D)
triangleoffsets = Vector(c_script_4.E)
vertoffsetdata = Data(c_script_4.B)
uniqueverts = Data(item_6)

triangle_offset_topodata_for_barycenters = Vector(c_script_4.AA)  # disabled
triangle_topodata_for_barycenters = Vector(c_script_4.F)  # disabled
item_7 = ListItem(List=uniqueverts, Index=verttopologydata, Wrap=True)
move_3 = Move(Geometry=item_7, Motion=expr("x*50", vertoffsetdata))  # -> Geometry, Transform
shift = ShiftList(List=move_3.Geometry, Shift=0, Wrap=True)  # -> simplify(List)
lng = ListLength(List=shift)
shift_2 = ShiftList(List=move_3.Geometry, Shift=1, Wrap=True)  # -> simplify(List)
repeat = RepeatData(Data=uniqueverts, Length=lng)  # -> simplify(graft(Data))

uniquepoints = Point(uniqueverts)
size_5 = Data(size_4)
panel = Panel("""{-1,-1,0}
{-1,0,0}
{-1,+1,0}
{+1,-1,0}
{+1,0,0}
{+1,+1,0}
{0,+1,0}
{0,-1,0}
{0,0,0}""")
pt = Point(panel)
multiplication_9 = Multiplication(A=pt, B=size_5)
move_4 = Move(Geometry=uniquepoints, Motion=graft(multiplication_9))  # -> flatten(Geometry), Transform
vcell = VoronoiCell(Point=graft(uniquepoints), Neighbours=move_4.Geometry)  # -> flatten(Cell); disabled
circle = CircleCNR(Center=uniquepoints, Normal=Vector(0, 0, 1), Radius=1)
debrep = DeconstructBrep(Brep=vcell)  # -> Faces, Edges, Vertices
alongcrv = SortAlongCurve(Points=debrep.Vertices, Curve=graft(circle))  # -> Points, Indices
cells = Data(alongcrv.Points)
trim = TrimTree(Tree=cells, Depth=1)
pshift = ShiftPaths(Data=trim, Offset=5)

uniquepoints_2 = Point(uniqueverts)
size_6 = Data(size_4)
panel_2 = Panel("""{-1,-1,0}
{-1,0,0}
{-1,+1,0}
{+1,-1,0}
{+1,0,0}
{+1,+1,0}
{0,+1,0}
{0,-1,0}
{0,0,0}""")
pt_2 = Point(panel_2)
multiplication_10 = Multiplication(A=pt_2, B=size_6)
move_5 = Move(Geometry=uniquepoints_2, Motion=graft(multiplication_10))  # -> flatten(Geometry), Transform
vcell_2 = VoronoiCell(Point=graft(uniquepoints_2), Neighbours=move_5.Geometry)  # -> flatten(Cell)
circle_2 = CircleCNR(Center=uniquepoints_2, Normal=Vector(0, 0, 1), Radius=1)
debrep_2 = DeconstructBrep(Brep=vcell_2)  # -> Faces, Edges, Vertices
alongcrv_2 = SortAlongCurve(Points=debrep_2.Vertices, Curve=graft(circle_2))  # -> Points, Indices
cells_2 = Data(alongcrv_2.Points)
trim_2 = TrimTree(Tree=cells_2, Depth=1)
pshift_2 = ShiftPaths(Data=trim_2, Offset=5)

size_7 = Data(size_4)
merge_5 = Merge(Data1=repeat, Data2=graft(shift), Data3=graft(shift_2))
triangle = MeshTriangle(CornerA=0, CornerB=1, CornerC=2)
conmesh_2 = ConstructMesh(Vertices=merge_5, Faces=triangle)

# ----
# Base Mesh
uniquepoints_3 = Point(uniqueverts)
triangleindexes_2 = Integer(triangleindexes)
triangleoffsets_2 = Vector(triangleoffsets)
item_8 = ListItem(List=uniquepoints_3, Index=triangleindexes_2, Wrap=True)
multiplication_11 = Multiplication(A=triangleoffsets_2, B=Slider(50, range=0..100))
move_6 = Move(Geometry=item_8, Motion=multiplication_11)  # -> Geometry, Transform
partition = PartitionList(List=move_6.Geometry, Size=3)
pline_3 = PolyLine(Vertices=partition, Closed=True)

triangleindexes_3 = Integer(triangleindexes)
triangleoffsets_3 = Vector(triangleoffsets)
topologydata = Data(verttopologydata)
uniqueverts_2 = Data(uniqueverts)
offsetdata_2 = Data(vertoffsetdata)
facen = FaceNormals(Mesh=mesh_3)  # -> Centers, Normals
uniqueverts_3 = Data(uniqueverts_2)
topologydata_2 = Data(topologydata)
triangleindexes_4 = Integer(triangleindexes_3)
triangleoffsets_4 = Vector(triangleoffsets_3)
offsetdata_3 = Data(offsetdata_2)
topologyoffset = Data(offsetdata_3)  # disabled
triangles = Integer(triangleindexes_4)  # disabled
topology = Data(topologydata_2)  # disabled
gridsize_3 = Data(size_7)  # disabled
offsets = Vector(triangleoffsets_4)  # disabled
points = Point(uniqueverts_3)  # disabled
centers = Data(facen.Centers)  # disabled
cells_3 = Data(pshift_2)  # disabled
dam = DataDam(
    DataA=triangles,
    DataB=offsets,
    DataC=points,
    DataD=centers,
    DataF=cells_3,
    DataE=gridsize_3,
    DataG=topology,
    DataH=topologyoffset,
    BufferDelay=10000000,
    BufferMode=0)  # -> DataA, DataB, DataC, DataD, DataF, DataE, DataG, DataH
topologyoffset_2 = Data(dam.DataH)
topology_2 = Data(dam.DataG)
triangles_2 = Integer(dam.DataA)
gridsize_4 = Data(dam.DataE)
offsets_2 = Vector(dam.DataB)
points_2 = Point(dam.DataC)
centers_2 = Data(dam.DataD)
cells_4 = Data(dam.DataF)
triangles_3 = Integer(triangles_2)
topology_3 = Data(topology_2)
topologyoffset_3 = Data(topologyoffset_2)
cells_5 = Data(cells_4)
gridsize_5 = Data(gridsize_4)
offsets_3 = Vector(offsets_2)
centers_3 = Data(centers_2)
points_3 = Point(points_2)
nestedsubdivisions = Data(Slider(5, range=0..10))
topologyoffset_4 = Data(topologyoffset_3)
topology_4 = Data(topology_3)
triangles_4 = Integer(triangles_3)
gridsize_6 = Data(gridsize_5)
offsets_4 = Vector(offsets_3)
points_4 = Point(points_3)
centers_4 = Data(centers_3)
cells_6 = Data(cells_5)
gridsize_7 = Data(gridsize_6)
nestedsubdivisions_2 = Data(nestedsubdivisions)
topology_5 = Data(topology_4)
topologyoffset_5 = Data(topologyoffset_4)

triangles_5 = Integer(triangles_4)
offsets_5 = Vector(offsets_4)
points_5 = Point(points_4)
centers_5 = Data(centers_4)

nestingamount = Data(nestedsubdivisions_2)

triangles_6 = Integer(triangles_4)
offsets_6 = Vector(offsets_4)
points_6 = Point(points_4)

cells_7 = Data(cells_6)

nestingamount_2 = Data(nestingamount)
gridsize_8 = Data(gridsize_7)
# InnerMeshScaleInfo
one_over_x = OneOverX(Value=nestingamount_2)
addition_3 = Addition(A=nestingamount_2, B=2)
multiplication_12 = Multiplication(A=gridsize_8, B=one_over_x)
series = Series(Start=0, Step=gridsize_8, Count=addition_3)
vec = VectorXYZ(XComponent=multiplication_12, YComponent=multiplication_12, ZComponent=0)  # -> Vector, Length
vec_2 = VectorXYZ(XComponent=series, YComponent=graft(series), ZComponent=0)  # -> flatten(Vector), Length
series_2 = Series(Start=0, Step=Slider(1, range=0..100), Count=addition_3)
neg = Negative(Value=vec.Vector)
int = Integer(series_2)
concat = Concatenate(FragmentA=int, FragmentB=",", FragmentC=graft(int))  # -> flatten(Result)
secondlayeroffset = Data(neg)
celloffsets = Data(vec_2.Vector)
cellids = Data(concat)

nestingamount_3 = Data(nestedsubdivisions_2)
gridsize_9 = Data(gridsize_7)
triangles_7 = Integer(triangles_6)

secondlayeroffset_2 = Data(secondlayeroffset)
uniquepoints_4 = Data(points_4)
centers_6 = Data(centers_4)
nestingamount_4 = Data(nestingamount)
celloffsets_2 = Data(celloffsets)
move_7 = Move(Geometry=centers_6, Motion=graft(celloffsets_2))  # -> Geometry, Transform
move_8 = Move(Geometry=uniquepoints_4, Motion=graft(celloffsets_2))  # -> Geometry, Transform
one_over_x_2 = OneOverX(Value=nestingamount_4)
scale = Scale(Geometry=move_7.Geometry, Center=Point(0, 0, 0), Factor=one_over_x_2)  # -> Geometry, Transform
scale_2 = Scale(Geometry=move_8.Geometry, Center=Point(0, 0, 0), Factor=one_over_x_2)  # -> Geometry, Transform
move_9 = Move(Geometry=scale_2.Geometry, Motion=secondlayeroffset_2)  # -> flatten(Geometry), Transform
move_10 = Move(Geometry=scale.Geometry, Motion=secondlayeroffset_2)  # -> flatten(Geometry), Transform
movedpoints = Data(move_9.Geometry)
movedcenters = Data(move_10.Geometry)

secondlayeroffset_3 = Data(secondlayeroffset)
nestingamount_5 = Data(nestingamount)
celloutlines = Data(cells_7)
centers_7 = Data(centers_4)
celloffsets_3 = Data(celloffsets)
pline_4 = PolyLine(Vertices=celloutlines, Closed=True)  # -> flatten(Polyline)
move_11 = Move(Geometry=centers_7, Motion=graft(celloffsets_3))  # -> Geometry, Transform
move_12 = Move(Geometry=pline_4, Motion=graft(celloffsets_3))  # -> Geometry, Transform
one_over_x_3 = OneOverX(Value=nestingamount_5)
scale_3 = Scale(Geometry=move_11.Geometry, Center=Point(0, 0, 0), Factor=one_over_x_3)  # -> Geometry, Transform
scale_4 = Scale(Geometry=move_12.Geometry, Center=Point(0, 0, 0), Factor=one_over_x_3)  # -> Geometry, Transform
move_13 = Move(Geometry=scale_4.Geometry, Motion=secondlayeroffset_3)  # -> flatten(Geometry), Transform
move_14 = Move(Geometry=scale_3.Geometry, Motion=secondlayeroffset_3)  # -> flatten(Geometry), Transform
movedpoints_2 = Data(move_13.Geometry)
movedcenters_2 = Data(move_14.Geometry)

# ----
# Get Triangles
offsets_7 = Vector(offsets_6)
triangles_8 = Integer(triangles_7)
points_7 = Point(points_6)
item_9 = ListItem(List=points_7, Index=triangles_8, Wrap=True)
multiplication_13 = Multiplication(A=offsets_7, B=Slider(50, range=0..100))
move_15 = Move(Geometry=item_9, Motion=multiplication_13)  # -> Geometry, Transform
partition_2 = PartitionList(List=move_15.Geometry, Size=3)
pshift_3 = ShiftPaths(Data=partition_2, Offset=5)
triangles_9 = Data(pshift_3)

points_8 = Point(points_6)
cells_8 = Data(cells_7)

lng_2 = ListLength(List=points_6)
series_3 = Series(Start=0, Step=1, Count=lng_2)
pointindexes = Integer(series_3)

celloffsets_4 = Data(celloffsets)
cellids_2 = Data(cellids)
movedpoints_3 = Data(movedpoints)
movedcenters_3 = Data(movedcenters)

# ----
# AllTriangleIndexes
triangles_10 = Integer(triangles_7)
movedcenters_4 = Data(movedcenters_3)
lng_3 = ListLength(List=triangles_10)
division = Division(A=lng_3, B=3)
lng_4 = ListLength(List=movedcenters_4)
int_2 = Integer(division)
series_4 = Series(Start=0, Step=1, Count=int_2)
int_3 = Integer(series_4)
repeat_2 = RepeatData(Data=int_3, Length=lng_4)
triangleindexes_5 = Data(repeat_2)

# ----
# All Points Indexes
pointindexes_2 = Integer(pointindexes)
celloffsets_5 = Data(celloffsets_4)
lng_5 = ListLength(List=flatten(celloffsets_5))
lng_6 = ListLength(List=pointindexes_2)
multiplication_14 = Multiplication(A=lng_6, B=lng_5)
repeat_3 = RepeatData(Data=pointindexes_2, Length=multiplication_14)  # -> flatten(Data)
nestedpointindexes = Data(repeat_3)

# ----
# TriangleMesh
quad = MeshQuad(CornerA=0, CornerB=1, CornerC=2, CornerD=2)
conmesh_3 = ConstructMesh(Vertices=triangles_9, Faces=quad)

nestingamount_6 = Data(nestingamount_3)
gridsize_10 = Data(gridsize_9)

data_15 = Data(conmesh_3)
# BarycentricHubs
demesh_4 = DeconstructMesh(Mesh=data_15)  # -> Vertices, Faces, Colours, Normals
item_10 = ListItem(List=demesh_4.Vertices, Index=0, Wrap=True)  # -> Item, Item1, Item2
facen_2 = FaceNormals(Mesh=data_15)  # -> Centers, Normals
merge_6 = Merge(Data1=item_10.Item2, Data2=item_10.Item)
merge_7 = Merge(Data1=item_10.Item1, Data2=item_10.Item2)
merge_8 = Merge(Data1=item_10.Item, Data2=item_10.Item1)
avr = Average(Input=merge_7)
avr_2 = Average(Input=merge_8)
avr_3 = Average(Input=merge_6)
series_5 = Series(Start=0, Step=1, Count=6)
shift_3 = ShiftList(List=series_5, Shift=1, Wrap=True)
merge_9 = Merge(Data1=item_10.Item, Data2=avr_2, Data3=item_10.Item1, Data4=avr, Data5=item_10.Item2, Data6=avr_3, Data7=facen_2.Centers)
triangle_2 = MeshTriangle(CornerA=series_5, CornerB=shift_3, CornerC=Slider(6, range=0..10))
conmesh_4 = ConstructMesh(Vertices=merge_9, Faces=triangle_2)

topologyoffset_6 = Data(topologyoffset_5)
topology_6 = Data(topology_5)

movedcenters_5 = Data(movedcenters)
movedpoints_4 = Data(movedpoints)

points_9 = Point(points_5)
triangles_11 = Integer(triangles_5)
offsets_8 = Vector(offsets_5)
centers_8 = Data(centers_5)

nestingamount_7 = Data(nestingamount_6)
gridsize_11 = Data(gridsize_10)

topologyoffset_7 = Data(topologyoffset_6)
topology_7 = Data(topology_6)

# ----
# All Points Offsets
_2doffsets = Data(cellids_2)
points_10 = Point(points_9)
lng_7 = ListLength(List=points_10)
repeat_4 = RepeatData(Data=graft(_2doffsets), Length=lng_7)  # -> flatten(Data)
_2doffsets_2 = Data(repeat_4)

# ----
# All Centers Offsets
_2doffsets_3 = Data(cellids_2)
points_11 = Point(centers_8)
lng_8 = ListLength(List=points_11)
repeat_5 = RepeatData(Data=graft(_2doffsets_3), Length=lng_8)  # -> flatten(Data)
_2doffsets_4 = Data(repeat_5)

nestingamount_8 = Data(nestingamount_7)
gridsize_12 = Data(gridsize_11)

topologyoffset_8 = Data(topologyoffset_7)

triangles_12 = Integer(triangles_11)
offsets_9 = Vector(offsets_8)
points_12 = Point(points_9)
centers_9 = Data(centers_8)

topology_8 = Data(topology_7)
panel_3 = Panel(topology_8)
movedpoints_5 = Data(movedpoints_4)
_2doffsets_5 = Data(_2doffsets_2)
nestedpointindexes_2 = Data(nestedpointindexes)

triangles_13 = Integer(triangles_12)
offsets_10 = Vector(offsets_9)
points_13 = Point(points_12)
centers_10 = Data(centers_9)

nestingamount_9 = Data(nestingamount_8)
gridsize_13 = Data(gridsize_12)

topology_9 = Data(topology_8)
topologyoffset_9 = Data(topologyoffset_8)

# ----
# TriangleCenterOffsets
pt_3 = Point(Point(0, 0, 0))
trianglecenters = Data(centers_10)
lng_9 = ListLength(List=trianglecenters)
repeat_6 = RepeatData(Data=pt_3, Length=lng_9)
data_16 = Data(repeat_6)
trianglecenteroffsets = Data(data_16)

triangles_14 = Data(triangles_13)
offsets_11 = Data(offsets_10)

positions = Data(points_13)

trianglecenters_2 = Data(centers_10)
trianglecenteroffsets_2 = Data(trianglecenteroffsets)

nestingamount_10 = Data(nestingamount_9)
gridsize_14 = Data(gridsize_13)

topology_10 = Data(topology_9)
topologyoffset_10 = Data(topologyoffset_9)

trianglecenteroffsets_3 = Data(trianglecenteroffsets_2)
trianglecenters_3 = Data(trianglecenters_2)

nestingamount_11 = Data(nestingamount_10)
gridsize_15 = Data(gridsize_14)

topologyoffset_11 = Data(topologyoffset_10)

triangles_15 = Data(triangles_14)
offsets_12 = Data(offsets_11)

positions_2 = Data(positions)
topology_11 = Data(topology_10)
topologyoffset_12 = Data(topologyoffset_11)
topology_12 = Data(topology_11)

triangles_16 = Data(triangles_15)
offsets_13 = Data(offsets_12)

gridsize_16 = Data(gridsize_15)
nestingamount_12 = Data(nestingamount_11)

positions_3 = Data(positions_2)

trianglecenters_4 = Data(trianglecenters_3)
trianglecenteroffsets_4 = Data(trianglecenteroffsets_3)

triangles_17 = Data(triangles_15)
offsets_14 = Data(offsets_12)
positions_4 = Data(positions_2)

topologyoffset_13 = Data(topologyoffset_12)
topology_13 = Data(topology_12)
triangles_18 = Data(triangles_17)
offsets_15 = Data(offsets_14)
points_14 = Data(positions_4)

triangles_19 = Data(triangles_17)
offsets_16 = Data(offsets_14)
positions_5 = Data(positions_4)

# ----
# Base Mesh
number_slider_2 = Slider(50, range=0..100)
triangleoffsets_5 = Vector(offsets_16)
triangleindexes_6 = Integer(triangles_19)
uniquepoints_5 = Point(positions_5)
item_11 = ListItem(List=uniquepoints_5, Index=triangleindexes_6, Wrap=True)
multiplication_15 = Multiplication(A=triangleoffsets_5, B=number_slider_2)
move_16 = Move(Geometry=item_11, Motion=multiplication_15)  # -> Geometry, Transform
partition_3 = PartitionList(List=move_16.Geometry, Size=3)
quad_2 = MeshQuad(CornerA=0, CornerB=1, CornerC=2, CornerD=2)
conmesh_5 = ConstructMesh(Vertices=partition_3, Faces=quad_2)  # -> flatten(Mesh)

topology_14 = Data(topology_13)
topologyoffset_14 = Data(topologyoffset_13)

gridsize_17 = Data(gridsize_16)
nestingamount_13 = Data(nestingamount_12)

triangles_20 = Data(triangles_16)
offsets_17 = Data(offsets_13)

positions_6 = Data(positions_3)

trianglecenters_5 = Data(trianglecenters_4)
trianglecenteroffsets_5 = Data(trianglecenteroffsets_4)

number_slider_3 = Slider(10, range=0..10)
one_over_x_4 = OneOverX(Value=Slider(5, range=0..10))
vec_3 = VectorXYZ(XComponent=number_slider_3, YComponent=number_slider_3, ZComponent=0)  # -> Vector, Length
neg_2 = Negative(Value=vec_3.Vector)
data_17 = Data(conmesh_5)
demesh_5 = DeconstructMesh(Mesh=data_17)  # -> Vertices, Faces, Colours, Normals
vec_4 = Vector(demesh_5.Vertices)
item_12 = ListItem(List=vec_4, Index=0, Wrap=True)  # -> Item, Item1, Item2
topologyoffset_15 = Data(topologyoffset_14)
topology_15 = Data(topology_14)
topology_16 = Data(topology_15)
topologyoffset_16 = Data(topologyoffset_15)
devec = DeconstructVector(Vector=topologyoffset_16)  # -> XComponent, YComponent, ZComponent
lng_10 = ListLength(List=topology_16)  # -> flatten(Length)
topology_17 = Data(topology_16)
merge_10 = Merge(Data1=graft(devec.XComponent), Data2=graft(devec.YComponent))  # -> flatten(Result)
int_4 = Integer(merge_10)

trianglecenteroffsets_6 = Data(trianglecenteroffsets_5)
trianglecenters_6 = Data(trianglecenters_5)

topologyoffset_17 = Data(flatten(int_4))

nestingamount_14 = Data(nestingamount_13)
gridsize_18 = Data(gridsize_17)

topologycount = Data(lng_10)
topology_18 = Data(flatten(topology_17))

triangles_21 = Data(triangles_20)
offsets_18 = Data(offsets_17)

positions_7 = Data(positions_6)
concat_2 = Concatenate(FragmentA="E:\User Files\Projects\Building Generator\Assets\Import\", FragmentB="dataWithVoronoi.meshTile.JSON")

# ----
# Points And Centers Within Cells
cells_9 = Data(cells_7)
movedpoints_6 = Data(movedpoints_3)
movedcenters_6 = Data(movedcenters_3)
number_slider_4 = Slider(1000, range=0..1000)
pline_5 = PolyLine(Vertices=cells_9, Closed=True)  # -> flatten(Polyline)

# ---- group: scaleForAccuracy
scale_5 = Scale(Geometry=pline_5, Center=Point(0, 0, 0), Factor=number_slider_4)  # -> Geometry, Transform
scale_6 = Scale(Geometry=movedpoints_6, Center=Point(0, 0, 0), Factor=number_slider_4)  # -> Geometry, Transform
scale_7 = Scale(Geometry=movedcenters_6, Center=Point(0, 0, 0), Factor=number_slider_4)  # -> Geometry, Transform

# ----
lng_11 = ListLength(List=scale_5.Geometry)
incurves = PointInCurves(Point=scale_6.Geometry, Curves=scale_5.Geometry)  # -> Relationship, Index, Point
incurves_2 = PointInCurves(Point=scale_7.Geometry, Curves=scale_5.Geometry)  # -> Relationship, Index, Point
series_6 = Series(Start=0, Step=1, Count=lng_11)
int_5 = Integer(series_6)
mindex = MemberIndex(Set=incurves.Index, Member=int_5)  # -> Index, Count
mindex_2 = MemberIndex(Set=incurves_2.Index, Member=int_5)  # -> Index, Count
centerswithincells = Data(mindex_2.Index)
pointswithincells = Data(mindex.Index)

# ----
# Nested Offsets And Points
mappedpoints = Data(pointswithincells)

nestedtriangleindexes = Data(triangleindexes_5)
movedcenters_7 = Data(movedcenters_5)
# Nested Offsets And Triangles
mappedcells = Data(centerswithincells)
_2doffsets_6 = Data(_2doffsets_4)
item_13 = ListItem(List=_2doffsets_6, Index=mappedcells, Wrap=True)
item_14 = ListItem(List=nestedtriangleindexes, Index=mappedcells, Wrap=True)
item_15 = ListItem(List=movedcenters_7, Index=mappedcells, Wrap=True)
culled2doffsets = Data(item_13)
culledindexes = Data(item_14)
culledcenters = Data(item_15)

item_16 = ListItem(List=nestedpointindexes_2, Index=mappedpoints, Wrap=True)
item_17 = ListItem(List=_2doffsets_5, Index=mappedpoints, Wrap=True)
item_18 = ListItem(List=movedpoints_5, Index=mappedpoints, Wrap=True)
culled2doffsets_2 = Data(item_17)
culledindexes_2 = Data(item_16)
culledpoints = Data(item_18)

# ----
# Distance From Node Center
points_15 = Point(points_8)
culledpoints_2 = Data(culledpoints)
cells_10 = Data(cells_8)
pshift_4 = ShiftPaths(Data=points_15, Offset=-5)
merge_11 = Merge(Data1=graft(pshift_4), Data2=cells_10)
lng_12 = ListLength(List=merge_11)
series_7 = Series(Start=1, Step=1, Count=expr("x-2", lng_12))
shift_4 = ShiftList(List=series_7, Shift=1, Wrap=True)
triangle_3 = MeshTriangle(CornerA=series_7, CornerB=shift_4, CornerC=0)
conmesh_6 = ConstructMesh(Vertices=merge_11, Faces=triangle_3)
trim_3 = TrimTree(Tree=conmesh_6, Depth=2)
meshtriangles = Data(trim_3)
culledpoints_3 = Data(culledpoints_2)
meshcp = MeshClosestPoint(Point=culledpoints_3, Mesh=meshtriangles)  # -> Point, Index, Parameter
data_18 = Data(meshcp.Parameter)
split_7 = TextSplit(Text=data_18, Separators="[];")
item_19 = ListItem(List=split_7, Index=0, Wrap=True)  # -> Item, Item1, Item2, Item3, Item4
trim_4 = TrimTree(Tree=item_19.Item3, Depth=1)

# ----
# InnerBarycenters
meshtriangles_2 = Data(conmesh_4)
culledpoints_4 = Data(culledpoints)
meshcp_2 = MeshClosestPoint(Point=culledpoints_4, Mesh=meshtriangles_2)  # -> Point, Index, Parameter
split_8 = TextSplit(Text=meshcp_2.Parameter, Separators="[];")
item_20 = ListItem(List=split_8, Index=0, Wrap=True)  # -> Item, Item1, Item2, Item3, Item4
pt_4 = ConstructPoint(XCoordinate=item_20.Item3, YCoordinate=item_20.Item2, ZCoordinate=item_20.Item1)
trim_5 = TrimTree(Tree=pt_4, Depth=1)
trim_6 = TrimTree(Tree=item_20.Item, Depth=1)
internalbarycentricindices = Data(trim_6)
internalbarycenters = Data(trim_5)

distancefromnodecenter = Data(trim_4)

nestedpointindexes_3 = Data(culledindexes_2)
nested2dpointoffsets = Data(culled2doffsets_2)

nested2dtriangleoffsets = Data(culled2doffsets)
nestedtriangleindexes_2 = Data(culledindexes)

distancefromnodecenter_2 = Data(distancefromnodecenter)

nested2dtriangleoffsets_2 = Data(nested2dtriangleoffsets)
nestedtriangleindexes_3 = Data(nestedtriangleindexes_2)

nested2dpointoffsets_2 = Data(nested2dpointoffsets)
nestedpointindexes_4 = Data(nestedpointindexes_3)

distancefromnodecenter_3 = Data(distancefromnodecenter_2)
culled2dtriangleoffsets = Data(nested2dtriangleoffsets_2)
split_9 = TextSplit(Text=culled2dtriangleoffsets, Separators=",")  # -> flatten(Result)
split_10 = TextSplit(Text=nested2dpointoffsets_2, Separators=",")  # -> flatten(Result)

culled2dtriangleoffsets_2 = Data(flatten(split_9))
culledtriangleindexes = Data(flatten(nestedtriangleindexes_3))
culled2dpointoffsets = Data(flatten(split_10))
culledpointindexes = Data(nestedpointindexes_4)

distancefromnodecenter_4 = Data(distancefromnodecenter_3)
culled2dtriangleoffsets_3 = Data(nested2dtriangleoffsets_2)
lng_13 = ListLength(List=culled2dtriangleoffsets)  # -> flatten(Length)
data_19 = Data(culledtriangleindexes)
data_20 = Data(lng_13)
partition_4 = PartitionList(List=data_19, Size=data_20)
culled2dtriangleoffsets_4 = Data(culled2dtriangleoffsets_3)
culledtriangleindexes_2 = Data(partition_4)
culledpointindexes_2 = Data(culledpointindexes)
distancefromnodecenter_5 = Data(distancefromnodecenter_4)
data_21 = Data(lng_13)

culled2dtriangleoffsets_5 = Data(flatten(culled2dtriangleoffsets_2))
culledtriangleindexes_3 = Data(flatten(culledtriangleindexes))
culled2dpointoffsets_2 = Data(flatten(culled2dpointoffsets))
culledpointindexes_3 = Data(culledpointindexes)

lng_14 = ListLength(List=culledpointindexes_2)  # -> flatten(Length)
distancefromnodecenter_6 = Data(distancefromnodecenter_5)
culledpointindexes_4 = Data(lng_14)
distancefromnodecenter_7 = Data(flatten(distancefromnodecenter_6))
innercellpointindexlist = Data(culledpointindexes_4)
nesteddistancefromnodecenter = Data(distancefromnodecenter_7)
innertrianglepointindexlist = Data(data_21)

nested2dtriangleoffsets_3 = Data(culled2dtriangleoffsets_5)
nestedpointindexes_5 = Data(flatten(culledpointindexes_3))
nestedtriangleindexes_4 = Data(culledtriangleindexes_3)
nested2dpointoffsets_3 = Data(culled2dpointoffsets_2)

innercellpointindexlist_2 = Data(innercellpointindexlist)

# ----
# Center Barycenters!
meshtriangles_3 = Data(conmesh_3)
culledpoints_5 = Data(culledcenters)
meshcp_3 = MeshClosestPoint(Point=culledpoints_5, Mesh=meshtriangles_3)  # -> Point, Index, Parameter
data_22 = Data(meshcp_3.Parameter)
split_11 = TextSplit(Text=data_22, Separators="[];")
item_21 = ListItem(List=split_11, Index=0, Wrap=True)  # -> Item, Item1, Item2, Item3, Item4
pt_5 = ConstructPoint(XCoordinate=item_21.Item3, YCoordinate=item_21.Item2, ZCoordinate=item_21.Item1)

trim_7 = TrimTree(Tree=pt_5, Depth=1)

centerbarycenters = Point(trim_7)

centerbarycenters_2 = Point(centerbarycenters)
centerbarycenters_3 = Point(centerbarycenters_2)
centerbarycenters_4 = Point(centerbarycenters_3)

pdecon = Deconstruct(Point=centerbarycenters_4)  # -> XComponent, YComponent, ZComponent
merge_12 = Merge(Data1=graft(pdecon.XComponent), Data2=graft(pdecon.YComponent), Data3=graft(pdecon.ZComponent))  # -> flatten(Result)

centerbarycenters_5 = Number(merge_12)
centerbarycenters_6 = Number(centerbarycenters_5)
centerbarycenters_7 = Number(centerbarycenters_6)

# ----
# Barycenters!
meshtriangles_4 = Data(conmesh_3)
culledpoints_6 = Data(culledpoints)
meshcp_4 = MeshClosestPoint(Point=culledpoints_6, Mesh=meshtriangles_4)  # -> Point, Index, Parameter
data_23 = Data(meshcp_4.Parameter)
split_12 = TextSplit(Text=data_23, Separators="[];")
item_22 = ListItem(List=split_12, Index=0, Wrap=True)  # -> Item, Item1, Item2, Item3, Item4
pt_6 = ConstructPoint(XCoordinate=item_22.Item3, YCoordinate=item_22.Item2, ZCoordinate=item_22.Item1)

trim_8 = TrimTree(Tree=pt_6, Depth=1)

barycenters = Point(trim_8)

internalbarycenters_2 = Data(internalbarycenters)
barycentriccoordinates = Data(barycenters)
internalbarycentricindices_2 = Data(internalbarycentricindices)

innerbarycentriccoordinates = Point(internalbarycenters_2)
internalbarycentricindices_3 = Data(internalbarycentricindices_2)
barycentriccoordinates_2 = Data(barycentriccoordinates)

barycentriccoordinates_3 = Data(barycentriccoordinates_2)
lng_15 = ListLength(List=barycentriccoordinates_3)  # -> flatten(Length)

pdecon_2 = Deconstruct(Point=innerbarycentriccoordinates)  # -> XComponent, YComponent, ZComponent
merge_13 = Merge(Data1=graft(pdecon_2.XComponent), Data2=graft(pdecon_2.YComponent), Data3=graft(pdecon_2.ZComponent))  # -> flatten(Result)

pdecon_3 = Deconstruct(Point=barycentriccoordinates_2)  # -> XComponent, YComponent, ZComponent
merge_14 = Merge(Data1=graft(pdecon_3.XComponent), Data2=graft(pdecon_3.YComponent), Data3=graft(pdecon_3.ZComponent))  # -> flatten(Result)

internalbarycentricindices_4 = Data(flatten(internalbarycentricindices_3))
innerbarycentriccoordinates_2 = Data(merge_13)
internalbarycentricindices_5 = Data(internalbarycentricindices_4)
barycentriccoordinates_4 = Data(merge_14)

innerbarycentriccoordinates_3 = Data(innerbarycentriccoordinates_2)
internalbarycentricindices_6 = Data(internalbarycentricindices_5)
barycentriccoordinates_5 = Data(barycentriccoordinates_4)

data_24 = Data(lng_15)

innerbarycentriccoordinates_4 = Data(innerbarycentriccoordinates_3)
internalbarycentricindices_7 = Data(internalbarycentricindices_6)
barycentriccoordinates_6 = Data(barycentriccoordinates_5)

barycentercount = Data(data_24)

# ----
# Nested Triangles Working Proof
culled2dtriangleoffsets_6 = Data(culled2dtriangleoffsets_4)
triangles_22 = Data(triangles_18)
points_16 = Data(points_14)
culledtriangleindexes_4 = Data(culledtriangleindexes_2)
offsets_19 = Data(offsets_15)
split_13 = TextSplit(Text=culled2dtriangleoffsets_6, Separators=",")
multiplication_16 = Multiplication(A=culledtriangleindexes_4, B=3)
multiplication_17 = Multiplication(A=culledtriangleindexes_4, B=3)
item_23 = ListItem(List=split_13, Index=0, Wrap=True)  # -> Item, Item1
item_24 = ListItem(List=offsets_19, Index=multiplication_16, Wrap=True)  # -> Item, Item1, Item2
item_25 = ListItem(List=triangles_22, Index=multiplication_17, Wrap=True)  # -> Item, Item1, Item2
int_6 = Integer(item_23.Item1)
int_7 = Integer(item_23.Item)
merge_15 = Merge(Data1=graft(item_24.Item), Data2=graft(item_24.Item1), Data3=graft(item_24.Item2))
merge_16 = Merge(Data1=graft(item_25.Item), Data2=graft(item_25.Item1), Data3=graft(item_25.Item2))
vec_5 = VectorXYZ(XComponent=int_7, YComponent=int_6, ZComponent=0)  # -> Vector, Length
item_26 = ListItem(List=points_16, Index=merge_16, Wrap=True)
triangle_4 = MeshTriangle(CornerA=0, CornerB=1, CornerC=2)

addition_4 = Addition(A=vec_5.Vector, B=merge_15)
panel_4 = Panel(merge_16)

multiplication_18 = Multiplication(A=addition_4, B=Slider(50, range=0..100))
move_17 = Move(Geometry=item_26, Motion=multiplication_18)  # -> Geometry, Transform
conmesh_7 = ConstructMesh(Vertices=move_17.Geometry, Faces=triangle_4)
trim_9 = TrimTree(Tree=conmesh_7, Depth=1)

mjoin = MeshJoin(Meshes=trim_9)
scale_8 = Scale(Geometry=mjoin, Center=Point(0, 0, 0), Factor=one_over_x_4)  # -> Geometry, Transform
move_18 = Move(Geometry=scale_8.Geometry, Motion=neg_2)  # -> flatten(Geometry), Transform
demesh_6 = DeconstructMesh(Mesh=move_18.Geometry)  # -> Vertices, Faces, Colours, Normals
vec_6 = Vector(demesh_6.Vertices)
pt_7 = Point(demesh_6.Vertices)

# ---- group: Barycenters for triangles
c_script_5 = CSharpScript(a=item_12.Item, b=item_12.Item1, c=item_12.Item2, p=vec_6)  # -> out, A; inputs a: Vector3d, b: Vector3d, c: Vector3d, p: Vector3d
# ---------- c_script_5: C# ----------
    Vector3d v0 = b - a, v1 = c - a, v2 = p - a;

    double d00 = Dot(v0, v0);
    double d01 = Dot(v0, v1);
    double d11 = Dot(v1, v1);
    double d20 = Dot(v2, v0);
    double d21 = Dot(v2, v1);
    double denom = d00 * d11 - d01 * d01;
    var v = (d11 * d20 - d01 * d21) / denom;
    var w = (d00 * d21 - d01 * d20) / denom;
    var u = 1.0f - v - w;

    Console.WriteLine("v");

    A = new Vector3d(u, v, w);
# ---------- c_script_5: C# additional code ----------
  private double Dot(Vector3d v0, Vector3d v1){

    return (v0.X * v1.X) + (v0.Y * v1.Y) + (v0.Z * v1.Z);

  }
# ---------- end c_script_5 ----------

# ----
lng_16 = ListLength(List=demesh_6.Vertices)  # -> flatten(Length)
devec_2 = DeconstructVector(Vector=graft(c_script_5.A))  # -> XComponent, YComponent, ZComponent
merge_17 = Merge(Data1=devec_2.ZComponent, Data2=devec_2.YComponent, Data3=devec_2.XComponent)
larger = LargerThan(FirstNumber=merge_17, SecondNumber=0)  # -> LargerThan, OrEqualTo
data_25 = Data(flatten(merge_17))
ma = MassAddition(Input=larger.LargerThan)  # -> Result, PartialResults
equals = Equality(FirstNumber=ma.Result, SecondNumber=3)  # -> Equality, Inequality
trim_10 = TrimTree(Tree=equals.Equality, Depth=1)
dispatch = Dispatch(List=pt_7, DispatchPattern=trim_10)  # -> ListA, ListB
data_26 = Data(data_25)
data_27 = Data(trim_10)
data_28 = Data(lng_16)

triangleaccessbarycenters = Data(data_26)
triangleaccessbarcenticlistlength = Data(data_28)
triangleaccessbarcenticinternalmask = Data(flatten(data_27))

triangleaccessbarcenticinternalmask_2 = Data(triangleaccessbarcenticinternalmask)
triangleaccessbarcenticlistlength_2 = Data(triangleaccessbarcenticlistlength)
triangleaccessbarycenters_2 = Data(triangleaccessbarycenters)

data_29 = Data(mjoin)
medges = MeshEdges(Mesh=data_29)  # -> NakedEdges, InteriorEdges, NonManifoldEdges
demesh_7 = DeconstructMesh(Mesh=data_29)  # -> Vertices, Faces, Colours, Normals
end = EndPoints(Curve=medges.NakedEdges)  # -> Start, End
merge_18 = Merge(Data1=end.Start, Data2=end.End)
cp_7 = ClosestPoint(Point=demesh_7.Vertices, Cloud=merge_18)  # -> ClosestPoint, CPIndex, Distance

# ---- group: tolerance
one_over_x_5 = OneOverX(Value=Slider(100, range=0..100))

# ----
smaller = SmallerThan(FirstNumber=cp_7.Distance, SecondNumber=one_over_x_5)  # -> SmallerThan, OrEqualTo
dispatch_2 = Dispatch(List=demesh_7.Vertices, DispatchPattern=smaller.OrEqualTo)  # -> ListA, ListB

data_30 = Data(smaller.OrEqualTo)
triangleaccessedgemask = Data(flatten(data_30))
triangleaccessedgemask_2 = Data(triangleaccessedgemask)
mesh_tile_data = CSharpScript(
    gridScale=gridsize_18,
    nestingScale=nestingamount_14,
    triangles=triangles_21,
    offsets=offsets_18,
    positions=positions_7,
    triangleCenters=trianglecenters_6,
    triangleCenterOffsets=trianglecenteroffsets_6,
    innerTrianglePointIndexList=innertrianglepointindexlist,
    culled2dTriangleOffsets=nested2dtriangleoffsets_3,
    culledTriangleIndexes=nestedtriangleindexes_4,
    culled2dPointOffsets=nested2dpointoffsets_3,
    culledPointIndexes=nestedpointindexes_5,
    innerPointIndexList=barycentercount,
    barycentricCoordinates=barycentriccoordinates_6,
    innerBarycentricCoordinates=innerbarycentriccoordinates_4,
    innerBarycentricIndices=internalbarycentricindices_7,
    triangleCenterBarycenters=centerbarycenters_7,
    triangleAccessBarcenticListLength=triangleaccessbarcenticlistlength_2,
    triangleAccessBarycenters=triangleaccessbarycenters_2,
    triangleAccessBarcenticInternalMask=triangleaccessbarcenticinternalmask_2,
    triangleAccessEdgeMask=triangleaccessedgemask_2,
    nestedDistanceFromNodeCenter=nesteddistancefromnodecenter,
    topologyCount=topologycount,
    topology=topology_18,
    topologyOffset=topologyoffset_17,
    innerCellPointIndexList=innercellpointindexlist_2)  # -> A; inputs gridScale: Int32, nestingScale: Int32, triangles: list of Int32, offsets: list of Point3d, positions: list of Point3d, triangleCenters: list of Point3d, triangleCenterOffsets: list of Point3d, innerTrianglePointIndexList: list of Int32, culled2dTriangleOffsets: list of String, culledTriangleIndexes: list of String, culled2dPointOffsets: list of String, culledPointIndexes: list of String, innerPointIndexList: list, barycentricCoordinates: list of Double, innerBarycentricCoordinates: list of Double, innerBarycentricIndices: list of Int32, triangleCenterBarycenters: list of Double, triangleAccessBarcenticListLength: list of Int32, triangleAccessBarycenters: list of Double, triangleAccessBarcenticInternalMask: list of Boolean, triangleAccessEdgeMask: list of Boolean, nestedDistanceFromNodeCenter: list, topologyCount: list, topology: list, topologyOffset: list, innerCellPointIndexList: list
# ---------- mesh_tile_data: C# usings ----------
using System.IO;
using System.Linq;
using System.Data;
using System.Drawing;
using System.Reflection;
using System.Windows.Forms;
using System.Xml;
using System.Xml.Linq;
using System.Runtime.InteropServices;

using Rhino.DocObjects;
using Rhino.Collections;
using GH_IO;
using GH_IO.Serialization;
# ---------- mesh_tile_data: C# ----------
  var dataStructure = new{
  gridScale = gridScale,
  nestingScale = nestingScale,
  triangles = triangles,
  offsets = FlattenPointListToInt(offsets),
  positions = FlattenPointListToFloat(positions),
  triangleCenters = FlattenPointListToFloat(triangleCenters),
  triangleCenterOffsets = FlattenPointListToInt(triangleCenterOffsets),
  innerTrianglePointIndexList = innerTrianglePointIndexList,
  innerPointIndexList = innerPointIndexList,
  nested2dTriangleOffsets = culled2dTriangleOffsets,
  nestedTriangleIndexes = culledTriangleIndexes,
  nested2dPointOffsets = culled2dPointOffsets,
  nestedPointIndexes = culledPointIndexes,
  barycentricCoordinates = barycentricCoordinates,
  innerBarycentricCoordinates = innerBarycentricCoordinates,
  innerBarycentricIndices = innerBarycentricIndices,
  triangleCenterBarycenters = triangleCenterBarycenters,
  triangleAccessBarcenticListLength = triangleAccessBarcenticListLength,
  triangleAccessBarycenters = triangleAccessBarycenters,
  triangleAccessBarcenticInternalMask = triangleAccessBarcenticInternalMask,
  triangleAccessEdgeMask = triangleAccessEdgeMask,
  nestedDistanceFromNodeCenter = nestedDistanceFromNodeCenter,
  topologyCount =topologyCount,
  topology = topology,
  topologyOffset = topologyOffset,
  innerCellPointIndexList = innerCellPointIndexList  
  };

  //var serializer = new System.Runtime.Serialization.Json.DataContractJsonSerializer();
  //var output = serializer.Serialize(dataStructure);

  A = dataStructure;
# ---------- mesh_tile_data: C# additional code ----------
  List<int> FlattenPointListToInt(List<Point3d> list){

    var offsetsFlat = new List<int>();

    for (int i = 0; i < list.Count; i++)
    {
      offsetsFlat.Add((int) list[i].X);
      offsetsFlat.Add((int) list[i].Y);

    }
    return     offsetsFlat;
  }

  List<float> FlattenPointListToFloat(List<Point3d> list){

    var offsetsFlat = new List<float>();

    for (int i = 0; i < list.Count; i++)
    {
      offsetsFlat.Add((float) list[i].X);
      offsetsFlat.Add((float) list[i].Y);

    }
    return     offsetsFlat;
  }
# ---------- end mesh_tile_data ----------
serialise = SerialiseToJSON(Object=mesh_tile_data)
writetext = WriteToFile(Path=concat_2, Text=serialise, Write=Toggle(False))
