# Grasshopper definition attemptedVoronoiRefocus-29.gh (Grasshopper 1.0.7)
# plug-ins: MeshEdit Components, Sandbox Topology, Kangaroo Components, PlanktonGh, TT Toolbox, AureconGrasshopper

size = Slider(50, range=0..100)
gridsize = Data(size)

# ----
# Create Tiling Boundary Curves
gridsize_2 = Data(gridsize)
rectangle = Rectangle(Plane=PlaneXY(0, 0, 0), XSize=gridsize_2, YSize=gridsize_2, Radius=0)  # -> Rectangle, Length
explode = Explode(Curve=rectangle.Rectangle, Recursive=True)  # -> Segments, Vertices
item = ListItem(List=explode.Segments, Index=0, Wrap=True)  # -> Item, Item1, Item2, Item3
number_slider = Slider(20, range=0..100)
flip = FlipCurve(Curve=item.Item)  # -> Curve, Flag
flip_2 = FlipCurve(Curve=item.Item1)  # -> Curve, Flag
merge = Merge(Data1=flip.Curve, Data2=item.Item2)
merge_2 = Merge(Data1=flip_2.Curve, Data2=item.Item3)
divide = DivideCurve(Curve=reparameterize(merge_2), Count=number_slider, Kinks=False)  # -> Points, Tangents, Parameters
pi = Pi(Factor=Slider(3, range=0..10))
pi_2 = Pi(Factor=Slider(4, range=0..10))
divide_2 = DivideCurve(Curve=reparameterize(merge), Count=number_slider, Kinks=False)  # -> Points, Tangents, Parameters
multiplication = Multiplication(A=divide.Parameters, B=pi_2)
multiplication_2 = Multiplication(A=divide.Parameters, B=pi)
pi_3 = Pi(Factor=Slider(4, range=0..10))
pi_4 = Pi(Factor=Slider(1, range=0..10))
sin = Sine(Value=multiplication)
sin_2 = Sine(Value=multiplication_2)
multiplication_3 = Multiplication(A=divide_2.Parameters, B=pi_4)
multiplication_4 = Multiplication(A=divide_2.Parameters, B=pi_3)
multiplication_5 = Multiplication(A=sin, B=Slider(2, range=0..10))
multiplication_6 = Multiplication(A=sin_2, B=Slider(3, range=0..10))
sin_3 = Sine(Value=multiplication_4)
sin_4 = Sine(Value=multiplication_3)
addition = Addition(A=multiplication_6, B=multiplication_5)
X = UnitX(Factor=addition)
multiplication_7 = Multiplication(A=sin_3, B=Slider(2, range=0..10))
multiplication_8 = Multiplication(A=sin_4, B=Slider(6, range=0..10))
move = Move(Geometry=divide.Points, Motion=X)  # -> Geometry, Transform
addition_2 = Addition(A=multiplication_8, B=multiplication_7)
Y = UnitY(Factor=addition_2)
move_2 = Move(Geometry=divide_2.Points, Motion=Y)  # -> Geometry, Transform
pline = PolyLine(Vertices=move.Geometry, Closed=False)  # -> flatten(Polyline)
pline_2 = PolyLine(Vertices=move_2.Geometry, Closed=False)  # -> flatten(Polyline)
bottomcurves = Data(pline)
topcurves = Data(pline_2)

size_2 = Data(gridsize)

# ----
# Create Mesh
# (Currently Baked)
bottomcurves_2 = Data(bottomcurves)  # disabled
topcurves_2 = Data(topcurves)  # disabled
merge_3 = Merge(Data1=topcurves_2, Data2=bottomcurves_2)
data = Data(merge_3)
join = JoinCurves(Curves=data, Preserve=False)
explode_2 = Explode(Curve=join, Recursive=True)  # -> Segments, Vertices
srf = Surface(join)
data_2 = Data(data)
split = SplitList(List=reverse(explode_2.Vertices), Index=1)  # -> ListA, reverse(ListB)
timer = Timer(TimerInterval=2, Target=meshmachine)  # disabled
meshmachine = MeshMachine(
    Geometry=srf,
    Length=Slider(1, range=0..1),
    FixCurves=data_2,
    FixVertices=split.ListB,
    Flip=1,
    PullStrength=0.8,
    CurvatureAdaptivity=0,
    BoundaryScale=1,
    BoundaryDistance=5,
    Exponent=2,
    Background=0.5,
    Iterations=1,
    Reset=Toggle(False))
pmesh = PlanktonMesh(meshmachine)
demesh = DeconstructMesh(Mesh=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)  # -> Vertices, Faces, Colours, Normals
conmesh = ConstructMesh(Vertices=demesh.Vertices, Faces=demesh.Faces)
weldvertices = MeshWeldVertices(Mesh=conmesh, Tolerance=0.01)  # -> RuntimeMessage, Mesh
mesh = Mesh(weldvertices.Mesh)

# ----
# Get Nodes to Loop From
topcurves_3 = Data(topcurves)
bottomcurves_3 = Data(bottomcurves)
item_2 = ListItem(List=topcurves_3, Index=0, Wrap=True)  # -> Item1, Item
item_3 = ListItem(List=bottomcurves_3, Index=0, Wrap=True)  # -> Item1, Item
data_3 = Data(item_2.Item1)
data_4 = Data(item_3.Item)
explode_3 = Explode(Curve=data_4, Recursive=True)  # -> Segments, Vertices
explode_4 = Explode(Curve=data_3, Recursive=True)  # -> Segments, Vertices
split_2 = SplitList(List=explode_3.Vertices, Index=1)  # -> ListA, ListB
split_3 = SplitList(List=explode_4.Vertices, Index=1)  # -> ListA, ListB
toprightnode = Data(split_2.ListA)
rightnodes = Data(split_2.ListB)
topnodes = Data(split_3.ListB)

size_3 = Data(size_2)

# ----
# Get Nodes to Loop To
topcurves_4 = Data(topcurves)
bottomcurves_4 = Data(bottomcurves)
item_4 = ListItem(List=topcurves_4, Index=0, Wrap=True)  # -> Item1, Item
item_5 = ListItem(List=bottomcurves_4, Index=0, Wrap=True)  # -> Item1, Item
data_5 = Data(item_4.Item)
data_6 = Data(item_5.Item1)
explode_5 = Explode(Curve=data_5, Recursive=True)  # -> Segments, Vertices
explode_6 = Explode(Curve=data_6, Recursive=True)  # -> Segments, Vertices
split_4 = SplitList(List=explode_6.Vertices, Index=1)  # -> ListA, ListB
split_5 = SplitList(List=explode_5.Vertices, Index=1)  # -> ListA, ListB
split_6 = SplitList(List=reverse(split_4.ListB), Index=1)  # -> ListA, reverse(ListB)
data_7 = Data(split_6.ListA)
bottomnodes = Data(split_5.ListB)
bottomleft = Data(data_7)
leftnodes = Data(split_4.ListB)

bottomnodes_2 = Data(bottomnodes)
mesh_2 = Mesh(mesh)
bottomleft_2 = Data(bottomleft)
leftnodes_2 = Data(leftnodes)
toprightnode_2 = Data(toprightnode)
rightnodes_2 = Data(rightnodes)
topnodes_2 = Data(topnodes)
demesh_2 = DeconstructMesh(Mesh=mesh_2)  # -> Vertices, Faces, Colours, Normals
data_8 = Data(bottomnodes_2)
data_9 = Data(leftnodes_2)
data_10 = Data(bottomleft_2)
data_11 = Data(topnodes_2)
data_12 = Data(rightnodes_2)
data_13 = Data(toprightnode_2)
cp = ClosestPoint(Point=data_13, Cloud=demesh_2.Vertices)  # -> ClosestPoint, CPIndex, Distance
cp_2 = ClosestPoint(Point=data_12, Cloud=demesh_2.Vertices)  # -> ClosestPoint, CPIndex, Distance
cp_3 = ClosestPoint(Point=data_11, Cloud=demesh_2.Vertices)  # -> ClosestPoint, CPIndex, Distance
cp_4 = ClosestPoint(Point=data_10, Cloud=demesh_2.Vertices)  # -> ClosestPoint, CPIndex, Distance
cp_5 = ClosestPoint(Point=data_9, Cloud=demesh_2.Vertices)  # -> ClosestPoint, CPIndex, Distance
cp_6 = ClosestPoint(Point=data_8, Cloud=demesh_2.Vertices)  # -> ClosestPoint, CPIndex, Distance
c_script = CSharpScript(x=cp.CPIndex, y=cp_4.CPIndex, z="1", u="1")  # -> out, A; inputs x: Int32, y: Int32, z: Int32, u: Int32
# ---------- c_script: C# ----------
    A = "{" + x + "," + y + "," + z + "," + u + "}";
# ---------- end c_script ----------
c_script_2 = CSharpScript(x=cp_2.CPIndex, y=cp_5.CPIndex, z="1", u="0")  # -> out, A; inputs x: Int32, y: Int32, z: Int32, u: Int32
# ---------- c_script_2: C# ----------
    A = "{" + x + "," + y + "," + z +"," + u + "}";
# ---------- end c_script_2 ----------
c_script_3 = CSharpScript(x=cp_3.CPIndex, y=cp_6.CPIndex, z="0", u="1")  # -> out, A; inputs x: Int32, y: Int32, z: Int32, u: Int32; same code as c_script_2
merge_4 = Merge(Data1=c_script.A, Data2=c_script_2.A, Data3=c_script_3.A)
data_14 = Data(merge_4)

mesh_3 = Mesh(mesh)
size_4 = Data(size_3)
panel = Panel("""2
7
8
80
94
110
114
140
145
167
173
197
200
221
249
250
274
276
293
319
323
329
58
59
60
61""")

# ----
# One Weird Error With 0,0 Corner
mesh_4 = Mesh(mesh_3)
mesh_topo_vertex = MeshTopologyVertex(Mesh=mesh_4)  # -> ListOfMeshVertices, VertexVertexStructure, VertexFaceStructure
explode_7 = MeshExplode(Mesh=mesh_4, Interpolate=False)
item_6 = ListItem(List=mesh_topo_vertex.ListOfMeshVertices, Index=mesh_topo_vertex.VertexVertexStructure, Wrap=True)
item_7 = ListItem(List=explode_7, Index=mesh_topo_vertex.VertexFaceStructure, Wrap=True)
ln = Line(StartPoint=graft(mesh_topo_vertex.ListOfMeshVertices), EndPoint=item_6)
tbi = TreeBranchIndex(DataTree=ln, BranchIndex=Slider(76, range=0..100))
tbi_2 = TreeBranchIndex(DataTree=item_7, BranchIndex=Slider(36, range=0..100))

int = Integer(panel)
number_slider_2 = Slider(46, range=0..100)
number_slider_3 = Slider(59, range=0..1000)
data_15 = Data(int)
panel_2 = Panel("""130
242
291
352
411
492
288
468
493
568
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""")
number_slider_4 = Slider(50, range=0..100)
size_5 = Data(size_4)
number_slider_5 = Slider(36, range=0..100)
cset = CreateSet(List=panel_2)  # -> Set, Map
neg = Negative(Value=Slider(0, range=0..1))
neg_2 = Negative(Value=Slider(1, range=0..10))
neg_3 = Negative(Value=Slider(0, range=0..1))
neg_4 = Negative(Value=Slider(1, range=0..10))
vec = VectorXYZ(XComponent=neg_2, YComponent=0, ZComponent=0)  # -> Vector, Length
vec_2 = VectorXYZ(XComponent=neg, YComponent=neg_2, ZComponent=0)  # -> Vector, Length
vec_3 = VectorXYZ(XComponent=neg_4, YComponent=0, ZComponent=0)  # -> Vector, Length
vec_4 = VectorXYZ(XComponent=neg_3, YComponent=neg_4, ZComponent=0)  # -> Vector, Length
merge_5 = Merge(Data1=vec.Vector, Data2=vec_2.Vector)
merge_6 = Merge(Data1=vec_3.Vector, Data2=vec_4.Vector)
panel_3 = Panel("""74
55""")
entwine = Entwine(Branch00=panel_3, FlattenInputs=True)
number_slider_6 = Slider(322, range=0..1000)
facen = FaceNormals(Mesh=mesh_3)  # -> Centers, Normals
gridsize_3 = Data(size_5)
centers = Data(facen.Centers)
nestedsubdivisions = Data(Slider(5, range=0..10))
nestedsubdivisions_2 = Data(nestedsubdivisions)
nestingamount = Data(nestedsubdivisions_2)
nestingamount_2 = Data(nestedsubdivisions_2)
number_slider_7 = Slider(322, range=0..1000)  # disabled
number_slider_8 = Slider(322, range=0..1000)  # disabled
number_slider_9 = Slider(322, range=0..1000)  # disabled
panel_4 = Panel(",")  # disabled
number_slider_10 = Slider(0, range=0..100)  # disabled
number_slider_11 = Slider(50, range=0..100)  # disabled
number_slider_12 = Slider(100, range=0..100)  # disabled
number_slider_13 = Slider(3, range=0..10)  # disabled
item_8 = ListItem(Index=0, Wrap=True)  # disabled
multiplication_9 = Multiplication()
one_over_x = OneOverX(Value=Slider(5, range=0..10))
vec_5 = VectorXYZ(XComponent=10, YComponent=10, ZComponent=0)  # -> Vector, Length
number_slider_14 = Slider(322, range=0..1000)
vec_6 = VectorXYZ(XComponent=Slider(50, range=0..100), YComponent=0, ZComponent=0)  # -> Vector, Length
number_slider_15 = Slider(10, range=0..10)
one_over_x_2 = OneOverX(Value=Slider(5, range=0..10))
vec_7 = VectorXYZ(XComponent=number_slider_15, YComponent=number_slider_15, ZComponent=0)  # -> Vector, Length
neg_5 = Negative(Value=vec_7.Vector)
concat = Concatenate(FragmentA="E:\User Files\Projects\Building Generator\Assets\Import\", FragmentB="dataWithVoronoi.meshTile.JSON")
panel_5 = Panel(concat)

offsetdata = Data(data_14)
mesh_5 = Mesh(mesh_3)
c_script_4 = CSharpScript(mesh=mesh_5, offsetList=offsetdata)  # -> out, C, A, B, D, E, F, AA; inputs mesh: Mesh, offsetList: list of String
# ---------- c_script_4: C# usings ----------
using System.Linq;
# ---------- c_script_4: C# ----------
    var verts = mesh.Vertices;
    var tris = mesh.Faces;
    var topology = mesh.TopologyVertices;
    var topoDataTree = new DataTree<System.Object>();
    var offsetDataTree = new DataTree<System.Object>();
    var triangleDataTree = new DataTree<System.Object>();
    var triangleOffsetDataTree = new DataTree<System.Object>();
    var originalVertexIndexToWrappingIndex = new int[mesh.Vertices.Count];
    var originalOffsetToWrappingOffset = new Vector3d[mesh.Vertices.Count];

    //Get old index, replacement index, x offset and y offset from datastruct
    var wrappingVerticesData = offsetList.Select(str =>
      {
      str = str.Substring(1);
      str = str.Substring(0, str.Length - 1);
      var array = str.Split(',');
      return new int[] { int.Parse(array[0]), int.Parse(array[1]), int.Parse(array[2]), int.Parse(array[3]) };
      }).ToArray();

    //Init offset array and topo array
    for (int i = 0; i < originalVertexIndexToWrappingIndex.Length; i++)
    {
      originalVertexIndexToWrappingIndex[i] = i;
      originalOffsetToWrappingOffset[i] = new Vector3d(0, 0, 0);
    }

    //Populate topoRemap and offsetRemap from datastruct.
    for (int i = 0; i < wrappingVerticesData.Length; i++)
    {
      var wrappingVertexData = wrappingVerticesData[i];
      originalVertexIndexToWrappingIndex[wrappingVertexData[0]] = wrappingVertexData[1];
      originalOffsetToWrappingOffset[wrappingVertexData[0]].X = wrappingVertexData[2];
      originalOffsetToWrappingOffset[wrappingVertexData[0]].Y = wrappingVertexData[3];
    }

    //Get the topos of the points about to be replaced
    var wrappingTopology = new List<List<int>>();
    var wrappingOffset = new List<List<Vector3d>>();
    var wrappingTriangles = new List<int[]>();
    var wrappingVerticesDataList = wrappingVerticesData.ToList();

    for (int i = 0; i < wrappingVerticesData.Length; i++)
    {
      var wrappingVertex = wrappingVerticesData[i];
      var currentVertexTopology = topology.ConnectedTopologyVertices(wrappingVertex[0]);
      var currentVertexConnectedFaces = topology.ConnectedFaces(wrappingVertex[0]);

      var leftOutTopos = new List<int>();
      var leftOutOffsets = new List<Vector3d>();

      for (int u = 0; u < currentVertexTopology.Length; u++)
      {
        var index = wrappingVerticesDataList.FindIndex(wrappingIndexOriginal => { return wrappingIndexOriginal[0] == currentVertexTopology[u]; });
        if (index == -1)
        {
          leftOutTopos.Add(currentVertexTopology[u]);
          leftOutOffsets.Add(new Vector3d(-wrappingVerticesData[i][2], -wrappingVerticesData[i][3], 0));
        }
      }
      wrappingTopology.Add(leftOutTopos);
      wrappingOffset.Add(leftOutOffsets);
      wrappingTriangles.Add(currentVertexConnectedFaces);
      //todo, manage triangle offsets
    }

    ///Create a map of all distinct values and an
    ///associated remapping from the original set to
    ///the new set.
    var distinctIndices = new List<int>();
    var remapOfOriginalVertexIndicesToDistinctIndices = new int[mesh.Vertices.Count];

    //Iterate through the existing data and populate the above two maps.

    var distinctVertexCount = 0;

    for (int i = 0; i < remapOfOriginalVertexIndicesToDistinctIndices.Length; i++)
    {
      var testIndex = originalVertexIndexToWrappingIndex[i];

      var index = distinctIndices.FindIndex(ind => { return ind == testIndex; });

      if (index == -1)
      {
        distinctIndices.Add(testIndex);
        remapOfOriginalVertexIndicesToDistinctIndices[i] = distinctVertexCount;
        distinctVertexCount++;
      }
      else
      {
        remapOfOriginalVertexIndicesToDistinctIndices[i] = index;
      }
    }

    //Iterate through the distinct indexes and find the connected verts using the original mesh topo
    for (int i = 0; i < distinctIndices.Count; i++)
    {
      var path = new GH_Path(i);
      var currentTopology = topology.ConnectedTopologyVertices(distinctIndices[i]);
      var currentTriangles = topology.ConnectedFaces(distinctIndices[i]);

      for (int u = 0; u < currentTopology.Length; u++)
      {
        //Perform a remap of the topology using the looping edge, and then to the distinct values
        topoDataTree.Add(remapOfOriginalVertexIndicesToDistinctIndices[originalVertexIndexToWrappingIndex[currentTopology[u]]], path);
        offsetDataTree.Add(originalOffsetToWrappingOffset[currentTopology[u]], path);

      }

      for (int u = 0; u < currentTriangles.Length; u++)
      {
        triangleDataTree.Add(currentTriangles[u], path);
        triangleOffsetDataTree.Add(new Vector3d(0, 0, 0), path);
      }

      var additionalToposIndex = wrappingVerticesDataList.FindIndex(ind => { return ind[1] == distinctIndices[i]; });

      //Finally, manage the other side of the grid so the whole thing wraps around nicely
      if (additionalToposIndex == -1) continue;

      var wrappingVertex = wrappingVerticesDataList[additionalToposIndex];
      var wrappingTriangeOffset = new Vector3d(-wrappingVertex[2], -wrappingVertex[3], 0);


      var storedTopo = wrappingTopology[additionalToposIndex];
      var storedOffset = wrappingOffset[additionalToposIndex];
      var storedTriangle = wrappingTriangles[additionalToposIndex];

      for (int u = 0; u < storedTopo.Count; u++)
      {
        topoDataTree.Add(remapOfOriginalVertexIndicesToDistinctIndices[originalVertexIndexToWrappingIndex[storedTopo[u]]], path);
        offsetDataTree.Add(storedOffset[u], path);
      }

      for (int u = 0; u < storedTriangle.Length; u++)
      {
        triangleDataTree.Add(storedTriangle[u], path);
        triangleOffsetDataTree.Add(wrappingTriangeOffset, path);
      }

    }

    //Iterate through the triangles and remap to the offsets
    var triangleIndexList = new List<int>();
    var triangleRemapList = new List<Vector3d>();

    for (int i = 0; i < tris.Count; i++)
    {
      var tri = tris[i];
      triangleIndexList.Add(remapOfOriginalVertexIndicesToDistinctIndices[originalVertexIndexToWrappingIndex[tri.A]]);
      triangleRemapList.Add(originalOffsetToWrappingOffset[tri.A]);

      triangleIndexList.Add(remapOfOriginalVertexIndicesToDistinctIndices[originalVertexIndexToWrappingIndex[tri.B]]);
      triangleRemapList.Add(originalOffsetToWrappingOffset[tri.B]);

      triangleIndexList.Add(remapOfOriginalVertexIndicesToDistinctIndices[originalVertexIndexToWrappingIndex[tri.C]]);
      triangleRemapList.Add(originalOffsetToWrappingOffset[tri.C]);
    }

    //Iterate through replaced indexes...

    C = distinctIndices;
    A = topoDataTree;
    B = offsetDataTree;
    D = triangleIndexList;
    E = triangleRemapList;
    F = triangleDataTree;
    AA = triangleOffsetDataTree;
# ---------- end c_script_4 ----------
demesh_3 = DeconstructMesh(Mesh=mesh_5)  # -> Vertices, Faces, Colours, Normals
item_9 = ListItem(List=demesh_3.Vertices, Index=c_script_4.C, Wrap=True)
triangleindexes = Integer(c_script_4.D)
triangleoffsets = Vector(c_script_4.E)
uniqueverts = Data(item_9)

panel_6 = Panel("""74
55""")
panel_7 = Panel("""105
27""")
vec_8 = Vector([Vector(-1, 0, 0), Vector(0, -1, 0)])
vec_9 = Vector([Vector(-1, 0, 0), Vector(0, -1, 0)])
path_mapper = PathMapper(panel_6, source="{0}", target="{36}")
path_mapper_2 = PathMapper(vec_8, source="{0}", target="{36}")
path_mapper_3 = PathMapper(panel_7, source="{0}", target="{36}")
path_mapper_4 = PathMapper(vec_9, source="{0}", target="{36}")
merge_7 = Merge(Data1=c_script_4.A, Data2=path_mapper)
merge_8 = Merge(Data1=c_script_4.B, Data2=path_mapper_2)
merge_9 = Merge(Data1=c_script_4.F, Data2=path_mapper_3)
merge_10 = Merge(Data1=c_script_4.AA, Data2=path_mapper_4)

verttopologydata = Data(merge_7)
vertoffsetdata = Data(merge_8)

tritopologydata = Data(merge_9)
trioffsetdata = Data(merge_10)
tbi_3 = TreeBranchIndex(DataTree=verttopologydata, BranchIndex=Slider(36, range=0..100))
partition = PartitionList(List=triangleindexes, Size=3)
partition_2 = PartitionList(List=triangleoffsets, Size=3)
tbi_4 = TreeBranchIndex(DataTree=tritopologydata, BranchIndex=data_15)
tbi_5 = TreeBranchIndex(DataTree=trioffsetdata, BranchIndex=data_15)
tbi_6 = TreeBranchIndex(DataTree=partition, BranchIndex=tbi_4)
tbi_7 = TreeBranchIndex(DataTree=partition_2, BranchIndex=tbi_4)
tbi_8 = TreeBranchIndex(DataTree=graft(uniqueverts), BranchIndex=number_slider_3)
tbi_9 = TreeBranchIndex(DataTree=verttopologydata, BranchIndex=number_slider_3)
tbi_10 = TreeBranchIndex(DataTree=vertoffsetdata, BranchIndex=number_slider_3)
data_16 = Data(flatten(tbi_4))
item_10 = ListItem(List=uniqueverts, Index=tbi_9, Wrap=True)
item_11 = ListItem(List=uniqueverts, Index=tbi_6, Wrap=True)

uniquepoints = Point(uniqueverts)
size_6 = Data(size_4)
panel_8 = Panel("""{-1,-1,0}
{-1,0,0}
{-1,+1,0}
{+1,-1,0}
{+1,0,0}
{+1,+1,0}
{0,+1,0}
{0,-1,0}
{0,0,0}""")
pt = Point(panel_8)
multiplication_10 = Multiplication(A=pt, B=size_6)
move_3 = Move(Geometry=uniquepoints, Motion=graft(multiplication_10))  # -> flatten(Geometry), Transform
vcell = VoronoiCell(Point=graft(uniquepoints), Neighbours=move_3.Geometry)  # -> flatten(Cell)
circle = CircleCNR(Center=uniquepoints, Normal=Vector(0, 0, 1), Radius=1)
debrep = DeconstructBrep(Brep=vcell)  # -> Faces, Edges, Vertices
alongcrv = SortAlongCurve(Points=debrep.Vertices, Curve=graft(circle))  # -> Points, Indices
cells = Data(alongcrv.Points)
trim = TrimTree(Tree=cells, Depth=1)
pshift = ShiftPaths(Data=trim, Offset=5)

multiplication_11 = Multiplication(A=tbi_10, B=Slider(50, range=0..100))
multiplication_12 = Multiplication(A=tbi_7, B=number_slider_4)
multiplication_13 = Multiplication(A=tbi_5, B=number_slider_4)
cset_2 = CreateSet(List=data_16)  # -> Set, Map
move_4 = Move(Geometry=item_11, Motion=multiplication_12)  # -> Geometry, Transform
move_5 = Move(Geometry=item_10, Motion=multiplication_11)  # -> Geometry, Transform

number_slider_16 = Slider(22, range=0..100)
# Difference Between Tri and Vert Mesh
number_slider_17 = Slider(38, range=0..100)
panel_9 = Panel(Slider(36, range=0..1000))
verttopologydata_2 = Data(verttopologydata)
tritopologydata_2 = Data(tritopologydata)
triangleindexes_2 = Integer(triangleindexes)
triangleoffsets_2 = Vector(triangleoffsets)
vertoffsetdata_2 = Data(vertoffsetdata)
trioffsetdata_2 = Data(trioffsetdata)
uniqueverts_2 = Data(uniqueverts)
lng = ListLength(List=uniqueverts_2)
series = Series(Start=0, Step=1, Count=lng)
verttopologydata_3 = Data(verttopologydata_2)
vertoffsetdata_3 = Data(vertoffsetdata_2)
uniqueverts_3 = Data(uniqueverts_2)
uniqueverts_4 = Data(uniqueverts_2)
tritopologydata_3 = Data(trioffsetdata_2)
tritopologydata_4 = Data(tritopologydata_2)
item_12 = ListItem(List=uniqueverts_3, Index=panel_9, Wrap=True)
tbi_11 = TreeBranchIndex(DataTree=verttopologydata_3, BranchIndex=panel_9)
tbi_12 = TreeBranchIndex(DataTree=vertoffsetdata_3, BranchIndex=panel_9)
tbi_13 = TreeBranchIndex(DataTree=tritopologydata_4, BranchIndex=panel_9)
item_13 = ListItem(List=triangleoffsets_2, Index=expr("x*3", tbi_13), Wrap=True)  # -> Item, Item1, Item2
item_14 = ListItem(List=uniqueverts_3, Index=tbi_11, Wrap=True)
tbi_14 = TreeBranchIndex(DataTree=tritopologydata_3, BranchIndex=panel_9)
item_15 = ListItem(List=triangleindexes_2, Index=expr("x*3", tbi_13), Wrap=True)  # -> Item, Item1, Item2
merge_11 = Merge(Data1=graft(item_13.Item), Data2=graft(item_13.Item1), Data3=graft(item_13.Item2))
item_16 = ListItem(List=uniqueverts_4, Index=panel_9, Wrap=True)
multiplication_14 = Multiplication(A=tbi_12, B=Slider(50, range=0..100))
merge_12 = Merge(Data1=graft(item_15.Item), Data2=graft(item_15.Item1), Data3=graft(item_15.Item2))
multiplication_15 = Multiplication(A=merge_11, B=Slider(50, range=0..100))
move_6 = Move(Geometry=item_14, Motion=multiplication_14)  # -> Geometry, Transform
item_17 = ListItem(List=uniqueverts_2, Index=merge_12, Wrap=True)
multiplication_16 = Multiplication(A=tbi_14, B=Slider(50, range=0..100))
ln_2 = Line(StartPoint=graft(item_12), EndPoint=move_6.Geometry)
move_7 = Move(Geometry=item_17, Motion=multiplication_15)  # -> Geometry, Transform
addition_3 = Addition(A=merge_11, B=tbi_14)
move_8 = Move(Geometry=move_7.Geometry, Motion=graft(multiplication_16))  # -> Geometry, Transform
trim_2 = TrimTree(Tree=move_8.Geometry, Depth=1)
ln_3 = Line(StartPoint=graft(item_16), EndPoint=trim_2)
cset_3 = CreateSet(List=trim_2)  # -> Set, Map
difference = SetDifference(SetA=cset_3.Set, SetB=graft(item_16))

ln_4 = Line(StartPoint=tbi_8, EndPoint=move_5.Geometry)
move_9 = Move(Geometry=ln_4, Motion=Vector(0.18302757, 0.1554223656, 0))  # -> Geometry, Transform
pline_3 = PolyLine(Vertices=move_4.Geometry, Closed=True)
move_10 = Move(Geometry=pline_3, Motion=graft(multiplication_13))  # -> Geometry, Transform

# ----
# Base Mesh
uniquepoints_2 = Point(uniqueverts)
triangleindexes_3 = Integer(triangleindexes)
triangleoffsets_3 = Vector(triangleoffsets)
item_18 = ListItem(List=uniquepoints_2, Index=triangleindexes_3, Wrap=True)
multiplication_17 = Multiplication(A=triangleoffsets_3, B=Slider(50, range=0..100))
move_11 = Move(Geometry=item_18, Motion=multiplication_17)  # -> Geometry, Transform
partition_3 = PartitionList(List=move_11.Geometry, Size=3)
pline_4 = PolyLine(Vertices=partition_3, Closed=True)  # -> flatten(Polyline)

panel_10 = Panel(cset_2.Set)

# ----
# One Weird Error With 0,0 Corner
verttopologydata_4 = Data(verttopologydata)
vertoffsetdata_4 = Data(vertoffsetdata)
uniqueverts_5 = Data(uniqueverts)
data_17 = Data(pshift)
pline_5 = PolyLine(Vertices=data_17, Closed=True)  # -> flatten(Polyline)
item_19 = ListItem(List=pline_5, Index=verttopologydata_4, Wrap=True)
item_20 = ListItem(List=uniqueverts_5, Index=verttopologydata_4, Wrap=True)
move_12 = Move(Geometry=item_19, Motion=expr("x*50", vertoffsetdata_4))  # -> Geometry, Transform
move_13 = Move(Geometry=item_20, Motion=expr("x*50", vertoffsetdata_4))  # -> Geometry, Transform
data_18 = Data(Slider(36, range=0..100))
ln_5 = Line(StartPoint=graft(uniqueverts_5), EndPoint=move_13.Geometry)
tbi_15 = TreeBranchIndex(DataTree=graft(pline_5), BranchIndex=data_18)
tbi_16 = TreeBranchIndex(DataTree=move_12.Geometry, BranchIndex=data_18)
tbi_17 = TreeBranchIndex(DataTree=move_13.Geometry, BranchIndex=data_18)
tbi_18 = TreeBranchIndex(DataTree=graft(uniqueverts_5), BranchIndex=data_18)
merge_13 = Merge(Data1=tbi_18, Data2=tbi_17)  # -> flatten(Result)
data_19 = Data(tbi_16)
del = DelaunayMesh(Points=merge_13, Plane=PlaneXY(0, 0, 0))
vec_10 = VectorXYZ(XComponent="50", YComponent="50", ZComponent=0)  # -> Vector, Length
mesh_6 = Mesh(del)
move_14 = Move(Geometry=data_19, Motion=vec_10.Vector)  # -> Geometry, Transform
move_15 = Move(Geometry=mesh_6, Motion=vec_10.Vector)  # -> Geometry, Transform

exdiff = SetDifferenceS(SetA=move_6.Geometry, SetB=difference)
panel_11 = Panel(exdiff)
tritopologydata_5 = Data(tritopologydata)
triangleindexes_4 = Integer(triangleindexes)
triangleoffsets_4 = Vector(triangleoffsets)
topologydata = Data(verttopologydata)
trioffsetdata_3 = Data(trioffsetdata)
uniqueverts_6 = Data(uniqueverts)
offsetdata_2 = Data(vertoffsetdata)
uniqueverts_7 = Data(uniqueverts_6)
topologydata_2 = Data(topologydata)
triangleindexes_5 = Integer(triangleindexes_4)
triangleoffsets_5 = Vector(triangleoffsets_4)
tritopologydata_6 = Data(tritopologydata_5)
trioffsetdata_4 = Data(trioffsetdata_3)
offsetdata_3 = Data(offsetdata_2)
tritopologydata_7 = Data(tritopologydata_6)
topologyoffset = Data(offsetdata_3)
trioffsetdata_5 = Data(trioffsetdata_4)
triangles = Integer(triangleindexes_5)
topology = Data(topologydata_2)
offsets = Vector(triangleoffsets_5)
points = Point(uniqueverts_7)
cells_2 = Data(pshift)
dam = DataDam(
    DataA=triangles,
    DataB=offsets,
    DataC=points,
    DataD=centers,
    DataF=cells_2,
    DataE=gridsize_3,
    DataG=topology,
    DataH=topologyoffset,
    DataI=tritopologydata_7,
    DataJ=trioffsetdata_5,
    BufferDelay=10000000,
    BufferMode=0)  # -> DataA, DataB, DataC, DataD, DataF, DataE, DataG, DataH, DataI, DataJ
tritopologydata_8 = Data(dam.DataI)
topologyoffset_2 = Data(dam.DataH)
trioffsetdata_6 = Data(dam.DataJ)
topology_2 = Data(dam.DataG)
triangles_2 = Integer(dam.DataA)
points_2 = Point(dam.DataC)
gridsize_4 = Data(dam.DataE)
offsets_2 = Vector(dam.DataB)
centers_2 = Data(dam.DataD)
cells_3 = Data(dam.DataF)
triangles_3 = Integer(triangles_2)
topologyoffset_3 = Data(topologyoffset_2)
tritopologydata_9 = Data(tritopologydata_8)
trioffsetdata_7 = Data(trioffsetdata_6)
gridsize_5 = Data(gridsize_4)
topology_3 = Data(topology_2)
cells_4 = Data(cells_3)
offsets_3 = Vector(offsets_2)
centers_3 = Data(centers_2)
points_3 = Point(points_2)
tritopologydata_10 = Data(tritopologydata_9)
topologyoffset_4 = Data(topologyoffset_3)
trioffsetdata_8 = Data(trioffsetdata_7)
topology_4 = Data(topology_3)
triangles_4 = Integer(triangles_3)
gridsize_6 = Data(gridsize_5)
offsets_4 = Vector(offsets_3)
points_4 = Point(points_3)
centers_4 = Data(centers_3)
cells_5 = Data(cells_4)

# ----
# Base Mesh
triangleindexes_6 = Integer(triangles_4)
uniquepoints_3 = Point(points_4)
triangleoffsets_6 = Vector(offsets_4)
item_21 = ListItem(List=uniquepoints_3, Index=triangleindexes_6, Wrap=True)
multiplication_18 = Multiplication(A=triangleoffsets_6, B=Slider(50, range=0..100))
move_16 = Move(Geometry=item_21, Motion=multiplication_18)  # -> Geometry, Transform
partition_4 = PartitionList(List=move_16.Geometry, Size=3)
pline_6 = PolyLine(Vertices=partition_4, Closed=True)

gridsize_7 = Data(gridsize_6)
topology_5 = Data(topology_4)
topologyoffset_5 = Data(topologyoffset_4)

triangles_5 = Integer(triangles_4)
offsets_5 = Vector(offsets_4)
points_5 = Point(points_4)
centers_5 = Data(centers_4)

triangles_6 = Integer(triangles_4)
offsets_6 = Vector(offsets_4)
points_6 = Point(points_4)

cells_6 = Data(cells_5)

nestingamount_3 = Data(nestingamount)
gridsize_8 = Data(gridsize_7)
# InnerMeshScaleInfo
one_over_x_3 = OneOverX(Value=nestingamount_3)
addition_4 = Addition(A=nestingamount_3, B=2)
multiplication_19 = Multiplication(A=gridsize_8, B=one_over_x_3)
series_2 = Series(Start=0, Step=gridsize_8, Count=addition_4)
vec_11 = VectorXYZ(XComponent=multiplication_19, YComponent=multiplication_19, ZComponent=0)  # -> Vector, Length
vec_12 = VectorXYZ(XComponent=series_2, YComponent=graft(series_2), ZComponent=0)  # -> flatten(Vector), Length
series_3 = Series(Start=0, Step=Slider(1, range=0..100), Count=addition_4)
neg_6 = Negative(Value=vec_11.Vector)
int_2 = Integer(series_3)
concat_2 = Concatenate(FragmentA=int_2, FragmentB=",", FragmentC=graft(int_2))  # -> flatten(Result)
secondlayeroffset = Data(neg_6)
celloffsets = Data(vec_12.Vector)
cellids = Data(concat_2)

gridsize_9 = Data(gridsize_7)
triangles_7 = Integer(triangles_6)

secondlayeroffset_2 = Data(secondlayeroffset)
uniquepoints_4 = Data(points_4)
centers_6 = Data(centers_4)
nestingamount_4 = Data(nestingamount)
celloffsets_2 = Data(celloffsets)
move_17 = Move(Geometry=centers_6, Motion=graft(celloffsets_2))  # -> Geometry, Transform
move_18 = Move(Geometry=uniquepoints_4, Motion=graft(celloffsets_2))  # -> Geometry, Transform
one_over_x_4 = OneOverX(Value=nestingamount_4)
scale = Scale(Geometry=move_17.Geometry, Center=Point(0, 0, 0), Factor=one_over_x_4)  # -> Geometry, Transform
scale_2 = Scale(Geometry=move_18.Geometry, Center=Point(0, 0, 0), Factor=one_over_x_4)  # -> Geometry, Transform
move_19 = Move(Geometry=scale_2.Geometry, Motion=secondlayeroffset_2)  # -> flatten(Geometry), Transform
move_20 = Move(Geometry=scale.Geometry, Motion=secondlayeroffset_2)  # -> flatten(Geometry), Transform
movedpoints = Data(move_19.Geometry)
movedcenters = Data(move_20.Geometry)

secondlayeroffset_3 = Data(secondlayeroffset)
nestingamount_5 = Data(nestingamount)
celloutlines = Data(cells_6)
centers_7 = Data(centers_4)
celloffsets_3 = Data(celloffsets)
pline_7 = PolyLine(Vertices=celloutlines, Closed=True)  # -> flatten(Polyline)
move_21 = Move(Geometry=centers_7, Motion=graft(celloffsets_3))  # -> Geometry, Transform
move_22 = Move(Geometry=pline_7, Motion=graft(celloffsets_3))  # -> Geometry, Transform
one_over_x_5 = OneOverX(Value=nestingamount_5)
scale_3 = Scale(Geometry=move_21.Geometry, Center=Point(0, 0, 0), Factor=one_over_x_5)  # -> Geometry, Transform
scale_4 = Scale(Geometry=move_22.Geometry, Center=Point(0, 0, 0), Factor=one_over_x_5)  # -> Geometry, Transform
move_23 = Move(Geometry=scale_4.Geometry, Motion=secondlayeroffset_3)  # -> flatten(Geometry), Transform
move_24 = Move(Geometry=scale_3.Geometry, Motion=secondlayeroffset_3)  # -> flatten(Geometry), Transform
movedpoints_2 = Data(move_23.Geometry)
movedcenters_2 = Data(move_24.Geometry)

topology_6 = Data(topology_4)
topologyoffset_6 = Data(topologyoffset_4)
tritopologydata_11 = Data(tritopologydata_10)
trioffsetdata_9 = Data(trioffsetdata_8)
gridsize_10 = Data(gridsize_6)

# ----
# Get Triangles
offsets_7 = Vector(offsets_6)
triangles_8 = Integer(triangles_7)
points_7 = Point(points_6)
item_22 = ListItem(List=points_7, Index=triangles_8, Wrap=True)
multiplication_20 = Multiplication(A=offsets_7, B=Slider(50, range=0..100))
move_25 = Move(Geometry=item_22, Motion=multiplication_20)  # -> Geometry, Transform
partition_5 = PartitionList(List=move_25.Geometry, Size=3)
pshift_2 = ShiftPaths(Data=partition_5, Offset=5)
triangles_9 = Data(pshift_2)

points_8 = Point(points_6)
cells_7 = Data(cells_6)

lng_2 = ListLength(List=points_6)
series_4 = Series(Start=0, Step=1, Count=lng_2)
pointindexes = Integer(series_4)

lng_3 = ListLength(List=celloffsets)
data_20 = Data(triangles_4)
lng_4 = ListLength(List=data_20)
multiplication_21 = Multiplication(A=lng_4, B=lng_3)
secondlayeroffset_4 = Data(secondlayeroffset)
repeat = RepeatData(Data=data_20, Length=multiplication_21)
celloffsets_4 = Data(celloffsets)
cellids_2 = Data(cellids)
pline_8 = PolyLine(Vertices=triangles_9, Closed=True)
item_23 = ListItem(List=movedcenters, Index=movedcenters_2, Wrap=True)
movedpoints_3 = Data(movedpoints)
movedcenters_3 = Data(movedcenters)
tritopologydata_12 = Data(tritopologydata_11)
topologyoffset_7 = Data(topologyoffset_6)
trioffsetdata_10 = Data(trioffsetdata_9)

# ----
# AllTriangleIndexes
triangles_10 = Integer(triangles_7)
movedcenters_4 = Data(movedcenters_3)
lng_5 = ListLength(List=triangles_10)
division = Division(A=lng_5, B=3)
lng_6 = ListLength(List=movedcenters_4)
int_3 = Integer(division)
series_5 = Series(Start=0, Step=1, Count=int_3)
int_4 = Integer(series_5)
repeat_2 = RepeatData(Data=int_4, Length=lng_6)
triangleindexes_7 = Data(repeat_2)

# ----
# All Points Indexes
pointindexes_2 = Integer(pointindexes)
celloffsets_5 = Data(celloffsets_4)
lng_7 = ListLength(List=flatten(celloffsets_5))
lng_8 = ListLength(List=pointindexes_2)
multiplication_22 = Multiplication(A=lng_8, B=lng_7)
repeat_3 = RepeatData(Data=pointindexes_2, Length=multiplication_22)  # -> flatten(Data)
nestedpointindexes = Data(repeat_3)

topology_7 = Data(topology_6)

# ----
# TriangleMesh
quad = MeshQuad(CornerA=0, CornerB=1, CornerC=2, CornerD=2)
conmesh_2 = ConstructMesh(Vertices=triangles_9, Faces=quad)

topology_8 = Data(topology_7)
topologyoffset_8 = Data(topologyoffset_7)
trioffsetdata_11 = Data(trioffsetdata_10)
tritopologydata_13 = Data(tritopologydata_12)

data_21 = Data(gridsize_10)
tritopologydata_14 = Data(tritopologydata_12)
trioffsetdata_12 = Data(trioffsetdata_10)
mesh_7 = Mesh(conmesh_2)
multiplication_23 = Multiplication(A=trioffsetdata_12, B=data_21)
item_24 = ListItem(List=flatten(mesh_7), Index=tritopologydata_14, Wrap=True)
move_26 = Move(Geometry=item_24, Motion=multiplication_23)  # -> Geometry, Transform
trianglefans = Data(move_26.Geometry)

secondlayeroffset_5 = Data(secondlayeroffset_4)

nestingamount_6 = Data(nestingamount_2)
gridsize_11 = Data(gridsize_9)

topologyoffset_9 = Data(topologyoffset_5)
topology_9 = Data(topology_5)
topology_10 = Data(topology_8)
topologyoffset_10 = Data(topologyoffset_8)
trianglefans_2 = Data(trianglefans)
tritopologydata_15 = Data(tritopologydata_13)
trioffsetdata_13 = Data(trioffsetdata_11)

data_22 = Data(conmesh_2)
# BarycentricHubs
demesh_4 = DeconstructMesh(Mesh=data_22)  # -> Vertices, Faces, Colours, Normals
item_25 = ListItem(List=demesh_4.Vertices, Index=0, Wrap=True)  # -> Item, Item1, Item2
facen_2 = FaceNormals(Mesh=data_22)  # -> Centers, Normals
merge_14 = Merge(Data1=item_25.Item2, Data2=item_25.Item)
merge_15 = Merge(Data1=item_25.Item1, Data2=item_25.Item2)
merge_16 = Merge(Data1=item_25.Item, Data2=item_25.Item1)
avr = Average(Input=merge_15)
avr_2 = Average(Input=merge_16)
avr_3 = Average(Input=merge_14)
series_6 = Series(Start=0, Step=1, Count=6)
shift = ShiftList(List=series_6, Shift=1, Wrap=True)
merge_17 = Merge(Data1=item_25.Item, Data2=avr_2, Data3=item_25.Item1, Data4=avr, Data5=item_25.Item2, Data6=avr_3, Data7=facen_2.Centers)
triangle = MeshTriangle(CornerA=series_6, CornerB=shift, CornerC=Slider(6, range=0..10))
conmesh_3 = ConstructMesh(Vertices=merge_17, Faces=triangle)

movedcenters_5 = Data(movedcenters)
movedpoints_4 = Data(movedpoints)

points_9 = Point(points_5)
triangles_11 = Integer(triangles_5)
offsets_8 = Vector(offsets_5)
centers_8 = Data(centers_5)

nestingamount_7 = Data(nestingamount_6)
gridsize_12 = Data(gridsize_11)

topologyoffset_11 = Data(topologyoffset_9)
topology_11 = Data(topology_9)

# ----
# All Points Offsets
_2doffsets = Data(cellids_2)
points_10 = Point(points_9)
lng_9 = ListLength(List=points_10)
repeat_4 = RepeatData(Data=graft(_2doffsets), Length=lng_9)  # -> flatten(Data)
_2doffsets_2 = Data(repeat_4)

# ----
# All Centers Offsets
_2doffsets_3 = Data(cellids_2)
points_11 = Point(centers_8)
lng_10 = ListLength(List=points_11)
repeat_5 = RepeatData(Data=graft(_2doffsets_3), Length=lng_10)  # -> flatten(Data)
_2doffsets_4 = Data(repeat_5)

tritopologydata_16 = Data(tritopologydata_15)
topologyoffset_12 = Data(topologyoffset_10)
trioffsetdata_14 = Data(trioffsetdata_13)
trianglefans_3 = Data(trianglefans_2)
points_12 = Point(points_8)
topology_12 = Data(topology_10)
secondlayeroffset_6 = Data(secondlayeroffset_5)

nestingamount_8 = Data(nestingamount_7)
gridsize_13 = Data(gridsize_12)

topologyoffset_13 = Data(topologyoffset_11)

triangles_12 = Integer(triangles_11)
points_13 = Point(points_9)
offsets_9 = Vector(offsets_8)
centers_9 = Data(centers_8)

topology_13 = Data(topology_11)
movedpoints_5 = Data(movedpoints_4)
_2doffsets_5 = Data(_2doffsets_2)
nestedpointindexes_2 = Data(nestedpointindexes)

nestingamount_9 = Data(nestingamount_6)
gridsize_14 = Data(gridsize_11)

topologyoffset_14 = Data(topologyoffset_13)
topology_14 = Data(topology_13)
points_14 = Point(points_13)
tritopologydata_17 = Data(tritopologydata_10)
trioffsetdata_15 = Data(trioffsetdata_8)
topologyoffset_15 = Data(topologyoffset_14)
points_15 = Point(points_14)
topology_15 = Data(topology_14)
tritopologydata_18 = Data(tritopologydata_17)  # disabled
trioffsetdata_16 = Data(trioffsetdata_15)  # disabled
points_16 = Point(points_4)  # disabled
offsets_10 = Vector(offsets_4)  # disabled
triangles_13 = Integer(triangles_6)  # disabled
multiplication_24 = Multiplication(A=offsets_10, B=number_slider_10)  # disabled
topologyoffset_16 = Data(topologyoffset_15)
topology_16 = Data(topology_15)
points_17 = Point(points_15)
points_18 = Point(points_17)
trioffsetdata_17 = Data(trioffsetdata_14)
tritopologydata_19 = Data(tritopologydata_16)

triangles_14 = Integer(triangles_12)
offsets_11 = Vector(offsets_9)
points_19 = Point(points_13)
centers_10 = Data(centers_9)

nestingamount_10 = Data(nestingamount_8)
gridsize_15 = Data(gridsize_13)

topologyoffset_17 = Data(topologyoffset_13)
topology_17 = Data(topology_13)
points_20 = Point(points_18)
tritopologydata_20 = Data(tritopologydata_19)
trioffsetdata_18 = Data(trioffsetdata_17)

# ----
# TriangleCenterOffsets
pt_2 = Point(Point(0, 0, 0))
trianglecenters = Data(centers_10)
lng_11 = ListLength(List=trianglecenters)
repeat_6 = RepeatData(Data=pt_2, Length=lng_11)
data_23 = Data(repeat_6)
trianglecenteroffsets = Data(data_23)

offsets_12 = Data(offsets_11)
triangles_15 = Data(triangles_14)

positions = Data(points_19)

trianglecenteroffsets_2 = Data(trianglecenteroffsets)
trianglecenters_2 = Data(centers_10)

nestingamount_11 = Data(nestingamount_10)
gridsize_16 = Data(gridsize_15)

trioffsetdata_19 = Data(trioffsetdata_18)
tritopologydata_21 = Data(tritopologydata_20)
topology_18 = Data(topology_17)
topologyoffset_18 = Data(topologyoffset_17)

trianglecenteroffsets_3 = Data(trianglecenteroffsets_2)
trianglecenters_3 = Data(trianglecenters_2)

nestingamount_12 = Data(nestingamount_11)
gridsize_17 = Data(gridsize_16)

tritopologydata_22 = Data(tritopologydata_21)
topologyoffset_19 = Data(topologyoffset_18)
trioffsetdata_20 = Data(trioffsetdata_19)

triangles_16 = Data(triangles_15)
offsets_13 = Data(offsets_12)

positions_2 = Data(positions)
topology_19 = Data(topology_18)
tritopologydata_23 = Data(tritopologydata_22)
trioffsetdata_21 = Data(trioffsetdata_20)
topology_20 = Data(topology_19)
topologyoffset_20 = Data(topologyoffset_19)

gridsize_18 = Data(gridsize_17)
nestingamount_13 = Data(nestingamount_12)

triangles_17 = Data(triangles_16)
offsets_14 = Data(offsets_13)

trianglecenters_4 = Data(trianglecenters_3)
trianglecenteroffsets_4 = Data(trianglecenteroffsets_3)

positions_3 = Data(positions_2)

triangles_18 = Data(triangles_16)
offsets_15 = Data(offsets_13)
positions_4 = Data(positions_2)

tritopologydata_24 = Data(tritopologydata_23)
topologyoffset_21 = Data(topologyoffset_20)
trioffsetdata_22 = Data(trioffsetdata_21)
topology_21 = Data(topology_20)
triangles_19 = Data(triangles_18)
offsets_16 = Data(offsets_15)
points_21 = Data(positions_4)

triangles_20 = Data(triangles_18)
offsets_17 = Data(offsets_15)
positions_5 = Data(positions_4)

# ----
# Base Mesh
number_slider_18 = Slider(50, range=0..100)
triangleoffsets_7 = Vector(offsets_17)
uniquepoints_5 = Point(positions_5)
triangleindexes_8 = Integer(triangles_20)
item_26 = ListItem(List=uniquepoints_5, Index=triangleindexes_8, Wrap=True)
multiplication_25 = Multiplication(A=triangleoffsets_7, B=number_slider_18)
move_27 = Move(Geometry=item_26, Motion=multiplication_25)  # -> Geometry, Transform
partition_6 = PartitionList(List=move_27.Geometry, Size=3)
quad_2 = MeshQuad(CornerA=0, CornerB=1, CornerC=2, CornerD=2)
conmesh_4 = ConstructMesh(Vertices=partition_6, Faces=quad_2)  # -> flatten(Mesh)

tritopologydata_25 = Data(tritopologydata_24)
trioffsetdata_23 = Data(trioffsetdata_22)
topology_22 = Data(topology_21)
topologyoffset_22 = Data(topologyoffset_21)

triangles_21 = Data(triangles_17)
offsets_18 = Data(offsets_14)

gridsize_19 = Data(gridsize_18)
nestingamount_14 = Data(nestingamount_13)

positions_6 = Data(positions_3)

trianglecenters_5 = Data(trianglecenters_4)
trianglecenteroffsets_5 = Data(trianglecenteroffsets_4)

data_24 = Data(conmesh_4)
demesh_5 = DeconstructMesh(Mesh=data_24)  # -> Vertices, Faces, Colours, Normals
vec_13 = Vector(demesh_5.Vertices)
item_27 = ListItem(List=vec_13, Index=0, Wrap=True)  # -> Item, Item1, Item2
tritopologydata_26 = Data(tritopologydata_25)
topologyoffset_23 = Data(topologyoffset_22)
trioffsetdata_24 = Data(trioffsetdata_23)
topology_23 = Data(topology_22)
topology_24 = Data(topology_23)
topologyoffset_24 = Data(topologyoffset_23)
tritopologydata_27 = Data(tritopologydata_26)
trioffsetdata_25 = Data(trioffsetdata_24)
devec = DeconstructVector(Vector=topologyoffset_24)  # -> XComponent, YComponent, ZComponent
lng_12 = ListLength(List=topology_24)  # -> flatten(Length)
topology_25 = Data(topology_24)
merge_18 = Merge(Data1=graft(devec.XComponent), Data2=graft(devec.YComponent))  # -> flatten(Result)
pdecon = Deconstruct(Point=trioffsetdata_25)  # -> XComponent, YComponent, ZComponent
merge_19 = Merge(Data1=graft(pdecon.XComponent), Data2=graft(pdecon.YComponent))  # -> flatten(Result)
int_5 = Integer(merge_18)
tritopologydata_28 = Data(tritopologydata_27)
trioffsetdata_26 = Data(trioffsetdata_25)
int_6 = Integer(merge_19)
lng_13 = ListLength(List=tritopologydata_28)  # -> flatten(Length)

trianglecenteroffsets_6 = Data(trianglecenteroffsets_5)
trianglecenters_6 = Data(trianglecenters_5)

tritopologydata_29 = Data(flatten(tritopologydata_28))
topologyoffset_25 = Data(flatten(int_5))
tritopologycount = Data(flatten(lng_13))
trioffsetdata_27 = Data(flatten(int_6))

nestingamount_15 = Data(nestingamount_14)
gridsize_20 = Data(gridsize_19)

topologycount = Data(lng_12)
topology_26 = Data(flatten(topology_25))

triangles_22 = Data(triangles_21)
offsets_19 = Data(offsets_18)

positions_7 = Data(positions_6)

# ----
# Points And Centers Within Cells
cells_8 = Data(cells_6)
movedpoints_6 = Data(movedpoints_3)
movedcenters_6 = Data(movedcenters_3)
number_slider_19 = Slider(1000, range=0..1000)
pline_9 = PolyLine(Vertices=cells_8, Closed=True)  # -> flatten(Polyline)

# ---- group: scaleForAccuracy
scale_5 = Scale(Geometry=pline_9, Center=Point(0, 0, 0), Factor=number_slider_19)  # -> Geometry, Transform
scale_6 = Scale(Geometry=movedpoints_6, Center=Point(0, 0, 0), Factor=number_slider_19)  # -> Geometry, Transform
scale_7 = Scale(Geometry=movedcenters_6, Center=Point(0, 0, 0), Factor=number_slider_19)  # -> Geometry, Transform

# ----
lng_14 = ListLength(List=scale_5.Geometry)
incurves = PointInCurves(Point=scale_6.Geometry, Curves=scale_5.Geometry)  # -> Relationship, Index, Point
incurves_2 = PointInCurves(Point=scale_7.Geometry, Curves=scale_5.Geometry)  # -> Relationship, Index, Point
series_7 = Series(Start=0, Step=1, Count=lng_14)
int_7 = Integer(series_7)
mindex = MemberIndex(Set=incurves.Index, Member=int_7)  # -> Index, Count
mindex_2 = MemberIndex(Set=incurves_2.Index, Member=int_7)  # -> Index, Count
centerswithincells = Data(mindex_2.Index)
pointswithincells = Data(mindex.Index)

# ----
# Nested Offsets And Points
mappedpoints = Data(pointswithincells)

_2doffsets_6 = Data(_2doffsets_4)
nestedtriangleindexes = Data(triangleindexes_7)
movedcenters_7 = Data(movedcenters_5)
# Nested Offsets And Triangles
mappedcells = Data(centerswithincells)
item_28 = ListItem(List=_2doffsets_6, Index=mappedcells, Wrap=True)
item_29 = ListItem(List=nestedtriangleindexes, Index=mappedcells, Wrap=True)
item_30 = ListItem(List=movedcenters_7, Index=mappedcells, Wrap=True)
culled2doffsets = Data(item_28)
culledindexes = Data(item_29)
culledcenters = Data(item_30)

item_31 = ListItem(List=nestedpointindexes_2, Index=mappedpoints, Wrap=True)
item_32 = ListItem(List=_2doffsets_5, Index=mappedpoints, Wrap=True)
item_33 = ListItem(List=movedpoints_5, Index=mappedpoints, Wrap=True)
culled2doffsets_2 = Data(item_32)
culledindexes_2 = Data(item_31)
culledpoints = Data(item_33)
panel_12 = Panel(culledcenters)
culled2doffsets_3 = Data(culled2doffsets_2)  # disabled
culledindexes_3 = Data(culledindexes_2)  # disabled
culledpoints_2 = Data(culledpoints)  # disabled
tbi_19 = TreeBranchIndex(DataTree=culledindexes_3, BranchIndex=number_slider_8)  # disabled
tbi_20 = TreeBranchIndex(DataTree=culledpoints_2, BranchIndex=number_slider_7)  # disabled
tbi_21 = TreeBranchIndex(DataTree=culled2doffsets_3, BranchIndex=number_slider_9)  # disabled
split_7 = TextSplit(Text=tbi_21, Separators=panel_4)  # disabled
item_34 = ListItem(List=points_16, Index=tbi_19, Wrap=True)  # disabled
item_35 = ListItem(List=points_16, Index=tbi_19, Wrap=True)  # disabled
tbi_22 = TreeBranchIndex(DataTree=tritopologydata_18, BranchIndex=tbi_19)  # disabled
tbi_23 = TreeBranchIndex(DataTree=trioffsetdata_16, BranchIndex=tbi_19)  # disabled
int_8 = Integer(split_7)  # disabled
item_36 = ListItem(List=int_8, Index=0, Wrap=True)  # -> Item, Item1; disabled
item_37 = ListItem(List=triangles_13, Index=expr("x*3", tbi_22), Wrap=True)  # -> Item, Item1, Item2; disabled
vec_14 = VectorXYZ(XComponent=item_36.Item, YComponent=item_36.Item1, ZComponent=0)  # -> Vector, Length; disabled
item_38 = ListItem(List=multiplication_24, Index=expr("x*3", tbi_22), Wrap=True)  # -> Item, Item1, Item2; disabled
trim_3 = TrimTree(Tree=vec_14.Vector, Depth=1)  # disabled
merge_20 = Merge(Data1=graft(item_37.Item), Data2=graft(item_37.Item1), Data3=graft(item_37.Item2))  # disabled
merge_21 = Merge(Data1=graft(item_38.Item), Data2=graft(item_38.Item1), Data3=graft(item_38.Item2))  # disabled
item_39 = ListItem(List=points_16, Index=merge_20, Wrap=True)  # disabled
cset_4 = CreateSet(List=flatten(merge_20))  # -> flatten(Set), Map; disabled
sort = SortList(Keys=cset_4.Set)  # -> Keys, ValuesA; disabled
move_28 = Move(Geometry=item_39, Motion=merge_21)  # -> Geometry, Transform; disabled
multiplication_26 = Multiplication(A=trim_3, B=number_slider_11)  # disabled
multiplication_27 = Multiplication(A=trim_3)  # disabled
pline_10 = PolyLine(Vertices=move_28.Geometry, Closed=True)  # disabled
panel_13 = Panel(sort.Keys)  # disabled
trim_4 = TrimTree(Tree=pline_10, Depth=1)  # disabled
move_29 = Move(Geometry=item_34, Motion=multiplication_26)  # -> Geometry, Transform; disabled
move_30 = Move(Geometry=trim_4, Motion=multiplication_27)  # -> Geometry, Transform; disabled
tbi_24 = TreeBranchIndex(DataTree=trim_4, BranchIndex=number_slider_13)  # disabled
item_40 = ListItem(List=tbi_24, Index=0, Wrap=True)  # disabled

# ----
# Barycenters!
tritopologydata_30 = Data(tritopologydata_16)
trioffsetdata_28 = Data(trioffsetdata_14)
culledpoints_3 = Data(culledpoints)
trianglefans_4 = Data(trianglefans_3)
tritopologydata_31 = Data(tritopologydata_30)
trioffsetdata_29 = Data(trioffsetdata_28)
mjoin = MeshJoin(Meshes=trianglefans_4)
meshcp = MeshClosestPoint(Point=culledpoints_3, Mesh=mjoin)  # -> Point, Index, Parameter
data_25 = Data(meshcp.Parameter)
split_8 = TextSplit(Text=data_25, Separators="[];")
item_41 = ListItem(List=split_8, Index=0, Wrap=True)  # -> Item, Item1, Item2, Item3, Item4
pt_3 = ConstructPoint(XCoordinate=item_41.Item3, YCoordinate=item_41.Item2, ZCoordinate=item_41.Item1)
trim_5 = TrimTree(Tree=item_41.Item, Depth=1)
trim_6 = TrimTree(Tree=pt_3, Depth=1)
indexdata = Data(trim_5)
item_42 = ListItem(List=tritopologydata_31, Index=indexdata, Wrap=True)
item_43 = ListItem(List=trioffsetdata_29, Index=indexdata, Wrap=True)
barycentricparentoffsets = Data(item_43)
barycentricparentidices = Data(item_42)
barycenters = Point(trim_6)

# ----
# Distance From Node Center
points_22 = Point(points_8)
culledpoints_4 = Data(culledpoints)
cells_9 = Data(cells_7)
pshift_3 = ShiftPaths(Data=points_22, Offset=-5)
merge_22 = Merge(Data1=graft(pshift_3), Data2=cells_9)
lng_15 = ListLength(List=merge_22)
series_8 = Series(Start=1, Step=1, Count=expr("x-2", lng_15))
shift_2 = ShiftList(List=series_8, Shift=1, Wrap=True)
triangle_2 = MeshTriangle(CornerA=series_8, CornerB=shift_2, CornerC=0)
conmesh_5 = ConstructMesh(Vertices=merge_22, Faces=triangle_2)
trim_7 = TrimTree(Tree=conmesh_5, Depth=2)
meshtriangles = Data(trim_7)
culledpoints_5 = Data(culledpoints_4)
meshcp_2 = MeshClosestPoint(Point=culledpoints_5, Mesh=meshtriangles)  # -> Point, Index, Parameter
data_26 = Data(meshcp_2.Parameter)
split_9 = TextSplit(Text=data_26, Separators="[];")
item_44 = ListItem(List=split_9, Index=0, Wrap=True)  # -> Item, Item1, Item2, Item3, Item4
trim_8 = TrimTree(Tree=item_44.Item3, Depth=1)

# ----
# InnerBarycenters
meshtriangles_2 = Data(conmesh_3)
culledpoints_6 = Data(culledpoints)
meshcp_3 = MeshClosestPoint(Point=culledpoints_6, Mesh=meshtriangles_2)  # -> Point, Index, Parameter
split_10 = TextSplit(Text=meshcp_3.Parameter, Separators="[];")
item_45 = ListItem(List=split_10, Index=0, Wrap=True)  # -> Item, Item1, Item2, Item3, Item4
pt_4 = ConstructPoint(XCoordinate=item_45.Item3, YCoordinate=item_45.Item2, ZCoordinate=item_45.Item1)
trim_9 = TrimTree(Tree=pt_4, Depth=1)
trim_10 = TrimTree(Tree=item_45.Item, Depth=1)
internalbarycentricindices = Data(trim_10)
internalbarycenters = Data(trim_9)

culledpoints_7 = Data(culledpoints)
tbi_25 = TreeBranchIndex(DataTree=culledpoints_3, BranchIndex=Slider(322, range=0..1000))
cset_5 = CreateSet(List=tbi_25)  # -> Set, Map
distancefromnodecenter = Data(trim_8)

nested2dtriangleoffsets = Data(culled2doffsets)
nestedtriangleindexes_2 = Data(culledindexes)

nested2dpointoffsets = Data(culled2doffsets_2)
nestedpointindexes_3 = Data(culledindexes_2)

barycentricparentidices_2 = Data(barycentricparentidices)
barycentricparentoffsets_2 = Data(barycentricparentoffsets)

internalbarycenters_2 = Data(internalbarycenters)
internalbarycentricindices_2 = Data(internalbarycentricindices)
barycentriccoordinates = Data(barycenters)

innerbarycentriccoordinates = Point(internalbarycenters_2)
internalbarycentricindices_3 = Data(internalbarycentricindices_2)
barycentriccoordinates_2 = Data(barycentriccoordinates)

distancefromnodecenter_2 = Data(distancefromnodecenter)

nested2dtriangleoffsets_2 = Data(nested2dtriangleoffsets)
nestedtriangleindexes_3 = Data(nestedtriangleindexes_2)

barycentricparentoffsets_3 = Data(barycentricparentoffsets_2)
barycentricparentidices_3 = Data(barycentricparentidices_2)

nested2dpointoffsets_2 = Data(nested2dpointoffsets)
nestedpointindexes_4 = Data(nestedpointindexes_3)

distancefromnodecenter_3 = Data(distancefromnodecenter_2)
barycentricparentidices_4 = Data(barycentricparentidices_3)
barycentricparentoffsets_4 = Data(barycentricparentoffsets_3)

barycentriccoordinates_3 = Data(barycentriccoordinates_2)
lng_16 = ListLength(List=barycentriccoordinates_3)  # -> flatten(Length)

pdecon_2 = Deconstruct(Point=innerbarycentriccoordinates)  # -> XComponent, YComponent, ZComponent
merge_23 = Merge(Data1=graft(pdecon_2.XComponent), Data2=graft(pdecon_2.YComponent), Data3=graft(pdecon_2.ZComponent))  # -> flatten(Result)

pdecon_3 = Deconstruct(Point=barycentriccoordinates_2)  # -> XComponent, YComponent, ZComponent
merge_24 = Merge(Data1=graft(pdecon_3.XComponent), Data2=graft(pdecon_3.YComponent), Data3=graft(pdecon_3.ZComponent))  # -> flatten(Result)

internalbarycentricindices_4 = Data(flatten(internalbarycentricindices_3))
innerbarycentriccoordinates_2 = Data(merge_23)
internalbarycentricindices_5 = Data(internalbarycentricindices_4)
barycentriccoordinates_4 = Data(merge_24)

culled2dtriangleoffsets = Data(nested2dtriangleoffsets_2)
split_11 = TextSplit(Text=culled2dtriangleoffsets, Separators=",")  # -> flatten(Result)
split_12 = TextSplit(Text=nested2dpointoffsets_2, Separators=",")  # -> flatten(Result)

culled2dtriangleoffsets_2 = Data(flatten(split_11))
culledtriangleindexes = Data(flatten(nestedtriangleindexes_3))
culled2dpointoffsets = Data(flatten(split_12))
culledpointindexes = Data(nestedpointindexes_4)

distancefromnodecenter_4 = Data(distancefromnodecenter_3)
barycentricparentoffsets_5 = Data(barycentricparentoffsets_4)
barycentricparentidices_5 = Data(barycentricparentidices_4)
culled2dtriangleoffsets_3 = Data(nested2dtriangleoffsets_2)
lng_17 = ListLength(List=culled2dtriangleoffsets)  # -> flatten(Length)
data_27 = Data(culledtriangleindexes)
data_28 = Data(lng_17)
partition_7 = PartitionList(List=data_27, Size=data_28)
culled2dtriangleoffsets_4 = Data(culled2dtriangleoffsets_3)
culledtriangleindexes_2 = Data(partition_7)
barycentricparentidices_6 = Data(barycentricparentidices_5)
barycentricparentoffsets_6 = Data(barycentricparentoffsets_5)
culledpointindexes_2 = Data(culledpointindexes)
distancefromnodecenter_5 = Data(distancefromnodecenter_4)

barycentriccoordinates_5 = Data(barycentriccoordinates_4)
innerbarycentriccoordinates_3 = Data(innerbarycentriccoordinates_2)
internalbarycentricindices_6 = Data(internalbarycentricindices_5)

data_29 = Data(lng_16)
data_30 = Data(lng_17)

culled2dtriangleoffsets_5 = Data(flatten(culled2dtriangleoffsets_2))
culledtriangleindexes_3 = Data(flatten(culledtriangleindexes))
culled2dpointoffsets_2 = Data(flatten(culled2dpointoffsets))
culledpointindexes_3 = Data(culledpointindexes)

lng_18 = ListLength(List=culledpointindexes_2)  # -> flatten(Length)
distancefromnodecenter_6 = Data(distancefromnodecenter_5)
barycentricparentoffsets_7 = Data(barycentricparentoffsets_6)
barycentricparentidices_7 = Data(barycentricparentidices_6)
culledpointindexes_4 = Data(lng_18)
distancefromnodecenter_7 = Data(flatten(distancefromnodecenter_6))
barycentricparentidices_8 = Data(flatten(barycentricparentidices_7))
barycentricparentoffsets_8 = Data(flatten(barycentricparentoffsets_7))
innercellpointindexlist = Data(culledpointindexes_4)
pdecon_4 = Deconstruct(Point=barycentricparentoffsets_8)  # -> XComponent, YComponent, ZComponent
merge_25 = Merge(Data1=graft(pdecon_4.XComponent), Data2=graft(pdecon_4.YComponent))  # -> flatten(Result)
int_9 = Integer(merge_25)
nesteddistancefromnodecenter = Data(distancefromnodecenter_7)

innerbarycentriccoordinates_4 = Data(innerbarycentriccoordinates_3)
internalbarycentricindices_7 = Data(internalbarycentricindices_6)
barycentriccoordinates_6 = Data(barycentriccoordinates_5)

innertrianglepointindexlist = Data(data_30)

nested2dtriangleoffsets_3 = Data(culled2dtriangleoffsets_5)
nestedpointindexes_5 = Data(flatten(culledpointindexes_3))
nestedtriangleindexes_4 = Data(culledtriangleindexes_3)
nested2dpointoffsets_3 = Data(culled2dpointoffsets_2)

barycentricparentoffsets_9 = Data(int_9)
barycentricparentidices_9 = Data(barycentricparentidices_8)
innercellpointindexlist_2 = Data(innercellpointindexlist)
barycentercount = Data(data_29)

nestingamount_16 = Data(nestingamount_9)
topology_27 = Data(topology_14)
topologyoffset_26 = Data(topologyoffset_14)
culled2doffsets_4 = Data(culled2doffsets_2)
gridsize_21 = Data(gridsize_14)
secondlayeroffset_7 = Data(secondlayeroffset_6)
points_23 = Point(points_14)
culledindexes_4 = Data(culledindexes_2)
culledpoints_8 = Data(culledpoints)
data_31 = Data(culledindexes_4)
data_32 = Data(culled2doffsets_4)
data_33 = Data(culledpoints_8)
data_34 = Data(data_31)
tbi_26 = TreeBranchIndex(DataTree=topologyoffset_26, BranchIndex=data_34)
data_35 = Data(data_33)
tbi_27 = TreeBranchIndex(DataTree=topology_27, BranchIndex=data_34)
trim_11 = TrimTree(Tree=tbi_27, Depth=1)
concat_3 = Concatenate(FragmentA=data_32, FragmentC=",", FragmentB=data_31)
one_over_x_6 = OneOverX(Value=nestingamount_16)

split_13 = TextSplit(Text=data_32, Separators=",")
item_46 = ListItem(List=split_13, Index=0, Wrap=True)  # -> Item, Item1
vec_15 = VectorXYZ(XComponent=item_46.Item, YComponent=item_46.Item1, ZComponent=0)  # -> Vector, Length

addition_5 = Addition(A=vec_15.Vector, B=tbi_26)
trim_12 = TrimTree(Tree=addition_5, Depth=1)
devec_2 = DeconstructVector(Vector=trim_12)  # -> XComponent, YComponent, ZComponent
concat_4 = Concatenate(FragmentA=devec_2.XComponent, FragmentC=",", FragmentB=devec_2.YComponent)
concat_5 = Concatenate(FragmentA=concat_4, FragmentC=",", FragmentB=trim_11)
merge_26 = Merge(Data1=concat_3, Data2=concat_5)
cset_6 = CreateSet(List=merge_26)  # -> Set, Map
split_14 = TextSplit(Text=cset_6.Set, Separators=",")
item_47 = ListItem(List=split_14, Index=0, Wrap=True)  # -> Item, Item1, Item2
vec_16 = VectorXYZ(XComponent=item_47.Item, YComponent=item_47.Item1, ZComponent=0)  # -> Vector, Length
int_10 = Integer(item_47.Item2)
trim_13 = TrimTree(Tree=vec_16.Vector, Depth=1)
trim_14 = TrimTree(Tree=int_10, Depth=1)
item_48 = ListItem(List=points_23, Index=trim_14, Wrap=True)
multiplication_28 = Multiplication(A=trim_13, B=gridsize_21)
move_31 = Move(Geometry=item_48, Motion=multiplication_28)  # -> Geometry, Transform
multiplication_29 = Multiplication(A=move_31.Geometry, B=one_over_x_6)
move_32 = Move(Geometry=multiplication_29, Motion=secondlayeroffset_7)  # -> Geometry, Transform
cp_7 = ClosestPoint(Point=move_32.Geometry, Cloud=data_35)  # -> ClosestPoint, CPIndex, Distance
equals = Equality(FirstNumber=cp_7.Distance, SecondNumber=0)  # -> Equality, Inequality
dispatch = Dispatch(List=move_32.Geometry, DispatchPattern=equals.Inequality)  # -> ListA, ListB
dispatch_2 = Dispatch(List=trim_14, DispatchPattern=equals.Inequality)  # -> ListA, ListB
dispatch_3 = Dispatch(List=trim_13, DispatchPattern=equals.Inequality)  # -> ListA, ListB
ring_positions = Data(dispatch.ListA)
ring_indices = Data(dispatch_2.ListA)
ring_offsets = Data(dispatch_3.ListA)

data_36 = Data(dispatch_3.ListB)
data_37 = Data(dispatch_2.ListB)
ringpositions = Data(ring_positions)

data_38 = Data(data_37)
data_39 = Data(data_36)
ring_indices_2 = Data(graft(ring_indices))
topologyoffset_27 = Data(topologyoffset_16)
ring_offsets_2 = Data(dispatch_3.ListA)
topology_28 = Data(topology_16)
pdecon_5 = Deconstruct(Point=data_39)  # -> XComponent, YComponent, ZComponent
tbi_28 = TreeBranchIndex(DataTree=topology_28, BranchIndex=ring_indices_2)
tbi_29 = TreeBranchIndex(DataTree=topologyoffset_27, BranchIndex=ring_indices_2)
pt_5 = ConstructPoint(XCoordinate=pdecon_5.XComponent, YCoordinate=pdecon_5.YComponent, ZCoordinate=data_38)
addition_6 = Addition(A=graft(ring_offsets_2), B=tbi_29)
devec_3 = DeconstructVector(Vector=addition_6)  # -> XComponent, YComponent, ZComponent
pt_6 = ConstructPoint(XCoordinate=devec_3.XComponent, YCoordinate=devec_3.YComponent, ZCoordinate=tbi_28)
trim_15 = TrimTree(Tree=pt_6, Depth=2)
cset_7 = CreateSet(List=trim_15)  # -> Set, Map
intersection = SetIntersection(SetA=pt_5, SetB=cset_7.Set)
devec_4 = DeconstructVector(Vector=intersection)  # -> XComponent, YComponent, ZComponent
vec_17 = VectorXYZ(XComponent=devec_4.XComponent, YComponent=devec_4.YComponent, ZComponent=0)  # -> Vector, Length
int_11 = Integer(devec_4.ZComponent)

topologyoffset_28 = Data(topologyoffset_16)
topology_29 = Data(topology_16)
ring_positions_2 = Data(dispatch.ListA)
points_24 = Point(points_17)
points_25 = Point(points_24)
topologyoffset_29 = Data(topologyoffset_28)
topology_30 = Data(topology_29)
multiplication_30 = Multiplication(A=topologyoffset_29, B=Slider(50, range=0..100))
item_49 = ListItem(List=points_25, Index=topology_30, Wrap=True)
move_33 = Move(Geometry=item_49, Motion=multiplication_30)  # -> Geometry, Transform
ln_6 = Line(StartPoint=graft(points_25), EndPoint=move_33.Geometry)

# ----
# Ring Barycenters!
tritopologydata_32 = Data(tritopologydata_16)
trioffsetdata_30 = Data(trioffsetdata_14)
trianglefans_5 = Data(trianglefans_3)
culledpoints_9 = Data(ringpositions)
tritopologydata_33 = Data(tritopologydata_32)
trioffsetdata_31 = Data(trioffsetdata_30)
mjoin_2 = MeshJoin(Meshes=trianglefans_5)
meshcp_4 = MeshClosestPoint(Point=culledpoints_9, Mesh=mjoin_2)  # -> Point, Index, Parameter
data_40 = Data(meshcp_4.Parameter)
split_15 = TextSplit(Text=data_40, Separators="[];")
item_50 = ListItem(List=split_15, Index=0, Wrap=True)  # -> Item, Item1, Item2, Item3, Item4
pt_7 = ConstructPoint(XCoordinate=item_50.Item3, YCoordinate=item_50.Item2, ZCoordinate=item_50.Item1)
trim_16 = TrimTree(Tree=item_50.Item, Depth=1)
trim_17 = TrimTree(Tree=pt_7, Depth=1)
indexdata_2 = Data(trim_16)
item_51 = ListItem(List=tritopologydata_33, Index=indexdata_2, Wrap=True)
item_52 = ListItem(List=trioffsetdata_31, Index=indexdata_2, Wrap=True)
barycentricparentoffsets_10 = Data(item_52)
barycentricparentidices_10 = Data(item_51)
barycenters_2 = Point(trim_17)

data_41 = Data(ln_6)
item_53 = ListItem(List=points_18, Index=int_11, Wrap=True)
move_34 = Move(Geometry=item_53, Motion=expr("x*50", vec_17.Vector))  # -> Geometry, Transform
multiplication_31 = Multiplication(A=move_34.Geometry, B=one_over_x)
move_35 = Move(Geometry=multiplication_31, Motion=expr("-x", vec_5.Vector))  # -> Geometry, Transform
cp_8 = ClosestPoint(Point=move_35.Geometry, Cloud=culledpoints_7)  # -> ClosestPoint, CPIndex, Distance
cluster = Cluster(ring_positions=cp_8.ClosestPoint, G=data_41)  # -> pos, i
cluster_2 = Cluster(ring_positions=ring_positions_2, G=data_41)  # -> pos, i
ln_7 = Line(StartPoint=graft(points_20), EndPoint=cluster.pos)
ln_8 = Line(StartPoint=graft(points_20), EndPoint=cluster_2.pos)
ln_9 = Line(StartPoint=cluster.pos, EndPoint=cluster_2.pos)
move_36 = Move(Geometry=ln_7, Motion=vec_6.Vector)  # -> Geometry, Transform
move_37 = Move(Geometry=ln_9, Motion=vec_6.Vector)  # -> Geometry, Transform
ringbarycentricparentidices = Data(barycentricparentidices_10)
ringbarycentricparentoffsets = Data(barycentricparentoffsets_10)
ringbarycenters = Point(barycenters_2)
ringindices = Data(ring_indices)
ringoffsets = Data(ring_offsets)
ringpositions_2 = Data(ringpositions)
ringbarycentricparentoffsets_2 = Data(ringbarycentricparentoffsets)
ringbarycentricparentidices_2 = Data(ringbarycentricparentidices)
ringbarycenters_2 = Point(ringbarycenters)
ringpositions_3 = Data(ringpositions_2)
ringindices_2 = Data(ringindices)
ringoffsets_2 = Data(ringoffsets)
ringpositions_4 = Data(ringpositions_3)
ringbarycentricparentidices_3 = Data(ringbarycentricparentidices_2)
ringbarycentricparentoffsets_3 = Data(ringbarycentricparentoffsets_2)
ringbarycenters_3 = Point(ringbarycenters_2)
ringindices_3 = Data(ringindices_2)
ringoffsets_3 = Data(ringoffsets_2)
ringbarycentricparentoffsets_4 = Data(ringbarycentricparentoffsets_3)
ringbarycentricparentidices_4 = Data(ringbarycentricparentidices_3)
ringbarycenters_4 = Point(ringbarycenters_3)
ringpositions_5 = Data(ringpositions_4)
ringindices_4 = Data(ringindices_3)
ringoffsets_4 = Data(ringoffsets_3)
ringpositions_6 = Data(ringpositions_5)
ringbarycentricparentidices_5 = Data(ringbarycentricparentidices_4)
ringindices_5 = Data(ringindices_4)
ringoffsets_5 = Data(ringoffsets_4)
ringbarycentricparentoffsets_5 = Data(ringbarycentricparentoffsets_4)
ringbarycenters_5 = Point(ringbarycenters_4)
ringbarycentricparentoffsets_6 = Data(ringbarycentricparentoffsets_5)
ringbarycentricparentidices_6 = Data(ringbarycentricparentidices_5)
ringbarycenters_6 = Point(ringbarycenters_5)
ringpositions_7 = Data(ringpositions_6)
ringindices_6 = Data(ringindices_5)
ringoffsets_6 = Data(ringoffsets_5)
ringbarycentricparentoffsets_7 = Data(flatten(ringbarycentricparentoffsets_6))
ringoffsets_7 = Data(flatten(ringoffsets_6))
ringbarycentricparentidices_7 = Data(ringbarycentricparentidices_6)
ringbarycenters_7 = Point(ringbarycenters_6)
ringpositions_8 = Data(ringpositions_7)
ringindices_7 = Data(ringindices_6)
pdecon_6 = Deconstruct(Point=ringbarycentricparentoffsets_7)  # -> XComponent, YComponent, ZComponent
pdecon_7 = Deconstruct(Point=ringoffsets_7)  # -> XComponent, YComponent, ZComponent
pdecon_8 = Deconstruct(Point=ringpositions_8)  # -> XComponent, YComponent, ZComponent
pdecon_9 = Deconstruct(Point=ringbarycenters_7)  # -> XComponent, YComponent, ZComponent
lng_19 = ListLength(List=ringbarycentricparentidices_7)  # -> flatten(Length)
merge_27 = Merge(Data1=graft(pdecon_6.XComponent), Data2=graft(pdecon_6.YComponent))  # -> flatten(Result)
merge_28 = Merge(Data1=graft(pdecon_7.XComponent), Data2=graft(pdecon_7.YComponent))  # -> flatten(Result)
merge_29 = Merge(Data1=graft(pdecon_8.XComponent), Data2=graft(pdecon_8.YComponent))  # -> flatten(Result)
merge_30 = Merge(Data1=graft(pdecon_9.XComponent), Data2=graft(pdecon_9.YComponent), Data3=graft(pdecon_9.ZComponent))  # -> flatten(Result)
int_12 = Integer(merge_27)
int_13 = Integer(merge_28)
ringbarycentricparentidices_8 = Data(flatten(ringbarycentricparentidices_7))
ringbarycentricparentoffsets_8 = Data(int_12)
ringindexcount = Data(flatten(lng_19))
ringbarycenters_8 = Number(merge_30)
ringindices_8 = Data(flatten(ringindices_7))
ringoffsets_8 = Data(flatten(int_13))
ringpositions_9 = Data(merge_29)

# ----
# Center Barycenters!
meshtriangles_3 = Data(conmesh_2)
culledpoints_10 = Data(culledcenters)
meshcp_5 = MeshClosestPoint(Point=culledpoints_10, Mesh=meshtriangles_3)  # -> Point, Index, Parameter
data_42 = Data(meshcp_5.Parameter)
split_16 = TextSplit(Text=data_42, Separators="[];")
item_54 = ListItem(List=split_16, Index=0, Wrap=True)  # -> Item, Item1, Item2, Item3, Item4
pt_8 = ConstructPoint(XCoordinate=item_54.Item3, YCoordinate=item_54.Item2, ZCoordinate=item_54.Item1)

trim_18 = TrimTree(Tree=pt_8, Depth=1)

centerbarycenters = Point(trim_18)

centerbarycenters_2 = Point(centerbarycenters)
centerbarycenters_3 = Point(centerbarycenters_2)
centerbarycenters_4 = Point(centerbarycenters_3)

pdecon_10 = Deconstruct(Point=centerbarycenters_4)  # -> XComponent, YComponent, ZComponent
merge_31 = Merge(Data1=graft(pdecon_10.XComponent), Data2=graft(pdecon_10.YComponent), Data3=graft(pdecon_10.ZComponent))  # -> flatten(Result)

centerbarycenters_5 = Number(merge_31)
centerbarycenters_6 = Number(centerbarycenters_5)
centerbarycenters_7 = Number(centerbarycenters_6)

# ----
# Nested Triangles Working Proof
culled2dtriangleoffsets_6 = Data(culled2dtriangleoffsets_4)
triangles_23 = Data(triangles_19)
points_26 = Data(points_21)
culledtriangleindexes_4 = Data(culledtriangleindexes_2)
offsets_20 = Data(offsets_16)
split_17 = TextSplit(Text=culled2dtriangleoffsets_6, Separators=",")
multiplication_32 = Multiplication(A=culledtriangleindexes_4, B=3)
multiplication_33 = Multiplication(A=culledtriangleindexes_4, B=3)
item_55 = ListItem(List=split_17, Index=0, Wrap=True)  # -> Item, Item1
item_56 = ListItem(List=offsets_20, Index=multiplication_32, Wrap=True)  # -> Item, Item1, Item2
item_57 = ListItem(List=triangles_23, Index=multiplication_33, Wrap=True)  # -> Item, Item1, Item2
int_14 = Integer(item_55.Item1)
int_15 = Integer(item_55.Item)
merge_32 = Merge(Data1=graft(item_56.Item), Data2=graft(item_56.Item1), Data3=graft(item_56.Item2))
merge_33 = Merge(Data1=graft(item_57.Item), Data2=graft(item_57.Item1), Data3=graft(item_57.Item2))
vec_18 = VectorXYZ(XComponent=int_15, YComponent=int_14, ZComponent=0)  # -> Vector, Length
item_58 = ListItem(List=points_26, Index=merge_33, Wrap=True)
triangle_3 = MeshTriangle(CornerA=0, CornerB=1, CornerC=2)

addition_7 = Addition(A=vec_18.Vector, B=merge_32)
panel_14 = Panel(merge_33)

multiplication_34 = Multiplication(A=addition_7, B=Slider(50, range=0..100))
move_38 = Move(Geometry=item_58, Motion=multiplication_34)  # -> Geometry, Transform
conmesh_6 = ConstructMesh(Vertices=move_38.Geometry, Faces=triangle_3)
trim_19 = TrimTree(Tree=conmesh_6, Depth=1)

mjoin_3 = MeshJoin(Meshes=trim_19)
item_59 = ListItem(List=flatten(mjoin_3), Index=Slider(20, range=0..100), Wrap=True)
scale_8 = Scale(Geometry=mjoin_3, Center=Point(0, 0, 0), Factor=one_over_x_2)  # -> Geometry, Transform
move_39 = Move(Geometry=scale_8.Geometry, Motion=neg_5)  # -> flatten(Geometry), Transform
demesh_6 = DeconstructMesh(Mesh=move_39.Geometry)  # -> Vertices, Faces, Colours, Normals

# ----
# Barycenters!
tritopologydata_34 = Data(tritopologydata_16)
trioffsetdata_32 = Data(trioffsetdata_14)
culledpoints_11 = Data(demesh_6.Vertices)
trianglefans_6 = Data(trianglefans_3)
tritopologydata_35 = Data(tritopologydata_34)
trioffsetdata_33 = Data(trioffsetdata_32)
mjoin_4 = MeshJoin(Meshes=trianglefans_6)
meshcp_6 = MeshClosestPoint(Point=culledpoints_11, Mesh=mjoin_4)  # -> Point, Index, Parameter
data_43 = Data(meshcp_6.Parameter)
split_18 = TextSplit(Text=data_43, Separators="[];")
item_60 = ListItem(List=split_18, Index=0, Wrap=True)  # -> Item, Item1, Item2, Item3, Item4
trim_20 = TrimTree(Tree=item_60.Item, Depth=1)
indexdata_3 = Data(trim_20)
item_61 = ListItem(List=tritopologydata_35, Index=indexdata_3, Wrap=True)
item_62 = ListItem(List=trioffsetdata_33, Index=indexdata_3, Wrap=True)
barycentricparentidices_11 = Data(flatten(item_61))
barycentricparentoffsets_11 = Data(item_62)

vec_19 = Vector(demesh_6.Vertices)
pt_9 = Point(demesh_6.Vertices)

# ---- group: Barycenters for triangles
c_script_5 = CSharpScript(a=item_27.Item, b=item_27.Item1, c=item_27.Item2, p=vec_19)  # -> out, A; inputs a: Vector3d, b: Vector3d, c: Vector3d, p: Vector3d
# ---------- c_script_5: C# ----------
    Vector3d v0 = b - a, v1 = c - a, v2 = p - a;

    double d00 = Dot(v0, v0);
    double d01 = Dot(v0, v1);
    double d11 = Dot(v1, v1);
    double d20 = Dot(v2, v0);
    double d21 = Dot(v2, v1);
    double denom = d00 * d11 - d01 * d01;
    var v = (d11 * d20 - d01 * d21) / denom;
    var w = (d00 * d21 - d01 * d20) / denom;
    var u = 1.0f - v - w;

    Console.WriteLine("v");

    A = new Vector3d(u, v, w);
# ---------- c_script_5: C# additional code ----------
  private double Dot(Vector3d v0, Vector3d v1){

    return (v0.X * v1.X) + (v0.Y * v1.Y) + (v0.Z * v1.Z);

  }
# ---------- end c_script_5 ----------

# ----
lng_20 = ListLength(List=demesh_6.Vertices)  # -> flatten(Length)
devec_5 = DeconstructVector(Vector=graft(c_script_5.A))  # -> XComponent, YComponent, ZComponent
merge_34 = Merge(Data1=item_60.Item3, Data2=item_60.Item2, Data3=item_60.Item1)  # -> flatten(Result)
pdecon_11 = Deconstruct(Point=barycentricparentoffsets_11)  # -> XComponent, YComponent, ZComponent
data_44 = Data(flatten(merge_34))
data_45 = Data(lng_20)
merge_35 = Merge(Data1=graft(pdecon_11.XComponent), Data2=graft(pdecon_11.YComponent))  # -> flatten(Result)
num = Number(data_44)
int_16 = Integer(merge_35)
barycentricparentidices_12 = Data(flatten(barycentricparentidices_11))
triangleaccessbarycentricparents = Data(flatten(barycentricparentidices_12))

triangleaccessbarycentricoffsets = Data(flatten(int_16))
triangleaccessbarycenters = Data(num)
triangleaccessbarcenticlistlength = Data(data_45)

triangleaccessbarycentricoffsets_2 = Data(triangleaccessbarycentricoffsets)
triangleaccessbarcenticlistlength_2 = Data(triangleaccessbarcenticlistlength)
triangleaccessbarycenters_2 = Data(triangleaccessbarycenters)

triangleaccessbarycentricparents_2 = Data(triangleaccessbarycentricparents)
mesh_tile_data = CSharpScript(
    gridScale=gridsize_20,
    nestingScale=nestingamount_15,
    triangles=triangles_22,
    offsets=offsets_19,
    positions=positions_7,
    triangleCenters=trianglecenters_6,
    triangleCenterOffsets=trianglecenteroffsets_6,
    innerTrianglePointIndexList=innertrianglepointindexlist,
    culled2dTriangleOffsets=nested2dtriangleoffsets_3,
    culledTriangleIndexes=nestedtriangleindexes_4,
    culled2dPointOffsets=nested2dpointoffsets_3,
    culledPointIndexes=nestedpointindexes_5,
    innerPointIndexList=barycentercount,
    barycentricCoordinates=barycentriccoordinates_6,
    innerBarycentricCoordinates=innerbarycentriccoordinates_4,
    innerBarycentricIndices=internalbarycentricindices_7,
    triangleCenterBarycenters=centerbarycenters_7,
    triangleAccessBarcenticListLength=triangleaccessbarcenticlistlength_2,
    triangleAccessBarycenters=triangleaccessbarycenters_2,
    triangleAccessBarycentricOffsets=triangleaccessbarycentricoffsets_2,
    triangleAccessBarycentricParents=triangleaccessbarycentricparents_2,
    nestedDistanceFromNodeCenter=nesteddistancefromnodecenter,
    topologyCount=topologycount,
    topology=topology_26,
    topologyOffset=topologyoffset_25,
    innerCellPointIndexList=innercellpointindexlist_2,
    barycentricParentIndices=barycentricparentidices_9,
    barycentricParentOffsets=barycentricparentoffsets_9,
    triTopologyCount=tritopologycount,
    triTopologyData=tritopologydata_29,
    triOffsetData=trioffsetdata_27,
    ringIndexCount=ringindexcount,
    ringBarycentricParentIdices=ringbarycentricparentidices_8,
    ringBarycentricParentOffsets=ringbarycentricparentoffsets_8,
    ringBarycenters=ringbarycenters_8,
    ringIndices=ringindices_8,
    ringOffsets=ringoffsets_8,
    ringPositions=ringpositions_9)  # -> A; inputs gridScale: Int32, nestingScale: Int32, triangles: list of Int32, offsets: list of Point3d, positions: list of Point3d, triangleCenters: list of Point3d, triangleCenterOffsets: list of Point3d, innerTrianglePointIndexList: list of Int32, culled2dTriangleOffsets: list of String, culledTriangleIndexes: list of String, culled2dPointOffsets: list of String, culledPointIndexes: list of String, innerPointIndexList: list, barycentricCoordinates: list of Double, innerBarycentricCoordinates: list of Double, innerBarycentricIndices: list of Int32, triangleCenterBarycenters: list of Double, triangleAccessBarcenticListLength: list of Int32, triangleAccessBarycenters: list of Double, triangleAccessBarycentricOffsets: list of Int32, triangleAccessBarycentricParents: list of Int32, nestedDistanceFromNodeCenter: list, topologyCount: list, topology: list, topologyOffset: list, innerCellPointIndexList: list, barycentricParentIndices: list, barycentricParentOffsets: list, triTopologyCount: list of Int32, triTopologyData: list, triOffsetData: list, ringIndexCount: list of Int32, ringBarycentricParentIdices: list of Int32, ringBarycentricParentOffsets: list of Int32, ringBarycenters: list of Double, ringIndices: list of Int32, ringOffsets: list of Int32, ringPositions: list of Double
# ---------- mesh_tile_data: C# usings ----------
using System.IO;
using System.Linq;
using System.Data;
using System.Drawing;
using System.Reflection;
using System.Windows.Forms;
using System.Xml;
using System.Xml.Linq;
using System.Runtime.InteropServices;

using Rhino.DocObjects;
using Rhino.Collections;
using GH_IO;
using GH_IO.Serialization;
# ---------- mesh_tile_data: C# ----------
  var dataStructure = new{
  gridScale = gridScale,
  nestingScale = nestingScale,
  triangles = triangles,
  offsets = FlattenPointListToInt(offsets),
  positions = FlattenPointListToFloat(positions),
  triangleCenters = FlattenPointListToFloat(triangleCenters),
  triangleCenterOffsets = FlattenPointListToInt(triangleCenterOffsets),
  innerTrianglePointIndexList = innerTrianglePointIndexList,
  innerPointIndexList = innerPointIndexList,
  nested2dTriangleOffsets = culled2dTriangleOffsets,
  nestedTriangleIndexes = culledTriangleIndexes,
  nested2dPointOffsets = culled2dPointOffsets,
  nestedPointIndexes = culledPointIndexes,
  barycentricCoordinates = barycentricCoordinates,
  innerBarycentricCoordinates = innerBarycentricCoordinates,
  innerBarycentricIndices = innerBarycentricIndices,
  triangleCenterBarycenters = triangleCenterBarycenters,
  triangleAccessBarcenticListLength = triangleAccessBarcenticListLength,
  triangleAccessBarycenters = triangleAccessBarycenters,
  triangleAccessBarycentricOffsets = triangleAccessBarycentricOffsets,
  triangleAccessBarycentricParents = triangleAccessBarycentricParents,
  nestedDistanceFromNodeCenter = nestedDistanceFromNodeCenter,
  topologyCount =topologyCount,
  topology = topology,
  topologyOffset = topologyOffset,
  innerCellPointIndexList = innerCellPointIndexList,
  barycentricParentIndices = barycentricParentIndices,
  barycentricParentOffsets = barycentricParentOffsets,
  triTopologyData = triTopologyData,
  triOffsetData = triOffsetData,
  ringIndexCount = ringIndexCount,
  ringBarycentricParentIdices = ringBarycentricParentIdices,
  ringBarycentricParentOffsets = ringBarycentricParentOffsets,
  ringBarycenters = ringBarycenters,
  ringIndices = ringIndices,
  ringOffsets = ringOffsets,
  ringPositions = ringPositions,
  triTopologyCount = triTopologyCount
  };

  //var serializer = new System.Runtime.Serialization.Json.DataContractJsonSerializer();
  //var output = serializer.Serialize(dataStructure);

  A = dataStructure;
# ---------- mesh_tile_data: C# additional code ----------
  List<int> FlattenPointListToInt(List<Point3d> list){

    var offsetsFlat = new List<int>();

    for (int i = 0; i < list.Count; i++)
    {
      offsetsFlat.Add((int) list[i].X);
      offsetsFlat.Add((int) list[i].Y);

    }
    return     offsetsFlat;
  }

  List<float> FlattenPointListToFloat(List<Point3d> list){

    var offsetsFlat = new List<float>();

    for (int i = 0; i < list.Count; i++)
    {
      offsetsFlat.Add((float) list[i].X);
      offsetsFlat.Add((float) list[i].Y);

    }
    return     offsetsFlat;
  }
# ---------- end mesh_tile_data ----------
serialise = SerialiseToJSON(Object=mesh_tile_data)
writetext = WriteToFile(Path=concat, Text=serialise, Write=Toggle(False))

data_46 = Data(mjoin_3)
medges = MeshEdges(Mesh=data_46)  # -> NakedEdges, InteriorEdges, NonManifoldEdges
demesh_7 = DeconstructMesh(Mesh=data_46)  # -> Vertices, Faces, Colours, Normals
end = EndPoints(Curve=medges.NakedEdges)  # -> Start, End
merge_36 = Merge(Data1=end.Start, Data2=end.End)
cp_9 = ClosestPoint(Point=demesh_7.Vertices, Cloud=merge_36)  # -> ClosestPoint, CPIndex, Distance

# ---- group: tolerance
one_over_x_7 = OneOverX(Value=Slider(100, range=0..100))

# ----
smaller = SmallerThan(FirstNumber=cp_9.Distance, SecondNumber=one_over_x_7)  # -> SmallerThan, OrEqualTo
dispatch_4 = Dispatch(List=demesh_7.Vertices, DispatchPattern=smaller.OrEqualTo)  # -> ListA, ListB

# ==== cluster Cluster
number_slider = Slider(1000, range=0..1000)
ring_positions = ClusterInput()
ring_positions_2 = Data(ring_positions)
G = ClusterInput()
scale = Scale(Geometry=ring_positions_2, Center=Point(0, 0, 0), Factor=number_slider)  # -> Geometry, Transform
scale_2 = Scale(Geometry=G, Center=Point(0, 0, 0), Factor=number_slider)  # -> Geometry, Transform
closestinset = CSharpScript(points=scale.Geometry, lines=scale_2.Geometry)  # -> out, A; inputs points: list of Point3d, lines: list of Line
# ---------- closestinset: C# ----------
    var match = new List<int>(lines.Count);
    foreach (Line line in lines)
    {
      var shortestDist = double.MaxValue;
      var shortestIndex = -1;
      for (int i = 0; i < points.Count; i++)
      {
        var point = points[i];
        var dist = line.DistanceTo(point, true);
        if(dist < shortestDist){
          shortestDist = dist;
          shortestIndex = i;
        }
      }
      match.Add(shortestIndex);
    }

    A = match;
# ---------- end closestinset ----------
item = ListItem(List=ring_positions_2, Index=closestinset.A, Wrap=True)
indices = Data(closestinset.A)
i = ClusterOutput(indices)
pos = ClusterOutput(item)
