# Grasshopper definition t1.gh (Grasshopper 1.0.7)

triangle = MeshTriangle(CornerA=0, CornerB=1, CornerC=2)
conmesh = ConstructMesh(
    Vertices=[Point(5.099754417, 10.29885365, 0), Point(-9.150887101, 10.29885365, 0), Point(-0.8502557016, -5.641296916, 0)],
    Faces=triangle)
popgeo = PopulateGeometry(Geometry=conmesh, Count=Slider(564, range=0..1000), Seed=1)
c_script = CSharpScript(x=conmesh, y=popgeo)  # -> out, A; inputs x: Mesh, y: Point3d
# ---------- c_script: C# ----------
    var bary = x.ClosestMeshPoint(y,0).T;
    A = new Vector3d(bary[0], bary[1], bary[2]);
# ---------- end c_script ----------
col = Colour(c_script.A)
preview = CustomPreview(Geometry=popgeo, Material=col)
