# Grasshopper definition t2.gh (Grasshopper 1.0.7)

panel = Panel("""1
0
0
0
1
0
0
0
1""")
triangle = MeshTriangle(CornerA=0, CornerB=1, CornerC=2)
partition = PartitionList(List=panel, Size=3)
conmesh = ConstructMesh(
    Vertices=[Point(5.099754417, 10.29885365, 0), Point(-9.150887101, 10.29885365, 0), Point(-0.8502557016, -5.641296916, 0)],
    Faces=triangle)
item = ListItem(List=partition, Index=0, Wrap=True)  # -> Item, Item1, Item2
panel_2 = Panel("""0.5
0.5
0
0.3333333333333333333333333333
0.3333333333333333333333333333
0.3333333333333333333333333333
0
1
0""")
popgeo = PopulateGeometry(Geometry=conmesh, Count=Slider(564, range=0..1000), Seed=1)
pt = ConstructPoint(XCoordinate=item.Item, YCoordinate=item.Item1, ZCoordinate=item.Item2)  # -> flatten(Point)
c_script = CSharpScript()  # -> Out, A
c_script_2 = CSharpScript(x=conmesh, y=popgeo)  # -> out, A; inputs x: Mesh, y: Point3d
# ---------- c_script_2: C# ----------
    var bary = x.ClosestMeshPoint(y, 0).T;
    A = new Vector3d(bary[0], bary[1], bary[2]);
# ---------- end c_script_2 ----------
pt_2 = Point(c_script_2.A)
c_script_3 = CSharpScript(x=pt_2)  # -> out, A; inputs x: Point3d
# ---------- c_script_3: C# usings ----------
using System.Linq;
# ---------- c_script_3: C# ----------
    if(PointInTriangle(new Point3d(1, 0, 0), new Point3d(0.5, 0.5, 0), new Point3d(0, 0, 1), x)){
      A = 0;
    } else{
      A = 0.8;
    }
# ---------- c_script_3: C# additional code ----------
  public static bool PointInTriangle(Point3d A, Point3d B, Point3d C, Point3d P)
  {
    double s1 = C.Y - A.Y;
    double s2 = C.X - A.X;
    double s3 = B.Y - A.Y;
    double s4 = P.Y - A.Y;

    double w1 = (A.X * s1 + s4 * s2 - P.X * s1) / (s3 * s2 - (B.X - A.X) * s1);
    double w2 = (s4 - w1 * s3) / s1;
    return w1 >= 0 && w2 >= 0 && (w1 + w2) <= 1;
  }
# ---------- end c_script_3 ----------
item_2 = ListItem(List=pt, Index=0, Wrap=True)  # -> Item, Item1, Item2
partition_2 = PartitionList(List=panel_2, Size=3)
devec = DeconstructVector(Vector=c_script_2.A)  # -> XComponent, YComponent, ZComponent
pt_3 = Point(c_script_2.A)
pl_3pt = Plane3Pt(PointA=item_2.Item, PointB=item_2.Item1, PointC=item_2.Item2)
item_3 = ListItem(List=partition_2, Index=0, Wrap=True)  # -> Item, Item1, Item2
frgb = ColourRGBF(Alpha=1, Red=c_script_3.A, Green=c_script_3.A, Blue=c_script_3.A)
frgb_2 = ColourRGBF(Alpha=1, Red=devec.XComponent, Green=devec.YComponent, Blue=devec.ZComponent)
pt_4 = ConstructPoint(XCoordinate=item_3.Item, YCoordinate=item_3.Item1, ZCoordinate=item_3.Item2)
preview = CustomPreview(Geometry=pt_3, Material=frgb)
orient = Orient(Geometry=flatten(pt), Source=pl_3pt, Target=PlaneXY(0, 0, 0))  # -> Geometry, Transform
number_slider = Slider(2, range=0..10)
pdecon = Deconstruct(Point=orient.Geometry)  # -> XComponent, YComponent, ZComponent
orient_2 = Orient(Geometry=flatten(pt_4), Source=pl_3pt, Target=PlaneXY(0, 0, 0))  # -> Geometry, Transform
data = Data(c_script_2.A)
triangle_2 = MeshTriangle(CornerA=0, CornerB=1, CornerC=2)
bnd = Bounds(Numbers=pdecon.XComponent)
bnd_2 = Bounds(Numbers=pdecon.YComponent)
conmesh_2 = ConstructMesh(Vertices=orient_2.Geometry, Faces=triangle_2)
remap = RemapNumbers(Value=pdecon.YComponent, Source=bnd_2, Target=Domain(0, 1))  # -> Mapped, Clipped
remap_2 = RemapNumbers(Value=pdecon.XComponent, Source=bnd, Target=Domain(0, 1))  # -> Mapped, Clipped
pt_5 = ConstructPoint(XCoordinate=pdecon.XComponent, YCoordinate=pdecon.YComponent, ZCoordinate=0)
item_4 = ListItem(List=pt_5, Index=0, Wrap=True)  # -> Item, Item1, Item2
data_2 = Data(pt_3)
c_script_4 = CSharpScript(weight=data_2, a=item_4.Item, b=item_4.Item1, c=item_4.Item2)  # -> out, A; inputs weight: Point3d, a: Point3d, b: Point3d, c: Point3d
# ---------- c_script_4: C# ----------
    var r = a.X * weight.X + b.X * weight.Y + c.X * weight.Z;
    var g = a.Y * weight.X + b.Y * weight.Y + c.Y * weight.Z;
    var bee = a.Z * weight.X + b.Z * weight.Y + c.Z * weight.Z;

    A = new Point3d(r, g, bee);
# ---------- end c_script_4 ----------
medges = MeshEdges(Mesh=conmesh_2)  # -> NakedEdges, InteriorEdges, NonManifoldEdges
join = JoinCurves(Curves=medges.NakedEdges, Preserve=False)
pt_6 = Point(c_script_4.A)
incurve = PointInCurve(Point=pt_6, Curve=join)  # -> Relationship, Point
dispatch = Dispatch(List=data_2, DispatchPattern=incurve.Relationship)  # -> ListA, ListB
dispatch_2 = Dispatch(List=pt_6, DispatchPattern=incurve.Relationship)  # -> ListA, ListB
data_3 = Data(dispatch.ListA)
panel_3 = Panel("""1
2
3""")
devec_2 = DeconstructVector(Vector=data_3)  # -> XComponent, YComponent, ZComponent
remap_3 = RemapNumbers(Value=devec_2.ZComponent, Source=Domain(0, 0.3333333), Target=Domain(0, 1))  # -> Mapped, Clipped
remap_4 = RemapNumbers(Value=devec_2.YComponent, Source=Domain(0.3333333333, 1), Target=Domain(0, 1))  # -> Mapped, Clipped
remap_5 = RemapNumbers(Value=devec_2.XComponent, Source=Domain(0, 0.5), Target=Domain(0, 1))  # -> Mapped, Clipped
vec = VectorXYZ(XComponent=remap_5.Mapped, YComponent=remap_4.Mapped, ZComponent=remap_3.Mapped)  # -> Vector, Length
c_script_5 = CSharpScript(weight=vec.Vector, y=panel_3)  # -> out, A; inputs weight: Point3d, y: list of Int32
# ---------- c_script_5: C# ----------
    var codeA = y[0];
    var codeB = y[1];
    var codeC = y[2];

    if (weight.X >= weight.Y && weight.X >= weight.Z)
    {
      A = codeA;
    }
    else if (weight.Y >= weight.Z && weight.Y >= weight.X)
    {
      A = codeB;
    }
    else
    {
      A = codeC;
    }
# ---------- end c_script_5 ----------
tag = TextTag(Location=dispatch_2.ListA, Text=c_script_5.A)
frgb_3 = ColourRGBF(Alpha=1, Red=remap_5.Mapped, Green=remap_4.Mapped, Blue=remap_3.Mapped)
preview_2 = CustomPreview(Geometry=dispatch_2.ListA, Material=frgb_3)
