# Grasshopper definition colours single bary - colour testing ohg od.gh (Grasshopper 1.0.5)

triangle = MeshTriangle(CornerA=0, CornerB=1, CornerC=2)
conmesh = ConstructMesh(
    Vertices=[Point(25.94590774, 22.23472939, 0), Point(0.6745579092, 20.21532929, 0), Point(20.69546748, -0.0363688672, 0)],
    Faces=triangle)
popgeo = PopulateGeometry(Geometry=conmesh, Count=Slider(1000, range=0..10000), Seed=1)
meshcp = MeshClosestPoint(Point=popgeo, Mesh=conmesh)  # -> Point, Index, Parameter
split = TextSplit(Text=meshcp.Parameter, Separators="[]")
panel = Panel(split)
panel_2 = Panel("""0
1
2""")
item = ListItem(List=split, Index=1, Wrap=True)
split_2 = TextSplit(Text=item, Separators=";")
split_3 = SplitList(List=split_2, Index=3)  # -> ListA, ListB
pt = Point(popgeo)
num = Number(split_3.ListA)
item_2 = ListItem(List=num, Index=0, Wrap=True)  # -> Item, Item1, Item2
subtraction = Subtraction(A=item_2.Item, B=item_2.Item1)
subtraction_2 = Subtraction(A=item_2.Item, B=item_2.Item2)
max = Maximum(A=subtraction, B=subtraction_2)
num_2 = Number(max)
frgb = ColourRGBF(Alpha=1, Red=num_2, Green=num_2, Blue=num_2)
dots = DotDisplay(Point=pt, Colour=RGB(0, 0, 0), Size=0.2)
