# Grasshopper definition colours single bary - colour testing.gh (Grasshopper 1.0.5)

triangle = MeshTriangle(CornerA=0, CornerB=1, CornerC=2)
conmesh = ConstructMesh(
    Vertices=[Point(25.94590774, 22.23472939, 0), Point(0.6745579092, 20.21532929, 0), Point(20.69546748, -0.0363688672, 0)],
    Faces=triangle)
popgeo = PopulateGeometry(Geometry=conmesh, Count=Slider(1000, range=0..10000), Seed=1)
meshcp = MeshClosestPoint(Point=popgeo, Mesh=conmesh)  # -> Point, Index, Parameter
split = TextSplit(Text=meshcp.Parameter, Separators="[]")
panel = Panel(split)
panel_2 = Panel("""0
1
2""")
item = ListItem(List=split, Index=1, Wrap=True)
split_2 = TextSplit(Text=item, Separators=";")
panel_3 = Panel("""1
0
0""")
item_2 = ListItem(Index=0, Wrap=True)
split_3 = SplitList(List=split_2, Index=3)  # -> ListA, ListB
sort = SortList(Keys=split_3.ListA, ValuesA=panel_2)  # -> Keys, reverse(ValuesA)
item_3 = ListItem(List=reverse(sort.Keys), Index=0, Wrap=True)  # -> Item, Item1, Item2
swatch = ColourSwatch(SwatchColor=RGB(255, 255, 255))
swatch_2 = ColourSwatch(SwatchColor=RGB(255, 0, 255))
swatch_3 = ColourSwatch(SwatchColor=RGB(255, 0, 0))
sort_2 = SortList(Keys=split_3.ListA, ValuesA=panel_3)  # -> Keys, ValuesA
subtraction = Subtraction(A=item_3.Item, B=item_3.Item1)
subtraction_2 = Subtraction(A=item_3.Item, B=item_3.Item2)
merge = Merge(Data1=swatch, Data2=swatch, Data3=ColourSwatch(SwatchColor=RGB(0, 0, 0)))
merge_2 = Merge(Data1=ColourSwatch(SwatchColor=RGB(0, 255, 0)), Data2=swatch_3, Data3=swatch_3)
panel_4 = Panel(item_3.Item1)
remap = RemapNumbers(Value=subtraction, Source=Domain(0.1, 0.9), Target=Domain(0, 1))  # -> Mapped, Clipped
min = Minimum(A=subtraction, B=subtraction_2)
max = Maximum(A=subtraction, B=subtraction_2)  # -> flatten(Result)
argb = SplitARGB(Colour=merge)  # -> Alpha, Red, Green, Blue
graph = GraphMapper(
    remap.Clipped,
    x0=0,
    x1=1,
    y0=0,
    y1=1,
    A=1,
    B=0,
    container_name="Linear",
    Graph_x0=0.25,
    Graph_x1=0.75,
    Graph_y0=0.25,
    Graph_y1=0.75)
argb_2 = SplitARGB(Colour=merge_2)  # -> Alpha, Red, Green, Blue
multiplication = Multiplication(A=sort_2.ValuesA, B=argb.Red)
multiplication_2 = Multiplication(A=sort_2.ValuesA, B=argb.Green)
multiplication_3 = Multiplication(A=sort_2.ValuesA, B=argb.Blue)
multiplication_4 = Multiplication(A=split_3.ListA, B=argb_2.Red)
multiplication_5 = Multiplication(A=split_3.ListA, B=argb_2.Green)
multiplication_6 = Multiplication(A=split_3.ListA, B=argb_2.Blue)
data = Data(graph)
panel_5 = Panel(min)
ma = MassAddition(Input=multiplication)  # -> Result, PartialResults
ma_2 = MassAddition(Input=multiplication_3)  # -> Result, PartialResults
ma_3 = MassAddition(Input=multiplication_4)  # -> Result, PartialResults
ma_4 = MassAddition(Input=multiplication_2)  # -> Result, PartialResults
ma_5 = MassAddition(Input=multiplication_6)  # -> Result, PartialResults
ma_6 = MassAddition(Input=multiplication_5)  # -> Result, PartialResults
frgb = ColourRGBF(Alpha=1, Red=ma.Result, Green=ma_4.Result, Blue=ma_2.Result)  # -> flatten(Colour)
frgb_2 = ColourRGBF(Alpha=1, Red=ma_3.Result, Green=ma_6.Result, Blue=ma_5.Result)  # -> flatten(Colour)
frgb_3 = ColourRGBF(Alpha=1, Red=data, Green=data, Blue=data)  # -> flatten(Colour)
argb_3 = SplitARGB(Colour=frgb)  # -> Alpha, Red, Green, Blue
max_2 = Maximum(A=data, B=graft(argb_3.Red))
min_2 = Minimum(A=Slider(0.5, range=0..1), B=argb_3.Red)  # -> graft(Result)
max_3 = Maximum()
remap_2 = RemapNumbers(Value=max_2, Source=Domain(0.5, 1), Target=Domain(0, 1))  # -> Mapped, Clipped
max_4 = Maximum(A=data, B=min_2)
data_2 = Data(flatten(max_4))
argb_4 = SplitARGB(Colour=frgb_2)  # -> Alpha, Red, Green, Blue
multiplication_7 = Multiplication(A=data_2, B=argb_4.Red)
frgb_4 = ColourRGBF(Alpha=1, Red=remap_2.Mapped, Green=remap_2.Mapped, Blue=remap_2.Mapped)  # -> flatten(Colour)
dots = DotDisplay(Point=popgeo, Colour=frgb, Size=0.25)
multiplication_8 = Multiplication(A=data_2, B=argb_4.Green)
multiplication_9 = Multiplication(A=data_2, B=argb_4.Blue)
frgb_5 = ColourRGBF(Alpha=1, Red=multiplication_7, Green=multiplication_8, Blue=multiplication_9)  # -> flatten(Colour)
