# Grasshopper definition colours single bary.gh (Grasshopper 1.0.5)

triangle = MeshTriangle(CornerA=0, CornerB=1, CornerC=2)
conmesh = ConstructMesh(
    Vertices=[Point(25.94590774, 22.23472939, 0), Point(0.6745579092, 20.21532929, 0), Point(20.69546748, -0.0363688672, 0)],
    Faces=triangle)
popgeo = PopulateGeometry(Geometry=conmesh, Count=Slider(500, range=0..10000), Seed=1)
meshcp = MeshClosestPoint(Point=popgeo, Mesh=conmesh)  # -> Point, Index, Parameter
split = TextSplit(Text=meshcp.Parameter, Separators="[]")
panel = Panel(split)
panel_2 = Panel("""0
1
2""")
item = ListItem(List=split, Index=1, Wrap=True)
swatch = ColourSwatch(SwatchColor=RGB(0, 255, 0))
swatch_2 = ColourSwatch(SwatchColor=RGB(255, 0, 255))
split_2 = TextSplit(Text=item, Separators=";")
item_2 = ListItem(Index=0, Wrap=True)
split_3 = SplitList(List=split_2, Index=3)  # -> ListA, ListB
merge = Merge(Data1=ColourSwatch(SwatchColor=RGB(142, 255, 0)), Data2=swatch_2, Data3=swatch_2)
sort = SortList(Keys=split_3.ListA, ValuesA=panel_2)  # -> Keys, reverse(ValuesA)
item_3 = ListItem(List=reverse(sort.Keys), Index=0, Wrap=True)  # -> Item, Item1, Item2
subtraction = Subtraction(A=item_3.Item, B=item_3.Item1)
subtraction_2 = Subtraction(A=item_3.Item, B=item_3.Item2)
panel_3 = Panel(item_3.Item1)
remap = RemapNumbers(Value=subtraction, Source=Domain(0.1, 0.9), Target=Domain(0, 1))  # -> Mapped, Clipped
min = Minimum(A=subtraction, B=subtraction_2)
max = Maximum(A=subtraction, B=subtraction_2)  # -> flatten(Result)
graph = GraphMapper(remap.Clipped, x0=0, x1=1, y0=0, y1=1, container_name="Bezier", cpx=[0, 0.6737192273, 0.6018835902, 1], cpy=[0, 1, 1, 1])
argb = SplitARGB(Colour=merge)  # -> Alpha, Red, Green, Blue
multiplication = Multiplication(A=split_3.ListA, B=argb.Red)
multiplication_2 = Multiplication(A=split_3.ListA, B=argb.Green)
multiplication_3 = Multiplication(A=split_3.ListA, B=argb.Blue)
data = Data(graph)
panel_4 = Panel(min)
ma = MassAddition(Input=multiplication)  # -> Result, PartialResults
ma_2 = MassAddition(Input=multiplication_3)  # -> Result, PartialResults
ma_3 = MassAddition(Input=multiplication_2)  # -> Result, PartialResults
frgb = ColourRGBF(Alpha=1, Red=data, Green=data, Blue=data)  # -> flatten(Colour)
frgb_2 = ColourRGBF(Alpha=1, Red=ma.Result, Green=ma_3.Result, Blue=ma_2.Result)  # -> flatten(Colour)
data_2 = Data(flatten(data))
argb_2 = SplitARGB(Colour=frgb_2)  # -> Alpha, Red, Green, Blue
multiplication_4 = Multiplication(A=data_2, B=argb_2.Red)
multiplication_5 = Multiplication(A=data_2, B=argb_2.Green)
multiplication_6 = Multiplication(A=data_2, B=argb_2.Blue)
frgb_3 = ColourRGBF(Alpha=1, Red=multiplication_4, Green=multiplication_5, Blue=multiplication_6)  # -> flatten(Colour)
dots = DotDisplay(Point=popgeo, Colour=frgb_3, Size=0.25)
