# Grasshopper definition colours.gh (Grasshopper 1.0.5)

circle = Circle({Plane=Plane(origin=(9.297730217, 6.74196112, 0), x=(0.9744961475, 0.2244042301, 0), y=(-0.2244042301, 0.9744961475, 0)), Radius=19.97444607})
area = Area(Geometry=circle)  # -> Area, Centroid
pop2d = Populate2D(
    Region={Plane=PlaneXY(8.259200216, 4.815180963, 0), Size=Domain2(u=-21.23838769..21.23838769, v=-17.98473843..17.98473843)},
    Count=50,
    Seed=1)
srf = Surface(circle)
scale = Scale(Geometry=srf, Center=area.Centroid, Factor=0.9)  # -> Geometry, Transform
popgeo = PopulateGeometry(Geometry=scale.Geometry, Count=Slider(50, range=0..100), Seed=1)
divide = DivideCurve(Curve=circle, Count=20, Kinks=False)  # -> Points, Tangents, Parameters
pt = Point(flatten([popgeo, divide.Points]))
con = DelaunayEdges(Points=pt, Plane=PlaneXY(0, 0, 0))  # -> Connectivity, Edges
del = DelaunayMesh(Points=pt, Plane=PlaneXY(0, 0, 0))
move = Move(Geometry=con.Edges, Motion=Vector(0, 0, 10))  # -> Geometry, Transform
popgeo_2 = PopulateGeometry(Geometry=del, Count=Slider(8000, range=0..10000), Seed=1)
preview = CustomPreview(Geometry=move.Geometry, Material=ColourSwatch(SwatchColor=RGB(0, 0, 0)))
meshcp = MeshClosestPoint(Point=popgeo_2, Mesh=del)  # -> Point, Index, Parameter
split = TextSplit(Text=meshcp.Parameter, Separators="[]")
panel = Panel(split)
panel_2 = Panel("""0
1
2""")
item = ListItem(List=split, Index=1, Wrap=True)
split_2 = TextSplit(Text=item, Separators=";")
item_2 = ListItem(Index=0, Wrap=True)
split_3 = SplitList(List=split_2, Index=3)  # -> ListA, ListB
merge = Merge(
    Data1=ColourSwatch(SwatchColor=RGB(255, 0, 0)),
    Data2=ColourSwatch(SwatchColor=RGB(0, 0, 255)),
    Data3=ColourSwatch(SwatchColor=RGB(0, 255, 0)))
panel_3 = Panel("""1
0
0""")
sort = SortList(Keys=split_3.ListA, ValuesA=panel_2)  # -> Keys, reverse(ValuesA)
item_3 = ListItem(List=reverse(sort.Keys), Index=0, Wrap=True)  # -> Item, Item1, Item2
sort_2 = SortList(Keys=sort.ValuesA, ValuesA=panel_3)  # -> Keys, ValuesA
argb = SplitARGB(Colour=merge)  # -> Alpha, Red, Green, Blue
multiplication = Multiplication(A=split_3.ListA, B=sort_2.ValuesA)
subtraction = Subtraction(A=item_3.Item, B=item_3.Item1)
subtraction_2 = Subtraction(A=item_3.Item, B=item_3.Item2)
neg = Negative(Value=multiplication)
panel_4 = Panel(item_3.Item1)
remap = RemapNumbers(Value=subtraction, Source=Domain(0.1, 0.9), Target=Domain(0, 1))  # -> Mapped, Clipped
min = Minimum(A=subtraction, B=subtraction_2)
max = Maximum(A=subtraction, B=subtraction_2)  # -> flatten(Result)
panel_5 = Panel(multiplication)
graph = GraphMapper(remap.Clipped, x0=0, x1=1, y0=0, y1=1, container_name="Bezier", cpx=[0, 0, 0.6018835902, 1], cpy=[0, 1, 1, 1])
multiplication_2 = Multiplication(A=multiplication, B=argb.Red)
multiplication_3 = Multiplication(A=multiplication, B=argb.Green)
multiplication_4 = Multiplication(A=multiplication, B=argb.Blue)
data = Data(graph)
panel_6 = Panel(min)
ma = MassAddition(Input=multiplication_2)  # -> Result, PartialResults
ma_2 = MassAddition(Input=multiplication_4)  # -> Result, PartialResults
ma_3 = MassAddition(Input=multiplication_3)  # -> Result, PartialResults
frgb = ColourRGBF(Alpha=1, Red=data, Green=data, Blue=data)  # -> flatten(Colour)
dots = DotDisplay(Point=popgeo_2, Colour=frgb, Size=0.25)
frgb_2 = ColourRGBF(Alpha=1, Red=ma.Result, Green=ma_3.Result, Blue=ma_2.Result)  # -> flatten(Colour)
preview_2 = CustomPreview(Geometry=popgeo_2, Material=frgb)
panel_7 = Panel(frgb_2)
