# Grasshopper definition createSurfaceExample.gh (Grasshopper 0.9.76)

number_slider = Slider(44, range=0..100)
crv = Curve(<curve referenced from the Rhino model>)
crv_2 = Curve(<curve referenced from the Rhino model>)
divide = DivideCurve(Curve=crv, Count=number_slider, Kinks=False)  # -> Points, Tangents, Parameters
divide_2 = DivideCurve(Curve=crv_2, Count=number_slider, Kinks=False)  # -> Points, Tangents, Parameters

# ---- group: Create Center Point
ln = Line(StartPoint=divide.Points, EndPoint=divide_2.Points)
len = Length(Curve=ln)
eval = EvaluateCurve(Curve=ln, Parameter=Slider(0.5, range=0..1))  # -> Point, Tangent, Angle
multiplication = Multiplication(A=Slider(0.574, range=0..1), B=len)
Z = UnitZ(Factor=multiplication)
move = Move(Geometry=eval.Point, Motion=Z)  # -> Geometry, Transform

# ----
arc = Arc3Pt(PointA=divide.Points, PointB=move.Geometry, PointC=divide_2.Points)  # -> Arc, Plane, Radius
loft = Loft(Curves=arc.Arc, Options={Adjust=False, Closed=False, LoftEnds=0, LoftSimp=0, LoftType=0, Rebuild=10, Refit=0.01})
srf = Surface(loft)

# ---- group: Create Surface Triangles
srf_2 = Surface(srf)
divide_3 = DivideDomain²(Domain=srf_2, UCount=Slider(58, range=0..100), VCount=Slider(19, range=0..100))
subsrf = Isotrim(Surface=srf_2, Domain=divide_3)
debrep = DeconstructBrep(Brep=subsrf)  # -> Faces, Edges, Vertices
item = ListItem(List=reverse(debrep.Vertices), Index=0, Wrap=True)  # -> Item, Item1, Item2, Item3
srf4pt = _4PointSurface(CornerA=item.Item2, CornerB=item.Item3, CornerC=item.Item)  # -> flatten(Surface)
srf4pt_2 = _4PointSurface(CornerA=item.Item, CornerB=item.Item1, CornerC=item.Item2)

# ----
lng = ListLength(List=srf4pt)
jitter = Jitter(List=srf4pt, Jitter=Slider(0.4, range=0..1), Seed=2)  # -> Values, Indices
multiplication_2 = Multiplication(A=lng, B=Slider(0.7, range=0..1))
mesh = Mesh(srf4pt_2)
split = SplitList(List=jitter.Values, Index=multiplication_2)  # -> ListA, ListB
preview = CustomPreview(Geometry=mesh, Shader=ColourSwatch(SwatchColor=RGB(82, 118, 255)))
mesh_2 = Mesh(split.ListA)
preview_2 = CustomPreview(Geometry=mesh_2, Shader=ColourSwatch(SwatchColor=RGB(177, 51, 255)))
