# Grasshopper definition fifty-five.gh (Grasshopper 0.9.76)
# plug-ins: MeshEdit Components

rectangle = Rectangle(Plane=PlaneXY(0, 0, 0), XSize=Slider(50, range=0..100), YSize=Slider(50, range=0..100), Radius=0)  # -> Rectangle, Length
explode = Explode(Curve=rectangle.Rectangle, Recursive=True)  # -> Segments, Vertices
item = ListItem(List=explode.Segments, Index=0, Wrap=True)  # -> Item, Item1, Item2, Item3
number_slider = Slider(10, range=0..100)
flip = FlipCurve(Curve=item.Item)  # -> Curve, Flag
flip_2 = FlipCurve(Curve=item.Item1)  # -> Curve, Flag
merge = Merge(Data1=flip.Curve, Data2=item.Item2)
merge_2 = Merge(Data1=flip_2.Curve, Data2=item.Item3)
divide = DivideCurve(Curve=reparameterize(merge_2), Count=number_slider, Kinks=False)  # -> Points, Tangents, Parameters
pi = Pi(Factor=Slider(3, range=0..10))
pi_2 = Pi(Factor=Slider(6, range=0..10))
divide_2 = DivideCurve(Curve=reparameterize(merge), Count=number_slider, Kinks=False)  # -> Points, Tangents, Parameters
multiplication = Multiplication(A=divide.Parameters, B=pi)
multiplication_2 = Multiplication(A=divide.Parameters, B=pi_2)
pi_3 = Pi(Factor=Slider(5, range=0..10))
pi_4 = Pi(Factor=Slider(1, range=0..10))
sin = Sine(Value=multiplication_2)
sin_2 = Sine(Value=multiplication)
multiplication_3 = Multiplication(A=divide_2.Parameters, B=pi_4)
multiplication_4 = Multiplication(A=divide_2.Parameters, B=pi_3)
multiplication_5 = Multiplication(A=sin_2, B=Slider(3, range=0..10))
multiplication_6 = Multiplication(A=sin, B=Slider(2, range=0..10))
sin_3 = Sine(Value=multiplication_4)
sin_4 = Sine(Value=multiplication_3)
addition = Addition(A=multiplication_5, B=multiplication_6)
X = UnitX(Factor=addition)
multiplication_7 = Multiplication(A=sin_4, B=Slider(6, range=0..10))
multiplication_8 = Multiplication(A=sin_3, B=Slider(2, range=0..10))
move = Move(Geometry=divide.Points, Motion=X)  # -> Geometry, Transform
addition_2 = Addition(A=multiplication_7, B=multiplication_8)
Y = UnitY(Factor=addition_2)
move_2 = Move(Geometry=divide_2.Points, Motion=Y)  # -> Geometry, Transform
pline = PolyLine(Vertices=move.Geometry, Closed=False)  # -> flatten(Polyline)
pline_2 = PolyLine(Vertices=move_2.Geometry, Closed=False)  # -> flatten(Polyline)
merge_3 = Merge(Data1=pline_2, Data2=pline)
join = JoinCurves(Curves=merge_3, Preserve=False)
neg = Negative(Value=Slider(2.8633, range=0..10))
explode_2 = Explode(Curve=join, Recursive=True)  # -> Segments, Vertices
data = Data(join)
offset = Offset(Curve=join, Distance=neg, Plane=PlaneXY(0, 0, 0), Corners=1)
srf = Surface(offset)
split = SplitList(List=explode_2.Vertices, Index=1)  # -> ListA, ListB
popgeo = PopulateGeometry(Geometry=srf, Count=Slider(100, range=0..1000), Seed=Slider(51.664, range=0..100))
merge_4 = Merge(Data1=split.ListB, Data2=popgeo)
del = DelaunayMesh(Points=merge_4, Plane=PlaneXY(0, 0, 0))
facen = FaceNormals(Mesh=del)  # -> Centers, Normals
demesh = DeconstructMesh(Mesh=del)  # -> Vertices, Faces, Colours, Normals
incurve = PointInCurve(Point=facen.Centers, Curve=data)  # -> Relationship, Point
dispatch = Dispatch(List=demesh.Faces, DispatchPattern=incurve.Relationship)  # -> ListA, ListB
conmesh = ConstructMesh(Vertices=demesh.Vertices, Faces=dispatch.ListA)
number_slider_2 = Slider(50, range=0..100)
number_slider_3 = Slider(4, range=0..10)
weldvertices = MeshWeldVertices(Mesh=conmesh, Tolerance=0.01)  # -> RuntimeMessage, Mesh
demesh_2 = DeconstructMesh(Mesh=weldvertices.Mesh)  # -> Vertices, Faces, Colours, Normals
series = Series(Start=0, Step=Slider(50, range=0..100), Count=Slider(2, range=0..10))
data_2 = Data(weldvertices.Mesh)
demesh_3 = DeconstructMesh(Mesh=weldvertices.Mesh)  # -> Vertices, Faces, Colours, Normals
lng = ListLength(List=demesh_2.Vertices)
addition_3 = Addition(A=number_slider_3, B=2)
one_over_x = OneOverX(Value=number_slider_3)
one_over_x_2 = OneOverX(Value=number_slider_3)
deface = DeconstructFace(Face=demesh_3.Faces)  # -> graft(CornerA), graft(CornerB), graft(CornerC), CornerD
series_2 = Series(Start=0, Step=1, Count=lng)
multiplication_9 = Multiplication(A=number_slider_2, B=one_over_x_2)
series_3 = Series(Start=0, Step=number_slider_2, Count=addition_3)
int = Integer(series_2)
merge_5 = Merge(Data1=deface.CornerA, Data2=deface.CornerB, Data3=deface.CornerC)  # -> flatten(Result)
demesh_4 = DeconstructMesh(Mesh=weldvertices.Mesh)  # -> Vertices, Faces, Colours, Normals
vec = VectorXYZ(XComponent=multiplication_9, YComponent=multiplication_9, ZComponent=0)  # -> Vector, Length
vec_2 = VectorXYZ(XComponent=series_3, YComponent=graft(series_3), ZComponent=0)  # -> Vector, Length
number_slider_4 = Slider(39, range=0..100)  # disabled
number_slider_5 = Slider(50, range=0..100)  # disabled
series_4 = Series(Start=0, Step=Slider(1, range=0..100), Count=addition_3)
neg_2 = Negative(Value=vec.Vector)
lng_2 = ListLength(List=merge_5)
lng_3 = ListLength(List=demesh_4.Vertices)
panel = Panel("f)")
vec_3 = VectorXYZ(XComponent=series, YComponent=graft(series), ZComponent=0)  # -> Vector, Length; disabled
pdecon = Deconstruct(Point=demesh_4.Vertices)  # -> XComponent, YComponent, ZComponent
int_2 = Integer(series_4)
repeat = RepeatData(Data=",", Length=expr("x-1", lng_2))
move_3 = Move(Geometry=data_2, Motion=vec_2.Vector)  # -> Geometry, Transform
concat = Concatenate(FragmentA=int_2, FragmentB=",", FragmentC=graft(int_2))  # -> flatten(Result)
repeat_2 = RepeatData(Data=",", Length=expr("x-1", lng_3))
concat_2 = Concatenate(FragmentA=merge_5)
move_4 = Move(Geometry=weldvertices.Mesh, Motion=vec_3.Vector)  # -> Geometry, Transform; disabled
concat_3 = Concatenate(
    FragmentA="new Vector3(",
    FragmentB=pdecon.XComponent,
    FragmentC="f,",
    FragmentD=pdecon.YComponent,
    FragmentE="f,",
    FragmentF=pdecon.ZComponent,
    FragmentG="f)")
pt = ConstructPoint(XCoordinate=number_slider_4, YCoordinate=number_slider_4, ZCoordinate=0)  # disabled
addition_4 = Addition(A=number_slider_4, B=number_slider_5)  # disabled
merge_6 = Merge(Data1=flatten(repeat), Data2=flatten("};"))
scale = Scale(Geometry=move_3.Geometry, Center=Point(0, 0, 0), Factor=one_over_x)  # -> Geometry, Transform
merge_7 = Merge(Data1=flatten(repeat_2), Data2=flatten("};"))
lng_4 = ListLength()
demesh_5 = DeconstructMesh(Mesh=move_4.Geometry)  # -> Vertices, Faces, Colours, Normals; disabled
facen_2 = FaceNormals(Mesh=move_4.Geometry)  # -> Centers, Normals; disabled
number_slider_6 = Slider(1000, range=0..1000)
lng_5 = ListLength(List=int)
lng_6 = ListLength(List=scale.Geometry)
dom = ConstructDomain(DomainStart=number_slider_4, DomainEnd=addition_4)  # disabled
move_5 = Move(Geometry=scale.Geometry, Motion=neg_2)  # -> flatten(Geometry), Transform
concat_4 = Concatenate(FragmentA=concat_2, FragmentB=merge_6)
split_2 = SplitList(List=concat_4, Index=1)  # -> ListA, ListB
concat_5 = Concatenate(FragmentA=concat_3, FragmentB=merge_7)
split_3 = SplitList(List=concat_5, Index=1)  # -> ListA, ListB
multiplication_10 = Multiplication(A=lng_5, B=lng_6)
pdecon_2 = Deconstruct(Point=facen_2.Centers)  # -> XComponent, YComponent, ZComponent; disabled
concat_6 = Concatenate(FragmentA="var indexes = new int[]{", FragmentB=split_2.ListA)
concat_7 = Concatenate(FragmentA="var pts = Vector3[]{", FragmentB=split_3.ListA)
repeat_3 = RepeatData(Data=graft(concat), Length=lng)  # -> flatten(Data)
scale_2 = Scale(Geometry=weldvertices.Mesh, Center=Point(0, 0, 0), Factor=number_slider_6)  # -> Geometry, Transform
inc = Includes(Value=pdecon_2.XComponent, Domain=dom)  # -> Includes, Deviation; disabled
inc_2 = Includes(Value=pdecon_2.YComponent, Domain=dom)  # -> Includes, Deviation; disabled
merge_8 = Merge(Data1=concat_6, Data2=split_2.ListB)
merge_9 = Merge(Data1=concat_7, Data2=split_3.ListB)
repeat_4 = RepeatData(Data=int, Length=multiplication_10)  # -> flatten(Data)
scale_3 = Scale(Geometry=move_5.Geometry, Center=Point(0, 0, 0), Factor=number_slider_6)  # -> Geometry, Transform
panel_2 = Panel(merge_8)
faceb = FaceBoundaries(Mesh=scale_2.Geometry)
and = GateAnd(A=inc.Includes, B=inc_2.Includes)  # disabled
panel_3 = Panel(merge_9)
demesh_6 = DeconstructMesh(Mesh=scale_3.Geometry)  # -> flatten(Vertices), Faces, Colours, Normals
neg_3 = Negative(Value=pt)  # disabled
incurves = PointInCurves(Point=demesh_6.Vertices, Curves=faceb)  # -> Relationship, Index, Point
dispatch_2 = Dispatch(List=demesh_5.Faces, DispatchPattern=and)  # -> ListA, ListB; disabled
explode_3 = MeshExplode(Mesh=scale_2.Geometry, Interpolate=False)  # -> graft(Faces)
cset = CreateSet(List=incurves.Index)  # -> Set, Map
data_3 = Data(dispatch_2.ListA)  # disabled
split_4 = SplitList(List=cset.Set, Index=1)  # -> ListA, ListB
conmesh_2 = ConstructMesh(Vertices=demesh_5.Vertices, Faces=data_3)  # disabled
sort = SortList(Keys=split_4.ListB, ValuesA=split_4.ListB)  # -> Keys, ValuesA
weldvertices_2 = MeshWeldVertices(Mesh=conmesh_2, Tolerance=0.01)  # -> RuntimeMessage, Mesh; disabled
mindex = MemberIndex(Set=incurves.Index, Member=sort.ValuesA)  # -> Index, Count
item_2 = ListItem(List=repeat_3, Index=mindex.Index, Wrap=True)
move_6 = Move(Geometry=weldvertices_2.Mesh, Motion=neg_3)  # -> Geometry, Transform; disabled
item_3 = ListItem(List=repeat_3, Index=mindex.Index, Wrap=True)
item_4 = ListItem(List=demesh_6.Vertices, Index=mindex.Index, Wrap=True)
item_5 = ListItem(List=repeat_4, Index=mindex.Index, Wrap=True)
split_5 = TextSplit(Text=item_3, Separators=", ")
item_6 = ListItem(List=demesh_2.Vertices, Index=item_5, Wrap=True)
meshcp = MeshClosestPoint(Point=item_4, Mesh=explode_3)  # -> Point, Index, Parameter
panel_4 = Panel(meshcp.Parameter)
multiplication_11 = Multiplication(A=split_5, B=Slider(50, range=0..100))
item_7 = ListItem(List=multiplication_11, Index=0, Wrap=True)  # -> Item, Item1
concat_8 = Concatenate(FragmentA="new Vector2Int(", FragmentB=item_2, FragmentC=")")
mjoin = MeshJoin(Meshes=flatten(move_6.Geometry))  # disabled
vec_4 = VectorXYZ(XComponent=item_7.Item, YComponent=item_7.Item1, ZComponent=0)  # -> Vector, Length
data_4 = Data(concat_8)
weldvertices_3 = MeshWeldVertices(Mesh=mjoin, Tolerance=0.01)  # -> RuntimeMessage, Mesh; disabled
number_slider_7 = Slider(2, range=0..10)  # disabled
number_slider_8 = Slider(50, range=0..100)  # disabled
number_slider_9 = Slider(0.5, range=0..1)  # disabled
move_7 = Move(Geometry=mjoin, Motion=vec_3.Vector)  # -> Geometry, Transform; disabled
lng_7 = ListLength(List=data_4)
trim = TrimTree(Tree=vec_4.Vector, Depth=1)
move_8 = Move(Geometry=item_6, Motion=trim)  # -> Geometry, Transform
scale_4 = Scale(Geometry=move_8.Geometry, Center=Point(0, 0, 0), Factor=Slider(0.25, range=0..1))  # -> Geometry, Transform
number_slider_10 = Slider(1000, range=0..1000)  # disabled
lng_8 = ListLength(List=lng_7)
data_5 = Data(weldvertices_3.Mesh)  # disabled
panel_5 = Panel("var relationships= new Vector2Int[][]{")
addition_5 = Addition(A=number_slider_7, B=2)  # disabled
one_over_x_3 = OneOverX(Value=number_slider_7)  # disabled
one_over_x_4 = OneOverX(Value=number_slider_7)  # disabled
medges = MeshEdges(Mesh=data_5)  # -> NakedEdges, InteriorEdges, NonManifoldEdges; disabled
multiplication_12 = Multiplication(A=number_slider_8, B=one_over_x_4)  # disabled
repeat_5 = RepeatData(Data=",", Length=expr("x-1", lng_7))
repeat_6 = RepeatData(Data="}", Length=expr("x", lng_8))
repeat_7 = RepeatData(Data="new Vector2Int[]{", Length=expr("x", lng_8))
series_5 = Series(Start=0, Step=number_slider_8, Count=addition_5)  # disabled
join_2 = TextJoin(Text=data_4, Join=",")
vec_5 = VectorXYZ(XComponent=multiplication_12, YComponent=multiplication_12, ZComponent=0)  # -> Vector, Length; disabled
vec_6 = VectorXYZ(XComponent=series_5, YComponent=graft(series_5), ZComponent=0)  # -> Vector, Length; disabled
concat_9 = Concatenate()
join_3 = JoinCurves(Curves=medges.NakedEdges, Preserve=False)  # disabled
neg_4 = Negative(Value=vec_5.Vector)  # disabled
scale_5 = Scale(Geometry=join_3, Center=Point(0, 0, 0), Factor=number_slider_10)  # -> Geometry, Transform; disabled
merge_10 = Merge(Data1=flatten(repeat_7), Data2=flatten("};"))
move_9 = Move(Geometry=data_5, Motion=vec_6.Vector)  # -> Geometry, Transform; disabled
concat_10 = Concatenate(FragmentA=repeat_7, FragmentC=join_2, FragmentB=repeat_6, FragmentD=",")  # -> flatten(Result)
concat_11 = Concatenate(FragmentA=concat_9, FragmentB=merge_10)
flip_3 = FlipCurve(Curve=scale_5.Geometry)  # -> Curve, Flag; disabled
split_6 = SplitList(List=concat_11, Index=1)  # -> ListA, ListB
scale_6 = Scale(Geometry=move_9.Geometry, Center=Point(0, 0, 0), Factor=one_over_x_3)  # -> Geometry, Transform; disabled
join_4 = TextJoin(Text=concat_10, Join=", ")
concat_12 = Concatenate(FragmentA=panel_5, FragmentB=join_4, FragmentC="};")
move_10 = Move(Geometry=scale_6.Geometry, Motion=neg_4)  # -> flatten(Geometry), Transform; disabled
xy = XYPlane(Origin=Point(0, 0, 0))  # disabled
lng_9 = ListLength(List=move_10.Geometry)  # disabled
merge_11 = Merge(Data1=panel_5, Data2=concat_10, Data3="};")
facen_3 = FaceNormals(Mesh=move_10.Geometry)  # -> Centers, Normals; disabled
panel_7 = Panel(merge_11)
scale_7 = Scale(Geometry=facen_3.Centers, Center=Point(0, 0, 0), Factor=number_slider_10)  # -> Geometry, Transform; disabled
demesh_7 = DeconstructMesh(Mesh=move_10.Geometry)  # -> Vertices, Faces, Colours, Normals; disabled
incurve_2 = PointInCurve(Point=scale_7.Geometry, Curve=flip_3.Curve)  # -> Relationship, Point; disabled
side = CurveSide(Curve=flip_3.Curve, Point=facen_3.Centers, Plane=xy)  # -> Side, Left, Right; disabled
equals = Equality(FirstNumber=incurve_2.Relationship, SecondNumber=0)  # -> Equality, Inequality; disabled
series_6 = Series(Start=0, Step=1, Count=lng_9)  # disabled
gradient = Gradient(
    LowerLimit=0,
    UpperLimit=lng_9,
    Parameter=series_6,
    stops=[0: RGB(243, 57, 0), 0.1: RGB(236, 27, 60), 0.2: RGB(210, 0, 118), 0.3: RGB(103, 0, 120), 0.4: RGB(39, 72, 161), 0.5: RGB(1, 192, 229), 0.6: RGB(18, 178, 90), 0.7: RGB(79, 186, 8), 0.8: RGB(220, 237, 32), 0.9: RGB(247, 159, 20), 1: RGB(243, 57, 0)])  # disabled
dispatch_3 = Dispatch(List=demesh_7.Faces, DispatchPattern=equals.Equality)  # -> ListA, ListB; disabled
preview = CustomPreview(Geometry=move_10.Geometry, Shader=gradient)  # disabled
conmesh_3 = ConstructMesh(Vertices=demesh_7.Vertices, Faces=dispatch_3.ListB)  # -> flatten(Mesh); disabled
mjoin_2 = MeshJoin(Meshes=conmesh_3)  # disabled
move_11 = Move(Geometry=mjoin_2, Motion=vec_3.Vector)  # -> Geometry, Transform; disabled
number_slider_11 = Slider(4, range=0..10)  # disabled
number_slider_12 = Slider(50, range=0..100)  # disabled
number_slider_13 = Slider(1000, range=0..1000)  # disabled
data_6 = Data(mjoin_2)  # disabled
addition_6 = Addition(A=number_slider_11, B=2)  # disabled
one_over_x_5 = OneOverX(Value=number_slider_11)  # disabled
one_over_x_6 = OneOverX(Value=number_slider_11)  # disabled
data_7 = Data(mjoin)  # disabled
data_8 = Data(mjoin_2)  # disabled
multiplication_13 = Multiplication(A=number_slider_12, B=one_over_x_6)  # disabled
series_7 = Series(Start=0, Step=number_slider_12, Count=addition_6)  # disabled
vec_7 = VectorXYZ(XComponent=multiplication_13, YComponent=multiplication_13, ZComponent=0)  # -> Vector, Length; disabled
scale_8 = Scale(Geometry=data_7, Center=Point(0, 0, 0), Factor=number_slider_13)  # -> Geometry, Transform; disabled
scale_9 = Scale(Geometry=data_8, Center=Point(0, 0, 0), Factor=number_slider_13)  # -> Geometry, Transform; disabled
vec_8 = VectorXYZ(XComponent=series_7, YComponent=graft(series_7), ZComponent=0)  # -> Vector, Length; disabled
neg_5 = Negative(Value=vec_7.Vector)  # disabled
facen_4 = FaceNormals(Mesh=scale_9.Geometry)  # -> Centers, Normals; disabled
faceb_2 = FaceBoundaries(Mesh=scale_8.Geometry)  # disabled
move_12 = Move(Geometry=data_6, Motion=vec_8.Vector)  # -> Geometry, Transform; disabled
incurves_2 = PointInCurves(Point=facen_4.Centers, Curves=faceb_2)  # -> Relationship, Index, Point; disabled
scale_10 = Scale(Geometry=move_12.Geometry, Center=Point(0, 0, 0), Factor=one_over_x_5)  # -> Geometry, Transform; disabled
move_13 = Move(Geometry=scale_10.Geometry, Motion=neg_5)  # -> flatten(Geometry), Transform; disabled
