# Grasshopper definition fifty-four.gh (Grasshopper 0.9.76)
# plug-ins: MeshEdit Components

rectangle = Rectangle(Plane=PlaneXY(0, 0, 0), XSize=Slider(50, range=0..100), YSize=Slider(50, range=0..100), Radius=0)  # -> Rectangle, Length
explode = Explode(Curve=rectangle.Rectangle, Recursive=True)  # -> Segments, Vertices
item = ListItem(List=explode.Segments, Index=0, Wrap=True)  # -> Item, Item1, Item2, Item3
number_slider = Slider(25, range=0..100)
flip = FlipCurve(Curve=item.Item)  # -> Curve, Flag
flip_2 = FlipCurve(Curve=item.Item1)  # -> Curve, Flag
merge = Merge(Data1=flip.Curve, Data2=item.Item2)
merge_2 = Merge(Data1=flip_2.Curve, Data2=item.Item3)
divide = DivideCurve(Curve=reparameterize(merge_2), Count=number_slider, Kinks=False)  # -> Points, Tangents, Parameters
pi = Pi(Factor=Slider(3, range=0..10))
pi_2 = Pi(Factor=Slider(6, range=0..10))
divide_2 = DivideCurve(Curve=reparameterize(merge), Count=number_slider, Kinks=False)  # -> Points, Tangents, Parameters
multiplication = Multiplication(A=divide.Parameters, B=pi)
multiplication_2 = Multiplication(A=divide.Parameters, B=pi_2)
pi_3 = Pi(Factor=Slider(5, range=0..10))
pi_4 = Pi(Factor=Slider(1, range=0..10))
sin = Sine(Value=multiplication_2)
sin_2 = Sine(Value=multiplication)
multiplication_3 = Multiplication(A=divide_2.Parameters, B=pi_4)
multiplication_4 = Multiplication(A=divide_2.Parameters, B=pi_3)
multiplication_5 = Multiplication(A=sin_2, B=Slider(3, range=0..10))
multiplication_6 = Multiplication(A=sin, B=Slider(2, range=0..10))
sin_3 = Sine(Value=multiplication_4)
sin_4 = Sine(Value=multiplication_3)
addition = Addition(A=multiplication_5, B=multiplication_6)
X = UnitX(Factor=addition)
multiplication_7 = Multiplication(A=sin_4, B=Slider(6, range=0..10))
multiplication_8 = Multiplication(A=sin_3, B=Slider(2, range=0..10))
move = Move(Geometry=divide.Points, Motion=X)  # -> Geometry, Transform
addition_2 = Addition(A=multiplication_7, B=multiplication_8)
Y = UnitY(Factor=addition_2)
move_2 = Move(Geometry=divide_2.Points, Motion=Y)  # -> Geometry, Transform
pline = PolyLine(Vertices=move.Geometry, Closed=False)  # -> flatten(Polyline)
pline_2 = PolyLine(Vertices=move_2.Geometry, Closed=False)  # -> flatten(Polyline)
merge_3 = Merge(Data1=pline_2, Data2=pline)
join = JoinCurves(Curves=merge_3, Preserve=False)
neg = Negative(Value=Slider(1.0201, range=0..10))
explode_2 = Explode(Curve=join, Recursive=True)  # -> Segments, Vertices
data = Data(join)
offset = Offset(Curve=join, Distance=neg, Plane=PlaneXY(0, 0, 0), Corners=1)
srf = Surface(offset)
split = SplitList(List=explode_2.Vertices, Index=1)  # -> ListA, ListB
popgeo = PopulateGeometry(Geometry=srf, Count=Slider(857, range=0..1000), Seed=Slider(51.664, range=0..100))
merge_4 = Merge(Data1=split.ListB, Data2=popgeo)
del = DelaunayMesh(Points=merge_4, Plane=PlaneXY(0, 0, 0))
facen = FaceNormals(Mesh=del)  # -> Centers, Normals
demesh = DeconstructMesh(Mesh=del)  # -> Vertices, Faces, Colours, Normals
incurve = PointInCurve(Point=facen.Centers, Curve=data)  # -> Relationship, Point
dispatch = Dispatch(List=demesh.Faces, DispatchPattern=incurve.Relationship)  # -> ListA, ListB
conmesh = ConstructMesh(Vertices=demesh.Vertices, Faces=dispatch.ListA)
weldvertices = MeshWeldVertices(Mesh=conmesh, Tolerance=0.01)  # -> RuntimeMessage, Mesh
demesh_2 = DeconstructMesh(Mesh=weldvertices.Mesh)  # -> Vertices, Faces, Colours, Normals
series = Series(Start=0, Step=Slider(50, range=0..100), Count=Slider(2, range=0..10))
lng = ListLength(List=demesh_2.Vertices)
number_slider_2 = Slider(50, range=0..100)
number_slider_3 = Slider(4, range=0..10)
series_2 = Series(Start=0, Step=1, Count=lng)
data_2 = Data(weldvertices.Mesh)
int = Integer(series_2)
addition_3 = Addition(A=number_slider_3, B=2)
one_over_x = OneOverX(Value=number_slider_3)
one_over_x_2 = OneOverX(Value=number_slider_3)
number_slider_4 = Slider(39, range=0..100)  # disabled
number_slider_5 = Slider(50, range=0..100)  # disabled
multiplication_9 = Multiplication(A=number_slider_2, B=one_over_x_2)
vec = VectorXYZ(XComponent=series, YComponent=graft(series), ZComponent=0)  # -> Vector, Length; disabled
series_3 = Series(Start=0, Step=number_slider_2, Count=addition_3)
vec_2 = VectorXYZ(XComponent=multiplication_9, YComponent=multiplication_9, ZComponent=0)  # -> Vector, Length
vec_3 = VectorXYZ(XComponent=series_3, YComponent=graft(series_3), ZComponent=0)  # -> Vector, Length
neg_2 = Negative(Value=vec_2.Vector)
lng_2 = ListLength(List=int)
move_3 = Move(Geometry=weldvertices.Mesh, Motion=vec.Vector)  # -> Geometry, Transform; disabled
pt = ConstructPoint(XCoordinate=number_slider_4, YCoordinate=number_slider_4, ZCoordinate=0)  # disabled
addition_4 = Addition(A=number_slider_4, B=number_slider_5)  # disabled
demesh_3 = DeconstructMesh(Mesh=move_3.Geometry)  # -> Vertices, Faces, Colours, Normals; disabled
move_4 = Move(Geometry=data_2, Motion=vec_3.Vector)  # -> Geometry, Transform
facen_2 = FaceNormals(Mesh=move_3.Geometry)  # -> Centers, Normals; disabled
dom = ConstructDomain(DomainStart=number_slider_4, DomainEnd=addition_4)  # disabled
scale = Scale(Geometry=move_4.Geometry, Center=Point(0, 0, 0), Factor=one_over_x)  # -> Geometry, Transform
lng_3 = ListLength(List=scale.Geometry)
multiplication_10 = Multiplication(A=lng_2, B=lng_3)
pdecon = Deconstruct(Point=facen_2.Centers)  # -> XComponent, YComponent, ZComponent; disabled
number_slider_6 = Slider(1000, range=0..1000)
move_5 = Move(Geometry=scale.Geometry, Motion=neg_2)  # -> flatten(Geometry), Transform
scale_2 = Scale(Geometry=weldvertices.Mesh, Center=Point(0, 0, 0), Factor=number_slider_6)  # -> Geometry, Transform
inc = Includes(Value=pdecon.XComponent, Domain=dom)  # -> Includes, Deviation; disabled
inc_2 = Includes(Value=pdecon.YComponent, Domain=dom)  # -> Includes, Deviation; disabled
repeat = RepeatData(Data=int, Length=multiplication_10)  # -> flatten(Data)
scale_3 = Scale(Geometry=move_5.Geometry, Center=Point(0, 0, 0), Factor=number_slider_6)  # -> Geometry, Transform
faceb = FaceBoundaries(Mesh=scale_2.Geometry)
and = GateAnd(A=inc.Includes, B=inc_2.Includes)  # disabled
demesh_4 = DeconstructMesh(Mesh=scale_3.Geometry)  # -> flatten(Vertices), Faces, Colours, Normals
neg_3 = Negative(Value=pt)  # disabled
incurves = PointInCurves(Point=demesh_4.Vertices, Curves=faceb)  # -> Relationship, Index, Point; disabled
dispatch_2 = Dispatch(List=demesh_3.Faces, DispatchPattern=and)  # -> ListA, ListB; disabled
cset = CreateSet(List=incurves.Index)  # -> Set, Map
split_2 = SplitList(List=cset.Set, Index=1)  # -> ListA, ListB
data_3 = Data(dispatch_2.ListA)  # disabled
sort = SortList(Keys=split_2.ListB, ValuesA=split_2.ListB)  # -> Keys, ValuesA
mindex = MemberIndex(Set=incurves.Index, Member=sort.ValuesA)  # -> Index, Count
conmesh_2 = ConstructMesh(Vertices=demesh_3.Vertices, Faces=data_3)  # disabled
item_2 = ListItem(List=repeat, Index=mindex.Index, Wrap=True)
weldvertices_2 = MeshWeldVertices(Mesh=conmesh_2, Tolerance=0.01)  # -> RuntimeMessage, Mesh; disabled
move_6 = Move(Geometry=weldvertices_2.Mesh, Motion=neg_3)  # -> Geometry, Transform; disabled
mjoin = MeshJoin(Meshes=flatten(move_6.Geometry))  # disabled
weldvertices_3 = MeshWeldVertices(Mesh=mjoin, Tolerance=0.01)  # -> RuntimeMessage, Mesh; disabled
number_slider_7 = Slider(2, range=0..10)  # disabled
number_slider_8 = Slider(50, range=0..100)  # disabled
number_slider_9 = Slider(0.5, range=0..1)  # disabled
move_7 = Move(Geometry=mjoin, Motion=vec.Vector)  # -> Geometry, Transform; disabled
number_slider_10 = Slider(1000, range=0..1000)  # disabled
data_4 = Data(weldvertices_3.Mesh)  # disabled
addition_5 = Addition(A=number_slider_7, B=2)  # disabled
one_over_x_3 = OneOverX(Value=number_slider_7)  # disabled
one_over_x_4 = OneOverX(Value=number_slider_7)  # disabled
medges = MeshEdges(Mesh=data_4)  # -> NakedEdges, InteriorEdges, NonManifoldEdges; disabled
multiplication_11 = Multiplication(A=number_slider_8, B=one_over_x_4)  # disabled
series_4 = Series(Start=0, Step=number_slider_8, Count=addition_5)  # disabled
vec_4 = VectorXYZ(XComponent=multiplication_11, YComponent=multiplication_11, ZComponent=0)  # -> Vector, Length; disabled
vec_5 = VectorXYZ(XComponent=series_4, YComponent=graft(series_4), ZComponent=0)  # -> Vector, Length; disabled
join_2 = JoinCurves(Curves=medges.NakedEdges, Preserve=False)  # disabled
neg_4 = Negative(Value=vec_4.Vector)  # disabled
scale_4 = Scale(Geometry=join_2, Center=Point(0, 0, 0), Factor=number_slider_10)  # -> Geometry, Transform; disabled
move_8 = Move(Geometry=data_4, Motion=vec_5.Vector)  # -> Geometry, Transform; disabled
flip_3 = FlipCurve(Curve=scale_4.Geometry)  # -> Curve, Flag; disabled
scale_5 = Scale(Geometry=move_8.Geometry, Center=Point(0, 0, 0), Factor=one_over_x_3)  # -> Geometry, Transform; disabled
move_9 = Move(Geometry=scale_5.Geometry, Motion=neg_4)  # -> flatten(Geometry), Transform; disabled
xy = XYPlane(Origin=Point(0, 0, 0))  # disabled
lng_4 = ListLength(List=move_9.Geometry)  # disabled
facen_3 = FaceNormals(Mesh=move_9.Geometry)  # -> Centers, Normals; disabled
scale_6 = Scale(Geometry=facen_3.Centers, Center=Point(0, 0, 0), Factor=number_slider_10)  # -> Geometry, Transform; disabled
demesh_5 = DeconstructMesh(Mesh=move_9.Geometry)  # -> Vertices, Faces, Colours, Normals; disabled
incurve_2 = PointInCurve(Point=scale_6.Geometry, Curve=flip_3.Curve)  # -> Relationship, Point; disabled
side = CurveSide(Curve=flip_3.Curve, Point=facen_3.Centers, Plane=xy)  # -> Side, Left, Right; disabled
equals = Equality(FirstNumber=incurve_2.Relationship, SecondNumber=0)  # -> Equality, Inequality; disabled
series_5 = Series(Start=0, Step=1, Count=lng_4)  # disabled
gradient = Gradient(
    LowerLimit=0,
    UpperLimit=lng_4,
    Parameter=series_5,
    stops=[0: RGB(243, 57, 0), 0.1: RGB(236, 27, 60), 0.2: RGB(210, 0, 118), 0.3: RGB(103, 0, 120), 0.4: RGB(39, 72, 161), 0.5: RGB(1, 192, 229), 0.6: RGB(18, 178, 90), 0.7: RGB(79, 186, 8), 0.8: RGB(220, 237, 32), 0.9: RGB(247, 159, 20), 1: RGB(243, 57, 0)])  # disabled
dispatch_3 = Dispatch(List=demesh_5.Faces, DispatchPattern=equals.Equality)  # -> ListA, ListB; disabled
preview = CustomPreview(Geometry=move_9.Geometry, Shader=gradient)  # disabled
conmesh_3 = ConstructMesh(Vertices=demesh_5.Vertices, Faces=dispatch_3.ListB)  # -> flatten(Mesh); disabled
mjoin_2 = MeshJoin(Meshes=conmesh_3)  # disabled
move_10 = Move(Geometry=mjoin_2, Motion=vec.Vector)  # -> Geometry, Transform; disabled
number_slider_11 = Slider(4, range=0..10)  # disabled
number_slider_12 = Slider(50, range=0..100)  # disabled
number_slider_13 = Slider(1000, range=0..1000)  # disabled
data_5 = Data(mjoin_2)  # disabled
addition_6 = Addition(A=number_slider_11, B=2)  # disabled
one_over_x_5 = OneOverX(Value=number_slider_11)  # disabled
one_over_x_6 = OneOverX(Value=number_slider_11)  # disabled
data_6 = Data(mjoin)  # disabled
data_7 = Data(mjoin_2)  # disabled
multiplication_12 = Multiplication(A=number_slider_12, B=one_over_x_6)  # disabled
series_6 = Series(Start=0, Step=number_slider_12, Count=addition_6)  # disabled
vec_6 = VectorXYZ(XComponent=multiplication_12, YComponent=multiplication_12, ZComponent=0)  # -> Vector, Length; disabled
scale_7 = Scale(Geometry=data_6, Center=Point(0, 0, 0), Factor=number_slider_13)  # -> Geometry, Transform; disabled
scale_8 = Scale(Geometry=data_7, Center=Point(0, 0, 0), Factor=number_slider_13)  # -> Geometry, Transform; disabled
vec_7 = VectorXYZ(XComponent=series_6, YComponent=graft(series_6), ZComponent=0)  # -> Vector, Length; disabled
neg_5 = Negative(Value=vec_6.Vector)  # disabled
facen_4 = FaceNormals(Mesh=scale_8.Geometry)  # -> Centers, Normals; disabled
faceb_2 = FaceBoundaries(Mesh=scale_7.Geometry)  # disabled
move_11 = Move(Geometry=data_5, Motion=vec_7.Vector)  # -> Geometry, Transform; disabled
incurves_2 = PointInCurves(Point=facen_4.Centers, Curves=faceb_2)  # -> Relationship, Index, Point; disabled
scale_9 = Scale(Geometry=move_11.Geometry, Center=Point(0, 0, 0), Factor=one_over_x_5)  # -> Geometry, Transform; disabled
move_12 = Move(Geometry=scale_9.Geometry, Motion=neg_5)  # -> flatten(Geometry), Transform; disabled
