# Grasshopper definition fifty-nine -duff-stuff gerduff-7-barycentric centers.gh (Grasshopper 0.9.76)
# plug-ins: MeshEdit Components, TT Toolbox

rectangle = Rectangle(Plane=PlaneXY(0, 0, 0), XSize=Slider(50, range=0..100), YSize=Slider(50, range=0..100), Radius=0)  # -> Rectangle, Length
explode = Explode(Curve=rectangle.Rectangle, Recursive=True)  # -> Segments, Vertices
item = ListItem(List=explode.Segments, Index=0, Wrap=True)  # -> Item, Item1, Item2, Item3
number_slider = Slider(10, range=0..100)
flip = FlipCurve(Curve=item.Item)  # -> Curve, Flag
flip_2 = FlipCurve(Curve=item.Item1)  # -> Curve, Flag
merge = Merge(Data1=flip.Curve, Data2=item.Item2)
merge_2 = Merge(Data1=flip_2.Curve, Data2=item.Item3)
divide = DivideCurve(Curve=reparameterize(merge_2), Count=number_slider, Kinks=False)  # -> Points, Tangents, Parameters
pi = Pi(Factor=Slider(3, range=0..10))
pi_2 = Pi(Factor=Slider(6, range=0..10))
divide_2 = DivideCurve(Curve=reparameterize(merge), Count=number_slider, Kinks=False)  # -> Points, Tangents, Parameters
multiplication = Multiplication(A=divide.Parameters, B=pi)
multiplication_2 = Multiplication(A=divide.Parameters, B=pi_2)
pi_3 = Pi(Factor=Slider(5, range=0..10))
pi_4 = Pi(Factor=Slider(1, range=0..10))
sin = Sine(Value=multiplication_2)
sin_2 = Sine(Value=multiplication)
multiplication_3 = Multiplication(A=divide_2.Parameters, B=pi_4)
multiplication_4 = Multiplication(A=divide_2.Parameters, B=pi_3)
multiplication_5 = Multiplication(A=sin_2, B=Slider(3, range=0..10))
multiplication_6 = Multiplication(A=sin, B=Slider(2, range=0..10))
sin_3 = Sine(Value=multiplication_4)
sin_4 = Sine(Value=multiplication_3)
addition = Addition(A=multiplication_5, B=multiplication_6)
X = UnitX(Factor=addition)
multiplication_7 = Multiplication(A=sin_4, B=Slider(6, range=0..10))
multiplication_8 = Multiplication(A=sin_3, B=Slider(2, range=0..10))
move = Move(Geometry=divide.Points, Motion=X)  # -> Geometry, Transform
addition_2 = Addition(A=multiplication_7, B=multiplication_8)
Y = UnitY(Factor=addition_2)
move_2 = Move(Geometry=divide_2.Points, Motion=Y)  # -> Geometry, Transform
pline = PolyLine(Vertices=move.Geometry, Closed=False)  # -> flatten(Polyline)
pline_2 = PolyLine(Vertices=move_2.Geometry, Closed=False)  # -> flatten(Polyline)
merge_3 = Merge(Data1=pline_2, Data2=pline)
item_2 = ListItem(List=pline_2, Index=0, Wrap=True)  # -> Item1, Item
item_3 = ListItem(List=pline, Index=0, Wrap=True)  # -> Item1, Item
item_4 = ListItem(List=pline_2, Index=0, Wrap=True)  # -> Item1, Item
item_5 = ListItem(List=pline, Index=0, Wrap=True)  # -> Item1, Item
join = JoinCurves(Curves=merge_3, Preserve=False)
data = Data(item_2.Item1)
data_2 = Data(item_4.Item)
data_3 = Data(item_3.Item)
data_4 = Data(item_5.Item1)
neg = Negative(Value=Slider(2.8633, range=0..10))
explode_2 = Explode(Curve=join, Recursive=True)  # -> Segments, Vertices
data_5 = Data(join)
offset = Offset(Curve=join, Distance=neg, Plane=PlaneXY(0, 0, 0), Corners=1)
join_2 = JoinCurves(Curves=[data, data_3], Preserve=False)
join_3 = JoinCurves(Curves=[data_2, data_4], Preserve=False)
explode_3 = Explode(Curve=data, Recursive=True)  # -> Segments, Vertices
explode_4 = Explode(Curve=data_2, Recursive=True)  # -> Segments, Vertices
srf = Surface(offset)
explode_5 = Explode(Curve=data_3, Recursive=True)  # -> Segments, Vertices
explode_6 = Explode(Curve=data_4, Recursive=True)  # -> Segments, Vertices
split = SplitList(List=explode_3.Vertices, Index=1)  # -> ListA, ListB
split_2 = SplitList(List=explode_4.Vertices, Index=1)  # -> ListA, ListB
split_3 = SplitList(List=explode_6.Vertices, Index=1)  # -> ListA, ListB
split_4 = SplitList(List=explode_2.Vertices, Index=1)  # -> ListA, ListB
popgeo = PopulateGeometry(Geometry=srf, Count=Slider(100, range=0..1000), Seed=Slider(22, range=0..100))
split_5 = SplitList(List=explode_5.Vertices, Index=1)  # -> ListA, ListB
split_6 = SplitList(List=reverse(split_2.ListB), Index=1)  # -> ListA, reverse(ListB)
split_7 = SplitList(List=reverse(split_3.ListB), Index=1)  # -> ListA, reverse(ListB)
merge_4 = Merge(Data1=split_4.ListB, Data2=popgeo)
split_8 = SplitList(List=reverse(split.ListB), Index=1)  # -> ListA, reverse(ListB)
split_9 = SplitList(List=reverse(split_6.ListB), Index=1)  # -> ListA, reverse(ListB)
split_10 = SplitList(List=reverse(split_5.ListB), Index=1)  # -> ListA, reverse(ListB)
del = DelaunayMesh(Points=merge_4, Plane=PlaneXY(0, 0, 0))
split_11 = SplitList(List=reverse(split_7.ListB), Index=1)  # -> ListA, reverse(ListB)
data_6 = Data(split_5.ListB)
split_12 = SplitList(List=split_8.ListB, Index=1)  # -> ListA, reverse(ListB)
facen = FaceNormals(Mesh=del)  # -> Centers, Normals
data_7 = Data(split_7.ListA)
incurve = PointInCurve(Point=facen.Centers, Curve=data_5)  # -> Relationship, Point
data_8 = Data(split_5.ListA)
demesh = DeconstructMesh(Mesh=del)  # -> Vertices, Faces, Colours, Normals
number_slider_2 = Slider(12.5, range=0..100)
dispatch = Dispatch(List=demesh.Faces, DispatchPattern=incurve.Relationship)  # -> ListA, ListB
conmesh = ConstructMesh(Vertices=demesh.Vertices, Faces=dispatch.ListA)
pt = ConstructPoint(XCoordinate=number_slider_2, YCoordinate=number_slider_2, ZCoordinate=0)
data_9 = Data(split.ListB)
data_10 = Data(data_6)
data_11 = Data(split_2.ListB)
data_12 = Data(data_8)
data_13 = Data(split_3.ListB)
data_14 = Data(data_7)
weldvertices = MeshWeldVertices(Mesh=conmesh, Tolerance=0.01)  # -> RuntimeMessage, Mesh
move_3 = Move(Geometry=weldvertices.Mesh, Motion=pt)  # -> Geometry, Transform
demesh_2 = DeconstructMesh(Mesh=weldvertices.Mesh)  # -> Vertices, Faces, Colours, Normals
cp = ClosestPoint(Point=data_12, Cloud=demesh_2.Vertices)  # -> ClosestPoint, CPIndex, Distance
cp_2 = ClosestPoint(Point=data_10, Cloud=demesh_2.Vertices)  # -> ClosestPoint, CPIndex, Distance
cp_3 = ClosestPoint(Point=data_9, Cloud=demesh_2.Vertices)  # -> ClosestPoint, CPIndex, Distance
cp_4 = ClosestPoint(Point=data_14, Cloud=demesh_2.Vertices)  # -> ClosestPoint, CPIndex, Distance
cp_5 = ClosestPoint(Point=data_13, Cloud=demesh_2.Vertices)  # -> ClosestPoint, CPIndex, Distance
cp_6 = ClosestPoint(Point=data_11, Cloud=demesh_2.Vertices)  # -> ClosestPoint, CPIndex, Distance
deface = DeconstructFace(Face=demesh_2.Faces)  # -> CornerA, CornerB, CornerC, CornerD
Y_2 = UnitY(Factor=1)
vec = VectorXYZ(XComponent=0, YComponent=0, ZComponent=0)  # -> Vector, Length
X_2 = UnitX(Factor=1)
split_13 = SplitList(List=demesh_2.Vertices, Index=Slider(14, range=0..100))  # -> ListA, ListB
lng = ListLength(List=cp_2.CPIndex)
merge_5 = Merge(Data1=cp_4.CPIndex, Data2=cp_5.CPIndex, Data3=cp_6.CPIndex)
lng_2 = ListLength(List=cp_3.CPIndex)
lng_3 = ListLength(List=demesh_2.Vertices)
merge_6 = Merge(Data1=cp.CPIndex, Data2=cp_2.CPIndex, Data3=cp_3.CPIndex)  # -> flatten(Result)
merge_7 = Merge(Data1=graft(deface.CornerA), Data2=graft(deface.CornerB), Data3=graft(deface.CornerC))  # -> flatten(Result)
repeat = RepeatData(Data=X_2, Length=lng)
lng_4 = ListLength(List=merge_7)
repeat_2 = RepeatData(Data=Y_2, Length=lng_2)
data_15 = Data(demesh_2.Vertices)
data_16 = Data(split_13.ListA)
series = Series(Start=0, Step=1, Count=lng_3)
replace = ReplaceItems(List=demesh_2.Vertices, Indices=merge_6, Wrap=False)
clean = CleanTree(RemoveNulls=True, RemoveInvalid=True, RemoveEmpty=False, Tree=replace)
repeat_3 = RepeatData(Data=vec.Vector, Length=lng_4)
series_2 = Series(Start=0, Step=1, Count=Slider(119, range=0..1000))
X_3 = UnitX(Factor=1)
int = Integer(series)
Y_3 = UnitY(Factor=1)
mindex = MemberIndex(Set=merge_7, Member=cp_3.CPIndex)  # -> flatten(Index), Count
mindex_2 = MemberIndex(Set=merge_7, Member=cp.CPIndex)  # -> flatten(Index), Count
mindex_3 = MemberIndex(Set=merge_7, Member=cp_2.CPIndex)  # -> flatten(Index), Count
int_2 = Integer(series_2)
replace_2 = ReplaceMembers(Set=merge_7, Find=flatten(merge_6), Replace=flatten(merge_5))
cset = CreateSet(List=replace_2)  # -> Set, Map
replace_3 = ReplaceMembers(Set=int, Find=flatten(merge_6), Replace=flatten(merge_5))
data_17 = Data(clean)
addition_3 = Addition(A=Y_3, B=X_3)
sort = SortList(Keys=flatten(cset.Set), ValuesA=flatten(cset.Set))  # -> Keys, ValuesA
cset_2 = CreateSet(List=replace_3)  # -> Set, Map
lng_5 = ListLength(List=cset.Set)
replace_4 = ReplaceItems(List=repeat_3, Item=addition_3, Indices=mindex_2.Index, Wrap=False)
sort_2 = SortList(Keys=flatten(cset_2.Set), ValuesA=flatten(cset_2.Set))  # -> Keys, ValuesA
mindex_4 = MemberIndex(Set=replace_2, Member=sort.ValuesA)  # -> Index, Count
series_3 = Series(Start=0, Step=1, Count=lng_5)
replace_5 = ReplaceItems(List=replace_4, Item=X_2, Indices=mindex_3.Index, Wrap=False)
mindex_5 = MemberIndex(Set=replace_3, Member=sort_2.ValuesA)  # -> Index, Count
int_3 = Integer(series_3)
repeat_4 = RepeatData(Data=graft(int_3), Length=graft(mindex_4.Count))  # -> flatten(Data)
replace_6 = ReplaceItems(List=replace_5, Item=Y_2, Indices=mindex.Index, Wrap=False)
item_6 = ListItem(List=int_2, Index=mindex_5.Index, Wrap=False)  # -> flatten(Item)
data_18 = Data(flatten(mindex_5.Index))
multiplication_9 = Multiplication(A=replace_6, B=Slider(50, range=0..100))
item_7 = ListItem(List=int_3, Index=mindex_4.Index, Wrap=True)
sort_3 = SortList(Keys=flatten(mindex_4.Index), ValuesA=flatten(repeat_4))  # -> Keys, ValuesA
replace_7 = ReplaceItems(List=data_18, Item=int_2, Indices=int_2, Wrap=False)
replace_8 = ReplaceMembers(Set=data_18, Find=sort_2.ValuesA, Replace=int_2)
item_8 = ListItem(List=data_17, Index=sort_3.ValuesA, Wrap=False)
facen_2 = FaceNormals(Mesh=weldvertices.Mesh)  # -> Centers, Normals
move_4 = Move(Geometry=item_8, Motion=multiplication_9)  # -> Geometry, Transform
pt_2 = Point(clean)
int_4 = Integer(sort_3.ValuesA)
vec_2 = Vector(replace_6)
int_5 = Integer(replace_8)
multiplication_10 = Multiplication(A=vec_2, B=Slider(50, range=0..100))
item_9 = ListItem(List=pt_2, Index=int_4, Wrap=True)
move_5 = Move(Geometry=item_9, Motion=multiplication_10)  # -> Geometry, Transform
pt_3 = Point(Point(0, 0, 0))
lng_6 = ListLength(List=facen_2.Centers)
repeat_5 = RepeatData(Data=pt_3, Length=lng_6)
partition = PartitionList(List=move_5.Geometry, Size=3)
pline_3 = PolyLine(Vertices=partition, Closed=True)
data_19 = Data(vec_2)
data_20 = Data(pt_2)
lng_7 = ListLength(List=data_20)
data_21 = Data(facen_2.Centers)
data_22 = Data(repeat_5)
data_23 = Data(int_4)
pdecon = Deconstruct(Point=data_20)  # -> XComponent, YComponent, ZComponent
pdecon_2 = Deconstruct(Point=data_19)  # -> XComponent, YComponent, ZComponent
repeat_6 = RepeatData(Data=",", Length=expr("x-1", lng_7))
lng_8 = ListLength(List=data_19)
concat = Concatenate(
    FragmentA="new Vector3(",
    FragmentB=pdecon.XComponent,
    FragmentC="f,",
    FragmentD=pdecon.YComponent,
    FragmentE="f,",
    FragmentF=pdecon.ZComponent,
    FragmentG="f)")
int_6 = Integer(pdecon_2.XComponent)
lng_9 = ListLength(List=data_23)
int_7 = Integer(pdecon_2.YComponent)
lng_10 = ListLength(List=data_21)
panel = Panel("f)")
lng_11 = ListLength(List=data_22)
merge_8 = Merge(Data1=flatten(repeat_6), Data2=flatten("};"))
pdecon_3 = Deconstruct(Point=data_21)  # -> XComponent, YComponent, ZComponent
pdecon_4 = Deconstruct(Point=data_22)  # -> XComponent, YComponent, ZComponent
repeat_7 = RepeatData(Data=",", Length=expr("x-1", lng_8))
repeat_8 = RepeatData(Data=",", Length=expr("x-1", lng_9))
int_8 = Integer(pdecon_4.XComponent)
int_9 = Integer(pdecon_4.YComponent)
repeat_9 = RepeatData(Data=",", Length=expr("x-1", lng_10))
concat_2 = Concatenate(FragmentA="new Vector2Int(", FragmentB=int_6, FragmentC=",", FragmentD=int_7, FragmentG=")")
repeat_10 = RepeatData(Data=",", Length=expr("x-1", lng_11))
concat_3 = Concatenate(FragmentA=data_23)
merge_9 = Merge(Data1=flatten(repeat_7), Data2=flatten("};"))
concat_4 = Concatenate(
    FragmentA="new Vector3(",
    FragmentB=pdecon_3.XComponent,
    FragmentC="f,",
    FragmentD=pdecon_3.YComponent,
    FragmentE="f,",
    FragmentF=pdecon_3.ZComponent,
    FragmentG="f)")
concat_5 = Concatenate(FragmentA=concat, FragmentB=merge_8)
concat_6 = Concatenate(FragmentA="new Vector2Int(", FragmentB=int_8, FragmentC=",", FragmentD=int_9, FragmentG=")")
merge_10 = Merge(Data1=flatten(repeat_8), Data2=flatten("};"))
split_14 = SplitList(List=concat_5, Index=1)  # -> ListA, ListB
merge_11 = Merge(Data1=flatten(repeat_9), Data2=flatten("};"))
merge_12 = Merge(Data1=flatten(repeat_10), Data2=flatten("};"))
concat_7 = Concatenate(FragmentA="var pts = Vector3[]{", FragmentB=split_14.ListA)
concat_8 = Concatenate(FragmentA=concat_2, FragmentB=merge_9)
split_15 = SplitList(List=concat_8, Index=1)  # -> ListA, ListB
concat_9 = Concatenate(FragmentA=concat_3, FragmentB=merge_10)
split_16 = SplitList(List=concat_9, Index=1)  # -> ListA, ListB
merge_13 = Merge(Data1=concat_7, Data2=split_14.ListB)
concat_10 = Concatenate(FragmentA=concat_4, FragmentB=merge_11)
concat_11 = Concatenate(FragmentA=concat_6, FragmentB=merge_12)
split_17 = SplitList(List=concat_10, Index=1)  # -> ListA, ListB
split_18 = SplitList(List=concat_11, Index=1)  # -> ListA, ListB
concat_12 = Concatenate(FragmentA="var pts = Vector3[]{", FragmentB=split_15.ListA)
concat_13 = Concatenate(FragmentA="var indexes = new int[]{", FragmentB=split_16.ListA)
concat_14 = Concatenate(FragmentA="Centers = Vector3[]{", FragmentB=split_17.ListA)
concat_15 = Concatenate(FragmentA="Offsets = Vector2Int[]{", FragmentB=split_18.ListA)
merge_14 = Merge(Data1=concat_12, Data2=split_15.ListB)
merge_15 = Merge(Data1=concat_13, Data2=split_16.ListB)
merge_16 = Merge(Data1=concat_14, Data2=split_17.ListB)
merge_17 = Merge(Data1=concat_15, Data2=split_18.ListB)
panel_2 = Panel(merge_13)
join_4 = TextJoin(Text=merge_15)
panel_3 = Panel(merge_14)
panel_4 = Panel(join_4)
panel_5 = Panel(merge_16)
panel_6 = Panel(merge_17)
number_slider_3 = Slider(50, range=0..100)
number_slider_4 = Slider(4, range=0..10)
pt_4 = Point(pt_2)
int_10 = Integer(int_4)
vec_3 = Vector(vec_2)
centers = Data(facen_2.Centers)
lng_12 = ListLength(List=int_10)
lng_13 = ListLength(List=pt_4)
multiplication_11 = Multiplication(A=vec_3, B=Slider(50, range=0..100))
addition_4 = Addition(A=number_slider_4, B=2)
one_over_x = OneOverX(Value=number_slider_4)
division = Division(A=lng_12, B=3)
one_over_x_2 = OneOverX(Value=number_slider_4)
item_10 = ListItem(List=pt_4, Index=int_10, Wrap=True)
int_11 = Integer(division)
series_4 = Series(Start=0, Step=1, Count=int_11)
int_12 = Integer(series_4)
multiplication_12 = Multiplication(A=number_slider_3, B=one_over_x_2)
series_5 = Series(Start=0, Step=number_slider_3, Count=addition_4)
move_6 = Move(Geometry=item_10, Motion=multiplication_11)  # -> Geometry, Transform
vec_4 = VectorXYZ(XComponent=multiplication_12, YComponent=multiplication_12, ZComponent=0)  # -> Vector, Length
lng_14 = ListLength(List=pt_4)
randlist = RandomListLength(R=Domain(-1, 1), L=move_6.Geometry, S=2)
vec_5 = VectorXYZ(XComponent=series_5, YComponent=graft(series_5), ZComponent=0)  # -> flatten(Vector), Length
series_6 = Series(Start=0, Step=Slider(1, range=0..100), Count=addition_4)
partition_2 = PartitionList(List=move_6.Geometry, Size=3)
neg_2 = Negative(Value=vec_4.Vector)
series_7 = Series(Start=0, Step=1, Count=lng_13)
vec_6 = VectorXYZ(XComponent=randlist, YComponent=reverse(randlist), ZComponent=0)  # -> Vector, Length
int_13 = Integer(series_6)
move_7 = Move(Geometry=centers, Motion=graft(vec_5.Vector))  # -> Geometry, Transform
move_8 = Move(Geometry=pt_4, Motion=graft(vec_5.Vector))  # -> Geometry, Transform
pline_4 = PolyLine(Vertices=partition_2, Closed=True)  # -> flatten(Polyline)
concat_16 = Concatenate(FragmentA=int_13, FragmentB=",", FragmentC=graft(int_13))  # -> flatten(Result)
repeat_11 = RepeatData(Data=graft(concat_16), Length=int_11)  # -> flatten(Data)
multiplication_13 = Multiplication(A=vec_6.Vector, B=Slider(0.5, range=0..1))
move_9 = Move(Geometry=move_6.Geometry, Motion=multiplication_13)  # -> Geometry, Transform
tag = TextTag(Location=move_9.Geometry, Text=int_10)
int_14 = Integer(series_7)
scale = Scale(Geometry=move_7.Geometry, Center=Point(0, 0, 0), Factor=one_over_x)  # -> Geometry, Transform
scale_2 = Scale(Geometry=move_8.Geometry, Center=Point(0, 0, 0), Factor=one_over_x)  # -> Geometry, Transform
lng_15 = ListLength(List=int_14)
number_slider_5 = Slider(1000, range=0..1000)
lng_16 = ListLength(List=flatten(vec_5.Vector))
move_10 = Move(Geometry=scale_2.Geometry, Motion=neg_2)  # -> flatten(Geometry), Transform
move_11 = Move(Geometry=scale.Geometry, Motion=neg_2)  # -> flatten(Geometry), Transform
quad = MeshQuad(CornerA=0, CornerB=1, CornerC=2, CornerD=2)
scale_3 = Scale(Geometry=repeat_11, Center=Point(0, 0, 0), Factor=number_slider_5)  # -> Geometry, Transform
multiplication_14 = Multiplication(A=lng_15, B=lng_16)
lng_17 = ListLength(List=move_11.Geometry)
repeat_12 = RepeatData(Data=int_12, Length=lng_17)
conmesh_2 = ConstructMesh(Vertices=partition_2, Faces=quad)
repeat_13 = RepeatData(Data=graft(concat_16), Length=lng_14)  # -> flatten(Data)
repeat_14 = RepeatData(Data=graft(concat_16), Length=lng_14)  # -> flatten(Data)
scale_4 = Scale(Geometry=pline_4, Center=Point(0, 0, 0), Factor=number_slider_5)  # -> Geometry, Transform
number_slider_6 = Slider(3, range=0..10)
repeat_15 = RepeatData(Data=int_14, Length=multiplication_14)  # -> flatten(Data)
scale_5 = Scale(Geometry=move_10.Geometry, Center=Point(0, 0, 0), Factor=number_slider_5)  # -> Geometry, Transform
scale_6 = Scale(Geometry=move_11.Geometry, Center=Point(0, 0, 0), Factor=number_slider_5)  # -> Geometry, Transform
lng_18 = ListLength(List=scale_4.Geometry)
series_8 = Series(Start=0, Step=1, Count=lng_18)
incurves = PointInCurves(Point=scale_5.Geometry, Curves=scale_4.Geometry)  # -> Relationship, Index, Point
incurves_2 = PointInCurves(Point=scale_6.Geometry, Curves=scale_4.Geometry)  # -> Relationship, Index, Point
int_15 = Integer(series_8)
lng_19 = ListLength(List=repeat_14)
mindex_6 = MemberIndex(Set=incurves.Index, Member=int_15)  # -> Index, Count
mindex_7 = MemberIndex(Set=incurves_2.Index, Member=int_15)  # -> Index, Count
data_24 = Data(data_19)
item_11 = ListItem(List=move_11.Geometry, Index=mindex_7.Index, Wrap=True)
item_12 = ListItem(List=repeat_14, Index=mindex_6.Index, Wrap=True)
split_19 = TextSplit(Text=item_12, Separators=",")
repeat_16 = RepeatData(Data=data_24, Length=lng_19)
item_13 = ListItem(List=repeat_16, Index=mindex_6.Index, Wrap=True)
item_14 = ListItem(List=repeat_14, Index=mindex_6.Index, Wrap=True)
item_15 = ListItem(List=repeat_13, Index=mindex_6.Index, Wrap=True)
int_16 = Integer(split_19)
item_16 = ListItem(List=repeat_15, Index=mindex_6.Index, Wrap=True)
item_17 = ListItem(List=move_10.Geometry, Index=mindex_6.Index, Wrap=True)
partition_3 = PartitionList(List=int_10, Size=3)
pdecon_5 = Deconstruct(Point=item_13)  # -> XComponent, YComponent, ZComponent
item_18 = ListItem(List=int_16, Index=0, Wrap=True)  # -> Item, Item1
item_19 = ListItem(List=repeat_14, Index=mindex_6.Index, Wrap=True)
match = MatchTreeStructure(DataList=flatten(pdecon_5.YComponent), TreeMask=item_18.Item)
match_2 = MatchTreeStructure(DataList=flatten(pdecon_5.XComponent), TreeMask=item_18.Item)
panel_7 = Panel(pdecon_5.YComponent)
split_20 = TextSplit(Text=item_19, Separators=", ")
addition_5 = Addition(A=match, B=item_18.Item1)
addition_6 = Addition(A=match_2, B=item_18.Item)
meshcp = MeshClosestPoint(Point=item_11, Mesh=conmesh_2)  # -> Point, Index, Parameter
meshcp_2 = MeshClosestPoint(Point=item_17, Mesh=conmesh_2)  # -> Point, Index, Parameter
data_25 = Data(meshcp_2.Parameter)
split_21 = TextSplit(Text=data_25, Separators="[];")
item_20 = ListItem(List=split_21, Index=0, Wrap=True)  # -> Item, Item1, Item2, Item3, Item4
merge_18 = Merge(Data1=item_20.Item3, Data2=item_20.Item2, Data3=item_20.Item1)
join_5 = TextJoin(Text=merge_18, Join="f,")
int_17 = Integer(addition_5)
int_18 = Integer(addition_6)
multiplication_15 = Multiplication(A=split_20, B=Slider(50, range=0..100))
item_21 = ListItem(List=multiplication_15, Index=0, Wrap=True)  # -> Item, Item1
data_26 = Data(meshcp_2.Parameter)
concat_17 = Concatenate(FragmentA="new Vector3(", FragmentB=join_5, FragmentC="f)")
vec_7 = VectorXYZ(XComponent=item_21.Item, YComponent=item_21.Item1, ZComponent=0)  # -> Vector, Length
concat_18 = Concatenate(FragmentA=int_18, FragmentC=",", FragmentB=int_17)
concat_19 = Concatenate(FragmentA="new Vector2Int(", FragmentB=item_12, FragmentC=")")
data_27 = Data(concat_19)
trim = TrimTree(Tree=concat_17, Depth=1)
lng_20 = ListLength(List=data_27)
split_22 = TextSplit(Text=data_26, Separators="[];")
data_28 = Data(trim)
trim_2 = TrimTree(Tree=concat_18, Depth=1)
trim_3 = TrimTree(Tree=vec_7.Vector, Depth=1)
lng_21 = ListLength(List=data_28)
lng_22 = ListLength(List=lng_20)
panel_8 = Panel("var relationships= new Vector2Int[][]{")
panel_9 = Panel(item_12)
item_22 = ListItem(List=split_22, Index=0, Wrap=True)  # -> Item, Item1, Item2, Item3, Item4
lng_23 = ListLength(List=lng_21)
panel_10 = Panel("Barycenters = new Vector3[][]{")
move_12 = Move(Motion=trim_3)  # -> Geometry, Transform
repeat_17 = RepeatData(Data=",", Length=expr("x-1", lng_20))
merge_19 = Merge(Data1=item_22.Item3, Data2=item_22.Item2, Data3=item_22.Item1)
data_29 = Data(merge_19)
trim_4 = TrimTree(Tree=data_29, Depth=1)
lng_24 = ListLength(List=trim_4)
repeat_18 = RepeatData(Data=partition_3, Length=lng_24)
trim_5 = TrimTree(Tree=repeat_18, Depth=1)
partition_4 = PartitionList(List=trim_5, Size=3)
sort_4 = SortList(Keys=data_29, ValuesA=partition_4)  # -> Keys, ValuesA
item_23 = ListItem(List=sort_4.ValuesA, Index=0, Wrap=True)
trim_6 = TrimTree(Tree=item_23, Depth=1)  # -> flatten(Tree)
mindex_8 = MemberIndex(Set=trim_6, Member=int_14)  # -> Index, Count
item_24 = ListItem(List=repeat_12, Index=mindex_8.Index, Wrap=True)
concat_20 = Concatenate(FragmentA=item_24)
repeat_19 = RepeatData(Data="}", Length=expr("x", lng_22))
panel_12 = Panel(trim_2)
repeat_20 = RepeatData(Data="new Vector2Int[]{", Length=expr("x", lng_22))
join_6 = TextJoin(Text=data_27, Join=",")
repeat_21 = RepeatData(Data=",", Length=expr("x-1", lng_21))
item_25 = ListItem(List=repeat_14, Index=mindex_6.Index, Wrap=True)
repeat_22 = RepeatData(Data="}", Length=expr("x", lng_23))
repeat_23 = RepeatData(Data="new Vector3[]{", Length=expr("x", lng_23))
join_7 = TextJoin(Join=",")
concat_21 = Concatenate()
join_8 = TextJoin(Text=data_28, Join=",")
merge_20 = Merge(Data1=flatten(repeat_20), Data2=flatten("};"))
concat_22 = Concatenate()
scale_7 = Scale(Geometry=move_12.Geometry, Center=Point(0, 0, 0), Factor=Slider(0.25, range=0..1))  # -> Geometry, Transform
merge_21 = Merge(Data1=flatten(repeat_23), Data2=flatten("};"))
panel_14 = Panel(join_7)
concat_23 = Concatenate(FragmentA=repeat_20, FragmentC=join_6, FragmentB=repeat_19, FragmentD=",")  # -> flatten(Result)
concat_24 = Concatenate(FragmentA=concat_21, FragmentB=merge_20)
split_23 = SplitList(List=concat_24, Index=1)  # -> ListA, ListB
concat_25 = Concatenate(FragmentA=repeat_23, FragmentC=join_8, FragmentB=repeat_22, FragmentD=",")  # -> flatten(Result)
concat_26 = Concatenate(FragmentA=concat_22, FragmentB=merge_21)
split_24 = SplitList(List=concat_26, Index=1)  # -> ListA, ListB
concat_27 = Concatenate(FragmentA="new int[]{", FragmentB=join_7, FragmentC="}")
join_9 = TextJoin(Text=concat_23, Join=", ")
concat_28 = Concatenate(FragmentA=panel_8, FragmentB=join_9, FragmentC="};")
panel_15 = Panel(item_24)
join_10 = TextJoin(Text=concat_25, Join=", ")
concat_29 = Concatenate(FragmentA=panel_10, FragmentB=join_10, FragmentC="};")
data_30 = Data(concat_27)
panel_16 = Panel("new Vector2Int[]{")
merge_22 = Merge(Data1=panel_8, Data2=concat_23, Data3="};")
merge_23 = Merge(Data1=panel_10, Data2=concat_25, Data3="};")
panel_17 = Panel(merge_22)
panel_18 = Panel("var relationships= int[][]{")
join_11 = TextJoin(Text=flatten(data_30), Join=",")
panel_20 = Panel(merge_23)
panel_21 = Panel(",")
join_12 = TextJoin(Text=join_11, Join=", ")
concat_30 = Concatenate(FragmentA=panel_18, FragmentB=flatten(join_11), FragmentC="};")
merge_24 = Merge(Data1=panel_18, Data2=join_12, Data3="};")
panel_22 = Panel(merge_24)

# ==== cluster RandomListLength
L = ClusterInput()
lng = ListLength(List=L)
R = ClusterInput()
S = ClusterInput()
random = Random(Range=R, Number=lng, Seed=S)
R_2 = ClusterOutput(random)
