# Grasshopper definition fifty-nine -duff-stuff gerduff.gh (Grasshopper 0.9.76)
# plug-ins: MeshEdit Components, TT Toolbox

rectangle = Rectangle(Plane=PlaneXY(0, 0, 0), XSize=Slider(50, range=0..100), YSize=Slider(50, range=0..100), Radius=0)  # -> Rectangle, Length
explode = Explode(Curve=rectangle.Rectangle, Recursive=True)  # -> Segments, Vertices
item = ListItem(List=explode.Segments, Index=0, Wrap=True)  # -> Item, Item1, Item2, Item3
number_slider = Slider(10, range=0..100)
flip = FlipCurve(Curve=item.Item)  # -> Curve, Flag
flip_2 = FlipCurve(Curve=item.Item1)  # -> Curve, Flag
merge = Merge(Data1=flip.Curve, Data2=item.Item2)
merge_2 = Merge(Data1=flip_2.Curve, Data2=item.Item3)
divide = DivideCurve(Curve=reparameterize(merge_2), Count=number_slider, Kinks=False)  # -> Points, Tangents, Parameters
pi = Pi(Factor=Slider(3, range=0..10))
pi_2 = Pi(Factor=Slider(6, range=0..10))
divide_2 = DivideCurve(Curve=reparameterize(merge), Count=number_slider, Kinks=False)  # -> Points, Tangents, Parameters
multiplication = Multiplication(A=divide.Parameters, B=pi)
multiplication_2 = Multiplication(A=divide.Parameters, B=pi_2)
pi_3 = Pi(Factor=Slider(5, range=0..10))
pi_4 = Pi(Factor=Slider(1, range=0..10))
sin = Sine(Value=multiplication_2)
sin_2 = Sine(Value=multiplication)
multiplication_3 = Multiplication(A=divide_2.Parameters, B=pi_4)
multiplication_4 = Multiplication(A=divide_2.Parameters, B=pi_3)
multiplication_5 = Multiplication(A=sin_2, B=Slider(3, range=0..10))
multiplication_6 = Multiplication(A=sin, B=Slider(2, range=0..10))
sin_3 = Sine(Value=multiplication_4)
sin_4 = Sine(Value=multiplication_3)
addition = Addition(A=multiplication_5, B=multiplication_6)
X = UnitX(Factor=addition)
multiplication_7 = Multiplication(A=sin_4, B=Slider(6, range=0..10))
multiplication_8 = Multiplication(A=sin_3, B=Slider(2, range=0..10))
move = Move(Geometry=divide.Points, Motion=X)  # -> Geometry, Transform
addition_2 = Addition(A=multiplication_7, B=multiplication_8)
Y = UnitY(Factor=addition_2)
move_2 = Move(Geometry=divide_2.Points, Motion=Y)  # -> Geometry, Transform
pline = PolyLine(Vertices=move.Geometry, Closed=False)  # -> flatten(Polyline)
pline_2 = PolyLine(Vertices=move_2.Geometry, Closed=False)  # -> flatten(Polyline)
merge_3 = Merge(Data1=pline_2, Data2=pline)
item_2 = ListItem(List=pline_2, Index=0, Wrap=True)  # -> Item1, Item
item_3 = ListItem(List=pline, Index=0, Wrap=True)  # -> Item1, Item
item_4 = ListItem(List=pline_2, Index=0, Wrap=True)  # -> Item1, Item
item_5 = ListItem(List=pline, Index=0, Wrap=True)  # -> Item1, Item
join = JoinCurves(Curves=merge_3, Preserve=False)
data = Data(item_2.Item1)
data_2 = Data(item_4.Item)
data_3 = Data(item_3.Item)
data_4 = Data(item_5.Item1)
neg = Negative(Value=Slider(2.8633, range=0..10))
explode_2 = Explode(Curve=join, Recursive=True)  # -> Segments, Vertices
data_5 = Data(join)
offset = Offset(Curve=join, Distance=neg, Plane=PlaneXY(0, 0, 0), Corners=1)
join_2 = JoinCurves(Curves=[data, data_3], Preserve=False)
join_3 = JoinCurves(Curves=[data_2, data_4], Preserve=False)
explode_3 = Explode(Curve=data, Recursive=True)  # -> Segments, Vertices
explode_4 = Explode(Curve=data_2, Recursive=True)  # -> Segments, Vertices
srf = Surface(offset)
explode_5 = Explode(Curve=data_3, Recursive=True)  # -> Segments, Vertices
explode_6 = Explode(Curve=data_4, Recursive=True)  # -> Segments, Vertices
split = SplitList(List=explode_3.Vertices, Index=1)  # -> ListA, ListB
split_2 = SplitList(List=explode_4.Vertices, Index=1)  # -> ListA, ListB
split_3 = SplitList(List=explode_6.Vertices, Index=1)  # -> ListA, ListB
split_4 = SplitList(List=explode_2.Vertices, Index=1)  # -> ListA, ListB
popgeo = PopulateGeometry(Geometry=srf, Count=Slider(100, range=0..1000), Seed=Slider(22, range=0..100))
split_5 = SplitList(List=explode_5.Vertices, Index=1)  # -> ListA, ListB
split_6 = SplitList(List=reverse(split_2.ListB), Index=1)  # -> ListA, reverse(ListB)
split_7 = SplitList(List=reverse(split_3.ListB), Index=1)  # -> ListA, reverse(ListB)
merge_4 = Merge(Data1=split_4.ListB, Data2=popgeo)
split_8 = SplitList(List=reverse(split.ListB), Index=1)  # -> ListA, reverse(ListB)
split_9 = SplitList(List=reverse(split_6.ListB), Index=1)  # -> ListA, reverse(ListB)
split_10 = SplitList(List=reverse(split_5.ListB), Index=1)  # -> ListA, reverse(ListB)
del = DelaunayMesh(Points=merge_4, Plane=PlaneXY(0, 0, 0))
split_11 = SplitList(List=reverse(split_7.ListB), Index=1)  # -> ListA, reverse(ListB)
data_6 = Data(split_5.ListB)
split_12 = SplitList(List=split_8.ListB, Index=1)  # -> ListA, reverse(ListB)
facen = FaceNormals(Mesh=del)  # -> Centers, Normals
data_7 = Data(split_7.ListA)
incurve = PointInCurve(Point=facen.Centers, Curve=data_5)  # -> Relationship, Point
data_8 = Data(split_5.ListA)
demesh = DeconstructMesh(Mesh=del)  # -> Vertices, Faces, Colours, Normals
number_slider_2 = Slider(12.5, range=0..100)
dispatch = Dispatch(List=demesh.Faces, DispatchPattern=incurve.Relationship)  # -> ListA, ListB
conmesh = ConstructMesh(Vertices=demesh.Vertices, Faces=dispatch.ListA)
pt = ConstructPoint(XCoordinate=number_slider_2, YCoordinate=number_slider_2, ZCoordinate=0)
data_9 = Data(split.ListB)
data_10 = Data(data_6)
data_11 = Data(split_2.ListB)
data_12 = Data(data_8)
data_13 = Data(split_3.ListB)
data_14 = Data(data_7)
weldvertices = MeshWeldVertices(Mesh=conmesh, Tolerance=0.01)  # -> RuntimeMessage, Mesh
move_3 = Move(Geometry=weldvertices.Mesh, Motion=pt)  # -> Geometry, Transform
demesh_2 = DeconstructMesh(Mesh=weldvertices.Mesh)  # -> Vertices, Faces, Colours, Normals
cp = ClosestPoint(Point=data_12, Cloud=demesh_2.Vertices)  # -> ClosestPoint, CPIndex, Distance
cp_2 = ClosestPoint(Point=data_10, Cloud=demesh_2.Vertices)  # -> ClosestPoint, CPIndex, Distance
cp_3 = ClosestPoint(Point=data_9, Cloud=demesh_2.Vertices)  # -> ClosestPoint, CPIndex, Distance
cp_4 = ClosestPoint(Point=data_14, Cloud=demesh_2.Vertices)  # -> ClosestPoint, CPIndex, Distance
cp_5 = ClosestPoint(Point=data_13, Cloud=demesh_2.Vertices)  # -> ClosestPoint, CPIndex, Distance
cp_6 = ClosestPoint(Point=data_11, Cloud=demesh_2.Vertices)  # -> ClosestPoint, CPIndex, Distance
deface = DeconstructFace(Face=demesh_2.Faces)  # -> CornerA, CornerB, CornerC, CornerD
Y_2 = UnitY(Factor=1)
vec = VectorXYZ(XComponent=0, YComponent=0, ZComponent=0)  # -> Vector, Length
X_2 = UnitX(Factor=1)
split_13 = SplitList(List=demesh_2.Vertices, Index=Slider(14, range=0..100))  # -> ListA, ListB
lng = ListLength(List=cp_2.CPIndex)
merge_5 = Merge(Data1=cp_4.CPIndex, Data2=cp_5.CPIndex, Data3=cp_6.CPIndex)
lng_2 = ListLength(List=cp_3.CPIndex)
lng_3 = ListLength(List=demesh_2.Vertices)
merge_6 = Merge(Data1=cp.CPIndex, Data2=cp_2.CPIndex, Data3=cp_3.CPIndex)  # -> flatten(Result)
merge_7 = Merge(Data1=graft(deface.CornerA), Data2=graft(deface.CornerB), Data3=graft(deface.CornerC))  # -> flatten(Result)
repeat = RepeatData(Data=X_2, Length=lng)
lng_4 = ListLength(List=merge_7)
repeat_2 = RepeatData(Data=Y_2, Length=lng_2)
data_15 = Data(demesh_2.Vertices)
data_16 = Data(split_13.ListA)
series = Series(Start=0, Step=1, Count=lng_3)
replace = ReplaceItems(List=demesh_2.Vertices, Indices=merge_6, Wrap=False)
clean = CleanTree(RemoveNulls=True, RemoveInvalid=True, RemoveEmpty=False, Tree=replace)
repeat_3 = RepeatData(Data=vec.Vector, Length=lng_4)
series_2 = Series(Start=0, Step=1, Count=Slider(119, range=0..1000))
X_3 = UnitX(Factor=1)
int = Integer(series)
Y_3 = UnitY(Factor=1)
mindex = MemberIndex(Set=merge_7, Member=cp_3.CPIndex)  # -> flatten(Index), Count
mindex_2 = MemberIndex(Set=merge_7, Member=cp.CPIndex)  # -> flatten(Index), Count
mindex_3 = MemberIndex(Set=merge_7, Member=cp_2.CPIndex)  # -> flatten(Index), Count
int_2 = Integer(series_2)
replace_2 = ReplaceMembers(Set=merge_7, Find=flatten(merge_6), Replace=flatten(merge_5))
cset = CreateSet(List=replace_2)  # -> Set, Map
replace_3 = ReplaceMembers(Set=int, Find=flatten(merge_6), Replace=flatten(merge_5))
data_17 = Data(clean)
addition_3 = Addition(A=Y_3, B=X_3)
sort = SortList(Keys=flatten(cset.Set), ValuesA=flatten(cset.Set))  # -> Keys, ValuesA
cset_2 = CreateSet(List=replace_3)  # -> Set, Map
lng_5 = ListLength(List=cset.Set)
replace_4 = ReplaceItems(List=repeat_3, Item=addition_3, Indices=mindex_2.Index, Wrap=False)
sort_2 = SortList(Keys=flatten(cset_2.Set), ValuesA=flatten(cset_2.Set))  # -> Keys, ValuesA
mindex_4 = MemberIndex(Set=replace_2, Member=sort.ValuesA)  # -> Index, Count
series_3 = Series(Start=0, Step=1, Count=lng_5)
replace_5 = ReplaceItems(List=replace_4, Item=X_2, Indices=mindex_3.Index, Wrap=False)
mindex_5 = MemberIndex(Set=replace_3, Member=sort_2.ValuesA)  # -> Index, Count
int_3 = Integer(series_3)
repeat_4 = RepeatData(Data=graft(int_3), Length=graft(mindex_4.Count))  # -> flatten(Data)
replace_6 = ReplaceItems(List=replace_5, Item=Y_2, Indices=mindex.Index, Wrap=False)
item_6 = ListItem(List=int_2, Index=mindex_5.Index, Wrap=False)  # -> flatten(Item)
data_18 = Data(flatten(mindex_5.Index))
multiplication_9 = Multiplication(A=replace_6, B=Slider(50, range=0..100))
item_7 = ListItem(List=int_3, Index=mindex_4.Index, Wrap=True)
sort_3 = SortList(Keys=flatten(mindex_4.Index), ValuesA=flatten(repeat_4))  # -> Keys, ValuesA
replace_7 = ReplaceItems(List=data_18, Item=int_2, Indices=int_2, Wrap=False)
replace_8 = ReplaceMembers(Set=data_18, Find=sort_2.ValuesA, Replace=int_2)
item_8 = ListItem(List=data_17, Index=sort_3.ValuesA, Wrap=False)
move_4 = Move(Geometry=item_8, Motion=multiplication_9)  # -> Geometry, Transform
ln = Line(StartPoint=item_8, EndPoint=move_4.Geometry)
pt_2 = Point(clean)
int_4 = Integer(sort_3.ValuesA)
vec_2 = Vector(replace_6)
int_5 = Integer(replace_8)
multiplication_10 = Multiplication(A=vec_2, B=Slider(50, range=0..100))
item_9 = ListItem(List=pt_2, Index=int_4, Wrap=True)
move_5 = Move(Geometry=item_9, Motion=multiplication_10)  # -> Geometry, Transform
partition = PartitionList(List=move_5.Geometry, Size=expr("3", [3, 2]))
pline_3 = PolyLine(Vertices=partition, Closed=True)
data_19 = Data(vec_2)
data_20 = Data(pt_2)
lng_6 = ListLength(List=data_20)
data_21 = Data(int_4)
pdecon = Deconstruct(Point=data_20)  # -> XComponent, YComponent, ZComponent
pdecon_2 = Deconstruct(Point=data_19)  # -> XComponent, YComponent, ZComponent
repeat_5 = RepeatData(Data=",", Length=expr("x-1", lng_6))
lng_7 = ListLength(List=data_19)
concat = Concatenate(
    FragmentA="new Vector3(",
    FragmentB=pdecon.XComponent,
    FragmentC="f,",
    FragmentD=pdecon.YComponent,
    FragmentE="f,",
    FragmentF=pdecon.ZComponent,
    FragmentG="f)")
int_6 = Integer(pdecon_2.XComponent)
lng_8 = ListLength(List=data_21)
int_7 = Integer(pdecon_2.YComponent)
panel = Panel("f)")
merge_8 = Merge(Data1=flatten(repeat_5), Data2=flatten("};"))
repeat_6 = RepeatData(Data=",", Length=expr("x-1", lng_7))
repeat_7 = RepeatData(Data=",", Length=expr("x-1", lng_8))
concat_2 = Concatenate(FragmentA="new Vector2Int(", FragmentB=int_6, FragmentC=",", FragmentD=int_7, FragmentG=")")
concat_3 = Concatenate(FragmentA=data_21)
merge_9 = Merge(Data1=flatten(repeat_6), Data2=flatten("};"))
concat_4 = Concatenate(FragmentA=concat, FragmentB=merge_8)
merge_10 = Merge(Data1=flatten(repeat_7), Data2=flatten("};"))
split_14 = SplitList(List=concat_4, Index=1)  # -> ListA, ListB
concat_5 = Concatenate(FragmentA="var pts = Vector3[]{", FragmentB=split_14.ListA)
concat_6 = Concatenate(FragmentA=concat_2, FragmentB=merge_9)
split_15 = SplitList(List=concat_6, Index=1)  # -> ListA, ListB
concat_7 = Concatenate(FragmentA=concat_3, FragmentB=merge_10)
split_16 = SplitList(List=concat_7, Index=1)  # -> ListA, ListB
merge_11 = Merge(Data1=concat_5, Data2=split_14.ListB)
concat_8 = Concatenate(FragmentA="var pts = Vector3[]{", FragmentB=split_15.ListA)
concat_9 = Concatenate(FragmentA="var indexes = new int[]{", FragmentB=split_16.ListA)
merge_12 = Merge(Data1=concat_8, Data2=split_15.ListB)
merge_13 = Merge(Data1=concat_9, Data2=split_16.ListB)
panel_2 = Panel(merge_11)
join_4 = TextJoin(Text=merge_13)
panel_3 = Panel(merge_12)
panel_4 = Panel(join_4)
number_slider_3 = Slider(50, range=0..100)
number_slider_4 = Slider(4, range=0..10)
demesh_3 = DeconstructMesh(Mesh=weldvertices.Mesh)  # -> Vertices, Faces, Colours, Normals
data_22 = Data(weldvertices.Mesh)
series_4 = Series(Start=0, Step=Slider(50, range=0..100), Count=Slider(2, range=0..10))
lng_9 = ListLength(List=demesh_3.Vertices)
addition_4 = Addition(A=number_slider_4, B=2)
one_over_x = OneOverX(Value=number_slider_4)
one_over_x_2 = OneOverX(Value=number_slider_4)
series_5 = Series(Start=0, Step=1, Count=lng_9)
multiplication_11 = Multiplication(A=number_slider_3, B=one_over_x_2)
series_6 = Series(Start=0, Step=number_slider_3, Count=addition_4)
vec_3 = VectorXYZ(XComponent=multiplication_11, YComponent=multiplication_11, ZComponent=0)  # -> Vector, Length
int_8 = Integer(series_5)
vec_4 = VectorXYZ(XComponent=series_6, YComponent=graft(series_6), ZComponent=0)  # -> Vector, Length
number_slider_5 = Slider(39, range=0..100)
series_7 = Series(Start=0, Step=Slider(1, range=0..100), Count=addition_4)
neg_2 = Negative(Value=vec_3.Vector)
vec_5 = VectorXYZ(XComponent=series_4, YComponent=graft(series_4), ZComponent=0)  # -> Vector, Length
int_9 = Integer(series_7)
move_6 = Move(Geometry=data_22, Motion=vec_4.Vector)  # -> Geometry, Transform
concat_10 = Concatenate(FragmentA=int_9, FragmentB=",", FragmentC=graft(int_9))  # -> flatten(Result)
move_7 = Move(Geometry=weldvertices.Mesh, Motion=vec_5.Vector)  # -> Geometry, Transform
pt_3 = ConstructPoint(XCoordinate=number_slider_5, YCoordinate=number_slider_5, ZCoordinate=0)
addition_5 = Addition(A=number_slider_5, B=Slider(50, range=0..100))
scale = Scale(Geometry=move_6.Geometry, Center=Point(0, 0, 0), Factor=one_over_x)  # -> Geometry, Transform
demesh_4 = DeconstructMesh(Mesh=move_7.Geometry)  # -> Vertices, Faces, Colours, Normals
facen_2 = FaceNormals(Mesh=move_7.Geometry)  # -> Centers, Normals
panel_5 = Panel(concat_10)
lng_10 = ListLength(List=int_8)
number_slider_6 = Slider(1000, range=0..1000)
lng_11 = ListLength(List=scale.Geometry)
dom = ConstructDomain(DomainStart=number_slider_5, DomainEnd=addition_5)
move_8 = Move(Geometry=scale.Geometry, Motion=neg_2)  # -> flatten(Geometry), Transform
multiplication_12 = Multiplication(A=lng_10, B=lng_11)
pdecon_3 = Deconstruct(Point=facen_2.Centers)  # -> XComponent, YComponent, ZComponent
repeat_8 = RepeatData(Data=graft(concat_10), Length=lng_9)  # -> flatten(Data)
repeat_9 = RepeatData(Data=graft(concat_10), Length=lng_9)  # -> flatten(Data)
scale_2 = Scale(Geometry=weldvertices.Mesh, Center=Point(0, 0, 0), Factor=number_slider_6)  # -> Geometry, Transform
inc = Includes(Value=pdecon_3.XComponent, Domain=dom)  # -> Includes, Deviation
inc_2 = Includes(Value=pdecon_3.YComponent, Domain=dom)  # -> Includes, Deviation
repeat_10 = RepeatData(Data=int_8, Length=multiplication_12)  # -> flatten(Data)
scale_3 = Scale(Geometry=move_8.Geometry, Center=Point(0, 0, 0), Factor=number_slider_6)  # -> Geometry, Transform
faceb = FaceBoundaries(Mesh=scale_2.Geometry)
and = GateAnd(A=inc.Includes, B=inc_2.Includes)
demesh_5 = DeconstructMesh(Mesh=scale_3.Geometry)  # -> flatten(Vertices), Faces, Colours, Normals
neg_3 = Negative(Value=pt_3)
lng_12 = ListLength(List=faceb)
incurves = PointInCurves(Point=demesh_5.Vertices, Curves=faceb)  # -> Relationship, Index, Point
dispatch_2 = Dispatch(List=demesh_4.Faces, DispatchPattern=and)  # -> ListA, ListB
explode_7 = MeshExplode(Mesh=scale_2.Geometry, Interpolate=False)  # -> graft(Faces)
data_23 = Data(dispatch_2.ListA)
series_8 = Series(Start=0, Step=1, Count=lng_12)
lng_13 = ListLength(List=repeat_9)
conmesh_2 = ConstructMesh(Vertices=demesh_4.Vertices, Faces=data_23)
data_24 = Data(data_19)
int_10 = Integer(series_8)
mindex_6 = MemberIndex(Set=incurves.Index, Member=int_10)  # -> Index, Count
weldvertices_2 = MeshWeldVertices(Mesh=conmesh_2, Tolerance=0.01)  # -> RuntimeMessage, Mesh
item_10 = ListItem(List=repeat_9, Index=mindex_6.Index, Wrap=True)
split_17 = TextSplit(Text=item_10, Separators=",")
repeat_11 = RepeatData(Data=data_24, Length=lng_13)
item_11 = ListItem(List=repeat_11, Index=mindex_6.Index, Wrap=True)
item_12 = ListItem(List=repeat_9, Index=mindex_6.Index, Wrap=True)
int_11 = Integer(split_17)
pdecon_4 = Deconstruct(Point=item_11)  # -> XComponent, YComponent, ZComponent
move_9 = Move(Geometry=weldvertices_2.Mesh, Motion=neg_3)  # -> Geometry, Transform
item_13 = ListItem(List=int_11, Index=0, Wrap=True)  # -> Item, Item1
item_14 = ListItem(List=demesh_5.Vertices, Index=mindex_6.Index, Wrap=True)
item_15 = ListItem(List=repeat_9, Index=mindex_6.Index, Wrap=True)
item_16 = ListItem(List=demesh_5.Vertices, Index=mindex_6.Index, Wrap=True)
item_17 = ListItem(List=repeat_10, Index=mindex_6.Index, Wrap=True)
match = MatchTreeStructure(DataList=flatten(pdecon_4.YComponent), TreeMask=item_13.Item)
match_2 = MatchTreeStructure(DataList=flatten(pdecon_4.XComponent), TreeMask=item_13.Item)
panel_6 = Panel(pdecon_4.YComponent)
split_18 = TextSplit(Text=item_15, Separators=", ")
item_18 = ListItem(List=demesh_3.Vertices, Index=item_17, Wrap=True)
addition_6 = Addition(A=match, B=item_13.Item1)
addition_7 = Addition(A=match_2, B=item_13.Item)
meshcp = MeshClosestPoint(Point=item_16, Mesh=explode_7)  # -> Point, Index, Parameter
data_25 = Data(meshcp.Parameter)
split_19 = TextSplit(Text=data_25, Separators="[];")
item_19 = ListItem(List=split_19, Index=0, Wrap=True)  # -> Item, Item1, Item2, Item3, Item4
merge_14 = Merge(Data1=item_19.Item1, Data2=item_19.Item2, Data3=item_19.Item3)
join_5 = TextJoin(Text=merge_14, Join="f,")
int_12 = Integer(addition_6)
int_13 = Integer(addition_7)
multiplication_13 = Multiplication(A=split_18, B=Slider(50, range=0..100))
item_20 = ListItem(List=multiplication_13, Index=0, Wrap=True)  # -> Item, Item1
mjoin = MeshJoin(Meshes=flatten(move_9.Geometry))
concat_11 = Concatenate(FragmentA="new Vector3(", FragmentB=join_5, FragmentC="f)")
vec_6 = VectorXYZ(XComponent=item_20.Item, YComponent=item_20.Item1, ZComponent=0)  # -> Vector, Length
concat_12 = Concatenate(FragmentA=int_13, FragmentC=",", FragmentB=int_12)
concat_13 = Concatenate(FragmentA="new Vector2Int(", FragmentB=item_10, FragmentC=")")
data_26 = Data(concat_13)
weldvertices_3 = MeshWeldVertices(Mesh=mjoin, Tolerance=0.01)  # -> RuntimeMessage, Mesh
number_slider_7 = Slider(2, range=0..10)  # disabled
number_slider_8 = Slider(50, range=0..100)
number_slider_9 = Slider(0.5, range=0..1)
trim = TrimTree(Tree=concat_11, Depth=1)
move_10 = Move(Geometry=mjoin, Motion=vec_5.Vector)  # -> Geometry, Transform
lng_14 = ListLength(List=data_26)
data_27 = Data(trim)
trim_2 = TrimTree(Tree=concat_12, Depth=1)
trim_3 = TrimTree(Tree=vec_6.Vector, Depth=1)
lng_15 = ListLength(List=data_27)
lng_16 = ListLength(List=lng_14)
number_slider_10 = Slider(1000, range=0..1000)
data_28 = Data(weldvertices_3.Mesh)
panel_7 = Panel("var relationships= new Vector2Int[][]{")
panel_8 = Panel(item_10)
addition_8 = Addition(A=number_slider_7, B=2)  # disabled
one_over_x_3 = OneOverX(Value=number_slider_7)
one_over_x_4 = OneOverX(Value=number_slider_7)  # disabled
lng_17 = ListLength(List=lng_15)
panel_9 = Panel("Barycenters = new Vector23[][]{")
move_11 = Move(Geometry=item_18, Motion=trim_3)  # -> Geometry, Transform
medges = MeshEdges(Mesh=data_28)  # -> NakedEdges, InteriorEdges, NonManifoldEdges
multiplication_14 = Multiplication(A=number_slider_8, B=one_over_x_4)  # disabled
repeat_12 = RepeatData(Data=",", Length=expr("x-1", lng_14))
repeat_13 = RepeatData(Data="}", Length=expr("x", lng_16))
panel_11 = Panel(trim_2)
repeat_14 = RepeatData(Data="new Vector2Int[]{", Length=expr("x", lng_16))
series_9 = Series(Start=0, Step=number_slider_8, Count=addition_8)  # disabled
join_6 = TextJoin(Text=data_26, Join=",")
repeat_15 = RepeatData(Data=",", Length=expr("x-1", lng_15))
vec_7 = VectorXYZ(XComponent=multiplication_14, YComponent=multiplication_14, ZComponent=0)  # -> Vector, Length; disabled
item_21 = ListItem(List=repeat_9, Index=mindex_6.Index, Wrap=True)
repeat_16 = RepeatData(Data="}", Length=expr("x", lng_17))
repeat_17 = RepeatData(Data="new Vector3[]{", Length=expr("x", lng_17))
vec_8 = VectorXYZ(XComponent=series_9, YComponent=graft(series_9), ZComponent=0)  # -> Vector, Length; disabled
join_7 = TextJoin(Text=item_17, Join=",")
concat_14 = Concatenate()
join_8 = JoinCurves(Curves=medges.NakedEdges, Preserve=False)
join_9 = TextJoin(Text=data_27, Join=",")
neg_4 = Negative(Value=vec_7.Vector)  # disabled
scale_4 = Scale(Geometry=join_8, Center=Point(0, 0, 0), Factor=number_slider_10)  # -> Geometry, Transform
merge_15 = Merge(Data1=flatten(repeat_14), Data2=flatten("};"))
concat_15 = Concatenate()
scale_5 = Scale(Geometry=move_11.Geometry, Center=Point(0, 0, 0), Factor=Slider(0.25, range=0..1))  # -> Geometry, Transform
merge_16 = Merge(Data1=flatten(repeat_17), Data2=flatten("};"))
panel_13 = Panel(join_7)
move_12 = Move(Geometry=data_28, Motion=vec_8.Vector)  # -> Geometry, Transform; disabled
concat_16 = Concatenate(FragmentA=repeat_14, FragmentC=join_6, FragmentB=repeat_13, FragmentD=",")  # -> flatten(Result)
concat_17 = Concatenate(FragmentA=concat_14, FragmentB=merge_15)
flip_3 = FlipCurve(Curve=scale_4.Geometry)  # -> Curve, Flag; disabled
split_20 = SplitList(List=concat_17, Index=1)  # -> ListA, ListB
concat_18 = Concatenate(FragmentA=repeat_17, FragmentC=join_9, FragmentB=repeat_16, FragmentD=",")  # -> flatten(Result)
concat_19 = Concatenate(FragmentA=concat_15, FragmentB=merge_16)
scale_6 = Scale(Geometry=move_12.Geometry, Center=Point(0, 0, 0), Factor=one_over_x_3)  # -> Geometry, Transform; disabled
split_21 = SplitList(List=concat_19, Index=1)  # -> ListA, ListB
concat_20 = Concatenate(FragmentA="new int[]{", FragmentB=join_7, FragmentC="}")
join_10 = TextJoin(Text=concat_16, Join=", ")
concat_21 = Concatenate(FragmentA=panel_7, FragmentB=join_10, FragmentC="};")
move_13 = Move(Geometry=scale_6.Geometry, Motion=neg_4)  # -> flatten(Geometry), Transform; disabled
xy = XYPlane(Origin=Point(0, 0, 0))  # disabled
join_11 = TextJoin(Text=concat_18, Join=", ")
concat_22 = Concatenate(FragmentA=panel_9, FragmentB=join_11, FragmentC="};")
data_29 = Data(concat_20)
lng_18 = ListLength(List=move_13.Geometry)  # disabled
panel_14 = Panel("new Vector2Int[]{")
merge_17 = Merge(Data1=panel_7, Data2=concat_16, Data3="};")
facen_3 = FaceNormals(Mesh=move_13.Geometry)  # -> Centers, Normals; disabled
merge_18 = Merge(Data1=panel_9, Data2=concat_18, Data3="};")
panel_15 = Panel(merge_17)
panel_16 = Panel("var relationships= int[][]{")
scale_7 = Scale(Geometry=facen_3.Centers, Center=Point(0, 0, 0), Factor=number_slider_10)  # -> Geometry, Transform; disabled
demesh_6 = DeconstructMesh(Mesh=move_13.Geometry)  # -> Vertices, Faces, Colours, Normals; disabled
join_12 = TextJoin(Text=flatten(data_29), Join=",")
incurve_2 = PointInCurve(Point=scale_7.Geometry, Curve=flip_3.Curve)  # -> Relationship, Point; disabled
panel_18 = Panel(merge_18)
side = CurveSide(Curve=flip_3.Curve, Point=facen_3.Centers, Plane=xy)  # -> Side, Left, Right; disabled
panel_19 = Panel(",")
equals = Equality(FirstNumber=incurve_2.Relationship, SecondNumber=0)  # -> Equality, Inequality; disabled
join_13 = TextJoin(Text=join_12, Join=", ")
series_10 = Series(Start=0, Step=1, Count=lng_18)  # disabled
gradient = Gradient(
    LowerLimit=0,
    UpperLimit=lng_18,
    Parameter=series_10,
    stops=[0: RGB(243, 57, 0), 0.1: RGB(236, 27, 60), 0.2: RGB(210, 0, 118), 0.3: RGB(103, 0, 120), 0.4: RGB(39, 72, 161), 0.5: RGB(1, 192, 229), 0.6: RGB(18, 178, 90), 0.7: RGB(79, 186, 8), 0.8: RGB(220, 237, 32), 0.9: RGB(247, 159, 20), 1: RGB(243, 57, 0)])  # disabled
concat_23 = Concatenate(FragmentA=panel_16, FragmentB=flatten(join_12), FragmentC="};")
dispatch_3 = Dispatch(List=demesh_6.Faces, DispatchPattern=equals.Equality)  # -> ListA, ListB; disabled
preview = CustomPreview(Geometry=move_13.Geometry, Shader=gradient)  # disabled
merge_19 = Merge(Data1=panel_16, Data2=join_13, Data3="};")
conmesh_3 = ConstructMesh(Vertices=demesh_6.Vertices, Faces=dispatch_3.ListB)  # -> flatten(Mesh); disabled
panel_20 = Panel(join_12)
mjoin_2 = MeshJoin(Meshes=conmesh_3)  # disabled
move_14 = Move(Geometry=mjoin_2, Motion=vec_5.Vector)  # -> Geometry, Transform; disabled
number_slider_11 = Slider(4, range=0..10)  # disabled
number_slider_12 = Slider(50, range=0..100)  # disabled
number_slider_13 = Slider(1000, range=0..1000)  # disabled
data_30 = Data(mjoin_2)  # disabled
addition_9 = Addition(A=number_slider_11, B=2)  # disabled
one_over_x_5 = OneOverX(Value=number_slider_11)  # disabled
one_over_x_6 = OneOverX(Value=number_slider_11)  # disabled
data_31 = Data(mjoin)  # disabled
data_32 = Data(mjoin_2)  # disabled
multiplication_15 = Multiplication(A=number_slider_12, B=one_over_x_6)  # disabled
series_11 = Series(Start=0, Step=number_slider_12, Count=addition_9)  # disabled
vec_9 = VectorXYZ(XComponent=multiplication_15, YComponent=multiplication_15, ZComponent=0)  # -> Vector, Length; disabled
scale_8 = Scale(Geometry=data_31, Center=Point(0, 0, 0), Factor=number_slider_13)  # -> Geometry, Transform; disabled
scale_9 = Scale(Geometry=data_32, Center=Point(0, 0, 0), Factor=number_slider_13)  # -> Geometry, Transform; disabled
vec_10 = VectorXYZ(XComponent=series_11, YComponent=graft(series_11), ZComponent=0)  # -> Vector, Length; disabled
neg_5 = Negative(Value=vec_9.Vector)  # disabled
facen_4 = FaceNormals(Mesh=scale_9.Geometry)  # -> Centers, Normals; disabled
faceb_2 = FaceBoundaries(Mesh=scale_8.Geometry)  # disabled
move_15 = Move(Geometry=data_30, Motion=vec_10.Vector)  # -> Geometry, Transform; disabled
incurves_2 = PointInCurves(Point=facen_4.Centers, Curves=faceb_2)  # -> Relationship, Index, Point; disabled
scale_10 = Scale(Geometry=move_15.Geometry, Center=Point(0, 0, 0), Factor=one_over_x_5)  # -> Geometry, Transform; disabled
move_16 = Move(Geometry=scale_10.Geometry, Motion=neg_5)  # -> flatten(Geometry), Transform; disabled
