# Grasshopper definition fifty-nine -duff-stuff- cleaned out.gh (Grasshopper 0.9.76)
# plug-ins: MeshEdit Components, TT Toolbox

rectangle = Rectangle(Plane=PlaneXY(0, 0, 0), XSize=Slider(50, range=0..100), YSize=Slider(50, range=0..100), Radius=0)  # -> Rectangle, Length
explode = Explode(Curve=rectangle.Rectangle, Recursive=True)  # -> Segments, Vertices
item = ListItem(List=explode.Segments, Index=0, Wrap=True)  # -> Item, Item1, Item2, Item3
number_slider = Slider(10, range=0..100)
flip = FlipCurve(Curve=item.Item)  # -> Curve, Flag
flip_2 = FlipCurve(Curve=item.Item1)  # -> Curve, Flag
merge = Merge(Data1=flip.Curve, Data2=item.Item2)
merge_2 = Merge(Data1=flip_2.Curve, Data2=item.Item3)
divide = DivideCurve(Curve=reparameterize(merge_2), Count=number_slider, Kinks=False)  # -> Points, Tangents, Parameters
pi = Pi(Factor=Slider(3, range=0..10))
pi_2 = Pi(Factor=Slider(6, range=0..10))
divide_2 = DivideCurve(Curve=reparameterize(merge), Count=number_slider, Kinks=False)  # -> Points, Tangents, Parameters
multiplication = Multiplication(A=divide.Parameters, B=pi)
multiplication_2 = Multiplication(A=divide.Parameters, B=pi_2)
pi_3 = Pi(Factor=Slider(5, range=0..10))
pi_4 = Pi(Factor=Slider(1, range=0..10))
sin = Sine(Value=multiplication_2)
sin_2 = Sine(Value=multiplication)
multiplication_3 = Multiplication(A=divide_2.Parameters, B=pi_4)
multiplication_4 = Multiplication(A=divide_2.Parameters, B=pi_3)
multiplication_5 = Multiplication(A=sin_2, B=Slider(3, range=0..10))
multiplication_6 = Multiplication(A=sin, B=Slider(2, range=0..10))
sin_3 = Sine(Value=multiplication_4)
sin_4 = Sine(Value=multiplication_3)
addition = Addition(A=multiplication_5, B=multiplication_6)
X = UnitX(Factor=addition)
multiplication_7 = Multiplication(A=sin_4, B=Slider(6, range=0..10))
multiplication_8 = Multiplication(A=sin_3, B=Slider(2, range=0..10))
move = Move(Geometry=divide.Points, Motion=X)  # -> Geometry, Transform
addition_2 = Addition(A=multiplication_7, B=multiplication_8)
Y = UnitY(Factor=addition_2)
move_2 = Move(Geometry=divide_2.Points, Motion=Y)  # -> Geometry, Transform
pline = PolyLine(Vertices=move.Geometry, Closed=False)  # -> flatten(Polyline)
pline_2 = PolyLine(Vertices=move_2.Geometry, Closed=False)  # -> flatten(Polyline)
item_2 = ListItem(List=pline_2, Index=0, Wrap=True)  # -> Item1, Item
item_3 = ListItem(List=pline, Index=0, Wrap=True)  # -> Item1, Item
item_4 = ListItem(List=pline_2, Index=0, Wrap=True)  # -> Item1, Item
item_5 = ListItem(List=pline, Index=0, Wrap=True)  # -> Item1, Item
merge_3 = Merge(Data1=pline_2, Data2=pline)
data = Data(item_2.Item1)
data_2 = Data(item_4.Item)
data_3 = Data(item_3.Item)
data_4 = Data(item_5.Item1)
join = JoinCurves(Curves=merge_3, Preserve=False)
neg = Negative(Value=Slider(2.8633, range=0..10))
join_2 = JoinCurves(Curves=[data, data_3], Preserve=False)
join_3 = JoinCurves(Curves=[data_2, data_4], Preserve=False)
explode_2 = Explode(Curve=data, Recursive=True)  # -> Segments, Vertices
explode_3 = Explode(Curve=data_2, Recursive=True)  # -> Segments, Vertices
explode_4 = Explode(Curve=join, Recursive=True)  # -> Segments, Vertices
data_5 = Data(join)
offset = Offset(Curve=join, Distance=neg, Plane=PlaneXY(0, 0, 0), Corners=1)
explode_5 = Explode(Curve=data_3, Recursive=True)  # -> Segments, Vertices
explode_6 = Explode(Curve=data_4, Recursive=True)  # -> Segments, Vertices
split = SplitList(List=explode_2.Vertices, Index=1)  # -> ListA, ListB
split_2 = SplitList(List=explode_3.Vertices, Index=1)  # -> ListA, ListB
srf = Surface(offset)
split_3 = SplitList(List=explode_6.Vertices, Index=1)  # -> ListA, ListB
split_4 = SplitList(List=explode_5.Vertices, Index=1)  # -> ListA, ListB
split_5 = SplitList(List=reverse(split_2.ListB), Index=1)  # -> ListA, reverse(ListB)
split_6 = SplitList(List=explode_4.Vertices, Index=1)  # -> ListA, ListB
split_7 = SplitList(List=reverse(split_3.ListB), Index=1)  # -> ListA, reverse(ListB)
popgeo = PopulateGeometry(Geometry=srf, Count=Slider(100, range=0..1000), Seed=Slider(22, range=0..100))
split_8 = SplitList(List=reverse(split.ListB), Index=1)  # -> ListA, reverse(ListB)
merge_4 = Merge(Data1=split_6.ListB, Data2=popgeo)
split_9 = SplitList(List=reverse(split_5.ListB), Index=1)  # -> ListA, reverse(ListB)
split_10 = SplitList(List=reverse(split_4.ListB), Index=1)  # -> ListA, reverse(ListB)
split_11 = SplitList(List=reverse(split_7.ListB), Index=1)  # -> ListA, reverse(ListB)
del = DelaunayMesh(Points=merge_4, Plane=PlaneXY(0, 0, 0))
data_6 = Data(split_4.ListB)
split_12 = SplitList(List=split_8.ListB, Index=1)  # -> ListA, reverse(ListB)
data_7 = Data(split_7.ListA)
facen = FaceNormals(Mesh=del)  # -> Centers, Normals
incurve = PointInCurve(Point=facen.Centers, Curve=data_5)  # -> Relationship, Point
data_8 = Data(split_4.ListA)
demesh = DeconstructMesh(Mesh=del)  # -> Vertices, Faces, Colours, Normals
data_9 = Data(split.ListB)
data_10 = Data(data_6)
data_11 = Data(data_8)
number_slider_2 = Slider(12.5, range=0..100)
dispatch = Dispatch(List=demesh.Faces, DispatchPattern=incurve.Relationship)  # -> ListA, ListB
conmesh = ConstructMesh(Vertices=demesh.Vertices, Faces=dispatch.ListA)
data_12 = Data(split_2.ListB)
data_13 = Data(split_3.ListB)
data_14 = Data(data_7)
pt = ConstructPoint(XCoordinate=number_slider_2, YCoordinate=number_slider_2, ZCoordinate=0)
weldvertices = MeshWeldVertices(Mesh=conmesh, Tolerance=0.01)  # -> RuntimeMessage, Mesh
demesh_2 = DeconstructMesh(Mesh=weldvertices.Mesh)  # -> Vertices, Faces, Colours, Normals
cp = ClosestPoint(Point=data_11, Cloud=demesh_2.Vertices)  # -> ClosestPoint, CPIndex, Distance
cp_2 = ClosestPoint(Point=data_10, Cloud=demesh_2.Vertices)  # -> ClosestPoint, CPIndex, Distance
cp_3 = ClosestPoint(Point=data_9, Cloud=demesh_2.Vertices)  # -> ClosestPoint, CPIndex, Distance
cp_4 = ClosestPoint(Point=data_14, Cloud=demesh_2.Vertices)  # -> ClosestPoint, CPIndex, Distance
cp_5 = ClosestPoint(Point=data_13, Cloud=demesh_2.Vertices)  # -> ClosestPoint, CPIndex, Distance
cp_6 = ClosestPoint(Point=data_12, Cloud=demesh_2.Vertices)  # -> ClosestPoint, CPIndex, Distance
move_3 = Move(Geometry=weldvertices.Mesh, Motion=pt)  # -> Geometry, Transform
deface = DeconstructFace(Face=demesh_2.Faces)  # -> CornerA, CornerB, CornerC, CornerD
lng = ListLength(List=demesh_2.Vertices)
merge_5 = Merge(Data1=cp_4.CPIndex, Data2=cp_5.CPIndex, Data3=cp_6.CPIndex)  # -> flatten(Result)
merge_6 = Merge(Data1=cp.CPIndex, Data2=cp_2.CPIndex, Data3=cp_3.CPIndex)  # -> flatten(Result)
vec = VectorXYZ(XComponent=0, YComponent=0, ZComponent=0)  # -> Vector, Length
series = Series(Start=0, Step=1, Count=lng)
merge_7 = Merge(Data1=graft(deface.CornerA), Data2=graft(deface.CornerB), Data3=graft(deface.CornerC))  # -> flatten(Result)
lng_2 = ListLength(List=merge_7)
int = Integer(series)
repeat = RepeatData(Data=vec.Vector, Length=lng_2)
replace = ReplaceItems(List=demesh_2.Vertices, Indices=merge_6, Wrap=False)
replace_2 = ReplaceMembers(Set=int, Find=merge_6, Replace=merge_5)
X_2 = UnitX(Factor=1)
Y_2 = UnitY(Factor=1)
mindex = MemberIndex(Set=merge_7, Member=cp_3.CPIndex)  # -> flatten(Index), Count
mindex_2 = MemberIndex(Set=merge_7, Member=cp.CPIndex)  # -> flatten(Index), Count
series_2 = Series(Start=0, Step=1, Count=Slider(119, range=0..1000))
mindex_3 = MemberIndex(Set=merge_7, Member=cp_2.CPIndex)  # -> flatten(Index), Count
clean = CleanTree(RemoveNulls=True, RemoveInvalid=True, RemoveEmpty=False, Tree=replace)
cset = CreateSet(List=replace_2)  # -> Set, Map
addition_3 = Addition(A=Y_2, B=X_2)
int_2 = Integer(series_2)
pt_2 = Point(clean)
replace_3 = ReplaceItems(List=repeat, Item=addition_3, Indices=mindex_2.Index, Wrap=False)
X_3 = UnitX(Factor=1)
Y_3 = UnitY(Factor=1)
replace_4 = ReplaceItems(List=replace_3, Item=X_3, Indices=mindex_3.Index, Wrap=False)
replace_5 = ReplaceItems(List=replace_4, Item=Y_3, Indices=mindex.Index, Wrap=False)
vec_2 = Vector(replace_5)
multiplication_9 = Multiplication(A=vec_2, B=Slider(50, range=0..100))
data_15 = Data(vec_2)
number_slider_3 = Slider(50, range=0..100)
number_slider_4 = Slider(4, range=0..10)
demesh_3 = DeconstructMesh(Mesh=weldvertices.Mesh)  # -> Vertices, Faces, Colours, Normals
data_16 = Data(weldvertices.Mesh)
lng_3 = ListLength(List=demesh_3.Vertices)
addition_4 = Addition(A=number_slider_4, B=2)
one_over_x = OneOverX(Value=number_slider_4)
one_over_x_2 = OneOverX(Value=number_slider_4)
series_3 = Series(Start=0, Step=1, Count=lng_3)
multiplication_10 = Multiplication(A=number_slider_3, B=one_over_x_2)
series_4 = Series(Start=0, Step=number_slider_3, Count=addition_4)
vec_3 = VectorXYZ(XComponent=multiplication_10, YComponent=multiplication_10, ZComponent=0)  # -> Vector, Length
int_3 = Integer(cset.Map)
vec_4 = VectorXYZ(XComponent=series_4, YComponent=graft(series_4), ZComponent=0)  # -> Vector, Length
series_5 = Series(Start=0, Step=Slider(1, range=0..100), Count=addition_4)
neg_2 = Negative(Value=vec_3.Vector)
int_4 = Integer(series_5)
move_4 = Move(Geometry=data_16, Motion=vec_4.Vector)  # -> Geometry, Transform
concat = Concatenate(FragmentA=int_4, FragmentB=",", FragmentC=graft(int_4))  # -> flatten(Result)
scale = Scale(Geometry=move_4.Geometry, Center=Point(0, 0, 0), Factor=one_over_x)  # -> Geometry, Transform
panel = Panel(concat)
lng_4 = ListLength(List=int_3)
number_slider_5 = Slider(1000, range=0..1000)
lng_5 = ListLength(List=scale.Geometry)
move_5 = Move(Geometry=scale.Geometry, Motion=neg_2)  # -> flatten(Geometry), Transform
multiplication_11 = Multiplication(A=lng_4, B=lng_5)
repeat_2 = RepeatData(Data=graft(concat), Length=lng_3)  # -> flatten(Data)
repeat_3 = RepeatData(Data=graft(concat), Length=lng_3)  # -> flatten(Data)
scale_2 = Scale(Geometry=weldvertices.Mesh, Center=Point(0, 0, 0), Factor=number_slider_5)  # -> Geometry, Transform
repeat_4 = RepeatData(Data=int_3, Length=multiplication_11)  # -> flatten(Data)
scale_3 = Scale(Geometry=move_5.Geometry, Center=Point(0, 0, 0), Factor=number_slider_5)  # -> Geometry, Transform
faceb = FaceBoundaries(Mesh=scale_2.Geometry)
demesh_4 = DeconstructMesh(Mesh=scale_3.Geometry)  # -> flatten(Vertices), Faces, Colours, Normals
lng_6 = ListLength(List=faceb)
incurves = PointInCurves(Point=demesh_4.Vertices, Curves=faceb)  # -> Relationship, Index, Point
explode_7 = MeshExplode(Mesh=scale_2.Geometry, Interpolate=False)  # -> graft(Faces)
series_6 = Series(Start=0, Step=1, Count=lng_6)
lng_7 = ListLength(List=repeat_3)
data_17 = Data(data_15)
int_5 = Integer(series_6)
mindex_4 = MemberIndex(Set=incurves.Index, Member=int_5)  # -> Index, Count
item_6 = ListItem(List=repeat_3, Index=mindex_4.Index, Wrap=True)
split_13 = TextSplit(Text=item_6, Separators=",")
repeat_5 = RepeatData(Data=data_17, Length=lng_7)
item_7 = ListItem(List=repeat_5, Index=mindex_4.Index, Wrap=True)
int_6 = Integer(split_13)
pdecon = Deconstruct(Point=item_7)  # -> XComponent, YComponent, ZComponent
item_8 = ListItem(List=int_6, Index=0, Wrap=True)  # -> Item, Item1
item_9 = ListItem(List=demesh_4.Vertices, Index=mindex_4.Index, Wrap=True)
item_10 = ListItem(List=multiplication_9, Index=mindex_4.Index, Wrap=True)
item_11 = ListItem(List=repeat_3, Index=mindex_4.Index, Wrap=True)
item_12 = ListItem(List=demesh_4.Vertices, Index=mindex_4.Index, Wrap=True)
item_13 = ListItem(List=repeat_4, Index=mindex_4.Index, Wrap=True)
match = MatchTreeStructure(DataList=flatten(pdecon.YComponent), TreeMask=item_8.Item)
match_2 = MatchTreeStructure(DataList=flatten(pdecon.XComponent), TreeMask=item_8.Item)
panel_2 = Panel(pdecon.YComponent)
split_14 = TextSplit(Text=item_11, Separators=", ")
item_14 = ListItem(List=demesh_3.Vertices, Index=item_13, Wrap=True)
item_15 = ListItem(List=pt_2, Index=item_13, Wrap=True)
addition_5 = Addition(A=match, B=item_8.Item1)
addition_6 = Addition(A=match_2, B=item_8.Item)
meshcp = MeshClosestPoint(Point=item_12, Mesh=explode_7)  # -> Point, Index, Parameter
int_7 = Integer(addition_5)
int_8 = Integer(addition_6)
multiplication_12 = Multiplication(A=split_14, B=Slider(50, range=0..100))
item_16 = ListItem(List=multiplication_12, Index=0, Wrap=True)  # -> Item, Item1
vec_5 = VectorXYZ(XComponent=item_16.Item, YComponent=item_16.Item1, ZComponent=0)  # -> Vector, Length
addition_7 = Addition(A=item_10, B=vec_5.Vector)
concat_2 = Concatenate(FragmentA=int_8, FragmentC=",", FragmentB=int_7)
concat_3 = Concatenate(FragmentA="new Vector2Int(", FragmentB=item_6, FragmentC=")")
data_18 = Data(concat_3)
lng_8 = ListLength(List=data_18)
trim = TrimTree(Tree=vec_5.Vector, Depth=1)
trim_2 = TrimTree(Tree=concat_2, Depth=1)
lng_9 = ListLength(List=lng_8)
panel_3 = Panel("var relationships= new Vector2Int[][]{")
panel_4 = Panel(item_6)
panel_5 = Panel("f)")
move_6 = Move(Geometry=item_14, Motion=trim)  # -> Geometry, Transform
move_7 = Move(Geometry=item_15, Motion=trim)  # -> Geometry, Transform
repeat_6 = RepeatData(Data=",", Length=expr("x-1", lng_8))
number_slider_6 = Slider(0.25, range=0..1)
repeat_7 = RepeatData(Data="}", Length=expr("x", lng_9))
panel_6 = Panel(trim_2)
repeat_8 = RepeatData(Data="new Vector2Int[]{", Length=expr("x", lng_9))
join_4 = TextJoin(Text=data_18, Join=",")
item_17 = ListItem(List=repeat_3, Index=mindex_4.Index, Wrap=True)
join_5 = TextJoin(Text=item_13, Join=",")
concat_4 = Concatenate()
merge_8 = Merge(Data1=flatten(repeat_8), Data2=flatten("};"))
scale_4 = Scale(Geometry=move_6.Geometry, Center=Point(0, 0, 0), Factor=number_slider_6)  # -> Geometry, Transform
scale_5 = Scale(Geometry=move_7.Geometry, Center=Point(0, 0, 0), Factor=number_slider_6)  # -> Geometry, Transform
panel_7 = Panel(join_5)
data_19 = Data(meshcp.Parameter)
split_15 = TextSplit(Text=data_19, Separators="[];")
concat_5 = Concatenate(FragmentA=repeat_8, FragmentC=join_4, FragmentB=repeat_7, FragmentD=",")  # -> flatten(Result)
concat_6 = Concatenate(FragmentA=concat_4, FragmentB=merge_8)
split_16 = SplitList(List=concat_6, Index=1)  # -> ListA, ListB
item_18 = ListItem(List=split_15, Index=0, Wrap=True)  # -> Item, Item1, Item2, Item3, Item4
merge_9 = Merge(Data1=item_18.Item1, Data2=item_18.Item2, Data3=item_18.Item3)
concat_7 = Concatenate(FragmentA="new int[]{", FragmentB=join_5, FragmentC="}")
join_6 = TextJoin(Text=concat_5, Join=", ")
concat_8 = Concatenate(FragmentA=panel_3, FragmentB=join_6, FragmentC="};")
data_20 = Data(concat_7)
join_7 = TextJoin(Text=merge_9, Join="f,")
panel_8 = Panel("new Vector2Int[]{")
merge_10 = Merge(Data1=panel_3, Data2=concat_5, Data3="};")
concat_9 = Concatenate(FragmentA="new Vector3(", FragmentB=join_7, FragmentC="f)")
panel_9 = Panel(merge_10)
panel_10 = Panel("var relationships= int[][]{")
trim_3 = TrimTree(Tree=concat_9, Depth=1)
data_21 = Data(trim_3)
lng_10 = ListLength(List=data_21)
join_8 = TextJoin(Text=flatten(data_20), Join=",")
lng_11 = ListLength(List=lng_10)
panel_12 = Panel("Barycenters = new Vector23[][]{")
panel_13 = Panel(",")
join_9 = TextJoin(Text=join_8, Join=", ")
repeat_9 = RepeatData(Data=",", Length=expr("x-1", lng_10))
repeat_10 = RepeatData(Data="}", Length=expr("x", lng_11))
repeat_11 = RepeatData(Data="new Vector3[]{", Length=expr("x", lng_11))
join_10 = TextJoin(Text=data_21, Join=",")
concat_10 = Concatenate()
merge_11 = Merge(Data1=flatten(repeat_11), Data2=flatten("};"))
concat_11 = Concatenate(FragmentA=panel_10, FragmentB=flatten(join_8), FragmentC="};")
concat_12 = Concatenate(FragmentA=repeat_11, FragmentC=join_10, FragmentB=repeat_10, FragmentD=",")  # -> flatten(Result)
concat_13 = Concatenate(FragmentA=concat_10, FragmentB=merge_11)
split_17 = SplitList(List=concat_13, Index=1)  # -> ListA, ListB
merge_12 = Merge(Data1=panel_10, Data2=join_9, Data3="};")
panel_15 = Panel(join_8)
join_11 = TextJoin(Text=concat_12, Join=", ")
concat_14 = Concatenate(FragmentA=panel_12, FragmentB=join_11, FragmentC="};")
merge_13 = Merge(Data1=panel_12, Data2=concat_12, Data3="};")
panel_16 = Panel(merge_13)
