# Grasshopper definition fifty-seven.gh (Grasshopper 0.9.76)
# plug-ins: MeshEdit Components

rectangle = Rectangle(Plane=PlaneXY(0, 0, 0), XSize=Slider(50, range=0..100), YSize=Slider(50, range=0..100), Radius=0)  # -> Rectangle, Length
explode = Explode(Curve=rectangle.Rectangle, Recursive=True)  # -> Segments, Vertices
item = ListItem(List=explode.Segments, Index=0, Wrap=True)  # -> Item, Item1, Item2, Item3
number_slider = Slider(10, range=0..100)
flip = FlipCurve(Curve=item.Item)  # -> Curve, Flag
flip_2 = FlipCurve(Curve=item.Item1)  # -> Curve, Flag
merge = Merge(Data1=flip.Curve, Data2=item.Item2)
merge_2 = Merge(Data1=flip_2.Curve, Data2=item.Item3)
divide = DivideCurve(Curve=reparameterize(merge_2), Count=number_slider, Kinks=False)  # -> Points, Tangents, Parameters
pi = Pi(Factor=Slider(3, range=0..10))
pi_2 = Pi(Factor=Slider(6, range=0..10))
divide_2 = DivideCurve(Curve=reparameterize(merge), Count=number_slider, Kinks=False)  # -> Points, Tangents, Parameters
multiplication = Multiplication(A=divide.Parameters, B=pi)
multiplication_2 = Multiplication(A=divide.Parameters, B=pi_2)
pi_3 = Pi(Factor=Slider(5, range=0..10))
pi_4 = Pi(Factor=Slider(1, range=0..10))
sin = Sine(Value=multiplication_2)
sin_2 = Sine(Value=multiplication)
multiplication_3 = Multiplication(A=divide_2.Parameters, B=pi_4)
multiplication_4 = Multiplication(A=divide_2.Parameters, B=pi_3)
multiplication_5 = Multiplication(A=sin_2, B=Slider(3, range=0..10))
multiplication_6 = Multiplication(A=sin, B=Slider(2, range=0..10))
sin_3 = Sine(Value=multiplication_4)
sin_4 = Sine(Value=multiplication_3)
addition = Addition(A=multiplication_5, B=multiplication_6)
X = UnitX(Factor=addition)
multiplication_7 = Multiplication(A=sin_4, B=Slider(6, range=0..10))
multiplication_8 = Multiplication(A=sin_3, B=Slider(2, range=0..10))
move = Move(Geometry=divide.Points, Motion=X)  # -> Geometry, Transform
addition_2 = Addition(A=multiplication_7, B=multiplication_8)
Y = UnitY(Factor=addition_2)
move_2 = Move(Geometry=divide_2.Points, Motion=Y)  # -> Geometry, Transform
pline = PolyLine(Vertices=move.Geometry, Closed=False)  # -> flatten(Polyline)
pline_2 = PolyLine(Vertices=move_2.Geometry, Closed=False)  # -> flatten(Polyline)
merge_3 = Merge(Data1=pline_2, Data2=pline)
item_2 = ListItem(List=pline_2, Index=0, Wrap=True)  # -> Item1, Item
item_3 = ListItem(List=pline, Index=0, Wrap=True)  # -> Item1, Item
item_4 = ListItem(List=pline_2, Index=0, Wrap=True)  # -> Item1, Item
item_5 = ListItem(List=pline, Index=0, Wrap=True)  # -> Item1, Item
join = JoinCurves(Curves=merge_3, Preserve=False)
data = Data(item_2.Item1)
data_2 = Data(item_4.Item)
data_3 = Data(item_3.Item)
data_4 = Data(item_5.Item1)
neg = Negative(Value=Slider(2.8633, range=0..10))
explode_2 = Explode(Curve=join, Recursive=True)  # -> Segments, Vertices
data_5 = Data(join)
offset = Offset(Curve=join, Distance=neg, Plane=PlaneXY(0, 0, 0), Corners=1)
join_2 = JoinCurves(Curves=[data, data_3], Preserve=False)
join_3 = JoinCurves(Curves=[data_2, data_4], Preserve=False)
explode_3 = Explode(Curve=data, Recursive=True)  # -> Segments, Vertices
explode_4 = Explode(Curve=data_2, Recursive=True)  # -> Segments, Vertices
srf = Surface(offset)
explode_5 = Explode(Curve=data_3, Recursive=True)  # -> Segments, Vertices
explode_6 = Explode(Curve=data_4, Recursive=True)  # -> Segments, Vertices
split = SplitList(List=explode_3.Vertices, Index=1)  # -> ListA, ListB
split_2 = SplitList(List=explode_4.Vertices, Index=1)  # -> ListA, ListB
split_3 = SplitList(List=explode_6.Vertices, Index=1)  # -> ListA, ListB
split_4 = SplitList(List=explode_2.Vertices, Index=1)  # -> ListA, ListB
popgeo = PopulateGeometry(Geometry=srf, Count=Slider(100, range=0..1000), Seed=Slider(22, range=0..100))
split_5 = SplitList(List=explode_5.Vertices, Index=1)  # -> ListA, ListB
split_6 = SplitList(List=reverse(split_2.ListB), Index=1)  # -> ListA, reverse(ListB)
split_7 = SplitList(List=reverse(split_3.ListB), Index=1)  # -> ListA, reverse(ListB)
merge_4 = Merge(Data1=split_4.ListB, Data2=popgeo)
split_8 = SplitList(List=reverse(split.ListB), Index=1)  # -> ListA, reverse(ListB)
split_9 = SplitList(List=reverse(split_6.ListB), Index=1)  # -> ListA, reverse(ListB)
split_10 = SplitList(List=reverse(split_5.ListB), Index=1)  # -> ListA, reverse(ListB)
del = DelaunayMesh(Points=merge_4, Plane=PlaneXY(0, 0, 0))
split_11 = SplitList(List=reverse(split_7.ListB), Index=1)  # -> ListA, reverse(ListB)
data_6 = Data(split_5.ListB)
split_12 = SplitList(List=split_8.ListB, Index=1)  # -> ListA, reverse(ListB)
facen = FaceNormals(Mesh=del)  # -> Centers, Normals
data_7 = Data(split_7.ListA)
incurve = PointInCurve(Point=facen.Centers, Curve=data_5)  # -> Relationship, Point
data_8 = Data(split_5.ListA)
demesh = DeconstructMesh(Mesh=del)  # -> Vertices, Faces, Colours, Normals
dispatch = Dispatch(List=demesh.Faces, DispatchPattern=incurve.Relationship)  # -> ListA, ListB
conmesh = ConstructMesh(Vertices=demesh.Vertices, Faces=dispatch.ListA)
data_9 = Data(split.ListB)
data_10 = Data(data_6)
data_11 = Data(split_2.ListB)
data_12 = Data(data_8)
data_13 = Data(split_3.ListB)
data_14 = Data(data_7)
weldvertices = MeshWeldVertices(Mesh=conmesh, Tolerance=0.01)  # -> RuntimeMessage, Mesh
demesh_2 = DeconstructMesh(Mesh=weldvertices.Mesh)  # -> Vertices, Faces, Colours, Normals
cp = ClosestPoint(Point=data_12, Cloud=demesh_2.Vertices)  # -> ClosestPoint, CPIndex, Distance
cp_2 = ClosestPoint(Point=data_10, Cloud=demesh_2.Vertices)  # -> ClosestPoint, CPIndex, Distance
cp_3 = ClosestPoint(Point=data_9, Cloud=demesh_2.Vertices)  # -> ClosestPoint, CPIndex, Distance
cp_4 = ClosestPoint(Point=data_14, Cloud=demesh_2.Vertices)  # -> ClosestPoint, CPIndex, Distance
cp_5 = ClosestPoint(Point=data_13, Cloud=demesh_2.Vertices)  # -> ClosestPoint, CPIndex, Distance
cp_6 = ClosestPoint(Point=data_11, Cloud=demesh_2.Vertices)  # -> ClosestPoint, CPIndex, Distance
deface = DeconstructFace(Face=demesh_2.Faces)  # -> CornerA, CornerB, CornerC, CornerD
Y_2 = UnitY(Factor=1)
vec = VectorXYZ(XComponent=0, YComponent=0, ZComponent=0)  # -> Vector, Length
X_2 = UnitX(Factor=1)
merge_5 = Merge(Data1=cp.CPIndex, Data2=cp_2.CPIndex, Data3=cp_3.CPIndex)  # -> flatten(Result)
lng = ListLength(List=cp_2.CPIndex)
merge_6 = Merge(Data1=cp_4.CPIndex, Data2=cp_5.CPIndex, Data3=cp_6.CPIndex)
lng_2 = ListLength(List=cp_3.CPIndex)
merge_7 = Merge(Data1=graft(deface.CornerA), Data2=graft(deface.CornerB), Data3=graft(deface.CornerC))  # -> flatten(Result)
repeat = RepeatData(Data=X_2, Length=lng)
lng_3 = ListLength(List=merge_7)
repeat_2 = RepeatData(Data=Y_2, Length=lng_2)
repeat_3 = RepeatData(Data=vec.Vector, Length=lng_3)
X_3 = UnitX(Factor=1)
Y_3 = UnitY(Factor=1)
mindex = MemberIndex(Set=merge_7, Member=cp_3.CPIndex)  # -> flatten(Index), Count
mindex_2 = MemberIndex(Set=merge_7, Member=cp.CPIndex)  # -> flatten(Index), Count
mindex_3 = MemberIndex(Set=merge_7, Member=cp_2.CPIndex)  # -> flatten(Index), Count
replace = ReplaceMembers(Set=merge_7, Find=flatten(merge_5), Replace=flatten(merge_6))
addition_3 = Addition(A=Y_3, B=X_3)
replace_2 = ReplaceItems(List=repeat_3, Item=addition_3, Indices=mindex_2.Index, Wrap=False)
replace_3 = ReplaceItems(List=replace_2, Item=X_2, Indices=mindex_3.Index, Wrap=False)
item_6 = ListItem(List=demesh_2.Vertices, Index=replace, Wrap=True)
replace_4 = ReplaceItems(List=replace_3, Item=Y_2, Indices=mindex.Index, Wrap=False)
multiplication_9 = Multiplication(A=replace_4, B=Slider(50, range=0..100))
move_3 = Move(Geometry=item_6, Motion=multiplication_9)  # -> Geometry, Transform
ln = Line(StartPoint=item_6, EndPoint=move_3.Geometry)
number_slider_2 = Slider(50, range=0..100)
number_slider_3 = Slider(4, range=0..10)
demesh_3 = DeconstructMesh(Mesh=weldvertices.Mesh)  # -> Vertices, Faces, Colours, Normals
data_15 = Data(weldvertices.Mesh)
series = Series(Start=0, Step=Slider(50, range=0..100), Count=Slider(2, range=0..10))
demesh_4 = DeconstructMesh(Mesh=weldvertices.Mesh)  # -> Vertices, Faces, Colours, Normals
lng_4 = ListLength(List=demesh_3.Vertices)
addition_4 = Addition(A=number_slider_3, B=2)
one_over_x = OneOverX(Value=number_slider_3)
one_over_x_2 = OneOverX(Value=number_slider_3)
deface_2 = DeconstructFace(Face=demesh_4.Faces)  # -> graft(CornerA), graft(CornerB), graft(CornerC), CornerD
series_2 = Series(Start=0, Step=1, Count=lng_4)
multiplication_10 = Multiplication(A=number_slider_2, B=one_over_x_2)
series_3 = Series(Start=0, Step=number_slider_2, Count=addition_4)
int = Integer(series_2)
merge_8 = Merge(Data1=deface_2.CornerA, Data2=deface_2.CornerB, Data3=deface_2.CornerC)  # -> flatten(Result)
demesh_5 = DeconstructMesh(Mesh=weldvertices.Mesh)  # -> Vertices, Faces, Colours, Normals
vec_2 = VectorXYZ(XComponent=multiplication_10, YComponent=multiplication_10, ZComponent=0)  # -> Vector, Length
vec_3 = VectorXYZ(XComponent=series_3, YComponent=graft(series_3), ZComponent=0)  # -> Vector, Length
number_slider_4 = Slider(39, range=0..100)
series_4 = Series(Start=0, Step=Slider(1, range=0..100), Count=addition_4)
neg_2 = Negative(Value=vec_2.Vector)
lng_5 = ListLength(List=merge_8)
lng_6 = ListLength(List=demesh_5.Vertices)
panel = Panel("f)")
vec_4 = VectorXYZ(XComponent=series, YComponent=graft(series), ZComponent=0)  # -> Vector, Length
pdecon = Deconstruct(Point=demesh_5.Vertices)  # -> XComponent, YComponent, ZComponent
int_2 = Integer(series_4)
repeat_4 = RepeatData(Data=",", Length=expr("x-1", lng_5))
move_4 = Move(Geometry=data_15, Motion=vec_3.Vector)  # -> Geometry, Transform
concat = Concatenate(FragmentA=int_2, FragmentB=",", FragmentC=graft(int_2))  # -> flatten(Result)
repeat_5 = RepeatData(Data=",", Length=expr("x-1", lng_6))
concat_2 = Concatenate(FragmentA=merge_8)
move_5 = Move(Geometry=weldvertices.Mesh, Motion=vec_4.Vector)  # -> Geometry, Transform
concat_3 = Concatenate(
    FragmentA="new Vector3(",
    FragmentB=pdecon.XComponent,
    FragmentC="f,",
    FragmentD=pdecon.YComponent,
    FragmentE="f,",
    FragmentF=pdecon.ZComponent,
    FragmentG="f)")
pt = ConstructPoint(XCoordinate=number_slider_4, YCoordinate=number_slider_4, ZCoordinate=0)
addition_5 = Addition(A=number_slider_4, B=Slider(50, range=0..100))
merge_9 = Merge(Data1=flatten(repeat_4), Data2=flatten("};"))
scale = Scale(Geometry=move_4.Geometry, Center=Point(0, 0, 0), Factor=one_over_x)  # -> Geometry, Transform
merge_10 = Merge(Data1=flatten(repeat_5), Data2=flatten("};"))
lng_7 = ListLength()
demesh_6 = DeconstructMesh(Mesh=move_5.Geometry)  # -> Vertices, Faces, Colours, Normals
facen_2 = FaceNormals(Mesh=move_5.Geometry)  # -> Centers, Normals
lng_8 = ListLength(List=int)
number_slider_5 = Slider(1000, range=0..1000)
lng_9 = ListLength(List=scale.Geometry)
dom = ConstructDomain(DomainStart=number_slider_4, DomainEnd=addition_5)
move_6 = Move(Geometry=scale.Geometry, Motion=neg_2)  # -> flatten(Geometry), Transform
concat_4 = Concatenate(FragmentA=concat_2, FragmentB=merge_9)
split_13 = SplitList(List=concat_4, Index=1)  # -> ListA, ListB
panel_2 = Panel(concat)
concat_5 = Concatenate(FragmentA=concat_3, FragmentB=merge_10)
split_14 = SplitList(List=concat_5, Index=1)  # -> ListA, ListB
multiplication_11 = Multiplication(A=lng_8, B=lng_9)
pdecon_2 = Deconstruct(Point=facen_2.Centers)  # -> XComponent, YComponent, ZComponent
concat_6 = Concatenate(FragmentA="var indexes = new int[]{", FragmentB=split_13.ListA)
concat_7 = Concatenate(FragmentA="var pts = Vector3[]{", FragmentB=split_14.ListA)
repeat_6 = RepeatData(Data=graft(concat), Length=lng_4)  # -> flatten(Data)
scale_2 = Scale(Geometry=weldvertices.Mesh, Center=Point(0, 0, 0), Factor=number_slider_5)  # -> Geometry, Transform
inc = Includes(Value=pdecon_2.XComponent, Domain=dom)  # -> Includes, Deviation
inc_2 = Includes(Value=pdecon_2.YComponent, Domain=dom)  # -> Includes, Deviation
merge_11 = Merge(Data1=concat_6, Data2=split_13.ListB)
merge_12 = Merge(Data1=concat_7, Data2=split_14.ListB)
repeat_7 = RepeatData(Data=int, Length=multiplication_11)  # -> flatten(Data)
scale_3 = Scale(Geometry=move_6.Geometry, Center=Point(0, 0, 0), Factor=number_slider_5)  # -> Geometry, Transform
panel_3 = Panel(merge_11)
faceb = FaceBoundaries(Mesh=scale_2.Geometry)
and = GateAnd(A=inc.Includes, B=inc_2.Includes)
demesh_7 = DeconstructMesh(Mesh=scale_3.Geometry)  # -> flatten(Vertices), Faces, Colours, Normals
neg_3 = Negative(Value=pt)
panel_4 = Panel(merge_12)
lng_10 = ListLength(List=faceb)
incurves = PointInCurves(Point=demesh_7.Vertices, Curves=faceb)  # -> Relationship, Index, Point
dispatch_2 = Dispatch(List=demesh_6.Faces, DispatchPattern=and)  # -> ListA, ListB
explode_7 = MeshExplode(Mesh=scale_2.Geometry, Interpolate=False)  # -> graft(Faces)
data_16 = Data(dispatch_2.ListA)
series_5 = Series(Start=0, Step=1, Count=lng_10)
conmesh_2 = ConstructMesh(Vertices=demesh_6.Vertices, Faces=data_16)
int_3 = Integer(series_5)
weldvertices_2 = MeshWeldVertices(Mesh=conmesh_2, Tolerance=0.01)  # -> RuntimeMessage, Mesh
mindex_4 = MemberIndex(Set=incurves.Index, Member=int_3)  # -> Index, Count
item_7 = ListItem(List=repeat_6, Index=mindex_4.Index, Wrap=True)
item_8 = ListItem(List=repeat_6, Index=mindex_4.Index, Wrap=True)
move_7 = Move(Geometry=weldvertices_2.Mesh, Motion=neg_3)  # -> Geometry, Transform
item_9 = ListItem(List=demesh_7.Vertices, Index=mindex_4.Index, Wrap=True)
item_10 = ListItem(List=repeat_6, Index=mindex_4.Index, Wrap=True)
item_11 = ListItem(List=demesh_7.Vertices, Index=mindex_4.Index, Wrap=True)
item_12 = ListItem(List=repeat_7, Index=mindex_4.Index, Wrap=True)
split_15 = TextSplit(Text=item_10, Separators=", ")
item_13 = ListItem(List=demesh_3.Vertices, Index=item_12, Wrap=True)
meshcp = MeshClosestPoint(Point=item_11, Mesh=explode_7)  # -> Point, Index, Parameter
data_17 = Data(meshcp.Parameter)
split_16 = TextSplit(Text=data_17, Separators="[];")
item_14 = ListItem(List=split_16, Index=0, Wrap=True)  # -> Item, Item1, Item2, Item3, Item4
merge_13 = Merge(Data1=item_14.Item1, Data2=item_14.Item2, Data3=item_14.Item3)
join_4 = TextJoin(Text=merge_13, Join="f,")
multiplication_12 = Multiplication(A=split_15, B=Slider(50, range=0..100))
item_15 = ListItem(List=multiplication_12, Index=0, Wrap=True)  # -> Item, Item1
concat_8 = Concatenate(FragmentA="new Vector2Int(", FragmentB=item_7, FragmentC=")")
mjoin = MeshJoin(Meshes=flatten(move_7.Geometry))
concat_9 = Concatenate(FragmentA="new Vector3(", FragmentB=join_4, FragmentC="f)")
vec_5 = VectorXYZ(XComponent=item_15.Item, YComponent=item_15.Item1, ZComponent=0)  # -> Vector, Length
data_18 = Data(concat_8)
weldvertices_3 = MeshWeldVertices(Mesh=mjoin, Tolerance=0.01)  # -> RuntimeMessage, Mesh
number_slider_6 = Slider(2, range=0..10)  # disabled
number_slider_7 = Slider(50, range=0..100)
number_slider_8 = Slider(0.5, range=0..1)
trim = TrimTree(Tree=concat_9, Depth=1)
move_8 = Move(Geometry=mjoin, Motion=vec_4.Vector)  # -> Geometry, Transform
lng_11 = ListLength(List=data_18)
data_19 = Data(trim)
trim_2 = TrimTree(Tree=vec_5.Vector, Depth=1)
move_9 = Move(Geometry=item_13, Motion=trim_2)  # -> Geometry, Transform
scale_4 = Scale(Geometry=move_9.Geometry, Center=Point(0, 0, 0), Factor=Slider(0.25, range=0..1))  # -> Geometry, Transform
lng_12 = ListLength(List=data_19)
number_slider_9 = Slider(1000, range=0..1000)
lng_13 = ListLength(List=lng_11)
data_20 = Data(weldvertices_3.Mesh)
panel_5 = Panel("var relationships= new Vector2Int[][]{")
addition_6 = Addition(A=number_slider_6, B=2)  # disabled
one_over_x_3 = OneOverX(Value=number_slider_6)
one_over_x_4 = OneOverX(Value=number_slider_6)  # disabled
lng_14 = ListLength(List=lng_12)
panel_6 = Panel("Barycenters = new Vector23[][]{")
medges = MeshEdges(Mesh=data_20)  # -> NakedEdges, InteriorEdges, NonManifoldEdges
multiplication_13 = Multiplication(A=number_slider_7, B=one_over_x_4)  # disabled
repeat_8 = RepeatData(Data=",", Length=expr("x-1", lng_11))
repeat_9 = RepeatData(Data="}", Length=expr("x", lng_13))
repeat_10 = RepeatData(Data="new Vector2Int[]{", Length=expr("x", lng_13))
series_6 = Series(Start=0, Step=number_slider_7, Count=addition_6)  # disabled
join_5 = TextJoin(Text=data_18, Join=",")
repeat_11 = RepeatData(Data=",", Length=expr("x-1", lng_12))
vec_6 = VectorXYZ(XComponent=multiplication_13, YComponent=multiplication_13, ZComponent=0)  # -> Vector, Length; disabled
item_16 = ListItem(List=repeat_6, Index=mindex_4.Index, Wrap=True)
repeat_12 = RepeatData(Data="}", Length=expr("x", lng_14))
repeat_13 = RepeatData(Data="new Vector3[]{", Length=expr("x", lng_14))
vec_7 = VectorXYZ(XComponent=series_6, YComponent=graft(series_6), ZComponent=0)  # -> Vector, Length; disabled
join_6 = TextJoin(Text=item_12, Join=",")
concat_10 = Concatenate()
join_7 = JoinCurves(Curves=medges.NakedEdges, Preserve=False)
join_8 = TextJoin(Text=data_19, Join=",")
neg_4 = Negative(Value=vec_6.Vector)  # disabled
scale_5 = Scale(Geometry=join_7, Center=Point(0, 0, 0), Factor=number_slider_9)  # -> Geometry, Transform
merge_14 = Merge(Data1=flatten(repeat_10), Data2=flatten("};"))
concat_11 = Concatenate()
merge_15 = Merge(Data1=flatten(repeat_13), Data2=flatten("};"))
panel_9 = Panel(join_6)
move_10 = Move(Geometry=data_20, Motion=vec_7.Vector)  # -> Geometry, Transform; disabled
concat_12 = Concatenate(FragmentA=repeat_10, FragmentC=join_5, FragmentB=repeat_9, FragmentD=",")  # -> flatten(Result)
concat_13 = Concatenate(FragmentA=concat_10, FragmentB=merge_14)
flip_3 = FlipCurve(Curve=scale_5.Geometry)  # -> Curve, Flag; disabled
split_17 = SplitList(List=concat_13, Index=1)  # -> ListA, ListB
concat_14 = Concatenate(FragmentA=repeat_13, FragmentC=join_8, FragmentB=repeat_12, FragmentD=",")  # -> flatten(Result)
concat_15 = Concatenate(FragmentA=concat_11, FragmentB=merge_15)
scale_6 = Scale(Geometry=move_10.Geometry, Center=Point(0, 0, 0), Factor=one_over_x_3)  # -> Geometry, Transform; disabled
split_18 = SplitList(List=concat_15, Index=1)  # -> ListA, ListB
concat_16 = Concatenate(FragmentA="new int[]{", FragmentB=join_6, FragmentC="}")
join_9 = TextJoin(Text=concat_12, Join=", ")
concat_17 = Concatenate(FragmentA=panel_5, FragmentB=join_9, FragmentC="};")
move_11 = Move(Geometry=scale_6.Geometry, Motion=neg_4)  # -> flatten(Geometry), Transform; disabled
xy = XYPlane(Origin=Point(0, 0, 0))  # disabled
join_10 = TextJoin(Text=concat_14, Join=", ")
concat_18 = Concatenate(FragmentA=panel_6, FragmentB=join_10, FragmentC="};")
data_21 = Data(concat_16)
lng_15 = ListLength(List=move_11.Geometry)  # disabled
panel_10 = Panel("new Vector2Int[]{")
merge_16 = Merge(Data1=panel_5, Data2=concat_12, Data3="};")
facen_3 = FaceNormals(Mesh=move_11.Geometry)  # -> Centers, Normals; disabled
merge_17 = Merge(Data1=panel_6, Data2=concat_14, Data3="};")
panel_11 = Panel(merge_16)
panel_12 = Panel("var relationships= int[][]{")
scale_7 = Scale(Geometry=facen_3.Centers, Center=Point(0, 0, 0), Factor=number_slider_9)  # -> Geometry, Transform; disabled
demesh_8 = DeconstructMesh(Mesh=move_11.Geometry)  # -> Vertices, Faces, Colours, Normals; disabled
join_11 = TextJoin(Text=flatten(data_21), Join=",")
incurve_2 = PointInCurve(Point=scale_7.Geometry, Curve=flip_3.Curve)  # -> Relationship, Point; disabled
panel_14 = Panel(merge_17)
side = CurveSide(Curve=flip_3.Curve, Point=facen_3.Centers, Plane=xy)  # -> Side, Left, Right; disabled
panel_15 = Panel(",")
equals = Equality(FirstNumber=incurve_2.Relationship, SecondNumber=0)  # -> Equality, Inequality; disabled
join_12 = TextJoin(Text=join_11, Join=", ")
series_7 = Series(Start=0, Step=1, Count=lng_15)  # disabled
gradient = Gradient(
    LowerLimit=0,
    UpperLimit=lng_15,
    Parameter=series_7,
    stops=[0: RGB(243, 57, 0), 0.1: RGB(236, 27, 60), 0.2: RGB(210, 0, 118), 0.3: RGB(103, 0, 120), 0.4: RGB(39, 72, 161), 0.5: RGB(1, 192, 229), 0.6: RGB(18, 178, 90), 0.7: RGB(79, 186, 8), 0.8: RGB(220, 237, 32), 0.9: RGB(247, 159, 20), 1: RGB(243, 57, 0)])  # disabled
concat_19 = Concatenate(FragmentA=panel_12, FragmentB=flatten(join_11), FragmentC="};")
dispatch_3 = Dispatch(List=demesh_8.Faces, DispatchPattern=equals.Equality)  # -> ListA, ListB; disabled
preview = CustomPreview(Geometry=move_11.Geometry, Shader=gradient)  # disabled
merge_18 = Merge(Data1=panel_12, Data2=join_12, Data3="};")
conmesh_3 = ConstructMesh(Vertices=demesh_8.Vertices, Faces=dispatch_3.ListB)  # -> flatten(Mesh); disabled
panel_16 = Panel(join_11)
mjoin_2 = MeshJoin(Meshes=conmesh_3)  # disabled
move_12 = Move(Geometry=mjoin_2, Motion=vec_4.Vector)  # -> Geometry, Transform; disabled
number_slider_10 = Slider(4, range=0..10)  # disabled
number_slider_11 = Slider(50, range=0..100)  # disabled
number_slider_12 = Slider(1000, range=0..1000)  # disabled
data_22 = Data(mjoin_2)  # disabled
addition_7 = Addition(A=number_slider_10, B=2)  # disabled
one_over_x_5 = OneOverX(Value=number_slider_10)  # disabled
one_over_x_6 = OneOverX(Value=number_slider_10)  # disabled
data_23 = Data(mjoin)  # disabled
data_24 = Data(mjoin_2)  # disabled
multiplication_14 = Multiplication(A=number_slider_11, B=one_over_x_6)  # disabled
series_8 = Series(Start=0, Step=number_slider_11, Count=addition_7)  # disabled
vec_8 = VectorXYZ(XComponent=multiplication_14, YComponent=multiplication_14, ZComponent=0)  # -> Vector, Length; disabled
scale_8 = Scale(Geometry=data_23, Center=Point(0, 0, 0), Factor=number_slider_12)  # -> Geometry, Transform; disabled
scale_9 = Scale(Geometry=data_24, Center=Point(0, 0, 0), Factor=number_slider_12)  # -> Geometry, Transform; disabled
vec_9 = VectorXYZ(XComponent=series_8, YComponent=graft(series_8), ZComponent=0)  # -> Vector, Length; disabled
neg_5 = Negative(Value=vec_8.Vector)  # disabled
facen_4 = FaceNormals(Mesh=scale_9.Geometry)  # -> Centers, Normals; disabled
faceb_2 = FaceBoundaries(Mesh=scale_8.Geometry)  # disabled
move_13 = Move(Geometry=data_22, Motion=vec_9.Vector)  # -> Geometry, Transform; disabled
incurves_2 = PointInCurves(Point=facen_4.Centers, Curves=faceb_2)  # -> Relationship, Index, Point; disabled
scale_10 = Scale(Geometry=move_13.Geometry, Center=Point(0, 0, 0), Factor=one_over_x_5)  # -> Geometry, Transform; disabled
move_14 = Move(Geometry=scale_10.Geometry, Motion=neg_5)  # -> flatten(Geometry), Transform; disabled
