# Grasshopper definition fifty-three.gh (Grasshopper 0.9.76)
# plug-ins: MeshEdit Components

rectangle = Rectangle(Plane=PlaneXY(0, 0, 0), XSize=Slider(50, range=0..100), YSize=Slider(50, range=0..100), Radius=0)  # -> Rectangle, Length
explode = Explode(Curve=rectangle.Rectangle, Recursive=True)  # -> Segments, Vertices
item = ListItem(List=explode.Segments, Index=0, Wrap=True)  # -> Item, Item1, Item2, Item3
number_slider = Slider(25, range=0..100)
flip = FlipCurve(Curve=item.Item)  # -> Curve, Flag
flip_2 = FlipCurve(Curve=item.Item1)  # -> Curve, Flag
merge = Merge(Data1=flip.Curve, Data2=item.Item2)
merge_2 = Merge(Data1=flip_2.Curve, Data2=item.Item3)
divide = DivideCurve(Curve=reparameterize(merge_2), Count=number_slider, Kinks=False)  # -> Points, Tangents, Parameters
pi = Pi(Factor=Slider(3, range=0..10))
pi_2 = Pi(Factor=Slider(6, range=0..10))
divide_2 = DivideCurve(Curve=reparameterize(merge), Count=number_slider, Kinks=False)  # -> Points, Tangents, Parameters
multiplication = Multiplication(A=divide.Parameters, B=pi)
multiplication_2 = Multiplication(A=divide.Parameters, B=pi_2)
pi_3 = Pi(Factor=Slider(5, range=0..10))
pi_4 = Pi(Factor=Slider(1, range=0..10))
sin = Sine(Value=multiplication_2)
sin_2 = Sine(Value=multiplication)
multiplication_3 = Multiplication(A=divide_2.Parameters, B=pi_4)
multiplication_4 = Multiplication(A=divide_2.Parameters, B=pi_3)
multiplication_5 = Multiplication(A=sin_2, B=Slider(3, range=0..10))
multiplication_6 = Multiplication(A=sin, B=Slider(2, range=0..10))
sin_3 = Sine(Value=multiplication_4)
sin_4 = Sine(Value=multiplication_3)
addition = Addition(A=multiplication_5, B=multiplication_6)
X = UnitX(Factor=addition)
multiplication_7 = Multiplication(A=sin_4, B=Slider(6, range=0..10))
multiplication_8 = Multiplication(A=sin_3, B=Slider(2, range=0..10))
move = Move(Geometry=divide.Points, Motion=X)  # -> Geometry, Transform
addition_2 = Addition(A=multiplication_7, B=multiplication_8)
Y = UnitY(Factor=addition_2)
move_2 = Move(Geometry=divide_2.Points, Motion=Y)  # -> Geometry, Transform
pline = PolyLine(Vertices=move.Geometry, Closed=False)  # -> flatten(Polyline)
pline_2 = PolyLine(Vertices=move_2.Geometry, Closed=False)  # -> flatten(Polyline)
merge_3 = Merge(Data1=pline_2, Data2=pline)
join = JoinCurves(Curves=merge_3, Preserve=False)
neg = Negative(Value=Slider(1.0201, range=0..10))
explode_2 = Explode(Curve=join, Recursive=True)  # -> Segments, Vertices
data = Data(join)
offset = Offset(Curve=join, Distance=neg, Plane=PlaneXY(0, 0, 0), Corners=1)
srf = Surface(offset)
split = SplitList(List=explode_2.Vertices, Index=1)  # -> ListA, ListB
popgeo = PopulateGeometry(Geometry=srf, Count=Slider(857, range=0..1000), Seed=Slider(51.664, range=0..100))
merge_4 = Merge(Data1=split.ListB, Data2=popgeo)
del = DelaunayMesh(Points=merge_4, Plane=PlaneXY(0, 0, 0))
facen = FaceNormals(Mesh=del)  # -> Centers, Normals
demesh = DeconstructMesh(Mesh=del)  # -> Vertices, Faces, Colours, Normals
incurve = PointInCurve(Point=facen.Centers, Curve=data)  # -> Relationship, Point
dispatch = Dispatch(List=demesh.Faces, DispatchPattern=incurve.Relationship)  # -> ListA, ListB
conmesh = ConstructMesh(Vertices=demesh.Vertices, Faces=dispatch.ListA)
number_slider_2 = Slider(39, range=0..100)
weldvertices = MeshWeldVertices(Mesh=conmesh, Tolerance=0.01)  # -> RuntimeMessage, Mesh
series = Series(Start=0, Step=Slider(50, range=0..100), Count=Slider(2, range=0..10))
vec = VectorXYZ(XComponent=series, YComponent=graft(series), ZComponent=0)  # -> Vector, Length
move_3 = Move(Geometry=weldvertices.Mesh, Motion=vec.Vector)  # -> Geometry, Transform
pt = ConstructPoint(XCoordinate=number_slider_2, YCoordinate=number_slider_2, ZCoordinate=0)
addition_3 = Addition(A=number_slider_2, B=Slider(50, range=0..100))
demesh_2 = DeconstructMesh(Mesh=move_3.Geometry)  # -> Vertices, Faces, Colours, Normals
facen_2 = FaceNormals(Mesh=move_3.Geometry)  # -> Centers, Normals
dom = ConstructDomain(DomainStart=number_slider_2, DomainEnd=addition_3)
pdecon = Deconstruct(Point=facen_2.Centers)  # -> XComponent, YComponent, ZComponent
inc = Includes(Value=pdecon.XComponent, Domain=dom)  # -> Includes, Deviation
inc_2 = Includes(Value=pdecon.YComponent, Domain=dom)  # -> Includes, Deviation
and = GateAnd(A=inc.Includes, B=inc_2.Includes)
neg_2 = Negative(Value=pt)
dispatch_2 = Dispatch(List=demesh_2.Faces, DispatchPattern=and)  # -> ListA, ListB
data_2 = Data(dispatch_2.ListA)
conmesh_2 = ConstructMesh(Vertices=demesh_2.Vertices, Faces=data_2)
weldvertices_2 = MeshWeldVertices(Mesh=conmesh_2, Tolerance=0.01)  # -> RuntimeMessage, Mesh
move_4 = Move(Geometry=weldvertices_2.Mesh, Motion=neg_2)  # -> Geometry, Transform
mjoin = MeshJoin(Meshes=flatten(move_4.Geometry))
weldvertices_3 = MeshWeldVertices(Mesh=mjoin, Tolerance=0.01)  # -> RuntimeMessage, Mesh
number_slider_3 = Slider(4, range=0..10)
number_slider_4 = Slider(50, range=0..100)
number_slider_5 = Slider(0.5, range=0..1)
move_5 = Move(Geometry=mjoin, Motion=vec.Vector)  # -> Geometry, Transform
number_slider_6 = Slider(1000, range=0..1000)
data_3 = Data(weldvertices_3.Mesh)
addition_4 = Addition(A=number_slider_3, B=2)
one_over_x = OneOverX(Value=number_slider_3)
one_over_x_2 = OneOverX(Value=number_slider_3)
medges = MeshEdges(Mesh=data_3)  # -> NakedEdges, InteriorEdges, NonManifoldEdges
multiplication_9 = Multiplication(A=number_slider_4, B=one_over_x_2)
series_2 = Series(Start=0, Step=number_slider_4, Count=addition_4)
vec_2 = VectorXYZ(XComponent=multiplication_9, YComponent=multiplication_9, ZComponent=0)  # -> Vector, Length
vec_3 = VectorXYZ(XComponent=series_2, YComponent=graft(series_2), ZComponent=0)  # -> Vector, Length
join_2 = JoinCurves(Curves=medges.NakedEdges, Preserve=False)
neg_3 = Negative(Value=vec_2.Vector)
scale = Scale(Geometry=join_2, Center=Point(0, 0, 0), Factor=number_slider_6)  # -> Geometry, Transform
move_6 = Move(Geometry=data_3, Motion=vec_3.Vector)  # -> Geometry, Transform
flip_3 = FlipCurve(Curve=scale.Geometry)  # -> Curve, Flag
scale_2 = Scale(Geometry=move_6.Geometry, Center=Point(0, 0, 0), Factor=one_over_x)  # -> Geometry, Transform
move_7 = Move(Geometry=scale_2.Geometry, Motion=neg_3)  # -> flatten(Geometry), Transform
xy = XYPlane(Origin=Point(0, 0, 0))
lng = ListLength(List=move_7.Geometry)
facen_3 = FaceNormals(Mesh=move_7.Geometry)  # -> Centers, Normals
scale_3 = Scale(Geometry=facen_3.Centers, Center=Point(0, 0, 0), Factor=number_slider_6)  # -> Geometry, Transform
demesh_3 = DeconstructMesh(Mesh=move_7.Geometry)  # -> Vertices, Faces, Colours, Normals
incurve_2 = PointInCurve(Point=scale_3.Geometry, Curve=flip_3.Curve)  # -> Relationship, Point
side = CurveSide(Curve=flip_3.Curve, Point=facen_3.Centers, Plane=xy)  # -> Side, Left, Right; disabled
equals = Equality(FirstNumber=incurve_2.Relationship, SecondNumber=0)  # -> Equality, Inequality
series_3 = Series(Start=0, Step=1, Count=lng)
gradient = Gradient(
    LowerLimit=0,
    UpperLimit=lng,
    Parameter=series_3,
    stops=[0: RGB(243, 57, 0), 0.1: RGB(236, 27, 60), 0.2: RGB(210, 0, 118), 0.3: RGB(103, 0, 120), 0.4: RGB(39, 72, 161), 0.5: RGB(1, 192, 229), 0.6: RGB(18, 178, 90), 0.7: RGB(79, 186, 8), 0.8: RGB(220, 237, 32), 0.9: RGB(247, 159, 20), 1: RGB(243, 57, 0)])
dispatch_3 = Dispatch(List=demesh_3.Faces, DispatchPattern=equals.Equality)  # -> ListA, ListB
preview = CustomPreview(Geometry=move_7.Geometry, Shader=gradient)
conmesh_3 = ConstructMesh(Vertices=demesh_3.Vertices, Faces=dispatch_3.ListB)  # -> flatten(Mesh)
mjoin_2 = MeshJoin(Meshes=conmesh_3)
move_8 = Move(Geometry=mjoin_2, Motion=vec.Vector)  # -> Geometry, Transform
number_slider_7 = Slider(4, range=0..10)
number_slider_8 = Slider(50, range=0..100)
data_4 = Data(mjoin_2)
addition_5 = Addition(A=number_slider_7, B=0)
one_over_x_3 = OneOverX(Value=number_slider_7)
one_over_x_4 = OneOverX(Value=number_slider_7)
multiplication_10 = Multiplication(A=number_slider_8, B=one_over_x_4)
series_4 = Series(Start=0, Step=number_slider_8, Count=addition_5)
vec_4 = VectorXYZ(XComponent=multiplication_10, YComponent=multiplication_10, ZComponent=0)  # -> Vector, Length
vec_5 = VectorXYZ(XComponent=series_4, YComponent=graft(series_4), ZComponent=0)  # -> Vector, Length
neg_4 = Negative(Value=vec_4.Vector)
move_9 = Move(Geometry=data_4, Motion=vec_5.Vector)  # -> Geometry, Transform
scale_4 = Scale(Geometry=move_9.Geometry, Center=Point(0, 0, 0), Factor=one_over_x_3)  # -> Geometry, Transform
