# Grasshopper definition fifty.gh (Grasshopper 0.9.76)
# plug-ins: MeshEdit Components

rectangle = Rectangle(Plane=PlaneXY(0, 0, 0), XSize=Slider(50, range=0..100), YSize=Slider(50, range=0..100), Radius=0)  # -> Rectangle, Length
explode = Explode(Curve=rectangle.Rectangle, Recursive=True)  # -> Segments, Vertices
item = ListItem(List=explode.Segments, Index=0, Wrap=True)  # -> Item, Item1, Item2, Item3
number_slider = Slider(25, range=0..100)
flip = FlipCurve(Curve=item.Item)  # -> Curve, Flag
flip_2 = FlipCurve(Curve=item.Item1)  # -> Curve, Flag
merge = Merge(Data1=flip.Curve, Data2=item.Item2)
merge_2 = Merge(Data1=flip_2.Curve, Data2=item.Item3)
divide = DivideCurve(Curve=reparameterize(merge_2), Count=number_slider, Kinks=False)  # -> Points, Tangents, Parameters
pi = Pi(Factor=Slider(3, range=0..10))
pi_2 = Pi(Factor=Slider(6, range=0..10))
divide_2 = DivideCurve(Curve=reparameterize(merge), Count=number_slider, Kinks=False)  # -> Points, Tangents, Parameters
multiplication = Multiplication(A=divide.Parameters, B=pi)
multiplication_2 = Multiplication(A=divide.Parameters, B=pi_2)
pi_3 = Pi(Factor=Slider(5, range=0..10))
pi_4 = Pi(Factor=Slider(1, range=0..10))
sin = Sine(Value=multiplication_2)
sin_2 = Sine(Value=multiplication)
multiplication_3 = Multiplication(A=divide_2.Parameters, B=pi_4)
multiplication_4 = Multiplication(A=divide_2.Parameters, B=pi_3)
multiplication_5 = Multiplication(A=sin_2, B=Slider(3, range=0..10))
multiplication_6 = Multiplication(A=sin, B=Slider(2, range=0..10))
sin_3 = Sine(Value=multiplication_4)
sin_4 = Sine(Value=multiplication_3)
addition = Addition(A=multiplication_5, B=multiplication_6)
X = UnitX(Factor=addition)
multiplication_7 = Multiplication(A=sin_4, B=Slider(6, range=0..10))
multiplication_8 = Multiplication(A=sin_3, B=Slider(2, range=0..10))
move = Move(Geometry=divide.Points, Motion=X)  # -> Geometry, Transform
addition_2 = Addition(A=multiplication_7, B=multiplication_8)
Y = UnitY(Factor=addition_2)
move_2 = Move(Geometry=divide_2.Points, Motion=Y)  # -> Geometry, Transform
pline = PolyLine(Vertices=move.Geometry, Closed=False)  # -> flatten(Polyline)
pline_2 = PolyLine(Vertices=move_2.Geometry, Closed=False)  # -> flatten(Polyline)
merge_3 = Merge(Data1=pline_2, Data2=pline)
join = JoinCurves(Curves=merge_3, Preserve=False)
neg = Negative(Value=Slider(1.0201, range=0..10))
explode_2 = Explode(Curve=join, Recursive=True)  # -> Segments, Vertices
data = Data(join)
offset = Offset(Curve=join, Distance=neg, Plane=PlaneXY(0, 0, 0), Corners=1)
srf = Surface(offset)
split = SplitList(List=explode_2.Vertices, Index=1)  # -> ListA, ListB
popgeo = PopulateGeometry(Geometry=srf, Count=Slider(857, range=0..1000), Seed=1)
merge_4 = Merge(Data1=split.ListB, Data2=popgeo)
del = DelaunayMesh(Points=merge_4, Plane=PlaneXY(0, 0, 0))
facen = FaceNormals(Mesh=del)  # -> Centers, Normals
demesh = DeconstructMesh(Mesh=del)  # -> Vertices, Faces, Colours, Normals
incurve = PointInCurve(Point=facen.Centers, Curve=data)  # -> Relationship, Point
dispatch = Dispatch(List=demesh.Faces, DispatchPattern=incurve.Relationship)  # -> ListA, ListB
conmesh = ConstructMesh(Vertices=demesh.Vertices, Faces=dispatch.ListA)
series = Series(Start=0, Step=Slider(50, range=0..100), Count=Slider(7, range=0..10))
vec = VectorXYZ(XComponent=series, YComponent=graft(series), ZComponent=0)  # -> Vector, Length
number_slider_2 = Slider(50, range=0..100)
move_3 = Move(Geometry=conmesh, Motion=vec.Vector)  # -> Geometry, Transform
pt = Point(Point(20.77969962, 21.53686976, 0))
facen_2 = FaceNormals(Mesh=move_3.Geometry)  # -> Centers, Normals
faceb = FaceBoundaries(Mesh=move_3.Geometry)
rectangle_2 = Rectangle(Plane=pt, XSize=number_slider_2, YSize=number_slider_2, Radius=0)  # -> Rectangle, Length
incurve_2 = PointInCurve(Point=facen_2.Centers, Curve=rectangle_2.Rectangle)  # -> Relationship, Point
dispatch_2 = Dispatch(List=faceb, DispatchPattern=incurve_2.Relationship)  # -> ListA, ListB
data_2 = Data(dispatch_2.ListA)
smesh = SimpleMesh(Brep=data_2)
mjoin = MeshJoin(Meshes=flatten(smesh))
weldvertices = MeshWeldVertices(Mesh=mjoin, Tolerance=0.01)  # -> RuntimeMessage, Mesh
move_4 = Move(Geometry=weldvertices.Mesh, Motion=vec.Vector)  # -> Geometry, Transform
scale = Scale(Geometry=move_4.Geometry, Center=Point(0, 0, 0), Factor=Slider(0.5, range=0..1))  # -> Geometry, Transform
medges = MeshEdges(Mesh=weldvertices.Mesh)  # -> NakedEdges, InteriorEdges, NonManifoldEdges
join_2 = JoinCurves(Curves=medges.NakedEdges, Preserve=False)
demesh_2 = DeconstructMesh(Mesh=scale.Geometry)  # -> Vertices, Faces, Colours, Normals
facen_3 = FaceNormals(Mesh=scale.Geometry)  # -> Centers, Normals
incurve_3 = PointInCurve(Point=facen_3.Centers, Curve=join_2)  # -> Relationship, Point
dispatch_3 = Dispatch(List=demesh_2.Faces, DispatchPattern=incurve_3.Relationship)  # -> ListA, ListB
conmesh_2 = ConstructMesh(Vertices=demesh_2.Vertices, Faces=dispatch_3.ListA)  # -> flatten(Mesh)
clean = CleanTree(RemoveNulls=True, RemoveInvalid=True, RemoveEmpty=False, Tree=conmesh_2)
mjoin_2 = MeshJoin(Meshes=clean)
move_5 = Move(Geometry=mjoin_2, Motion=vec.Vector)  # -> Geometry, Transform
