# Grasshopper definition i guess thats the answerr.gh (Grasshopper 1.0.5)

triangle = MeshTriangle(CornerA=0, CornerB=1, CornerC=2)
conmesh = ConstructMesh(
    Vertices=[Point(25.94590774, 22.23472939, 0), Point(0.6745579092, 20.21532929, 0), Point(20.69546748, -0.0363688672, 0)],
    Faces=triangle)
popgeo = PopulateGeometry(Geometry=conmesh, Count=Slider(500, range=0..10000), Seed=1)
meshcp = MeshClosestPoint(Point=popgeo, Mesh=conmesh)  # -> Point, Index, Parameter
split = TextSplit(Text=meshcp.Parameter, Separators="[]")
panel = Panel(split)
item = ListItem(List=split, Index=1, Wrap=True)
split_2 = TextSplit(Text=item, Separators=";")
panel_2 = Panel("""0
1
2""")
panel_3 = Panel("""1
0
0""")
split_3 = SplitList(List=split_2, Index=3)  # -> ListA, ListB
sort = SortList(Keys=split_3.ListA, ValuesA=panel_2)  # -> Keys, ValuesA
item_2 = ListItem(List=reverse(sort.Keys), Index=0, Wrap=True)  # -> Item, Item1, Item2
sort_2 = SortList(Keys=reverse(sort.ValuesA), ValuesA=panel_3)  # -> Keys, ValuesA
item_3 = ListItem(List=split_3.ListA, Index=Slider(4, range=0..10), Wrap=True)
subtraction = Subtraction(A=item_2.Item, B=item_2.Item1)
subtraction_2 = Subtraction(A=item_2.Item, B=item_2.Item2)
multiplication = Multiplication(A=split_3.ListA, B=sort_2.ValuesA)
panel_4 = Panel(item_2.Item1)
item_4 = ListItem(List=sort_2.ValuesA, Index=0, Wrap=True)  # -> Item, Item1, Item2
data = Data(item_3)
min = Minimum(A=subtraction, B=subtraction_2)
max = Maximum(A=subtraction, B=subtraction_2)  # -> flatten(Result)
neg = Negative(Value=data)
addition = Addition(A=neg, B=Slider(1, range=0..1))
max_2 = Maximum(A=subtraction, B=addition)
remap = RemapNumbers(Value=max_2, Source=Domain(0, 1), Target=Domain(0, 1))  # -> Mapped, Clipped
graph = GraphMapper(max_2, x0=0, x1=1, y0=0, y1=1, Cx=0.9457364082, Cy=0.1958041787, container_name="Conic")
min_2 = Minimum()
data_2 = Data(graph)
panel_5 = Panel(min)
graph_2 = GraphMapper(
    addition,
    x0=0,
    x1=1,
    y0=0,
    y1=1,
    A=2.954849192,
    B=-1.385340056,
    container_name="Linear",
    Graph_x0=0.4688361287,
    Graph_x1=0.75,
    Graph_y0=0,
    Graph_y1=0.8307968378)
frgb = ColourRGBF(Alpha=1, Red=data_2, Green=data_2, Blue=data_2)  # -> flatten(Colour)
frgb_2 = ColourRGBF(Alpha=1, Red=item_4.Item, Green=item_4.Item1, Blue=item_4.Item2)  # -> flatten(Colour)
frgb_3 = ColourRGBF(Alpha=1, Red=data, Green=data, Blue=data)  # -> flatten(Colour)
argb = SplitARGB(Colour=frgb)  # -> Alpha, Red, Green, Blue
argb_2 = SplitARGB(Colour=frgb_2)  # -> Alpha, Red, Green, Blue
multiplication_2 = Multiplication(A=argb.Red, B=argb_2.Red)
multiplication_3 = Multiplication(A=argb.Green, B=argb_2.Green)
multiplication_4 = Multiplication(A=argb.Blue, B=argb_2.Blue)
dots = DotDisplay(Point=popgeo, Colour=frgb, Size=0.6)
frgb_4 = ColourRGBF(Alpha=1, Red=multiplication_2, Green=multiplication_3, Blue=multiplication_4)  # -> flatten(Colour)
