# Grasshopper definition recursiveTriangles.gh (Grasshopper 1.0.5)
# plug-ins: MeshEdit Components, MeshMachine, PlanktonGh

polygon = Polygon(Plane=PlaneXY(0, 0, 0), Radius=Slider(50, range=0..100), Segments=3, FilletRadius=0)  # -> Polygon, Length
srf = Surface(polygon.Polygon)
explode = Explode(Curve=polygon.Polygon, Recursive=True)  # -> Segments, Vertices
smesh = SimpleMesh(Brep=srf)

number_slider = Slider(10, range=0..10)
srf_2 = Surface(srf)
data = Data(explode.Segments)
timer = Timer(TimerInterval=20, Target=meshmachine)  # disabled
meshmachine = MeshMachine(
    Geometry=srf_2,
    Length=Slider(9, range=0..100),
    FixCurves=data,
    FixVertices=explode.Vertices,
    Flip=1,
    PullStrength=0,
    CurvatureAdaptivity=0,
    Reset=Toggle(False))
pmesh = PlanktonMesh(meshmachine)
demesh = DeconstructMesh(Mesh=pmesh)  # -> Vertices, Faces, Colours, Normals
conmesh = ConstructMesh(Vertices=demesh.Vertices, Faces=demesh.Faces)
weldvertices = MeshWeldVertices(Mesh=conmesh, Tolerance=0.01)  # -> RuntimeMessage, Mesh
mesh = Mesh(weldvertices.Mesh)

bcentric = Barycentric(CoordinateU=1, CoordinateV=1, CoordinateW=1)
meshcp = MeshClosestPoint(Point=demesh.Vertices, Mesh=smesh)  # -> Point, Index, Parameter
explode_2 = MeshExplode(Mesh=pmesh, Interpolate=False)
meval = MeshEval(Mesh=graft(explode_2), Parameter=meshcp.Parameter)  # -> Point, Normal, Colour
conmesh_2 = ConstructMesh(Vertices=meval.Point, Faces=demesh.Faces)
