# Grasshopper definition refactorBarycenters-08.gh (Grasshopper 1.0.5)
# plug-ins: MeshEdit Components, Kangaroo Components, PlanktonGh, AureconGrasshopper

size = Slider(50, range=0..100)
gridsize = Data(size)

gridsize_2 = Data(gridsize)
rectangle = Rectangle(Plane=PlaneXY(0, 0, 0), XSize=gridsize_2, YSize=gridsize_2, Radius=0)  # -> Rectangle, Length
explode = Explode(Curve=rectangle.Rectangle, Recursive=True)  # -> Segments, Vertices
item = ListItem(List=explode.Segments, Index=0, Wrap=True)  # -> Item, Item1, Item2, Item3
number_slider = Slider(20, range=0..100)
flip = FlipCurve(Curve=item.Item)  # -> Curve, Flag
flip_2 = FlipCurve(Curve=item.Item1)  # -> Curve, Flag
merge = Merge(Data1=flip.Curve, Data2=item.Item2)
merge_2 = Merge(Data1=flip_2.Curve, Data2=item.Item3)
divide = DivideCurve(Curve=reparameterize(merge_2), Count=number_slider, Kinks=False)  # -> Points, Tangents, Parameters
pi = Pi(Factor=Slider(3, range=0..10))
pi_2 = Pi(Factor=Slider(4, range=0..10))
divide_2 = DivideCurve(Curve=reparameterize(merge), Count=number_slider, Kinks=False)  # -> Points, Tangents, Parameters
multiplication = Multiplication(A=divide.Parameters, B=pi_2)
multiplication_2 = Multiplication(A=divide.Parameters, B=pi)
pi_3 = Pi(Factor=Slider(4, range=0..10))
pi_4 = Pi(Factor=Slider(1, range=0..10))
sin = Sine(Value=multiplication)
sin_2 = Sine(Value=multiplication_2)
multiplication_3 = Multiplication(A=divide_2.Parameters, B=pi_4)
multiplication_4 = Multiplication(A=divide_2.Parameters, B=pi_3)
multiplication_5 = Multiplication(A=sin, B=Slider(2, range=0..10))
multiplication_6 = Multiplication(A=sin_2, B=Slider(3, range=0..10))
sin_3 = Sine(Value=multiplication_4)
sin_4 = Sine(Value=multiplication_3)
addition = Addition(A=multiplication_6, B=multiplication_5)
X = UnitX(Factor=addition)
multiplication_7 = Multiplication(A=sin_3, B=Slider(2, range=0..10))
multiplication_8 = Multiplication(A=sin_4, B=Slider(6, range=0..10))
move = Move(Geometry=divide.Points, Motion=X)  # -> Geometry, Transform
addition_2 = Addition(A=multiplication_8, B=multiplication_7)
Y = UnitY(Factor=addition_2)
move_2 = Move(Geometry=divide_2.Points, Motion=Y)  # -> Geometry, Transform
pline = PolyLine(Vertices=move.Geometry, Closed=False)  # -> flatten(Polyline)
pline_2 = PolyLine(Vertices=move_2.Geometry, Closed=False)  # -> flatten(Polyline)
data = Data(pline)
data_2 = Data(pline_2)

size_2 = Data(gridsize)

data_3 = Data(data_2)  # disabled
data_4 = Data(data)  # disabled
merge_3 = Merge(Data1=data_3, Data2=data_4)
data_5 = Data(merge_3)
join = JoinCurves(Curves=data_5, Preserve=False)
explode_2 = Explode(Curve=join, Recursive=True)  # -> Segments, Vertices
srf = Surface(join)
data_6 = Data(data_5)
split = SplitList(List=reverse(explode_2.Vertices), Index=1)  # -> ListA, reverse(ListB)
timer = Timer(TimerInterval=2, Target=meshmachine)  # disabled
meshmachine = MeshMachine(
    Geometry=srf,
    Length=Slider(1, range=0..1),
    FixCurves=data_6,
    FixVertices=split.ListB,
    Flip=1,
    PullStrength=0.8,
    CurvatureAdaptivity=0,
    BoundaryScale=1,
    BoundaryDistance=5,
    Exponent=2,
    Background=0.5,
    Iterations=1,
    Reset=Toggle(False))
pmesh = PlanktonMesh(meshmachine)
demesh = DeconstructMesh(Mesh=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)  # -> Vertices, Faces, Colours, Normals
conmesh = ConstructMesh(Vertices=demesh.Vertices, Faces=demesh.Faces)
weldvertices = MeshWeldVertices(Mesh=conmesh, Tolerance=0.01)  # -> RuntimeMessage, Mesh
mesh = Mesh(weldvertices.Mesh)

data_7 = Data(data_2)
data_8 = Data(data)
item_2 = ListItem(List=data_7, Index=0, Wrap=True)  # -> Item1, Item
item_3 = ListItem(List=data_8, Index=0, Wrap=True)  # -> Item1, Item
data_9 = Data(item_2.Item1)
data_10 = Data(item_3.Item)
explode_3 = Explode(Curve=data_10, Recursive=True)  # -> Segments, Vertices
explode_4 = Explode(Curve=data_9, Recursive=True)  # -> Segments, Vertices
split_2 = SplitList(List=explode_3.Vertices, Index=1)  # -> ListA, ListB
split_3 = SplitList(List=explode_4.Vertices, Index=1)  # -> ListA, ListB
data_11 = Data(split_2.ListB)
data_12 = Data(split_2.ListA)
data_13 = Data(split_3.ListB)

size_3 = Data(size_2)

data_14 = Data(data)
data_15 = Data(data_2)
item_4 = ListItem(List=data_15, Index=0, Wrap=True)  # -> Item1, Item
item_5 = ListItem(List=data_14, Index=0, Wrap=True)  # -> Item1, Item
data_16 = Data(item_4.Item)
data_17 = Data(item_5.Item1)
explode_5 = Explode(Curve=data_16, Recursive=True)  # -> Segments, Vertices
explode_6 = Explode(Curve=data_17, Recursive=True)  # -> Segments, Vertices
split_4 = SplitList(List=explode_6.Vertices, Index=1)  # -> ListA, ListB
split_5 = SplitList(List=explode_5.Vertices, Index=1)  # -> ListA, ListB
split_6 = SplitList(List=reverse(split_4.ListB), Index=1)  # -> ListA, reverse(ListB)
data_18 = Data(split_6.ListA)
data_19 = Data(split_4.ListB)
data_20 = Data(data_18)
data_21 = Data(split_5.ListB)

mesh_2 = Mesh(mesh)
data_22 = Data(data_11)
data_23 = Data(data_12)
data_24 = Data(data_13)
demesh_2 = DeconstructMesh(Mesh=mesh_2)  # -> Vertices, Faces, Colours, Normals
data_25 = Data(data_19)
data_26 = Data(data_20)
data_27 = Data(data_21)
data_28 = Data(data_27)
data_29 = Data(data_25)
data_30 = Data(data_26)
data_31 = Data(data_24)
data_32 = Data(data_22)
data_33 = Data(data_23)
cp = ClosestPoint(Point=data_33, Cloud=demesh_2.Vertices)  # -> ClosestPoint, CPIndex, Distance
cp_2 = ClosestPoint(Point=data_32, Cloud=demesh_2.Vertices)  # -> ClosestPoint, CPIndex, Distance
cp_3 = ClosestPoint(Point=data_31, Cloud=demesh_2.Vertices)  # -> ClosestPoint, CPIndex, Distance
cp_4 = ClosestPoint(Point=data_30, Cloud=demesh_2.Vertices)  # -> ClosestPoint, CPIndex, Distance
cp_5 = ClosestPoint(Point=data_29, Cloud=demesh_2.Vertices)  # -> ClosestPoint, CPIndex, Distance
cp_6 = ClosestPoint(Point=data_28, Cloud=demesh_2.Vertices)  # -> ClosestPoint, CPIndex, Distance
merge_4 = Merge(Data1=cp_4.CPIndex, Data2=cp_5.CPIndex, Data3=cp_6.CPIndex)
merge_5 = Merge(Data1=cp.CPIndex, Data2=cp_2.CPIndex, Data3=cp_3.CPIndex)  # -> flatten(Result)
deface = DeconstructFace(Face=demesh_2.Faces)  # -> CornerA, CornerB, CornerC, CornerD
merge_6 = Merge(Data1=graft(deface.CornerA), Data2=graft(deface.CornerB), Data3=graft(deface.CornerC))  # -> flatten(Result)
replace = ReplaceItems(List=demesh_2.Vertices, Indices=merge_5, Wrap=False)
replace_2 = ReplaceMembers(Set=merge_6, Find=flatten(merge_5), Replace=flatten(merge_4))
cset = CreateSet(List=replace_2)  # -> Set, Map
lng = ListLength(List=merge_6)
vec = VectorXYZ(XComponent=0, YComponent=0, ZComponent=0)  # -> Vector, Length
clean = CleanTree(RemoveNulls=True, RemoveInvalid=True, RemoveEmpty=False, Tree=replace)
X_2 = UnitX(Factor=1)
Y_2 = UnitY(Factor=1)
mindex = MemberIndex(Set=merge_6, Member=cp_3.CPIndex)  # -> flatten(Index), Count
mindex_2 = MemberIndex(Set=merge_6, Member=cp.CPIndex)  # -> flatten(Index), Count
mindex_3 = MemberIndex(Set=merge_6, Member=cp_2.CPIndex)  # -> flatten(Index), Count
lng_2 = ListLength(List=cset.Set)
repeat = RepeatData(Data=vec.Vector, Length=lng)
sort = SortList(Keys=flatten(cset.Set), ValuesA=flatten(cset.Set))  # -> Keys, ValuesA
series = Series(Start=0, Step=1, Count=lng_2)
addition_3 = Addition(A=Y_2, B=X_2)
mindex_4 = MemberIndex(Set=replace_2, Member=sort.ValuesA)  # -> Index, Count
replace_3 = ReplaceItems(List=repeat, Item=addition_3, Indices=mindex_2.Index, Wrap=False)
repeat_2 = RepeatData(Data=graft(series), Length=graft(mindex_4.Count))  # -> flatten(Data)
X_3 = UnitX(Factor=1)
replace_4 = ReplaceItems(List=replace_3, Item=X_3, Indices=mindex_3.Index, Wrap=False)
Y_3 = UnitY(Factor=1)
sort_2 = SortList(Keys=flatten(mindex_4.Index), ValuesA=flatten(repeat_2))  # -> Keys, ValuesA
replace_5 = ReplaceItems(List=replace_4, Item=Y_3, Indices=mindex.Index, Wrap=False)
triangleindexes = Integer(sort_2.ValuesA)
triangleoffsets = Vector(replace_5)
uniquepoints = Point(clean)

facen = FaceNormals(Mesh=mesh)  # -> Centers, Normals
uniquecenters = Integer(facen.Centers)

triangles = Integer(triangleindexes)
offsets = Vector(triangleoffsets)
points = Point(uniquepoints)
centers = Data(facen.Centers)
gridsize_3 = Data(size_3)

dam = DataDam(DataA=triangles, DataB=offsets, DataC=points, DataD=centers, DataE=gridsize_3, BufferDelay=10000000, BufferMode=0)  # -> DataA, DataB, DataC, DataD, DataE

triangles_2 = Integer(dam.DataA)
gridsize_4 = Data(dam.DataE)
offsets_2 = Vector(dam.DataB)
points_2 = Point(dam.DataC)
centers_2 = Data(dam.DataD)

triangleindexes_2 = Integer(triangleindexes)
triangleoffsets_2 = Vector(triangleoffsets)
uniquepoints_2 = Point(uniquepoints)

nestedsubdivisions = Data(Slider(5, range=0..10))
triangles_3 = Integer(triangles_2)
gridsize_5 = Data(gridsize_4)
points_3 = Point(points_2)
offsets_3 = Vector(offsets_2)
centers_3 = Data(centers_2)

# ----
# Base Mesh
item_6 = ListItem(List=uniquepoints_2, Index=triangleindexes_2, Wrap=True)
multiplication_9 = Multiplication(A=triangleoffsets_2, B=Slider(50, range=0..100))
move_3 = Move(Geometry=item_6, Motion=multiplication_9)  # -> Geometry, Transform
partition = PartitionList(List=move_3.Geometry, Size=3)
pline_3 = PolyLine(Vertices=partition, Closed=True)

nestedsubdivisions_2 = Data(nestedsubdivisions)
gridsize_6 = Data(gridsize_5)

triangles_4 = Integer(triangles_3)
offsets_4 = Vector(offsets_3)
points_4 = Point(points_3)
centers_4 = Data(centers_3)

nestingamount = Data(nestedsubdivisions_2)

triangles_5 = Integer(triangles_3)
offsets_5 = Vector(offsets_3)
points_5 = Point(points_3)

nestingamount_2 = Data(nestingamount)
gridsize_7 = Data(gridsize_6)
# InnerMeshScaleInfo
one_over_x = OneOverX(Value=nestingamount_2)
addition_4 = Addition(A=nestingamount_2, B=2)
multiplication_10 = Multiplication(A=gridsize_7, B=one_over_x)
series_2 = Series(Start=0, Step=gridsize_7, Count=addition_4)
vec_2 = VectorXYZ(XComponent=multiplication_10, YComponent=multiplication_10, ZComponent=0)  # -> Vector, Length
vec_3 = VectorXYZ(XComponent=series_2, YComponent=graft(series_2), ZComponent=0)  # -> flatten(Vector), Length
series_3 = Series(Start=0, Step=Slider(1, range=0..100), Count=addition_4)
neg = Negative(Value=vec_2.Vector)
int = Integer(series_3)
concat = Concatenate(FragmentA=int, FragmentB=",", FragmentC=graft(int))  # -> flatten(Result)
secondlayeroffset = Data(neg)
celloffsets = Data(vec_3.Vector)
cellids = Data(concat)

nestingamount_3 = Data(nestedsubdivisions_2)
gridsize_8 = Data(gridsize_6)
# Triangles
triangles_6 = Integer(triangles_5)

offsets_6 = Vector(offsets_5)
triangles_7 = Integer(triangles_5)
# PointIndexes
points_6 = Point(points_5)
multiplication_11 = Multiplication(A=offsets_6, B=Slider(50, range=0..100))
item_7 = ListItem(List=points_6, Index=triangles_7, Wrap=True)
move_4 = Move(Geometry=item_7, Motion=multiplication_11)  # -> Geometry, Transform
partition_2 = PartitionList(List=move_4.Geometry, Size=3)
triangles_8 = Data(partition_2)

lng_3 = ListLength(List=points_5)
# RepeatPointsAndCenters
series_4 = Series(Start=0, Step=1, Count=lng_3)
pointindexes = Integer(series_4)

nestingamount_4 = Data(nestingamount)
centers_5 = Data(centers_3)
celloffsets_2 = Data(vec_3.Vector)
points_7 = Point(points_3)
move_5 = Move(Geometry=centers_5, Motion=graft(celloffsets_2))  # -> Geometry, Transform
move_6 = Move(Geometry=points_7, Motion=graft(celloffsets_2))  # -> Geometry, Transform
one_over_x_2 = OneOverX(Value=nestingamount_4)
scale = Scale(Geometry=move_5.Geometry, Center=Point(0, 0, 0), Factor=one_over_x_2)  # -> Geometry, Transform
scale_2 = Scale(Geometry=move_6.Geometry, Center=Point(0, 0, 0), Factor=one_over_x_2)  # -> Geometry, Transform
move_7 = Move(Geometry=scale_2.Geometry, Motion=secondlayeroffset)  # -> flatten(Geometry), Transform
move_8 = Move(Geometry=scale.Geometry, Motion=secondlayeroffset)  # -> flatten(Geometry), Transform
movedpoints = Data(move_7.Geometry)
movedcenters = Data(move_8.Geometry)

celloffsets_3 = Data(celloffsets)
cellids_2 = Data(cellids)
movedpoints_2 = Data(movedpoints)
movedcenters_2 = Data(movedcenters)

# ----
# AllTriangleIndexes
triangles_9 = Integer(triangles_6)
movedcenters_3 = Data(movedcenters_2)
lng_4 = ListLength(List=triangles_9)
division = Division(A=lng_4, B=3)
lng_5 = ListLength(List=movedcenters_3)
int_2 = Integer(division)
series_5 = Series(Start=0, Step=1, Count=int_2)
int_3 = Integer(series_5)
repeat_3 = RepeatData(Data=int_3, Length=lng_5)
triangleindexes_3 = Data(repeat_3)

# ----
# All Points Indexes
pointindexes_2 = Integer(pointindexes)
celloffsets_4 = Data(celloffsets_3)
lng_6 = ListLength(List=flatten(celloffsets_4))
lng_7 = ListLength(List=pointindexes_2)
multiplication_12 = Multiplication(A=lng_7, B=lng_6)
repeat_4 = RepeatData(Data=pointindexes_2, Length=multiplication_12)  # -> flatten(Data)
nestedpointindexes = Data(repeat_4)

# ----
# TriangleMesh
quad = MeshQuad(CornerA=0, CornerB=1, CornerC=2, CornerD=2)
conmesh_2 = ConstructMesh(Vertices=triangles_8, Faces=quad)

nestingamount_5 = Data(nestingamount_3)
gridsize_9 = Data(gridsize_8)

data_34 = Data(conmesh_2)
# BarycentricHubs
demesh_3 = DeconstructMesh(Mesh=data_34)  # -> Vertices, Faces, Colours, Normals
item_8 = ListItem(List=demesh_3.Vertices, Index=0, Wrap=True)  # -> Item, Item1, Item2
facen_2 = FaceNormals(Mesh=data_34)  # -> Centers, Normals
merge_7 = Merge(Data1=item_8.Item2, Data2=item_8.Item)
merge_8 = Merge(Data1=item_8.Item1, Data2=item_8.Item2)
merge_9 = Merge(Data1=item_8.Item, Data2=item_8.Item1)
avr = Average(Input=merge_8)
avr_2 = Average(Input=merge_9)
avr_3 = Average(Input=merge_7)
series_6 = Series(Start=0, Step=1, Count=6)
shift = ShiftList(List=series_6, Shift=1, Wrap=True)
merge_10 = Merge(Data1=item_8.Item, Data2=avr_2, Data3=item_8.Item1, Data4=avr, Data5=item_8.Item2, Data6=avr_3, Data7=facen_2.Centers)
triangle = MeshTriangle(CornerA=series_6, CornerB=shift, CornerC=Slider(6, range=0..10))
conmesh_3 = ConstructMesh(Vertices=merge_10, Faces=triangle)

movedcenters_4 = Data(movedcenters)
movedpoints_3 = Data(movedpoints)

triangles_10 = Integer(triangles_4)
offsets_7 = Vector(offsets_4)
points_8 = Point(points_4)
centers_6 = Data(centers_4)

nestingamount_6 = Data(nestingamount_5)
gridsize_10 = Data(gridsize_9)

# ----
# All Centers Offsets
_2doffsets = Data(cellids_2)
points_9 = Point(centers_6)
lng_8 = ListLength(List=points_9)
repeat_5 = RepeatData(Data=graft(_2doffsets), Length=lng_8)  # -> flatten(Data)
_2doffsets_2 = Data(repeat_5)

# ----
# All Points Offsets
_2doffsets_3 = Data(cellids_2)
points_10 = Point(points_8)
lng_9 = ListLength(List=points_10)
repeat_6 = RepeatData(Data=graft(_2doffsets_3), Length=lng_9)  # -> flatten(Data)
_2doffsets_4 = Data(repeat_6)

item_9 = ListItem(List=points_9, Index=0, Wrap=True)

nestingamount_7 = Data(nestingamount_6)
gridsize_11 = Data(gridsize_10)

triangles_11 = Integer(triangles_10)
points_11 = Point(points_8)
centers_7 = Data(centers_6)
offsets_8 = Vector(offsets_7)

offsets_9 = Vector(offsets_8)
centers_8 = Data(centers_7)
triangles_12 = Integer(triangles_11)
points_12 = Point(points_11)

nestingamount_8 = Data(nestingamount_7)
gridsize_12 = Data(gridsize_11)

# ----
# TriangleCenterOffsets
pt = Point(Point(0, 0, 0))
trianglecenters = Data(centers_8)
lng_10 = ListLength(List=trianglecenters)
repeat_7 = RepeatData(Data=pt, Length=lng_10)
data_35 = Data(repeat_7)
trianglecenteroffsets = Data(data_35)

triangles_13 = Data(triangles_12)
offsets_10 = Data(offsets_9)

positions = Data(points_12)

trianglecenters_2 = Data(centers_8)
trianglecenteroffsets_2 = Data(trianglecenteroffsets)

nestingamount_9 = Data(nestingamount_8)
gridsize_13 = Data(gridsize_12)

trianglecenteroffsets_3 = Data(trianglecenteroffsets_2)
trianglecenters_3 = Data(trianglecenters_2)

nestingamount_10 = Data(nestingamount_9)
gridsize_14 = Data(gridsize_13)

triangles_14 = Data(triangles_13)
offsets_11 = Data(offsets_10)

positions_2 = Data(positions)

gridsize_15 = Data(gridsize_14)
nestingamount_11 = Data(nestingamount_10)

triangles_15 = Data(triangles_14)
offsets_12 = Data(offsets_11)

positions_3 = Data(positions_2)

trianglecenters_4 = Data(trianglecenters_3)
trianglecenteroffsets_4 = Data(trianglecenteroffsets_3)

triangles_16 = Data(triangles_14)
offsets_13 = Data(offsets_11)
positions_4 = Data(positions_2)

triangles_17 = Data(triangles_16)
offsets_14 = Data(offsets_13)
points_13 = Data(positions_4)

offsets_15 = Data(offsets_13)
triangles_18 = Data(triangles_16)
positions_5 = Data(positions_4)

# ----
# Base Mesh
number_slider_2 = Slider(50, range=0..100)
triangleindexes_4 = Integer(triangles_18)
triangleoffsets_3 = Vector(offsets_15)
uniquepoints_3 = Point(positions_5)
item_10 = ListItem(List=uniquepoints_3, Index=triangleindexes_4, Wrap=True)
multiplication_13 = Multiplication(A=triangleoffsets_3, B=number_slider_2)
move_9 = Move(Geometry=item_10, Motion=multiplication_13)  # -> Geometry, Transform
partition_3 = PartitionList(List=move_9.Geometry, Size=3)
quad_2 = MeshQuad(CornerA=0, CornerB=1, CornerC=2, CornerD=2)
conmesh_4 = ConstructMesh(Vertices=partition_3, Faces=quad_2)  # -> flatten(Mesh)

gridsize_16 = Data(gridsize_15)
nestingamount_12 = Data(nestingamount_11)

triangles_19 = Data(triangles_15)
offsets_16 = Data(offsets_12)

trianglecenters_5 = Data(trianglecenters_4)
trianglecenteroffsets_5 = Data(trianglecenteroffsets_4)

positions_6 = Data(positions_3)
number_slider_3 = Slider(10, range=0..10)
one_over_x_3 = OneOverX(Value=Slider(5, range=0..10))
vec_4 = VectorXYZ(XComponent=number_slider_3, YComponent=number_slider_3, ZComponent=0)  # -> Vector, Length
neg_2 = Negative(Value=vec_4.Vector)
data_36 = Data(conmesh_4)
demesh_4 = DeconstructMesh(Mesh=data_36)  # -> Vertices, Faces, Colours, Normals
vec_5 = Vector(demesh_4.Vertices)
item_11 = ListItem(List=vec_5, Index=0, Wrap=True)  # -> Item, Item1, Item2

trianglecenteroffsets_6 = Data(trianglecenteroffsets_5)
trianglecenters_6 = Data(trianglecenters_5)

nestingamount_13 = Data(nestingamount_12)
gridsize_17 = Data(gridsize_16)

triangles_20 = Data(triangles_19)
offsets_17 = Data(offsets_16)

positions_7 = Data(positions_6)
concat_2 = Concatenate(FragmentA="E:\User Files\Projects\Building Generator\Assets\Import\", FragmentB="data.meshTile.JSON")

# ----
# Points And Centers Within Cells
triangles_21 = Data(triangles_8)
movedpoints_4 = Data(movedpoints_2)
movedcenters_5 = Data(movedcenters_2)
number_slider_4 = Slider(1000, range=0..1000)
pline_4 = PolyLine(Vertices=triangles_21, Closed=True)  # -> flatten(Polyline)

# ---- group: scaleForAccuracy
scale_3 = Scale(Geometry=pline_4, Center=Point(0, 0, 0), Factor=number_slider_4)  # -> Geometry, Transform
scale_4 = Scale(Geometry=movedpoints_4, Center=Point(0, 0, 0), Factor=number_slider_4)  # -> Geometry, Transform
scale_5 = Scale(Geometry=movedcenters_5, Center=Point(0, 0, 0), Factor=number_slider_4)  # -> Geometry, Transform

# ----
lng_11 = ListLength(List=scale_3.Geometry)
series_7 = Series(Start=0, Step=1, Count=lng_11)
incurves = PointInCurves(Point=scale_5.Geometry, Curves=scale_3.Geometry)  # -> Relationship, Index, Point
incurves_2 = PointInCurves(Point=scale_4.Geometry, Curves=scale_3.Geometry)  # -> Relationship, Index, Point
int_4 = Integer(series_7)
mindex_5 = MemberIndex(Set=incurves_2.Index, Member=int_4)  # -> Index, Count
mindex_6 = MemberIndex(Set=incurves.Index, Member=int_4)  # -> Index, Count
centerswithincells = Data(mindex_6.Index)
pointswithincells = Data(mindex_5.Index)

# ----
# Nested Offsets And Points
mappedpoints = Data(pointswithincells)
_2doffsets_5 = Data(_2doffsets_4)
nestedpointindexes_2 = Data(nestedpointindexes)
movedpoints_5 = Data(movedpoints_3)
item_12 = ListItem(List=nestedpointindexes_2, Index=mappedpoints, Wrap=True)
item_13 = ListItem(List=_2doffsets_5, Index=mappedpoints, Wrap=True)
item_14 = ListItem(List=movedpoints_5, Index=mappedpoints, Wrap=True)
culled2doffsets = Data(item_13)
culledindexes = Data(item_12)
culledpoints = Data(item_14)

# ----
# Nested Offsets And Triangles
mappedcells = Data(centerswithincells)
_2doffsets_6 = Data(_2doffsets_2)
nestedtriangleindexes = Data(triangleindexes_3)
movedcenters_6 = Data(movedcenters_4)
item_15 = ListItem(List=_2doffsets_6, Index=mappedcells, Wrap=True)
item_16 = ListItem(List=nestedtriangleindexes, Index=mappedcells, Wrap=True)
item_17 = ListItem(List=movedcenters_6, Index=mappedcells, Wrap=True)
culled2doffsets_2 = Data(item_15)
culledindexes_2 = Data(item_16)
culledcenters = Data(item_17)

# ----
# InnerBarycenters
meshtriangles = Data(conmesh_3)
culledpoints_2 = Data(culledpoints)
meshcp = MeshClosestPoint(Point=culledpoints_2, Mesh=meshtriangles)  # -> Point, Index, Parameter
split_7 = TextSplit(Text=meshcp.Parameter, Separators="[];")
item_18 = ListItem(List=split_7, Index=0, Wrap=True)  # -> Item, Item1, Item2, Item3, Item4
pt_2 = ConstructPoint(XCoordinate=item_18.Item3, YCoordinate=item_18.Item2, ZCoordinate=item_18.Item1)
trim = TrimTree(Tree=pt_2, Depth=1)
trim_2 = TrimTree(Tree=item_18.Item, Depth=1)
internalbarycentricindices = Data(trim_2)
internalbarycenters = Data(trim)

culled2dtriangleoffsets = Data(culled2doffsets_2)
culledtriangleindexes = Data(culledindexes_2)

culled2dpointoffsets = Data(culled2doffsets)
culledpointindexes = Data(culledindexes)

culled2dtriangleoffsets_2 = Data(culled2dtriangleoffsets)
culledtriangleindexes_2 = Data(culledtriangleindexes)

culled2dpointoffsets_2 = Data(culled2dpointoffsets)
culledpointindexes_2 = Data(culledpointindexes)

culled2dtriangleoffsets_3 = Data(culled2dtriangleoffsets_2)
split_8 = TextSplit(Text=culled2dtriangleoffsets_3, Separators=",")  # -> flatten(Result)
split_9 = TextSplit(Text=culled2dpointoffsets_2, Separators=",")  # -> flatten(Result)

culled2dtriangleoffsets_4 = Data(flatten(split_8))
culledtriangleindexes_3 = Data(flatten(culledtriangleindexes_2))
culled2dpointoffsets_3 = Data(flatten(split_9))
culledpointindexes_3 = Data(flatten(culledpointindexes_2))

culled2dtriangleoffsets_5 = Data(culled2dtriangleoffsets_2)
lng_12 = ListLength(List=culled2dtriangleoffsets_3)  # -> flatten(Length)
data_37 = Data(culledtriangleindexes_3)
data_38 = Data(lng_12)
partition_4 = PartitionList(List=data_37, Size=data_38)
culled2dtriangleoffsets_6 = Data(culled2dtriangleoffsets_5)
culledtriangleindexes_4 = Data(partition_4)
data_39 = Data(lng_12)

culledtriangleindexes_5 = Data(flatten(culledtriangleindexes_3))
culled2dpointoffsets_4 = Data(flatten(culled2dpointoffsets_3))
culledpointindexes_4 = Data(flatten(culledpointindexes_3))
culled2dtriangleoffsets_7 = Data(flatten(culled2dtriangleoffsets_4))

culled2dtriangleoffsets_8 = Data(culled2dtriangleoffsets_7)
culledtriangleindexes_6 = Data(culledtriangleindexes_5)
culled2dpointoffsets_5 = Data(culled2dpointoffsets_4)
culledpointindexes_5 = Data(culledpointindexes_4)

data_40 = Data(data_39)

# ----
# Center Barycenters!
meshtriangles_2 = Data(conmesh_2)
culledpoints_3 = Data(culledcenters)
meshcp_2 = MeshClosestPoint(Point=culledpoints_3, Mesh=meshtriangles_2)  # -> Point, Index, Parameter
data_41 = Data(meshcp_2.Parameter)
split_10 = TextSplit(Text=data_41, Separators="[];")
item_19 = ListItem(List=split_10, Index=0, Wrap=True)  # -> Item, Item1, Item2, Item3, Item4
pt_3 = ConstructPoint(XCoordinate=item_19.Item3, YCoordinate=item_19.Item2, ZCoordinate=item_19.Item1)

trim_3 = TrimTree(Tree=pt_3, Depth=1)

centerbarycenters = Point(trim_3)

centerbarycenters_2 = Point(centerbarycenters)
centerbarycenters_3 = Point(centerbarycenters_2)
centerbarycenters_4 = Point(centerbarycenters_3)

pdecon = Deconstruct(Point=centerbarycenters_4)  # -> XComponent, YComponent, ZComponent
merge_11 = Merge(Data1=graft(pdecon.XComponent), Data2=graft(pdecon.YComponent), Data3=graft(pdecon.ZComponent))  # -> flatten(Result)

centerbarycenters_5 = Number(merge_11)
centerbarycenters_6 = Number(centerbarycenters_5)
centerbarycenters_7 = Number(centerbarycenters_6)

# ----
# Barycenters!
meshtriangles_3 = Data(conmesh_2)
culledpoints_4 = Data(culledpoints)
meshcp_3 = MeshClosestPoint(Point=culledpoints_4, Mesh=meshtriangles_3)  # -> Point, Index, Parameter
data_42 = Data(meshcp_3.Parameter)
split_11 = TextSplit(Text=data_42, Separators="[];")
item_20 = ListItem(List=split_11, Index=0, Wrap=True)  # -> Item, Item1, Item2, Item3, Item4
pt_4 = ConstructPoint(XCoordinate=item_20.Item3, YCoordinate=item_20.Item2, ZCoordinate=item_20.Item1)

trim_4 = TrimTree(Tree=pt_4, Depth=1)

barycenters = Point(trim_4)

barycentriccoordinates = Data(barycenters)
internalbarycenters_2 = Data(internalbarycenters)
internalbarycentricindices_2 = Data(internalbarycentricindices)

innerbarycentriccoordinates = Point(internalbarycenters_2)
internalbarycentricindices_3 = Data(internalbarycentricindices_2)
barycentriccoordinates_2 = Data(barycentriccoordinates)

barycentriccoordinates_3 = Data(barycentriccoordinates_2)
lng_13 = ListLength(List=barycentriccoordinates_3)  # -> flatten(Length)

pdecon_2 = Deconstruct(Point=innerbarycentriccoordinates)  # -> XComponent, YComponent, ZComponent
merge_12 = Merge(Data1=graft(pdecon_2.XComponent), Data2=graft(pdecon_2.YComponent), Data3=graft(pdecon_2.ZComponent))  # -> flatten(Result)

pdecon_3 = Deconstruct(Point=barycentriccoordinates_2)  # -> XComponent, YComponent, ZComponent
merge_13 = Merge(Data1=graft(pdecon_3.XComponent), Data2=graft(pdecon_3.YComponent), Data3=graft(pdecon_3.ZComponent))  # -> flatten(Result)

internalbarycentricindices_4 = Data(flatten(internalbarycentricindices_3))
innerbarycentriccoordinates_2 = Data(merge_12)
internalbarycentricindices_5 = Data(internalbarycentricindices_4)
barycentriccoordinates_4 = Data(merge_13)

barycentriccoordinates_5 = Data(barycentriccoordinates_4)
innerbarycentriccoordinates_3 = Data(innerbarycentriccoordinates_2)
internalbarycentricindices_6 = Data(internalbarycentricindices_5)

data_43 = Data(lng_13)

innerbarycentriccoordinates_4 = Data(innerbarycentriccoordinates_3)
internalbarycentricindices_7 = Data(internalbarycentricindices_6)
barycentriccoordinates_6 = Data(barycentriccoordinates_5)

barycentercount = Data(data_43)

# ----
# Nested Triangles Working Proof
triangles_22 = Data(triangles_17)
points_14 = Data(points_13)
culled2dtriangleoffsets_9 = Data(culled2dtriangleoffsets_6)
culledtriangleindexes_7 = Data(culledtriangleindexes_4)
offsets_18 = Data(offsets_14)
split_12 = TextSplit(Text=culled2dtriangleoffsets_9, Separators=",")
multiplication_14 = Multiplication(A=culledtriangleindexes_7, B=3)
multiplication_15 = Multiplication(A=culledtriangleindexes_7, B=3)
item_21 = ListItem(List=split_12, Index=0, Wrap=True)  # -> Item, Item1
item_22 = ListItem(List=offsets_18, Index=multiplication_14, Wrap=True)  # -> Item, Item1, Item2
item_23 = ListItem(List=triangles_22, Index=multiplication_15, Wrap=True)  # -> Item, Item1, Item2
int_5 = Integer(item_21.Item1)
int_6 = Integer(item_21.Item)
merge_14 = Merge(Data1=graft(item_22.Item), Data2=graft(item_22.Item1), Data3=graft(item_22.Item2))
merge_15 = Merge(Data1=graft(item_23.Item), Data2=graft(item_23.Item1), Data3=graft(item_23.Item2))
vec_6 = VectorXYZ(XComponent=int_6, YComponent=int_5, ZComponent=0)  # -> Vector, Length
item_24 = ListItem(List=points_14, Index=merge_15, Wrap=True)
triangle_2 = MeshTriangle(CornerA=0, CornerB=1, CornerC=2)

addition_5 = Addition(A=vec_6.Vector, B=merge_14)
panel = Panel(merge_15)

multiplication_16 = Multiplication(A=addition_5, B=Slider(50, range=0..100))
move_10 = Move(Geometry=item_24, Motion=multiplication_16)  # -> Geometry, Transform
conmesh_5 = ConstructMesh(Vertices=move_10.Geometry, Faces=triangle_2)
trim_5 = TrimTree(Tree=conmesh_5, Depth=1)

mjoin = MeshJoin(Meshes=trim_5)
scale_6 = Scale(Geometry=mjoin, Center=Point(0, 0, 0), Factor=one_over_x_3)  # -> Geometry, Transform
move_11 = Move(Geometry=scale_6.Geometry, Motion=neg_2)  # -> flatten(Geometry), Transform
demesh_5 = DeconstructMesh(Mesh=move_11.Geometry)  # -> Vertices, Faces, Colours, Normals
vec_7 = Vector(demesh_5.Vertices)
pt_5 = Point(demesh_5.Vertices)

# ---- group: Barycenters for triangles
c_script = CSharpScript(a=item_11.Item, b=item_11.Item1, c=item_11.Item2, p=vec_7)  # -> out, A; inputs a: Vector3d, b: Vector3d, c: Vector3d, p: Vector3d
# ---------- c_script: C# ----------
    Vector3d v0 = b - a, v1 = c - a, v2 = p - a;

    double d00 = Dot(v0, v0);
    double d01 = Dot(v0, v1);
    double d11 = Dot(v1, v1);
    double d20 = Dot(v2, v0);
    double d21 = Dot(v2, v1);
    double denom = d00 * d11 - d01 * d01;
    var v = (d11 * d20 - d01 * d21) / denom;
    var w = (d00 * d21 - d01 * d20) / denom;
    var u = 1.0f - v - w;

    Console.WriteLine("v");

    A = new Vector3d(u, v, w);
# ---------- c_script: C# additional code ----------
  private double Dot(Vector3d v0, Vector3d v1){

    return (v0.X * v1.X) + (v0.Y * v1.Y) + (v0.Z * v1.Z);

  }
# ---------- end c_script ----------

# ----
lng_14 = ListLength(List=demesh_5.Vertices)  # -> flatten(Length)
devec = DeconstructVector(Vector=graft(c_script.A))  # -> XComponent, YComponent, ZComponent
merge_16 = Merge(Data1=devec.ZComponent, Data2=devec.YComponent, Data3=devec.XComponent)
larger = LargerThan(FirstNumber=merge_16, SecondNumber=0)  # -> LargerThan, OrEqualTo
data_44 = Data(flatten(merge_16))
ma = MassAddition(Input=larger.LargerThan)  # -> Result, PartialResults
equals = Equality(FirstNumber=ma.Result, SecondNumber=3)  # -> Equality, Inequality
trim_6 = TrimTree(Tree=equals.Equality, Depth=1)
dispatch = Dispatch(List=pt_5, DispatchPattern=trim_6)  # -> ListA, ListB
data_45 = Data(lng_14)
data_46 = Data(data_44)
data_47 = Data(trim_6)

triangleaccessbarycenters = Data(data_46)
triangleaccessbarcenticlistlength = Data(data_45)
triangleaccessbarcenticinternalmask = Data(flatten(data_47))

triangleaccessbarcenticinternalmask_2 = Data(triangleaccessbarcenticinternalmask)
triangleaccessbarcenticlistlength_2 = Data(triangleaccessbarcenticlistlength)
triangleaccessbarycenters_2 = Data(triangleaccessbarycenters)

data_48 = Data(mjoin)
medges = MeshEdges(Mesh=data_48)  # -> NakedEdges, InteriorEdges, NonManifoldEdges
demesh_6 = DeconstructMesh(Mesh=data_48)  # -> Vertices, Faces, Colours, Normals
end = EndPoints(Curve=medges.NakedEdges)  # -> Start, End
merge_17 = Merge(Data1=end.Start, Data2=end.End)
cp_7 = ClosestPoint(Point=demesh_6.Vertices, Cloud=merge_17)  # -> ClosestPoint, CPIndex, Distance

# ---- group: tolerance
one_over_x_4 = OneOverX(Value=Slider(100, range=0..100))

# ----
smaller = SmallerThan(FirstNumber=cp_7.Distance, SecondNumber=one_over_x_4)  # -> SmallerThan, OrEqualTo
dispatch_2 = Dispatch(List=demesh_6.Vertices, DispatchPattern=smaller.OrEqualTo)  # -> ListA, ListB

data_49 = Data(smaller.OrEqualTo)
triangleaccessedgemask = Data(flatten(data_49))
triangleaccessedgemask_2 = Data(triangleaccessedgemask)
mesh_tile_data = CSharpScript(
    gridScale=gridsize_17,
    nestingScale=nestingamount_13,
    triangles=triangles_20,
    offsets=offsets_17,
    positions=positions_7,
    triangleCenters=trianglecenters_6,
    triangleCenterOffsets=trianglecenteroffsets_6,
    innerTrianglePointIndexList=data_40,
    culled2dTriangleOffsets=culled2dtriangleoffsets_8,
    culledTriangleIndexes=culledtriangleindexes_6,
    culled2dPointOffsets=culled2dpointoffsets_5,
    culledPointIndexes=culledpointindexes_5,
    innerPointIndexList=barycentercount,
    barycentricCoordinates=barycentriccoordinates_6,
    innerBarycentricCoordinates=innerbarycentriccoordinates_4,
    innerBarycentricIndices=internalbarycentricindices_7,
    triangleCenterBarycenters=centerbarycenters_7,
    triangleAccessBarcenticListLength=triangleaccessbarcenticlistlength_2,
    triangleAccessBarycenters=triangleaccessbarycenters_2,
    triangleAccessBarcenticInternalMask=triangleaccessbarcenticinternalmask_2,
    triangleAccessEdgeMask=triangleaccessedgemask_2)  # -> A; inputs gridScale: Int32, nestingScale: Int32, triangles: list of Int32, offsets: list of Point3d, positions: list of Point3d, triangleCenters: list of Point3d, triangleCenterOffsets: list of Point3d, innerTrianglePointIndexList: list of Int32, culled2dTriangleOffsets: list of String, culledTriangleIndexes: list of String, culled2dPointOffsets: list of String, culledPointIndexes: list of String, innerPointIndexList: list, barycentricCoordinates: list of Double, innerBarycentricCoordinates: list of Double, innerBarycentricIndices: list of Int32, triangleCenterBarycenters: list of Double, triangleAccessBarcenticListLength: list of Int32, triangleAccessBarycenters: list of Double, triangleAccessBarcenticInternalMask: list of Boolean, triangleAccessEdgeMask: list of Boolean
# ---------- mesh_tile_data: C# ----------
  var dataStructure = new{
  gridScale = gridScale,
  nestingScale = nestingScale,
  triangles = triangles,
  offsets = FlattenPointListToInt(offsets),
  positions = FlattenPointListToFloat(positions),
  triangleCenters = FlattenPointListToFloat(triangleCenters),
  triangleCenterOffsets = FlattenPointListToInt(triangleCenterOffsets),
  innerTrianglePointIndexList = innerTrianglePointIndexList,
  innerPointIndexList = innerPointIndexList,
  culled2dTriangleOffsets = culled2dTriangleOffsets,
  culledTriangleIndexes = culledTriangleIndexes,
  culled2dPointOffsets = culled2dPointOffsets,
  culledPointIndexes = culledPointIndexes,
  barycentricCoordinates = barycentricCoordinates,
  innerBarycentricCoordinates = innerBarycentricCoordinates,
  innerBarycentricIndices = innerBarycentricIndices,
  triangleCenterBarycenters = triangleCenterBarycenters,
  triangleAccessBarcenticListLength = triangleAccessBarcenticListLength,
  triangleAccessBarycenters = triangleAccessBarycenters,
  triangleAccessBarcenticInternalMask = triangleAccessBarcenticInternalMask,
  triangleAccessEdgeMask = triangleAccessEdgeMask
  };

  //var serializer = new System.Runtime.Serialization.Json.DataContractJsonSerializer();
  //var output = serializer.Serialize(dataStructure);

  A = dataStructure;
# ---------- mesh_tile_data: C# additional code ----------
  List<int> FlattenPointListToInt(List<Point3d> list){

    var offsetsFlat = new List<int>();

    for (int i = 0; i < list.Count; i++)
    {
      offsetsFlat.Add((int) list[i].X);
      offsetsFlat.Add((int) list[i].Y);

    }
    return     offsetsFlat;
  }

  List<float> FlattenPointListToFloat(List<Point3d> list){

    var offsetsFlat = new List<float>();

    for (int i = 0; i < list.Count; i++)
    {
      offsetsFlat.Add((float) list[i].X);
      offsetsFlat.Add((float) list[i].Y);

    }
    return     offsetsFlat;
  }
# ---------- end mesh_tile_data ----------
serialise = SerialiseToJSON(Object=mesh_tile_data)
writetext = WriteToFile(Path=concat_2, Text=serialise, Write=Toggle(False))
