# Grasshopper definition restart-01.gh (Grasshopper 1.0.5)
# plug-ins: MeshEdit Components, MeshMachine, PlanktonGh, TT Toolbox

rectangle = Rectangle(Plane=PlaneXY(0, 0, 0), XSize=Slider(50, range=0..100), YSize=Slider(50, range=0..100), Radius=0)  # -> Rectangle, Length
explode = Explode(Curve=rectangle.Rectangle, Recursive=True)  # -> Segments, Vertices
item = ListItem(List=explode.Segments, Index=0, Wrap=True)  # -> Item, Item1, Item2, Item3
number_slider = Slider(10, range=0..100)
flip = FlipCurve(Curve=item.Item)  # -> Curve, Flag
flip_2 = FlipCurve(Curve=item.Item1)  # -> Curve, Flag
merge = Merge(Data1=flip.Curve, Data2=item.Item2)
merge_2 = Merge(Data1=flip_2.Curve, Data2=item.Item3)
divide = DivideCurve(Curve=reparameterize(merge_2), Count=number_slider, Kinks=False)  # -> Points, Tangents, Parameters
pi = Pi(Factor=Slider(3, range=0..10))
pi_2 = Pi(Factor=Slider(4, range=0..10))
divide_2 = DivideCurve(Curve=reparameterize(merge), Count=number_slider, Kinks=False)  # -> Points, Tangents, Parameters
multiplication = Multiplication(A=divide.Parameters, B=pi_2)
multiplication_2 = Multiplication(A=divide.Parameters, B=pi)
pi_3 = Pi(Factor=Slider(4, range=0..10))
pi_4 = Pi(Factor=Slider(1, range=0..10))
sin = Sine(Value=multiplication)
sin_2 = Sine(Value=multiplication_2)
multiplication_3 = Multiplication(A=divide_2.Parameters, B=pi_4)
multiplication_4 = Multiplication(A=divide_2.Parameters, B=pi_3)
multiplication_5 = Multiplication(A=sin, B=Slider(2, range=0..10))
multiplication_6 = Multiplication(A=sin_2, B=Slider(3, range=0..10))
sin_3 = Sine(Value=multiplication_4)
sin_4 = Sine(Value=multiplication_3)
addition = Addition(A=multiplication_6, B=multiplication_5)
X = UnitX(Factor=addition)
multiplication_7 = Multiplication(A=sin_3, B=Slider(2, range=0..10))
multiplication_8 = Multiplication(A=sin_4, B=Slider(6, range=0..10))
move = Move(Geometry=divide.Points, Motion=X)  # -> Geometry, Transform
addition_2 = Addition(A=multiplication_8, B=multiplication_7)
Y = UnitY(Factor=addition_2)
move_2 = Move(Geometry=divide_2.Points, Motion=Y)  # -> Geometry, Transform
pline = PolyLine(Vertices=move.Geometry, Closed=False)  # -> flatten(Polyline)
pline_2 = PolyLine(Vertices=move_2.Geometry, Closed=False)  # -> flatten(Polyline)
data = Data(pline)
data_2 = Data(pline_2)

data_3 = Data(data)
data_4 = Data(data_2)
merge_3 = Merge(Data1=data_4, Data2=data_3)
data_5 = Data(merge_3)
join = JoinCurves(Curves=data_5, Preserve=False)
explode_2 = Explode(Curve=join, Recursive=True)  # -> Segments, Vertices
srf = Surface(join)
data_6 = Data(data_5)
split = SplitList(List=reverse(explode_2.Vertices), Index=1)  # -> ListA, reverse(ListB)
timer = Timer(TimerInterval=20, Target=meshmachine)  # disabled
meshmachine = MeshMachine(
    Geometry=srf,
    Length=Slider(5.65, range=0..10),
    FixCurves=data_6,
    FixVertices=split.ListB,
    Flip=1,
    PullStrength=0.8,
    CurvatureAdaptivity=0,
    Reset=Toggle(False))
pmesh = PlanktonMesh(meshmachine)
demesh = DeconstructMesh(Mesh=pmesh)  # -> Vertices, Faces, Colours, Normals
conmesh = ConstructMesh(Vertices=demesh.Vertices, Faces=demesh.Faces)
weldvertices = MeshWeldVertices(Mesh=conmesh, Tolerance=0.01)  # -> RuntimeMessage, Mesh
mesh = Mesh(weldvertices.Mesh)

data_7 = Data(data)
data_8 = Data(data_2)
item_2 = ListItem(List=data_8, Index=0, Wrap=True)  # -> Item1, Item
item_3 = ListItem(List=data_7, Index=0, Wrap=True)  # -> Item1, Item
data_9 = Data(item_2.Item1)
data_10 = Data(item_3.Item)
explode_3 = Explode(Curve=data_10, Recursive=True)  # -> Segments, Vertices
explode_4 = Explode(Curve=data_9, Recursive=True)  # -> Segments, Vertices
split_2 = SplitList(List=explode_3.Vertices, Index=1)  # -> ListA, ListB
split_3 = SplitList(List=explode_4.Vertices, Index=1)  # -> ListA, ListB
data_11 = Data(split_2.ListB)
data_12 = Data(split_2.ListA)
data_13 = Data(split_3.ListB)

data_14 = Data(data)
data_15 = Data(data_2)
item_4 = ListItem(List=data_15, Index=0, Wrap=True)  # -> Item1, Item
item_5 = ListItem(List=data_14, Index=0, Wrap=True)  # -> Item1, Item
data_16 = Data(item_4.Item)
data_17 = Data(item_5.Item1)
explode_5 = Explode(Curve=data_16, Recursive=True)  # -> Segments, Vertices
explode_6 = Explode(Curve=data_17, Recursive=True)  # -> Segments, Vertices
split_4 = SplitList(List=explode_6.Vertices, Index=1)  # -> ListA, ListB
split_5 = SplitList(List=explode_5.Vertices, Index=1)  # -> ListA, ListB
split_6 = SplitList(List=reverse(split_4.ListB), Index=1)  # -> ListA, reverse(ListB)
data_18 = Data(split_6.ListA)
data_19 = Data(split_4.ListB)
data_20 = Data(data_18)
data_21 = Data(split_5.ListB)

mesh_2 = Mesh(mesh)
data_22 = Data(data_11)
data_23 = Data(data_12)
data_24 = Data(data_13)
demesh_2 = DeconstructMesh(Mesh=mesh_2)  # -> Vertices, Faces, Colours, Normals
data_25 = Data(data_19)
data_26 = Data(data_20)
data_27 = Data(data_21)
data_28 = Data(data_27)
data_29 = Data(data_25)
data_30 = Data(data_26)
data_31 = Data(data_24)
mesh_3 = Mesh(mesh)
data_32 = Data(data_22)
data_33 = Data(data_23)
cp = ClosestPoint(Point=data_33, Cloud=demesh_2.Vertices)  # -> ClosestPoint, CPIndex, Distance
cp_2 = ClosestPoint(Point=data_32, Cloud=demesh_2.Vertices)  # -> ClosestPoint, CPIndex, Distance
cp_3 = ClosestPoint(Point=data_31, Cloud=demesh_2.Vertices)  # -> ClosestPoint, CPIndex, Distance
cp_4 = ClosestPoint(Point=data_30, Cloud=demesh_2.Vertices)  # -> ClosestPoint, CPIndex, Distance
cp_5 = ClosestPoint(Point=data_29, Cloud=demesh_2.Vertices)  # -> ClosestPoint, CPIndex, Distance
cp_6 = ClosestPoint(Point=data_28, Cloud=demesh_2.Vertices)  # -> ClosestPoint, CPIndex, Distance
merge_4 = Merge(Data1=cp_4.CPIndex, Data2=cp_5.CPIndex, Data3=cp_6.CPIndex)
merge_5 = Merge(Data1=cp.CPIndex, Data2=cp_2.CPIndex, Data3=cp_3.CPIndex)  # -> flatten(Result)
deface = DeconstructFace(Face=demesh_2.Faces)  # -> CornerA, CornerB, CornerC, CornerD
merge_6 = Merge(Data1=graft(deface.CornerA), Data2=graft(deface.CornerB), Data3=graft(deface.CornerC))  # -> flatten(Result)
replace = ReplaceItems(List=demesh_2.Vertices, Indices=merge_5, Wrap=False)

replace_2 = ReplaceMembers(Set=merge_6, Find=flatten(merge_5), Replace=flatten(merge_4))
cset = CreateSet(List=replace_2)  # -> Set, Map
lng = ListLength(List=cset.Set)
sort = SortList(Keys=flatten(cset.Set), ValuesA=flatten(cset.Set))  # -> Keys, ValuesA
series = Series(Start=0, Step=1, Count=lng)
mindex = MemberIndex(Set=replace_2, Member=sort.ValuesA)  # -> Index, Count
repeat = RepeatData(Data=graft(series), Length=graft(mindex.Count))  # -> flatten(Data)
sort_2 = SortList(Keys=flatten(mindex.Index), ValuesA=flatten(repeat))  # -> Keys, ValuesA

lng_2 = ListLength(List=merge_6)
vec = VectorXYZ(XComponent=0, YComponent=0, ZComponent=0)  # -> Vector, Length
clean = CleanTree(RemoveNulls=True, RemoveInvalid=True, RemoveEmpty=False, Tree=replace)
X_2 = UnitX(Factor=1)
Y_2 = UnitY(Factor=1)
mindex_2 = MemberIndex(Set=merge_6, Member=cp_3.CPIndex)  # -> flatten(Index), Count
mindex_3 = MemberIndex(Set=merge_6, Member=cp.CPIndex)  # -> flatten(Index), Count
mindex_4 = MemberIndex(Set=merge_6, Member=cp_2.CPIndex)  # -> flatten(Index), Count
repeat_2 = RepeatData(Data=vec.Vector, Length=lng_2)
addition_3 = Addition(A=Y_2, B=X_2)
replace_3 = ReplaceItems(List=repeat_2, Item=addition_3, Indices=mindex_3.Index, Wrap=False)
X_3 = UnitX(Factor=1)
replace_4 = ReplaceItems(List=replace_3, Item=X_3, Indices=mindex_4.Index, Wrap=False)
Y_3 = UnitY(Factor=1)
replace_5 = ReplaceItems(List=replace_4, Item=Y_3, Indices=mindex_2.Index, Wrap=False)
facen = FaceNormals(Mesh=mesh_3)  # -> Centers, Normals
int = Integer(sort_2.ValuesA)  # disabled
vec_2 = Vector(replace_5)  # disabled
pt = Point(clean)  # disabled
multiplication_9 = Multiplication(A=vec_2, B=Slider(50, range=0..100))
item_6 = ListItem(List=pt, Index=int, Wrap=True)
move_3 = Move(Geometry=item_6, Motion=multiplication_9)  # -> Geometry, Transform
pt_2 = Point(Point(0, 0, 0))
lng_3 = ListLength(List=facen.Centers)
repeat_3 = RepeatData(Data=pt_2, Length=lng_3)
partition = PartitionList(List=move_3.Geometry, Size=3)
pline_3 = PolyLine(Vertices=partition, Closed=True)
data_34 = Data(vec_2)
data_35 = Data(pt)
lng_4 = ListLength(List=data_35)
data_36 = Data(facen.Centers)
data_37 = Data(repeat_3)
pdecon = Deconstruct(Point=data_35)  # -> XComponent, YComponent, ZComponent
data_38 = Data(int)
pdecon_2 = Deconstruct(Point=data_34)  # -> XComponent, YComponent, ZComponent
repeat_4 = RepeatData(Data=",", Length=expr("x-1", lng_4))
lng_5 = ListLength(List=data_34)
concat = Concatenate(
    FragmentA="new Vector3(",
    FragmentB=pdecon.XComponent,
    FragmentC="f,",
    FragmentD=pdecon.YComponent,
    FragmentE="f,",
    FragmentF=pdecon.ZComponent,
    FragmentG="f)")
int_2 = Integer(pdecon_2.XComponent)
lng_6 = ListLength(List=data_38)
int_3 = Integer(pdecon_2.YComponent)
lng_7 = ListLength(List=data_36)
lng_8 = ListLength(List=data_37)
panel = Panel("f)")
merge_7 = Merge(Data1=flatten(repeat_4), Data2=flatten("};"))
pdecon_3 = Deconstruct(Point=data_36)  # -> XComponent, YComponent, ZComponent
pdecon_4 = Deconstruct(Point=data_37)  # -> XComponent, YComponent, ZComponent
repeat_5 = RepeatData(Data=",", Length=expr("x-1", lng_5))
repeat_6 = RepeatData(Data=",", Length=expr("x-1", lng_6))
int_4 = Integer(pdecon_4.XComponent)
int_5 = Integer(pdecon_4.YComponent)
repeat_7 = RepeatData(Data=",", Length=expr("x-1", lng_7))
concat_2 = Concatenate(FragmentA="new Vector2Int(", FragmentB=int_2, FragmentC=",", FragmentD=int_3, FragmentG=")")
repeat_8 = RepeatData(Data=",", Length=expr("x-1", lng_8))
concat_3 = Concatenate(FragmentA=data_38)
merge_8 = Merge(Data1=flatten(repeat_5), Data2=flatten("};"))
concat_4 = Concatenate(
    FragmentA="new Vector3(",
    FragmentB=pdecon_3.XComponent,
    FragmentC="f,",
    FragmentD=pdecon_3.YComponent,
    FragmentE="f,",
    FragmentF=pdecon_3.ZComponent,
    FragmentG="f)")
concat_5 = Concatenate(FragmentA=concat, FragmentB=merge_7)
concat_6 = Concatenate(FragmentA="new Vector2Int(", FragmentB=int_4, FragmentC=",", FragmentD=int_5, FragmentG=")")
merge_9 = Merge(Data1=flatten(repeat_6), Data2=flatten("};"))
split_7 = SplitList(List=concat_5, Index=1)  # -> ListA, ListB
merge_10 = Merge(Data1=flatten(repeat_7), Data2=flatten("};"))
merge_11 = Merge(Data1=flatten(repeat_8), Data2=flatten("};"))
concat_7 = Concatenate(FragmentA="var pts = Vector3[]{", FragmentB=split_7.ListA)
concat_8 = Concatenate(FragmentA=concat_2, FragmentB=merge_8)
split_8 = SplitList(List=concat_8, Index=1)  # -> ListA, ListB
concat_9 = Concatenate(FragmentA=concat_3, FragmentB=merge_9)
split_9 = SplitList(List=concat_9, Index=1)  # -> ListA, ListB
merge_12 = Merge(Data1=concat_7, Data2=split_7.ListB)
concat_10 = Concatenate(FragmentA=concat_4, FragmentB=merge_10)
concat_11 = Concatenate(FragmentA=concat_6, FragmentB=merge_11)
split_10 = SplitList(List=concat_10, Index=1)  # -> ListA, ListB
split_11 = SplitList(List=concat_11, Index=1)  # -> ListA, ListB
concat_12 = Concatenate(FragmentA="var pts = Vector3[]{", FragmentB=split_8.ListA)
concat_13 = Concatenate(FragmentA="var indexes = new int[]{", FragmentB=split_9.ListA)
concat_14 = Concatenate(FragmentA="Centers = Vector3[]{", FragmentB=split_10.ListA)
concat_15 = Concatenate(FragmentA="Offsets = Vector2Int[]{", FragmentB=split_11.ListA)
merge_13 = Merge(Data1=concat_12, Data2=split_8.ListB)
merge_14 = Merge(Data1=concat_13, Data2=split_9.ListB)
merge_15 = Merge(Data1=concat_14, Data2=split_10.ListB)
merge_16 = Merge(Data1=concat_15, Data2=split_11.ListB)
panel_2 = Panel(merge_12)
join_2 = TextJoin(Text=merge_14)
panel_3 = Panel(merge_13)
panel_4 = Panel(join_2)
panel_5 = Panel(merge_15)
panel_6 = Panel(merge_16)
number_slider_2 = Slider(50, range=0..100)  # disabled
number_slider_3 = Slider(50, range=0..100)  # disabled
number_slider_4 = Slider(4, range=0..10)
pt_3 = Point(pt)  # disabled
int_6 = Integer(int)  # disabled
vec_3 = Vector(vec_2)  # disabled
centers = Data(facen.Centers)  # disabled
lng_9 = ListLength(List=int_6)  # disabled
lng_10 = ListLength(List=pt_3)  # disabled
multiplication_10 = Multiplication(A=vec_3, B=number_slider_3)
addition_4 = Addition(A=number_slider_4, B=2)
one_over_x = OneOverX(Value=number_slider_4)
division = Division(A=lng_9, B=3)
one_over_x_2 = OneOverX(Value=number_slider_4)
item_7 = ListItem(List=pt_3, Index=int_6, Wrap=True)
int_7 = Integer(division)
series_2 = Series(Start=0, Step=1, Count=int_7)
int_8 = Integer(series_2)
multiplication_11 = Multiplication(A=number_slider_2, B=one_over_x_2)
series_3 = Series(Start=0, Step=number_slider_2, Count=addition_4)
move_4 = Move(Geometry=item_7, Motion=multiplication_10)  # -> Geometry, Transform
vec_4 = VectorXYZ(XComponent=multiplication_11, YComponent=multiplication_11, ZComponent=0)  # -> Vector, Length
lng_11 = ListLength(List=pt_3)
randlist = RandomListLength(R=Domain(-1, 1), L=move_4.Geometry, S=2)
vec_5 = VectorXYZ(XComponent=series_3, YComponent=graft(series_3), ZComponent=0)  # -> flatten(Vector), Length
series_4 = Series(Start=0, Step=Slider(1, range=0..100), Count=addition_4)
partition_2 = PartitionList(List=move_4.Geometry, Size=3)
neg = Negative(Value=vec_4.Vector)
series_5 = Series(Start=0, Step=1, Count=lng_10)
vec_6 = VectorXYZ(XComponent=randlist, YComponent=reverse(randlist), ZComponent=0)  # -> Vector, Length
int_9 = Integer(series_4)
move_5 = Move(Geometry=centers, Motion=graft(vec_5.Vector))  # -> Geometry, Transform
move_6 = Move(Geometry=pt_3, Motion=graft(vec_5.Vector))  # -> Geometry, Transform
pline_4 = PolyLine(Vertices=partition_2, Closed=True)  # -> flatten(Polyline)
concat_16 = Concatenate(FragmentA=int_9, FragmentB=",", FragmentC=graft(int_9))  # -> flatten(Result)
repeat_9 = RepeatData(Data=graft(concat_16), Length=int_7)  # -> flatten(Data)
multiplication_12 = Multiplication(A=vec_6.Vector, B=Slider(0.5, range=0..1))
move_7 = Move(Geometry=move_4.Geometry, Motion=multiplication_12)  # -> Geometry, Transform
tag = TextTag(Location=move_7.Geometry, Text=int_6)
int_10 = Integer(series_5)
scale = Scale(Geometry=move_5.Geometry, Center=Point(0, 0, 0), Factor=one_over_x)  # -> Geometry, Transform
scale_2 = Scale(Geometry=move_6.Geometry, Center=Point(0, 0, 0), Factor=one_over_x)  # -> Geometry, Transform
lng_12 = ListLength(List=int_10)
number_slider_5 = Slider(1000, range=0..1000)
lng_13 = ListLength(List=flatten(vec_5.Vector))
move_8 = Move(Geometry=scale_2.Geometry, Motion=neg)  # -> flatten(Geometry), Transform
move_9 = Move(Geometry=scale.Geometry, Motion=neg)  # -> flatten(Geometry), Transform
quad = MeshQuad(CornerA=0, CornerB=1, CornerC=2, CornerD=2)
scale_3 = Scale(Geometry=repeat_9, Center=Point(0, 0, 0), Factor=number_slider_5)  # -> Geometry, Transform
multiplication_13 = Multiplication(A=lng_12, B=lng_13)
lng_14 = ListLength(List=move_9.Geometry)
repeat_10 = RepeatData(Data=int_8, Length=lng_14)
conmesh_2 = ConstructMesh(Vertices=partition_2, Faces=quad)
repeat_11 = RepeatData(Data=graft(concat_16), Length=lng_11)  # -> flatten(Data)
repeat_12 = RepeatData(Data=graft(concat_16), Length=lng_11)  # -> flatten(Data)
scale_4 = Scale(Geometry=pline_4, Center=Point(0, 0, 0), Factor=number_slider_5)  # -> Geometry, Transform
number_slider_6 = Slider(3, range=0..10)
repeat_13 = RepeatData(Data=int_10, Length=multiplication_13)  # -> flatten(Data)
scale_5 = Scale(Geometry=move_8.Geometry, Center=Point(0, 0, 0), Factor=number_slider_5)  # -> Geometry, Transform
scale_6 = Scale(Geometry=move_9.Geometry, Center=Point(0, 0, 0), Factor=number_slider_5)  # -> Geometry, Transform
lng_15 = ListLength(List=scale_4.Geometry)
series_6 = Series(Start=0, Step=1, Count=lng_15)  # disabled
incurves = PointInCurves(Point=scale_5.Geometry, Curves=scale_4.Geometry)  # -> Relationship, Index, Point; disabled
incurves_2 = PointInCurves(Point=scale_6.Geometry, Curves=scale_4.Geometry)  # -> Relationship, Index, Point; disabled
int_11 = Integer(series_6)  # disabled
lng_16 = ListLength(List=repeat_12)  # disabled
mindex_5 = MemberIndex(Set=incurves.Index, Member=int_11)  # -> Index, Count; disabled
mindex_6 = MemberIndex(Set=incurves_2.Index, Member=int_11)  # -> Index, Count; disabled
data_39 = Data(data_34)  # disabled
item_8 = ListItem(List=move_9.Geometry, Index=mindex_6.Index, Wrap=True)  # disabled
item_9 = ListItem(List=repeat_12, Index=mindex_5.Index, Wrap=True)  # disabled
split_12 = TextSplit(Text=item_9, Separators=",")  # disabled
repeat_14 = RepeatData(Data=data_39, Length=lng_16)  # disabled
item_10 = ListItem(List=repeat_14, Index=mindex_5.Index, Wrap=True)  # disabled
item_11 = ListItem(List=repeat_12, Index=mindex_5.Index, Wrap=True)  # disabled
item_12 = ListItem(List=repeat_11, Index=mindex_5.Index, Wrap=True)  # disabled
int_12 = Integer(split_12)  # disabled
item_13 = ListItem(List=repeat_13, Index=mindex_5.Index, Wrap=True)  # disabled
item_14 = ListItem(List=move_8.Geometry, Index=mindex_5.Index, Wrap=True)  # disabled
partition_3 = PartitionList(List=int_6, Size=3)  # disabled
pdecon_5 = Deconstruct(Point=item_10)  # -> XComponent, YComponent, ZComponent; disabled
item_15 = ListItem(List=int_12, Index=0, Wrap=True)  # -> Item, Item1; disabled
item_16 = ListItem(List=repeat_12, Index=mindex_5.Index, Wrap=True)  # disabled
panel_7 = Panel(")")  # disabled
match = MatchTreeStructure(DataList=flatten(pdecon_5.YComponent), TreeMask=item_15.Item)  # disabled
number_slider_7 = Slider(50, range=0..100)  # disabled
match_2 = MatchTreeStructure(DataList=flatten(pdecon_5.XComponent), TreeMask=item_15.Item)  # disabled
panel_8 = Panel(pdecon_5.YComponent)  # disabled
split_13 = TextSplit(Text=item_16, Separators=", ")  # disabled
panel_9 = Panel("new Vector3(")  # disabled
addition_5 = Addition(A=match, B=item_15.Item1)  # disabled
panel_10 = Panel("f)")  # disabled
addition_6 = Addition(A=match_2, B=item_15.Item)  # disabled
meshcp = MeshClosestPoint(Point=item_8, Mesh=conmesh_2)  # -> Point, Index, Parameter; disabled
meshcp_2 = MeshClosestPoint(Point=item_14, Mesh=conmesh_2)  # -> Point, Index, Parameter; disabled
data_40 = Data(meshcp_2.Parameter)  # disabled
split_14 = TextSplit(Text=data_40, Separators="[];")  # disabled
item_17 = ListItem(List=split_14, Index=0, Wrap=True)  # -> Item, Item1, Item2, Item3, Item4; disabled
merge_17 = Merge(Data1=item_17.Item3, Data2=item_17.Item2, Data3=item_17.Item1)  # disabled
join_3 = TextJoin(Text=merge_17, Join="f,")  # disabled
int_13 = Integer(addition_5)  # disabled
int_14 = Integer(addition_6)  # disabled
panel_11 = Panel(",")  # disabled
multiplication_14 = Multiplication(A=split_13, B=number_slider_7)  # disabled
item_18 = ListItem(List=multiplication_14, Index=0, Wrap=True)  # -> Item, Item1; disabled
data_41 = Data(meshcp_2.Parameter)  # disabled
concat_17 = Concatenate(FragmentA=panel_9, FragmentB=join_3, FragmentC=panel_10)  # disabled
vec_7 = VectorXYZ(XComponent=item_18.Item, YComponent=item_18.Item1, ZComponent=0)  # -> Vector, Length; disabled
concat_18 = Concatenate(FragmentA=int_14, FragmentC=panel_11, FragmentB=int_13)  # disabled
panel_12 = Panel("new Vector2Int(")  # disabled
concat_19 = Concatenate(FragmentA=panel_12, FragmentB=item_9, FragmentC=panel_7)  # disabled
data_42 = Data(concat_19)  # disabled
panel_13 = Panel("new Vector2Int[]{")  # disabled
trim = TrimTree(Tree=concat_17, Depth=1)  # disabled
lng_17 = ListLength(List=data_42)  # disabled
split_15 = TextSplit(Text=data_41, Separators="[];")  # disabled
data_43 = Data(trim)  # disabled
trim_2 = TrimTree(Tree=concat_18, Depth=1)  # disabled
panel_14 = Panel("new Vector3[]{")  # disabled
trim_3 = TrimTree(Tree=vec_7.Vector, Depth=1)  # disabled
lng_18 = ListLength(List=data_43)  # disabled
lng_19 = ListLength(List=lng_17)  # disabled
panel_15 = Panel("var relationships= new Vector2Int[][]{")  # disabled
panel_16 = Panel(item_9)  # disabled
panel_17 = Panel("}")  # disabled
item_19 = ListItem(List=split_15, Index=0, Wrap=True)  # -> Item, Item1, Item2, Item3, Item4; disabled
panel_18 = Panel("};")  # disabled
lng_20 = ListLength(List=lng_18)  # disabled
panel_19 = Panel("Barycenters = new Vector3[][]{")  # disabled
panel_20 = Panel("f)")  # disabled
panel_21 = Panel("}")  # disabled
move_10 = Move(Motion=trim_3)  # -> Geometry, Transform; disabled
panel_22 = Panel("};")  # disabled
panel_23 = Panel(",")  # disabled
repeat_15 = RepeatData(Data=panel_23, Length=expr("x-1", lng_17))  # disabled
merge_18 = Merge(Data1=item_19.Item3, Data2=item_19.Item2, Data3=item_19.Item1)  # disabled
data_44 = Data(merge_18)  # disabled
trim_4 = TrimTree(Tree=data_44, Depth=1)  # disabled
lng_21 = ListLength(List=trim_4)  # disabled
repeat_16 = RepeatData(Data=partition_3, Length=lng_21)  # disabled
trim_5 = TrimTree(Tree=repeat_16, Depth=1)  # disabled
partition_4 = PartitionList(List=trim_5, Size=3)  # disabled
sort_3 = SortList(Keys=data_44, ValuesA=partition_4)  # -> Keys, ValuesA; disabled
item_20 = ListItem(List=sort_3.ValuesA, Index=0, Wrap=True)  # disabled
trim_6 = TrimTree(Tree=item_20, Depth=1)  # -> flatten(Tree); disabled
mindex_7 = MemberIndex(Set=trim_6, Member=int_10)  # -> Index, Count; disabled
item_21 = ListItem(List=repeat_10, Index=mindex_7.Index, Wrap=True)  # disabled
concat_20 = Concatenate(FragmentA=item_21)  # disabled
number_slider_8 = Slider(0.25, range=0..1)  # disabled
repeat_17 = RepeatData(Data=panel_17, Length=expr("x", lng_19))  # disabled
panel_24 = Panel(trim_2)  # disabled
repeat_18 = RepeatData(Data=panel_13, Length=expr("x", lng_19))  # disabled
panel_26 = Panel(",")  # disabled
join_4 = TextJoin(Text=data_42, Join=",")  # disabled
repeat_19 = RepeatData(Data=panel_26, Length=expr("x-1", lng_18))  # disabled
item_22 = ListItem(List=repeat_12, Index=mindex_5.Index, Wrap=True)  # disabled
panel_27 = Panel("};")  # disabled
repeat_20 = RepeatData(Data=panel_21, Length=expr("x", lng_20))  # disabled
repeat_21 = RepeatData(Data=panel_14, Length=expr("x", lng_20))  # disabled
join_5 = TextJoin(Join=",")  # disabled
concat_21 = Concatenate()  # disabled
join_6 = TextJoin(Text=data_43, Join=",")  # disabled
panel_28 = Panel("};")  # disabled
merge_19 = Merge(Data1=flatten(repeat_18), Data2=flatten(panel_27))  # disabled
panel_29 = Panel(",")  # disabled
concat_22 = Concatenate()  # disabled
scale_7 = Scale(Geometry=move_10.Geometry, Center=Point(0, 0, 0), Factor=number_slider_8)  # -> Geometry, Transform; disabled
panel_30 = Panel("}")  # disabled
merge_20 = Merge(Data1=flatten(repeat_21), Data2=flatten(panel_28))  # disabled
panel_31 = Panel(join_5)  # disabled
panel_32 = Panel(",")  # disabled
panel_33 = Panel("new int[]{")  # disabled
concat_23 = Concatenate(FragmentA=repeat_18, FragmentC=join_4, FragmentB=repeat_17, FragmentD=panel_29)  # -> flatten(Result); disabled
concat_24 = Concatenate(FragmentA=concat_21, FragmentB=merge_19)  # disabled
split_16 = SplitList(List=concat_24, Index=1)  # -> ListA, ListB; disabled
concat_25 = Concatenate(FragmentA=repeat_21, FragmentC=join_6, FragmentB=repeat_20, FragmentD=panel_32)  # -> flatten(Result); disabled
concat_26 = Concatenate(FragmentA=concat_22, FragmentB=merge_20)  # disabled
split_17 = SplitList(List=concat_26, Index=1)  # -> ListA, ListB; disabled
concat_27 = Concatenate(FragmentA=panel_33, FragmentB=join_5, FragmentC=panel_30)  # disabled
join_7 = TextJoin(Text=concat_23, Join=", ")  # disabled
concat_28 = Concatenate(FragmentA=panel_15, FragmentB=join_7, FragmentC=panel_18)  # disabled
panel_34 = Panel(item_21)  # disabled
join_8 = TextJoin(Text=concat_25, Join=", ")  # disabled
concat_29 = Concatenate(FragmentA=panel_19, FragmentB=join_8, FragmentC=panel_22)  # disabled
data_45 = Data(concat_27)  # disabled
panel_35 = Panel("new Vector2Int[]{")  # disabled
merge_21 = Merge(Data1=panel_15, Data2=concat_23, Data3=panel_18)  # disabled
merge_22 = Merge(Data1=panel_19, Data2=concat_25, Data3=panel_22)  # disabled
panel_36 = Panel(merge_21)  # disabled
panel_37 = Panel("var relationships= int[][]{")  # disabled
panel_38 = Panel("};")  # disabled
join_9 = TextJoin(Text=flatten(data_45), Join=",")  # disabled
panel_40 = Panel(merge_22)  # disabled
panel_41 = Panel(",")  # disabled
join_10 = TextJoin(Text=join_9, Join=", ")  # disabled
concat_30 = Concatenate(FragmentA=panel_37, FragmentB=flatten(join_9), FragmentC=panel_38)  # disabled
merge_23 = Merge(Data1=panel_37, Data2=join_10, Data3=panel_38)  # disabled
panel_42 = Panel(merge_23)  # disabled

# ==== cluster RandomListLength
L = ClusterInput()
lng = ListLength(List=L)
R = ClusterInput()
S = ClusterInput()
random = Random(Range=R, Number=lng, Seed=S)
R_2 = ClusterOutput(random)
