# Grasshopper definition restart-04.gh (Grasshopper 1.0.5)
# plug-ins: MeshEdit Components, MeshMachine, PlanktonGh, TT Toolbox

rectangle = Rectangle(Plane=PlaneXY(0, 0, 0), XSize=Slider(50, range=0..100), YSize=Slider(50, range=0..100), Radius=0)  # -> Rectangle, Length
explode = Explode(Curve=rectangle.Rectangle, Recursive=True)  # -> Segments, Vertices
item = ListItem(List=explode.Segments, Index=0, Wrap=True)  # -> Item, Item1, Item2, Item3
number_slider = Slider(10, range=0..100)
flip = FlipCurve(Curve=item.Item)  # -> Curve, Flag
flip_2 = FlipCurve(Curve=item.Item1)  # -> Curve, Flag
merge = Merge(Data1=flip.Curve, Data2=item.Item2)
merge_2 = Merge(Data1=flip_2.Curve, Data2=item.Item3)
divide = DivideCurve(Curve=reparameterize(merge_2), Count=number_slider, Kinks=False)  # -> Points, Tangents, Parameters
pi = Pi(Factor=Slider(3, range=0..10))
pi_2 = Pi(Factor=Slider(4, range=0..10))
divide_2 = DivideCurve(Curve=reparameterize(merge), Count=number_slider, Kinks=False)  # -> Points, Tangents, Parameters
multiplication = Multiplication(A=divide.Parameters, B=pi_2)
multiplication_2 = Multiplication(A=divide.Parameters, B=pi)
pi_3 = Pi(Factor=Slider(4, range=0..10))
pi_4 = Pi(Factor=Slider(1, range=0..10))
sin = Sine(Value=multiplication)
sin_2 = Sine(Value=multiplication_2)
multiplication_3 = Multiplication(A=divide_2.Parameters, B=pi_4)
multiplication_4 = Multiplication(A=divide_2.Parameters, B=pi_3)
multiplication_5 = Multiplication(A=sin, B=Slider(2, range=0..10))
multiplication_6 = Multiplication(A=sin_2, B=Slider(3, range=0..10))
sin_3 = Sine(Value=multiplication_4)
sin_4 = Sine(Value=multiplication_3)
addition = Addition(A=multiplication_6, B=multiplication_5)
X = UnitX(Factor=addition)
multiplication_7 = Multiplication(A=sin_3, B=Slider(2, range=0..10))
multiplication_8 = Multiplication(A=sin_4, B=Slider(6, range=0..10))
move = Move(Geometry=divide.Points, Motion=X)  # -> Geometry, Transform
addition_2 = Addition(A=multiplication_8, B=multiplication_7)
Y = UnitY(Factor=addition_2)
move_2 = Move(Geometry=divide_2.Points, Motion=Y)  # -> Geometry, Transform
pline = PolyLine(Vertices=move.Geometry, Closed=False)  # -> flatten(Polyline)
pline_2 = PolyLine(Vertices=move_2.Geometry, Closed=False)  # -> flatten(Polyline)
data = Data(pline)
data_2 = Data(pline_2)

data_3 = Data(data)
data_4 = Data(data_2)
item_2 = ListItem(List=data_4, Index=0, Wrap=True)  # -> Item1, Item
item_3 = ListItem(List=data_3, Index=0, Wrap=True)  # -> Item1, Item
data_5 = Data(item_2.Item1)
data_6 = Data(item_3.Item)
explode_2 = Explode(Curve=data_6, Recursive=True)  # -> Segments, Vertices
explode_3 = Explode(Curve=data_5, Recursive=True)  # -> Segments, Vertices
split = SplitList(List=explode_2.Vertices, Index=1)  # -> ListA, ListB
split_2 = SplitList(List=explode_3.Vertices, Index=1)  # -> ListA, ListB
data_7 = Data(split.ListB)
data_8 = Data(split.ListA)
data_9 = Data(split_2.ListB)

data_10 = Data(data)
data_11 = Data(data_2)
item_4 = ListItem(List=data_11, Index=0, Wrap=True)  # -> Item1, Item
item_5 = ListItem(List=data_10, Index=0, Wrap=True)  # -> Item1, Item
data_12 = Data(item_4.Item)
data_13 = Data(item_5.Item1)
explode_4 = Explode(Curve=data_12, Recursive=True)  # -> Segments, Vertices
explode_5 = Explode(Curve=data_13, Recursive=True)  # -> Segments, Vertices
split_3 = SplitList(List=explode_5.Vertices, Index=1)  # -> ListA, ListB
split_4 = SplitList(List=explode_4.Vertices, Index=1)  # -> ListA, ListB
split_5 = SplitList(List=reverse(split_3.ListB), Index=1)  # -> ListA, reverse(ListB)
data_14 = Data(split_5.ListA)
data_15 = Data(split_3.ListB)
data_16 = Data(data_14)
data_17 = Data(split_4.ListB)

data_18 = Data(data)  # disabled
data_19 = Data(data_2)  # disabled
merge_3 = Merge(Data1=data_19, Data2=data_18)
data_20 = Data(merge_3)
join = JoinCurves(Curves=data_20, Preserve=False)
explode_6 = Explode(Curve=join, Recursive=True)  # -> Segments, Vertices
srf = Surface(join)
data_21 = Data(data_20)
split_6 = SplitList(List=reverse(explode_6.Vertices), Index=1)  # -> ListA, reverse(ListB)
timer = Timer(TimerInterval=20, Target=meshmachine)  # disabled
meshmachine = MeshMachine(
    Geometry=srf,
    Length=Slider(5.88, range=0..10),
    FixCurves=data_21,
    FixVertices=split_6.ListB,
    Flip=1,
    PullStrength=Slider(1, range=0..1),
    CurvatureAdaptivity=0,
    Reset=Toggle(False))
pmesh = PlanktonMesh(meshmachine)
demesh = DeconstructMesh(Mesh=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)  # -> Vertices, Faces, Colours, Normals
conmesh = ConstructMesh(Vertices=demesh.Vertices, Faces=demesh.Faces)
weldvertices = MeshWeldVertices(Mesh=conmesh, Tolerance=0.01)  # -> RuntimeMessage, Mesh
mesh = Mesh(weldvertices.Mesh)

mesh_2 = Mesh(mesh)
data_22 = Data(data_7)
data_23 = Data(data_8)
data_24 = Data(data_9)
demesh_2 = DeconstructMesh(Mesh=mesh_2)  # -> Vertices, Faces, Colours, Normals
data_25 = Data(data_15)
data_26 = Data(data_16)
data_27 = Data(data_17)
data_28 = Data(data_27)
data_29 = Data(data_25)
data_30 = Data(data_26)
data_31 = Data(data_24)
data_32 = Data(data_22)
data_33 = Data(data_23)
cp = ClosestPoint(Point=data_33, Cloud=demesh_2.Vertices)  # -> ClosestPoint, CPIndex, Distance
cp_2 = ClosestPoint(Point=data_32, Cloud=demesh_2.Vertices)  # -> ClosestPoint, CPIndex, Distance
cp_3 = ClosestPoint(Point=data_31, Cloud=demesh_2.Vertices)  # -> ClosestPoint, CPIndex, Distance
cp_4 = ClosestPoint(Point=data_30, Cloud=demesh_2.Vertices)  # -> ClosestPoint, CPIndex, Distance
cp_5 = ClosestPoint(Point=data_29, Cloud=demesh_2.Vertices)  # -> ClosestPoint, CPIndex, Distance
cp_6 = ClosestPoint(Point=data_28, Cloud=demesh_2.Vertices)  # -> ClosestPoint, CPIndex, Distance
merge_4 = Merge(Data1=cp_4.CPIndex, Data2=cp_5.CPIndex, Data3=cp_6.CPIndex)
merge_5 = Merge(Data1=cp.CPIndex, Data2=cp_2.CPIndex, Data3=cp_3.CPIndex)  # -> flatten(Result)
deface = DeconstructFace(Face=demesh_2.Faces)  # -> CornerA, CornerB, CornerC, CornerD
merge_6 = Merge(Data1=graft(deface.CornerA), Data2=graft(deface.CornerB), Data3=graft(deface.CornerC))  # -> flatten(Result)
replace = ReplaceItems(List=demesh_2.Vertices, Indices=merge_5, Wrap=False)
replace_2 = ReplaceMembers(Set=merge_6, Find=flatten(merge_5), Replace=flatten(merge_4))
cset = CreateSet(List=replace_2)  # -> Set, Map
lng = ListLength(List=merge_6)
vec = VectorXYZ(XComponent=0, YComponent=0, ZComponent=0)  # -> Vector, Length
clean = CleanTree(RemoveNulls=True, RemoveInvalid=True, RemoveEmpty=False, Tree=replace)
X_2 = UnitX(Factor=1)
Y_2 = UnitY(Factor=1)
mindex = MemberIndex(Set=merge_6, Member=cp_3.CPIndex)  # -> flatten(Index), Count
mindex_2 = MemberIndex(Set=merge_6, Member=cp.CPIndex)  # -> flatten(Index), Count
mindex_3 = MemberIndex(Set=merge_6, Member=cp_2.CPIndex)  # -> flatten(Index), Count
lng_2 = ListLength(List=cset.Set)
repeat = RepeatData(Data=vec.Vector, Length=lng)
sort = SortList(Keys=flatten(cset.Set), ValuesA=flatten(cset.Set))  # -> Keys, ValuesA
series = Series(Start=0, Step=1, Count=lng_2)
addition_3 = Addition(A=Y_2, B=X_2)
mindex_4 = MemberIndex(Set=replace_2, Member=sort.ValuesA)  # -> Index, Count
replace_3 = ReplaceItems(List=repeat, Item=addition_3, Indices=mindex_2.Index, Wrap=False)
repeat_2 = RepeatData(Data=graft(series), Length=graft(mindex_4.Count))  # -> flatten(Data)
X_3 = UnitX(Factor=1)
replace_4 = ReplaceItems(List=replace_3, Item=X_3, Indices=mindex_3.Index, Wrap=False)
Y_3 = UnitY(Factor=1)
sort_2 = SortList(Keys=flatten(mindex_4.Index), ValuesA=flatten(repeat_2))  # -> Keys, ValuesA
replace_5 = ReplaceItems(List=replace_4, Item=Y_3, Indices=mindex.Index, Wrap=False)
int = Integer(sort_2.ValuesA)
vec_2 = Vector(replace_5)
pt = Point(clean)

facen = FaceNormals(Mesh=mesh)  # -> Centers, Normals
data_34 = Data(facen.Centers)

data_35 = Data(data_34)
pdecon = Deconstruct(Point=data_35)  # -> XComponent, YComponent, ZComponent
lng_3 = ListLength(List=data_35)
int_2 = Integer(pdecon.XComponent)
int_3 = Integer(pdecon.YComponent)
repeat_3 = RepeatData(Data=",", Length=expr("x-1", lng_3))
concat = Concatenate(FragmentA="new Vector2Int(", FragmentB=int_2, FragmentC=",", FragmentD=int_3, FragmentG=")")
merge_7 = Merge(Data1=flatten(repeat_3), Data2=flatten("};"))
concat_2 = Concatenate(FragmentA=concat, FragmentB=merge_7)
split_7 = SplitList(List=concat_2, Index=1)  # -> ListA, ListB
concat_3 = Concatenate(FragmentA="var pts = Vector3[]{", FragmentB=split_7.ListA)
merge_8 = Merge(Data1=concat_3, Data2=split_7.ListB)

data_36 = Data(data_34)
lng_4 = ListLength(List=data_36)
pdecon_2 = Deconstruct(Point=data_36)  # -> XComponent, YComponent, ZComponent
repeat_4 = RepeatData(Data=",", Length=expr("x-1", lng_4))
concat_4 = Concatenate(
    FragmentA="new Vector3(",
    FragmentB=pdecon_2.XComponent,
    FragmentC="f,",
    FragmentD=pdecon_2.YComponent,
    FragmentE="f,",
    FragmentF=pdecon_2.ZComponent,
    FragmentG="f)")
merge_9 = Merge(Data1=flatten(repeat_4), Data2=flatten("};"))
concat_5 = Concatenate(FragmentA=concat_4, FragmentB=merge_9)
split_8 = SplitList(List=concat_5, Index=1)  # -> ListA, ListB
concat_6 = Concatenate(FragmentA="var pts = Vector3[]{", FragmentB=split_8.ListA)
merge_10 = Merge(Data1=concat_6, Data2=split_8.ListB)

data_37 = Data(data_34)
lng_5 = ListLength(List=data_37)
panel = Panel("f)")
repeat_5 = RepeatData(Data=",", Length=expr("x-1", lng_5))
concat_7 = Concatenate(FragmentA=data_37)
merge_11 = Merge(Data1=flatten(repeat_5), Data2=flatten("};"))
concat_8 = Concatenate(FragmentA=concat_7, FragmentB=merge_11)
split_9 = SplitList(List=concat_8, Index=1)  # -> ListA, ListB
concat_9 = Concatenate(FragmentA="var indexes = new int[][]{", FragmentB=split_9.ListA)
merge_12 = Merge(Data1=concat_9, Data2=split_9.ListB)
join_2 = TextJoin(Text=merge_12)

# ----
# Center Offsets
pt_2 = Point(Point(0, 0, 0))
lng_6 = ListLength(List=data_34)
repeat_6 = RepeatData(Data=pt_2, Length=lng_6)
data_38 = Data(repeat_6)
lng_7 = ListLength(List=data_38)
pdecon_3 = Deconstruct(Point=data_38)  # -> XComponent, YComponent, ZComponent
int_4 = Integer(pdecon_3.XComponent)
int_5 = Integer(pdecon_3.YComponent)
repeat_7 = RepeatData(Data=",", Length=expr("x-1", lng_7))
concat_10 = Concatenate(FragmentA="new Vector2Int(", FragmentB=int_4, FragmentC=",", FragmentD=int_5, FragmentG=")")
merge_13 = Merge(Data1=flatten(repeat_7), Data2=flatten("};"))
concat_11 = Concatenate(FragmentA=concat_10, FragmentB=merge_13)
split_10 = SplitList(List=concat_11, Index=1)  # -> ListA, ListB
concat_12 = Concatenate(FragmentA="Offsets = Vector2Int[]{", FragmentB=split_10.ListA)
merge_14 = Merge(Data1=concat_12, Data2=split_10.ListB)

# ----
# Centers
panel_2 = Panel("new Vector3(")

data_39 = Data(data_34)
lng_8 = ListLength(List=data_39)
pdecon_4 = Deconstruct(Point=data_39)  # -> XComponent, YComponent, ZComponent
repeat_8 = RepeatData(Data=",", Length=expr("x-1", lng_8))
concat_13 = Concatenate(
    FragmentA=panel_2,
    FragmentB=pdecon_4.XComponent,
    FragmentC="f,",
    FragmentD=pdecon_4.YComponent,
    FragmentE="f,",
    FragmentF=pdecon_4.ZComponent,
    FragmentG="f)")
merge_15 = Merge(Data1=flatten(repeat_8), Data2=flatten("};"))
concat_14 = Concatenate(FragmentA=concat_13, FragmentB=merge_15)
split_11 = SplitList(List=concat_14, Index=1)  # -> ListA, ListB
concat_15 = Concatenate(FragmentA="Centers = Vector3[]{", FragmentB=split_11.ListA)
merge_16 = Merge(Data1=concat_15, Data2=split_11.ListB)

panel_3 = Panel(merge_8)
panel_4 = Panel(merge_16)
panel_5 = Panel(join_2)
panel_6 = Panel(merge_10)
number_slider_2 = Slider(50, range=0..100)
panel_7 = Panel(merge_14)
number_slider_3 = Slider(4, range=0..10)
pt_3 = Point(pt)
int_6 = Integer(int)
lng_9 = ListLength(List=int_6)
division = Division(A=lng_9, B=3)
vec_3 = Vector(vec_2)
centers = Data(facen.Centers)
int_7 = Integer(division)
lng_10 = ListLength(List=pt_3)
multiplication_9 = Multiplication(A=vec_3, B=Slider(50, range=0..100))
series_2 = Series(Start=0, Step=1, Count=int_7)
int_8 = Integer(series_2)
addition_4 = Addition(A=number_slider_3, B=2)
one_over_x = OneOverX(Value=number_slider_3)
one_over_x_2 = OneOverX(Value=number_slider_3)
item_6 = ListItem(List=pt_3, Index=int_6, Wrap=True)
multiplication_10 = Multiplication(A=number_slider_2, B=one_over_x_2)
series_3 = Series(Start=0, Step=number_slider_2, Count=addition_4)
move_3 = Move(Geometry=item_6, Motion=multiplication_9)  # -> Geometry, Transform
vec_4 = VectorXYZ(XComponent=multiplication_10, YComponent=multiplication_10, ZComponent=0)  # -> Vector, Length
lng_11 = ListLength(List=pt_3)
vec_5 = VectorXYZ(XComponent=series_3, YComponent=graft(series_3), ZComponent=0)  # -> flatten(Vector), Length
series_4 = Series(Start=0, Step=Slider(1, range=0..100), Count=addition_4)
partition = PartitionList(List=move_3.Geometry, Size=3)
neg = Negative(Value=vec_4.Vector)
series_5 = Series(Start=0, Step=1, Count=lng_10)
int_9 = Integer(series_4)
move_4 = Move(Geometry=centers, Motion=graft(vec_5.Vector))  # -> Geometry, Transform
move_5 = Move(Geometry=pt_3, Motion=graft(vec_5.Vector))  # -> Geometry, Transform
pline_3 = PolyLine(Vertices=partition, Closed=True)  # -> flatten(Polyline)
concat_16 = Concatenate(FragmentA=int_9, FragmentB=",", FragmentC=graft(int_9))  # -> flatten(Result)
int_10 = Integer(series_5)
scale = Scale(Geometry=move_4.Geometry, Center=Point(0, 0, 0), Factor=one_over_x)  # -> Geometry, Transform
scale_2 = Scale(Geometry=move_5.Geometry, Center=Point(0, 0, 0), Factor=one_over_x)  # -> Geometry, Transform
lng_12 = ListLength(List=int_10)
number_slider_4 = Slider(1000, range=0..1000)
lng_13 = ListLength(List=flatten(vec_5.Vector))
move_6 = Move(Geometry=scale_2.Geometry, Motion=neg)  # -> flatten(Geometry), Transform
move_7 = Move(Geometry=scale.Geometry, Motion=neg)  # -> flatten(Geometry), Transform
quad = MeshQuad(CornerA=0, CornerB=1, CornerC=2, CornerD=2)
multiplication_11 = Multiplication(A=lng_12, B=lng_13)
lng_14 = ListLength(List=move_7.Geometry)
repeat_9 = RepeatData(Data=int_8, Length=lng_14)
conmesh_2 = ConstructMesh(Vertices=partition, Faces=quad)
repeat_10 = RepeatData(Data=graft(concat_16), Length=lng_11)  # -> flatten(Data)
repeat_11 = RepeatData(Data=graft(concat_16), Length=lng_11)  # -> flatten(Data)
scale_3 = Scale(Geometry=pline_3, Center=Point(0, 0, 0), Factor=number_slider_4)  # -> Geometry, Transform
number_slider_5 = Slider(3, range=0..10)
repeat_12 = RepeatData(Data=int_10, Length=multiplication_11)  # -> flatten(Data)
scale_4 = Scale(Geometry=move_6.Geometry, Center=Point(0, 0, 0), Factor=number_slider_4)  # -> Geometry, Transform
scale_5 = Scale(Geometry=move_7.Geometry, Center=Point(0, 0, 0), Factor=number_slider_4)  # -> Geometry, Transform
lng_15 = ListLength(List=scale_3.Geometry)
series_6 = Series(Start=0, Step=1, Count=lng_15)
incurves = PointInCurves(Point=scale_4.Geometry, Curves=scale_3.Geometry)  # -> Relationship, Index, Point
incurves_2 = PointInCurves(Point=scale_5.Geometry, Curves=scale_3.Geometry)  # -> Relationship, Index, Point
int_11 = Integer(series_6)
lng_16 = ListLength(List=repeat_11)
mindex_5 = MemberIndex(Set=incurves.Index, Member=int_11)  # -> Index, Count
mindex_6 = MemberIndex(Set=incurves_2.Index, Member=int_11)  # -> Index, Count
data_40 = Data(data_35)
item_7 = ListItem(List=move_7.Geometry, Index=mindex_6.Index, Wrap=True)
item_8 = ListItem(List=repeat_11, Index=mindex_5.Index, Wrap=True)
split_12 = TextSplit(Text=item_8, Separators=",")
repeat_13 = RepeatData(Data=data_40, Length=lng_16)
item_9 = ListItem(List=repeat_13, Index=mindex_5.Index, Wrap=True)
item_10 = ListItem(List=repeat_10, Index=mindex_5.Index, Wrap=True)
int_12 = Integer(split_12)
item_11 = ListItem(List=repeat_12, Index=mindex_5.Index, Wrap=True)
item_12 = ListItem(List=move_6.Geometry, Index=mindex_5.Index, Wrap=True)
partition_2 = PartitionList(List=int_6, Size=3)
pdecon_5 = Deconstruct(Point=item_9)  # -> XComponent, YComponent, ZComponent
item_13 = ListItem(List=int_12, Index=0, Wrap=True)  # -> Item, Item1
match = MatchTreeStructure(DataList=flatten(pdecon_5.YComponent), TreeMask=item_13.Item)
match_2 = MatchTreeStructure(DataList=flatten(pdecon_5.XComponent), TreeMask=item_13.Item)
panel_8 = Panel(pdecon_5.YComponent)
addition_5 = Addition(A=match, B=item_13.Item1)
addition_6 = Addition(A=match_2, B=item_13.Item)
meshcp = MeshClosestPoint(Point=item_7, Mesh=conmesh_2)  # -> Point, Index, Parameter
meshcp_2 = MeshClosestPoint(Point=item_12, Mesh=conmesh_2)  # -> Point, Index, Parameter
int_13 = Integer(addition_5)
int_14 = Integer(addition_6)
data_41 = Data(meshcp_2.Parameter)
concat_17 = Concatenate(FragmentA=int_14, FragmentC=",", FragmentB=int_13)
split_13 = TextSplit(Text=data_41, Separators="[];")
trim = TrimTree(Tree=concat_17, Depth=1)
panel_9 = Panel(item_8)
item_14 = ListItem(List=split_13, Index=0, Wrap=True)  # -> Item, Item1, Item2, Item3, Item4
merge_17 = Merge(Data1=item_14.Item3, Data2=item_14.Item2, Data3=item_14.Item1)
data_42 = Data(merge_17)
trim_2 = TrimTree(Tree=data_42, Depth=1)
lng_17 = ListLength(List=trim_2)
repeat_14 = RepeatData(Data=partition_2, Length=lng_17)
trim_3 = TrimTree(Tree=repeat_14, Depth=1)
partition_3 = PartitionList(List=trim_3, Size=3)
sort_3 = SortList(Keys=data_42, ValuesA=partition_3)  # -> Keys, ValuesA
item_15 = ListItem(List=sort_3.ValuesA, Index=0, Wrap=True)
trim_4 = TrimTree(Tree=item_15, Depth=1)  # -> flatten(Tree)
mindex_7 = MemberIndex(Set=trim_4, Member=int_10)  # -> Index, Count
item_16 = ListItem(List=repeat_9, Index=mindex_7.Index, Wrap=True)
item_17 = ListItem(List=repeat_11, Index=mindex_5.Index, Wrap=True)
panel_10 = Panel(trim)

concat_18 = Concatenate(FragmentA="new Vector2Int(", FragmentB=item_8, FragmentC=")")
data_43 = Data(concat_18)
lng_18 = ListLength(List=data_43)
lng_19 = ListLength(List=lng_18)
repeat_15 = RepeatData(Data="}", Length=expr("x", lng_19))
join_3 = TextJoin(Text=data_43, Join=",")
repeat_16 = RepeatData(Data="new Vector2Int[]{", Length=expr("x", lng_19))
concat_19 = Concatenate(FragmentA=repeat_16, FragmentC=join_3, FragmentB=repeat_15, FragmentD=",")  # -> flatten(Result)
merge_18 = Merge(Data1="var relationships= new Vector2Int[][]{", Data2=concat_19, Data3="};")

panel_11 = Panel(item_16)

data_44 = Data(meshcp_2.Parameter)
split_14 = TextSplit(Text=data_44, Separators="[];")
item_18 = ListItem(List=split_14, Index=0, Wrap=True)  # -> Item, Item1, Item2, Item3, Item4
merge_19 = Merge(Data1=item_18.Item3, Data2=item_18.Item2, Data3=item_18.Item1)
join_4 = TextJoin(Text=merge_19, Join="f,")
concat_20 = Concatenate(FragmentA="new Vector3(", FragmentB=join_4, FragmentC="f)")
trim_5 = TrimTree(Tree=concat_20, Depth=1)
data_45 = Data(trim_5)
lng_20 = ListLength(List=data_45)
lng_21 = ListLength(List=lng_20)
panel_12 = Panel("Barycenters = new Vector3[][]{")
repeat_17 = RepeatData(Data=",", Length=expr("x-1", lng_20))
repeat_18 = RepeatData(Data="}", Length=expr("x", lng_21))
repeat_19 = RepeatData(Data="new Vector3[]{", Length=expr("x", lng_21))
join_5 = TextJoin(Text=data_45, Join=",")
concat_21 = Concatenate()
merge_20 = Merge(Data1=flatten(repeat_19), Data2=flatten("};"))
concat_22 = Concatenate(FragmentA=repeat_19, FragmentC=join_5, FragmentB=repeat_18, FragmentD=",")  # -> flatten(Result)
concat_23 = Concatenate(FragmentA=concat_21, FragmentB=merge_20)
split_15 = SplitList(List=concat_23, Index=1)  # -> ListA, ListB
join_6 = TextJoin(Text=concat_22, Join=", ")
concat_24 = Concatenate(FragmentA=panel_12, FragmentB=join_6, FragmentC="};")
merge_21 = Merge(Data1=panel_12, Data2=concat_22, Data3="};")
panel_14 = Panel(merge_21)

panel_15 = Panel(merge_18)

join_7 = TextJoin(Join=",")
panel_16 = Panel("new Vector2Int[]{")
panel_17 = Panel(join_7)
concat_25 = Concatenate(FragmentA="new int[]{", FragmentB=join_7, FragmentC="}")
data_46 = Data(concat_25)
join_8 = TextJoin(Text=flatten(data_46), Join=",")
panel_18 = Panel("var relationships= int[][]{")
join_9 = TextJoin(Text=join_8, Join=", ")
concat_26 = Concatenate(FragmentA=panel_18, FragmentB=flatten(join_8), FragmentC="};")
merge_22 = Merge(Data1=panel_18, Data2=join_9, Data3="};")
panel_19 = Panel(merge_22)
