# Grasshopper definition restart-05.gh (Grasshopper 1.0.5)
# plug-ins: MeshEdit Components, MeshMachine, PlanktonGh, TT Toolbox

rectangle = Rectangle(Plane=PlaneXY(0, 0, 0), XSize=Slider(50, range=0..100), YSize=Slider(50, range=0..100), Radius=0)  # -> Rectangle, Length
explode = Explode(Curve=rectangle.Rectangle, Recursive=True)  # -> Segments, Vertices
item = ListItem(List=explode.Segments, Index=0, Wrap=True)  # -> Item, Item1, Item2, Item3
number_slider = Slider(10, range=0..100)
flip = FlipCurve(Curve=item.Item)  # -> Curve, Flag
flip_2 = FlipCurve(Curve=item.Item1)  # -> Curve, Flag
merge = Merge(Data1=flip.Curve, Data2=item.Item2)
merge_2 = Merge(Data1=flip_2.Curve, Data2=item.Item3)
divide = DivideCurve(Curve=reparameterize(merge_2), Count=number_slider, Kinks=False)  # -> Points, Tangents, Parameters
pi = Pi(Factor=Slider(3, range=0..10))
pi_2 = Pi(Factor=Slider(4, range=0..10))
divide_2 = DivideCurve(Curve=reparameterize(merge), Count=number_slider, Kinks=False)  # -> Points, Tangents, Parameters
multiplication = Multiplication(A=divide.Parameters, B=pi_2)
multiplication_2 = Multiplication(A=divide.Parameters, B=pi)
pi_3 = Pi(Factor=Slider(4, range=0..10))
pi_4 = Pi(Factor=Slider(1, range=0..10))
sin = Sine(Value=multiplication)
sin_2 = Sine(Value=multiplication_2)
multiplication_3 = Multiplication(A=divide_2.Parameters, B=pi_4)
multiplication_4 = Multiplication(A=divide_2.Parameters, B=pi_3)
multiplication_5 = Multiplication(A=sin, B=Slider(2, range=0..10))
multiplication_6 = Multiplication(A=sin_2, B=Slider(3, range=0..10))
sin_3 = Sine(Value=multiplication_4)
sin_4 = Sine(Value=multiplication_3)
addition = Addition(A=multiplication_6, B=multiplication_5)
X = UnitX(Factor=addition)
multiplication_7 = Multiplication(A=sin_3, B=Slider(2, range=0..10))
multiplication_8 = Multiplication(A=sin_4, B=Slider(6, range=0..10))
move = Move(Geometry=divide.Points, Motion=X)  # -> Geometry, Transform
addition_2 = Addition(A=multiplication_8, B=multiplication_7)
Y = UnitY(Factor=addition_2)
move_2 = Move(Geometry=divide_2.Points, Motion=Y)  # -> Geometry, Transform
pline = PolyLine(Vertices=move.Geometry, Closed=False)  # -> flatten(Polyline)
pline_2 = PolyLine(Vertices=move_2.Geometry, Closed=False)  # -> flatten(Polyline)
data = Data(pline)
data_2 = Data(pline_2)

data_3 = Data(data)
data_4 = Data(data_2)
item_2 = ListItem(List=data_4, Index=0, Wrap=True)  # -> Item1, Item
item_3 = ListItem(List=data_3, Index=0, Wrap=True)  # -> Item1, Item
data_5 = Data(item_2.Item1)
data_6 = Data(item_3.Item)
explode_2 = Explode(Curve=data_6, Recursive=True)  # -> Segments, Vertices
explode_3 = Explode(Curve=data_5, Recursive=True)  # -> Segments, Vertices
split = SplitList(List=explode_2.Vertices, Index=1)  # -> ListA, ListB
split_2 = SplitList(List=explode_3.Vertices, Index=1)  # -> ListA, ListB
data_7 = Data(split.ListB)
data_8 = Data(split.ListA)
data_9 = Data(split_2.ListB)

data_10 = Data(data)
data_11 = Data(data_2)
item_4 = ListItem(List=data_11, Index=0, Wrap=True)  # -> Item1, Item
item_5 = ListItem(List=data_10, Index=0, Wrap=True)  # -> Item1, Item
data_12 = Data(item_4.Item)
data_13 = Data(item_5.Item1)
explode_4 = Explode(Curve=data_12, Recursive=True)  # -> Segments, Vertices
explode_5 = Explode(Curve=data_13, Recursive=True)  # -> Segments, Vertices
split_3 = SplitList(List=explode_5.Vertices, Index=1)  # -> ListA, ListB
split_4 = SplitList(List=explode_4.Vertices, Index=1)  # -> ListA, ListB
split_5 = SplitList(List=reverse(split_3.ListB), Index=1)  # -> ListA, reverse(ListB)
data_14 = Data(split_5.ListA)
data_15 = Data(split_3.ListB)
data_16 = Data(data_14)
data_17 = Data(split_4.ListB)

data_18 = Data(data)  # disabled
data_19 = Data(data_2)  # disabled
merge_3 = Merge(Data1=data_19, Data2=data_18)
data_20 = Data(merge_3)
join = JoinCurves(Curves=data_20, Preserve=False)
explode_6 = Explode(Curve=join, Recursive=True)  # -> Segments, Vertices
srf = Surface(join)
data_21 = Data(data_20)
split_6 = SplitList(List=reverse(explode_6.Vertices), Index=1)  # -> ListA, reverse(ListB)
timer = Timer(TimerInterval=20, Target=meshmachine)  # disabled
meshmachine = MeshMachine(
    Geometry=srf,
    Length=Slider(5.88, range=0..10),
    FixCurves=data_21,
    FixVertices=split_6.ListB,
    Flip=1,
    PullStrength=Slider(1, range=0..1),
    CurvatureAdaptivity=0,
    Reset=Toggle(False))
pmesh = PlanktonMesh(meshmachine)
demesh = DeconstructMesh(Mesh=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)  # -> Vertices, Faces, Colours, Normals
conmesh = ConstructMesh(Vertices=demesh.Vertices, Faces=demesh.Faces)
weldvertices = MeshWeldVertices(Mesh=conmesh, Tolerance=0.01)  # -> RuntimeMessage, Mesh
mesh = Mesh(weldvertices.Mesh)

mesh_2 = Mesh(mesh)
data_22 = Data(data_7)
data_23 = Data(data_8)
data_24 = Data(data_9)
demesh_2 = DeconstructMesh(Mesh=mesh_2)  # -> Vertices, Faces, Colours, Normals
data_25 = Data(data_15)
data_26 = Data(data_16)
data_27 = Data(data_17)
data_28 = Data(data_27)
data_29 = Data(data_25)
data_30 = Data(data_26)
data_31 = Data(data_24)
data_32 = Data(data_22)
data_33 = Data(data_23)
cp = ClosestPoint(Point=data_33, Cloud=demesh_2.Vertices)  # -> ClosestPoint, CPIndex, Distance
cp_2 = ClosestPoint(Point=data_32, Cloud=demesh_2.Vertices)  # -> ClosestPoint, CPIndex, Distance
cp_3 = ClosestPoint(Point=data_31, Cloud=demesh_2.Vertices)  # -> ClosestPoint, CPIndex, Distance
cp_4 = ClosestPoint(Point=data_30, Cloud=demesh_2.Vertices)  # -> ClosestPoint, CPIndex, Distance
cp_5 = ClosestPoint(Point=data_29, Cloud=demesh_2.Vertices)  # -> ClosestPoint, CPIndex, Distance
cp_6 = ClosestPoint(Point=data_28, Cloud=demesh_2.Vertices)  # -> ClosestPoint, CPIndex, Distance
merge_4 = Merge(Data1=cp_4.CPIndex, Data2=cp_5.CPIndex, Data3=cp_6.CPIndex)
merge_5 = Merge(Data1=cp.CPIndex, Data2=cp_2.CPIndex, Data3=cp_3.CPIndex)  # -> flatten(Result)
deface = DeconstructFace(Face=demesh_2.Faces)  # -> CornerA, CornerB, CornerC, CornerD
merge_6 = Merge(Data1=graft(deface.CornerA), Data2=graft(deface.CornerB), Data3=graft(deface.CornerC))  # -> flatten(Result)
replace = ReplaceItems(List=demesh_2.Vertices, Indices=merge_5, Wrap=False)
replace_2 = ReplaceMembers(Set=merge_6, Find=flatten(merge_5), Replace=flatten(merge_4))
cset = CreateSet(List=replace_2)  # -> Set, Map
lng = ListLength(List=merge_6)
vec = VectorXYZ(XComponent=0, YComponent=0, ZComponent=0)  # -> Vector, Length
clean = CleanTree(RemoveNulls=True, RemoveInvalid=True, RemoveEmpty=False, Tree=replace)
X_2 = UnitX(Factor=1)
Y_2 = UnitY(Factor=1)
mindex = MemberIndex(Set=merge_6, Member=cp_3.CPIndex)  # -> flatten(Index), Count
mindex_2 = MemberIndex(Set=merge_6, Member=cp.CPIndex)  # -> flatten(Index), Count
mindex_3 = MemberIndex(Set=merge_6, Member=cp_2.CPIndex)  # -> flatten(Index), Count
lng_2 = ListLength(List=cset.Set)
repeat = RepeatData(Data=vec.Vector, Length=lng)
sort = SortList(Keys=flatten(cset.Set), ValuesA=flatten(cset.Set))  # -> Keys, ValuesA
series = Series(Start=0, Step=1, Count=lng_2)
addition_3 = Addition(A=Y_2, B=X_2)
mindex_4 = MemberIndex(Set=replace_2, Member=sort.ValuesA)  # -> Index, Count
replace_3 = ReplaceItems(List=repeat, Item=addition_3, Indices=mindex_2.Index, Wrap=False)
repeat_2 = RepeatData(Data=graft(series), Length=graft(mindex_4.Count))  # -> flatten(Data)
X_3 = UnitX(Factor=1)
replace_4 = ReplaceItems(List=replace_3, Item=X_3, Indices=mindex_3.Index, Wrap=False)
Y_3 = UnitY(Factor=1)
sort_2 = SortList(Keys=flatten(mindex_4.Index), ValuesA=flatten(repeat_2))  # -> Keys, ValuesA
replace_5 = ReplaceItems(List=replace_4, Item=Y_3, Indices=mindex.Index, Wrap=False)
triangleindexes = Integer(sort_2.ValuesA)
triangleoffsets = Vector(replace_5)
uniquepoints = Point(clean)

facen = FaceNormals(Mesh=mesh)  # -> Centers, Normals
uniquecenters = Integer(facen.Centers)
triangleindexes_2 = Integer(triangleindexes)
triangleoffsets_2 = Vector(triangleoffsets)
uniquepoints_2 = Point(uniquepoints)
data_34 = Data(facen.Centers)

# ----
# Base Mesh
item_6 = ListItem(List=uniquepoints_2, Index=triangleindexes_2, Wrap=True)
multiplication_9 = Multiplication(A=triangleoffsets_2, B=Slider(50, range=0..100))
move_3 = Move(Geometry=item_6, Motion=multiplication_9)  # -> Geometry, Transform
partition = PartitionList(List=move_3.Geometry, Size=3)
pline_3 = PolyLine(Vertices=partition, Closed=True)

centers = Data(facen.Centers)
points = Point(uniquepoints)
triangles = Integer(triangleindexes)
offsets = Vector(triangleoffsets)

data_35 = Data(data_34)
pdecon = Deconstruct(Point=data_35)  # -> XComponent, YComponent, ZComponent
lng_3 = ListLength(List=data_35)
int = Integer(pdecon.XComponent)
int_2 = Integer(pdecon.YComponent)
repeat_3 = RepeatData(Data=",", Length=expr("x-1", lng_3))
concat = Concatenate(FragmentA="new Vector2Int(", FragmentB=int, FragmentC=",", FragmentD=int_2, FragmentG=")")
merge_7 = Merge(Data1=flatten(repeat_3), Data2=flatten("};"))
concat_2 = Concatenate(FragmentA=concat, FragmentB=merge_7)
split_7 = SplitList(List=concat_2, Index=1)  # -> ListA, ListB
concat_3 = Concatenate(FragmentA="var pts = Vector3[]{", FragmentB=split_7.ListA)
merge_8 = Merge(Data1=concat_3, Data2=split_7.ListB)

data_36 = Data(data_34)
lng_4 = ListLength(List=data_36)
pdecon_2 = Deconstruct(Point=data_36)  # -> XComponent, YComponent, ZComponent
repeat_4 = RepeatData(Data=",", Length=expr("x-1", lng_4))
concat_4 = Concatenate(
    FragmentA="new Vector3(",
    FragmentB=pdecon_2.XComponent,
    FragmentC="f,",
    FragmentD=pdecon_2.YComponent,
    FragmentE="f,",
    FragmentF=pdecon_2.ZComponent,
    FragmentG="f)")
merge_9 = Merge(Data1=flatten(repeat_4), Data2=flatten("};"))
concat_5 = Concatenate(FragmentA=concat_4, FragmentB=merge_9)
split_8 = SplitList(List=concat_5, Index=1)  # -> ListA, ListB
concat_6 = Concatenate(FragmentA="var pts = Vector3[]{", FragmentB=split_8.ListA)
merge_10 = Merge(Data1=concat_6, Data2=split_8.ListB)

data_37 = Data(data_34)
lng_5 = ListLength(List=data_37)
panel = Panel("f)")
repeat_5 = RepeatData(Data=",", Length=expr("x-1", lng_5))
concat_7 = Concatenate(FragmentA=data_37)
merge_11 = Merge(Data1=flatten(repeat_5), Data2=flatten("};"))
concat_8 = Concatenate(FragmentA=concat_7, FragmentB=merge_11)
split_9 = SplitList(List=concat_8, Index=1)  # -> ListA, ListB
concat_9 = Concatenate(FragmentA="var indexes = new int[][]{", FragmentB=split_9.ListA)
merge_12 = Merge(Data1=concat_9, Data2=split_9.ListB)
join_2 = TextJoin(Text=merge_12)

# ----
# Center Offsets
pt = Point(Point(0, 0, 0))
lng_6 = ListLength(List=data_34)
repeat_6 = RepeatData(Data=pt, Length=lng_6)
data_38 = Data(repeat_6)
lng_7 = ListLength(List=data_38)
pdecon_3 = Deconstruct(Point=data_38)  # -> XComponent, YComponent, ZComponent
int_3 = Integer(pdecon_3.XComponent)
int_4 = Integer(pdecon_3.YComponent)
repeat_7 = RepeatData(Data=",", Length=expr("x-1", lng_7))
concat_10 = Concatenate(FragmentA="new Vector2Int(", FragmentB=int_3, FragmentC=",", FragmentD=int_4, FragmentG=")")
merge_13 = Merge(Data1=flatten(repeat_7), Data2=flatten("};"))
concat_11 = Concatenate(FragmentA=concat_10, FragmentB=merge_13)
split_10 = SplitList(List=concat_11, Index=1)  # -> ListA, ListB
concat_12 = Concatenate(FragmentA="Offsets = Vector2Int[]{", FragmentB=split_10.ListA)
merge_14 = Merge(Data1=concat_12, Data2=split_10.ListB)

# ----
# Centers
panel_2 = Panel("new Vector3(")

data_39 = Data(data_34)
lng_8 = ListLength(List=data_39)
pdecon_4 = Deconstruct(Point=data_39)  # -> XComponent, YComponent, ZComponent
repeat_8 = RepeatData(Data=",", Length=expr("x-1", lng_8))
concat_13 = Concatenate(
    FragmentA=panel_2,
    FragmentB=pdecon_4.XComponent,
    FragmentC="f,",
    FragmentD=pdecon_4.YComponent,
    FragmentE="f,",
    FragmentF=pdecon_4.ZComponent,
    FragmentG="f)")
merge_15 = Merge(Data1=flatten(repeat_8), Data2=flatten("};"))
concat_14 = Concatenate(FragmentA=concat_13, FragmentB=merge_15)
split_11 = SplitList(List=concat_14, Index=1)  # -> ListA, ListB
concat_15 = Concatenate(FragmentA="Centers = Vector3[]{", FragmentB=split_11.ListA)
merge_16 = Merge(Data1=concat_15, Data2=split_11.ListB)

points_2 = Point(points)
centers_2 = Data(centers)
triangles_2 = Integer(triangles)
offsets_2 = Vector(offsets)

nestingamount = Data(Slider(4, range=0..10))

nestingamount_2 = Data(nestingamount)
gridsize = Data(Slider(50, range=0..100))
# InnerMeshScaleInfo
one_over_x = OneOverX(Value=nestingamount_2)
addition_4 = Addition(A=nestingamount_2, B=2)
multiplication_10 = Multiplication(A=gridsize, B=one_over_x)
series_2 = Series(Start=0, Step=gridsize, Count=addition_4)
vec_2 = VectorXYZ(XComponent=multiplication_10, YComponent=multiplication_10, ZComponent=0)  # -> Vector, Length
vec_3 = VectorXYZ(XComponent=series_2, YComponent=graft(series_2), ZComponent=0)  # -> flatten(Vector), Length
series_3 = Series(Start=0, Step=Slider(1, range=0..100), Count=addition_4)
neg = Negative(Value=vec_2.Vector)
int_5 = Integer(series_3)
concat_16 = Concatenate(FragmentA=int_5, FragmentB=",", FragmentC=graft(int_5))  # -> flatten(Result)
secondlayeroffset = Data(neg)
celloffsets = Data(vec_3.Vector)
cellids = Data(concat_16)

points_3 = Point(points)
triangles_3 = Integer(triangles)
offsets_3 = Vector(offsets)

triangles_4 = Integer(triangles_3)

offsets_4 = Vector(offsets_3)
# Triangles
triangles_5 = Integer(triangles_3)
points_4 = Point(points_3)
multiplication_11 = Multiplication(A=offsets_4, B=Slider(50, range=0..100))
item_7 = ListItem(List=points_4, Index=triangles_5, Wrap=True)
move_4 = Move(Geometry=item_7, Motion=multiplication_11)  # -> Geometry, Transform
partition_2 = PartitionList(List=move_4.Geometry, Size=3)
triangles_6 = Data(partition_2)

# ----
# PointIndexes
lng_9 = ListLength(List=points_3)
# RepeatPointsAndCenters
series_4 = Series(Start=0, Step=1, Count=lng_9)
pointindexes = Integer(series_4)

panel_3 = Panel(merge_8)
panel_4 = Panel(merge_16)
panel_5 = Panel(join_2)
panel_6 = Panel(merge_10)
panel_7 = Panel(merge_14)

nestingamount_3 = Data(nestingamount)
centers_3 = Data(centers)
celloffsets_2 = Data(vec_3.Vector)
points_5 = Point(points)
move_5 = Move(Geometry=centers_3, Motion=graft(celloffsets_2))  # -> Geometry, Transform
move_6 = Move(Geometry=points_5, Motion=graft(celloffsets_2))  # -> Geometry, Transform
one_over_x_2 = OneOverX(Value=nestingamount_3)
scale = Scale(Geometry=move_5.Geometry, Center=Point(0, 0, 0), Factor=one_over_x_2)  # -> Geometry, Transform
scale_2 = Scale(Geometry=move_6.Geometry, Center=Point(0, 0, 0), Factor=one_over_x_2)  # -> Geometry, Transform
move_7 = Move(Geometry=scale_2.Geometry, Motion=secondlayeroffset)  # -> flatten(Geometry), Transform
move_8 = Move(Geometry=scale.Geometry, Motion=secondlayeroffset)  # -> flatten(Geometry), Transform
movedpoints = Data(move_7.Geometry)
movedcenters = Data(move_8.Geometry)

celloffsets_3 = Data(celloffsets)
cellids_2 = Data(cellids)
movedpoints_2 = Data(movedpoints)
movedcenters_2 = Data(movedcenters)

triangles_7 = Integer(triangles_4)
# Points And Centers Within Cells
movedcenters_3 = Data(movedcenters_2)
lng_10 = ListLength(List=triangles_7)
division = Division(A=lng_10, B=3)
lng_11 = ListLength(List=movedcenters_3)
int_6 = Integer(division)
series_5 = Series(Start=0, Step=1, Count=int_6)
int_7 = Integer(series_5)
repeat_9 = RepeatData(Data=int_7, Length=lng_11)

# ----
# TriangleMesh
# AllTriangleIndexes
quad = MeshQuad(CornerA=0, CornerB=1, CornerC=2, CornerD=2)
conmesh_2 = ConstructMesh(Vertices=triangles_6, Faces=quad)

pointindexes_2 = Integer(pointindexes)
celloffsets_4 = Data(celloffsets_3)
lng_12 = ListLength(List=flatten(celloffsets_4))
lng_13 = ListLength(List=pointindexes_2)
multiplication_12 = Multiplication(A=lng_13, B=lng_12)
repeat_10 = RepeatData(Data=pointindexes_2, Length=multiplication_12)  # -> flatten(Data)

movedpoints_3 = Data(movedpoints)
movedcenters_4 = Data(movedcenters)

nestedpointindexes = Data(repeat_10)
number_slider_2 = Slider(3, range=0..10)

points_6 = Point(points_2)
centers_4 = Data(centers_2)
triangles_8 = Integer(triangles_2)
offsets_5 = Vector(offsets_2)

triangleindexes_3 = Integer(triangles_8)
triangleoffsets_3 = Vector(offsets_5)
uniquepoints_3 = Point(points_6)

# ----
# Base Mesh
item_8 = ListItem(List=uniquepoints_3, Index=triangleindexes_3, Wrap=True)
multiplication_13 = Multiplication(A=triangleoffsets_3, B=Slider(50, range=0..100))
move_9 = Move(Geometry=item_8, Motion=multiplication_13)  # -> Geometry, Transform
partition_3 = PartitionList(List=move_9.Geometry, Size=3)
pline_4 = PolyLine(Vertices=partition_3, Closed=True)  # -> flatten(Polyline)

_2doffsets = Data(cellids_2)
points_7 = Point(centers_4)
lng_14 = ListLength(List=points_7)
repeat_11 = RepeatData(Data=graft(_2doffsets), Length=lng_14)  # -> flatten(Data)

# ----
# All Points Offsets
_2doffsets_2 = Data(cellids_2)
# All Centers Offsets
points_8 = Point(points_6)
lng_15 = ListLength(List=points_8)
repeat_12 = RepeatData(Data=graft(_2doffsets_2), Length=lng_15)  # -> flatten(Data)

quad_2 = MeshQuad(CornerA=0, CornerB=1, CornerC=2, CornerD=2)
conmesh_3 = ConstructMesh(Vertices=partition_3, Faces=quad_2)  # -> flatten(Mesh)

points_9 = Point(points_6)
centers_5 = Data(centers_4)
triangles_9 = Integer(triangles_8)
offsets_6 = Vector(offsets_5)

_2doffsets_3 = Data(repeat_11)
_2doffsets_4 = Data(repeat_12)
lng_16 = ListLength(List=_2doffsets_4)
data_40 = Data(data_35)
repeat_13 = RepeatData(Data=data_40, Length=lng_16)
partition_4 = PartitionList(List=triangles, Size=3)

join_3 = TextJoin(Join=",")
panel_8 = Panel("new Vector2Int[]{")
panel_9 = Panel(join_3)
concat_17 = Concatenate(FragmentA="new int[]{", FragmentB=join_3, FragmentC="}")
data_41 = Data(concat_17)
join_4 = TextJoin(Text=flatten(data_41), Join=",")
panel_10 = Panel("var relationships= int[][]{")
join_5 = TextJoin(Text=join_4, Join=", ")
concat_18 = Concatenate(FragmentA=panel_10, FragmentB=flatten(join_4), FragmentC="};")
merge_17 = Merge(Data1=panel_10, Data2=join_5, Data3="};")
panel_11 = Panel(merge_17)

movedpoints_4 = Data(movedpoints_2)
movedcenters_5 = Data(movedcenters_2)
triangles_10 = Data(triangles_6)
# All Points Indexes
number_slider_3 = Slider(1000, range=0..1000)
pline_5 = PolyLine(Vertices=triangles_10, Closed=True)  # -> flatten(Polyline)

# ---- group: scaleForAccuracy
scale_3 = Scale(Geometry=pline_5, Center=Point(0, 0, 0), Factor=number_slider_3)  # -> Geometry, Transform
scale_4 = Scale(Geometry=movedpoints_4, Center=Point(0, 0, 0), Factor=number_slider_3)  # -> Geometry, Transform
scale_5 = Scale(Geometry=movedcenters_5, Center=Point(0, 0, 0), Factor=number_slider_3)  # -> Geometry, Transform

# ----
lng_17 = ListLength(List=scale_3.Geometry)
series_6 = Series(Start=0, Step=1, Count=lng_17)
incurves = PointInCurves(Point=scale_5.Geometry, Curves=scale_3.Geometry)  # -> Relationship, Index, Point
incurves_2 = PointInCurves(Point=scale_4.Geometry, Curves=scale_3.Geometry)  # -> Relationship, Index, Point
int_8 = Integer(series_6)
mindex_5 = MemberIndex(Set=incurves_2.Index, Member=int_8)  # -> Index, Count
mindex_6 = MemberIndex(Set=incurves.Index, Member=int_8)  # -> Index, Count
centerswithincells = Data(mindex_6.Index)
pointswithincells = Data(mindex_5.Index)

nestedpointindexes_2 = Data(nestedpointindexes)
# Nested Offsets And Points
mappedpoints = Data(pointswithincells)
movedpoints_5 = Data(movedpoints_3)
_2doffsets_5 = Data(_2doffsets_4)
item_9 = ListItem(List=nestedpointindexes_2, Index=mappedpoints, Wrap=True)
item_10 = ListItem(List=_2doffsets_5, Index=mappedpoints, Wrap=True)
item_11 = ListItem(List=movedpoints_5, Index=mappedpoints, Wrap=True)

nestedtriangleindexes = Data(repeat_9)
# Nested Offsets And Triangles
mappedcells = Data(centerswithincells)
movedcenters_6 = Data(movedcenters_4)
_2doffsets_6 = Data(_2doffsets_3)
item_12 = ListItem(List=nestedtriangleindexes, Index=mappedcells, Wrap=True)
item_13 = ListItem(List=_2doffsets_6, Index=mappedcells, Wrap=True)
item_14 = ListItem(List=movedcenters_6, Index=mappedcells, Wrap=True)

culledpoints = Data(item_11)
culled2doffsets = Data(item_10)
culledindexes = Data(item_9)

# ----
# Nested Points Working Proof
culled2doffsets_2 = Data(culled2doffsets)
culledindexes_2 = Data(culledindexes)
# Nested Points Working Proof
points_10 = Point(points_9)
item_15 = ListItem(List=points_10, Index=culledindexes_2, Wrap=True)
split_12 = TextSplit(Text=culled2doffsets_2, Separators=",")
item_16 = ListItem(List=split_12, Index=0, Wrap=True)  # -> Item, Item1
int_9 = Integer(item_16.Item1)
int_10 = Integer(item_16.Item)
vec_4 = VectorXYZ(XComponent=int_10, YComponent=int_9, ZComponent=0)  # -> Vector, Length
multiplication_14 = Multiplication(A=vec_4.Vector, B=Slider(50, range=0..100))
trim = TrimTree(Tree=multiplication_14, Depth=1)
move_10 = Move(Geometry=item_15, Motion=trim)  # -> Geometry, Transform

culled2doffsets_3 = Data(item_13)
culled2doffsets_4 = Data(culled2doffsets_3)
culledcenters = Data(item_14)
culledindexes_3 = Data(item_12)
culledindexes_4 = Data(culledindexes_3)

culled2doffsets_5 = Data(culled2doffsets_4)
culledindexes_5 = Data(culledindexes_4)
item_17 = ListItem(List=conmesh_3, Index=culledindexes_5, Wrap=True)
split_13 = TextSplit(Text=culled2doffsets_5, Separators=",")
item_18 = ListItem(List=split_13, Index=0, Wrap=True)  # -> Item, Item1
int_11 = Integer(item_18.Item1)
int_12 = Integer(item_18.Item)
vec_5 = VectorXYZ(XComponent=int_12, YComponent=int_11, ZComponent=0)  # -> Vector, Length
multiplication_15 = Multiplication(A=vec_5.Vector, B=Slider(50, range=0..100))
trim_2 = TrimTree(Tree=multiplication_15, Depth=1)
move_11 = Move(Geometry=item_17, Motion=trim_2)  # -> Geometry, Transform

item_19 = ListItem(List=movedcenters, Index=centerswithincells, Wrap=True)
item_20 = ListItem(List=_2doffsets_4, Index=pointswithincells, Wrap=True)
split_14 = TextSplit(Text=item_20, Separators=",")
item_21 = ListItem(List=repeat_13, Index=pointswithincells, Wrap=True)
int_13 = Integer(split_14)
pdecon_5 = Deconstruct(Point=item_21)  # -> XComponent, YComponent, ZComponent
item_22 = ListItem(List=int_13, Index=0, Wrap=True)  # -> Item, Item1
match = MatchTreeStructure(DataList=flatten(pdecon_5.YComponent), TreeMask=item_22.Item)
match_2 = MatchTreeStructure(DataList=flatten(pdecon_5.XComponent), TreeMask=item_22.Item)
panel_12 = Panel(pdecon_5.YComponent)
mjoin = MeshJoin(Meshes=move_11.Geometry)  # -> flatten(Mesh)
lng_18 = ListLength(List=mjoin)  # -> flatten(Length)
addition_5 = Addition(A=match, B=item_22.Item1)
addition_6 = Addition(A=match_2, B=item_22.Item)
meshcp = MeshClosestPoint(Point=item_19, Mesh=conmesh_2)  # -> Point, Index, Parameter
meshcp_2 = MeshClosestPoint(Point=culledpoints, Mesh=conmesh_2)  # -> Point, Index, Parameter
series_7 = Series(Start=0, Step=1, Count=lng_18)
int_14 = Integer(addition_5)
int_15 = Integer(addition_6)
gradient = Gradient(
    LowerLimit=0,
    UpperLimit=expr("x-1", lng_18),
    Parameter=series_7,
    stops=[0: RGB(243, 57, 0), 0.1: RGB(236, 27, 60), 0.2: RGB(210, 0, 118), 0.3: RGB(103, 0, 120), 0.4: RGB(39, 72, 161), 0.5: RGB(1, 192, 229), 0.6: RGB(18, 178, 90), 0.7: RGB(79, 186, 8), 0.8: RGB(220, 237, 32), 0.9: RGB(247, 159, 20), 1: RGB(243, 57, 0)])
jitter = Jitter(List=mjoin, Jitter=1, Seed=2)  # -> Values, Indices
data_42 = Data(meshcp_2.Parameter)
concat_19 = Concatenate(FragmentA=int_15, FragmentC=",", FragmentB=int_14)
split_15 = TextSplit(Text=data_42, Separators="[];")
trim_3 = TrimTree(Tree=concat_19, Depth=1)
panel_13 = Panel(item_20)
item_23 = ListItem(List=split_15, Index=0, Wrap=True)  # -> Item, Item1, Item2, Item3, Item4
merge_18 = Merge(Data1=item_23.Item3, Data2=item_23.Item2, Data3=item_23.Item1)
data_43 = Data(merge_18)
trim_4 = TrimTree(Tree=data_43, Depth=1)
lng_19 = ListLength(List=trim_4)
repeat_14 = RepeatData(Data=partition_4, Length=lng_19)
trim_5 = TrimTree(Tree=repeat_14, Depth=1)
partition_5 = PartitionList(List=trim_5, Size=3)
sort_3 = SortList(Keys=data_43, ValuesA=partition_5)  # -> Keys, ValuesA
item_24 = ListItem(List=sort_3.ValuesA, Index=0, Wrap=True)
trim_6 = TrimTree(Tree=item_24, Depth=1)  # -> flatten(Tree)
mindex_7 = MemberIndex(Set=trim_6, Member=pointindexes)  # -> Index, Count
item_25 = ListItem(List=repeat_9, Index=mindex_7.Index, Wrap=True)
preview = CustomPreview(Geometry=jitter.Values, Material=gradient)
item_26 = ListItem(List=_2doffsets_4, Index=pointswithincells, Wrap=True)
panel_14 = Panel(trim_3)

concat_20 = Concatenate(FragmentA="new Vector2Int(", FragmentB=item_20, FragmentC=")")
data_44 = Data(concat_20)
lng_20 = ListLength(List=data_44)
lng_21 = ListLength(List=lng_20)
repeat_15 = RepeatData(Data="}", Length=expr("x", lng_21))
join_6 = TextJoin(Text=data_44, Join=",")
repeat_16 = RepeatData(Data="new Vector2Int[]{", Length=expr("x", lng_21))
concat_21 = Concatenate(FragmentA=repeat_16, FragmentC=join_6, FragmentB=repeat_15, FragmentD=",")  # -> flatten(Result)
merge_19 = Merge(Data1="var relationships= new Vector2Int[][]{", Data2=concat_21, Data3="};")

panel_15 = Panel(item_25)

data_45 = Data(meshcp_2.Parameter)
split_16 = TextSplit(Text=data_45, Separators="[];")
item_27 = ListItem(List=split_16, Index=0, Wrap=True)  # -> Item, Item1, Item2, Item3, Item4
merge_20 = Merge(Data1=item_27.Item3, Data2=item_27.Item2, Data3=item_27.Item1)
join_7 = TextJoin(Text=merge_20, Join="f,")
concat_22 = Concatenate(FragmentA="new Vector3(", FragmentB=join_7, FragmentC="f)")
trim_7 = TrimTree(Tree=concat_22, Depth=1)
data_46 = Data(trim_7)
lng_22 = ListLength(List=data_46)
lng_23 = ListLength(List=lng_22)
panel_16 = Panel("Barycenters = new Vector3[][]{")
repeat_17 = RepeatData(Data=",", Length=expr("x-1", lng_22))
repeat_18 = RepeatData(Data="}", Length=expr("x", lng_23))
repeat_19 = RepeatData(Data="new Vector3[]{", Length=expr("x", lng_23))
join_8 = TextJoin(Text=data_46, Join=",")
concat_23 = Concatenate()
merge_21 = Merge(Data1=flatten(repeat_19), Data2=flatten("};"))
concat_24 = Concatenate(FragmentA=repeat_19, FragmentC=join_8, FragmentB=repeat_18, FragmentD=",")  # -> flatten(Result)
concat_25 = Concatenate(FragmentA=concat_23, FragmentB=merge_21)
split_17 = SplitList(List=concat_25, Index=1)  # -> ListA, ListB
join_9 = TextJoin(Text=concat_24, Join=", ")
concat_26 = Concatenate(FragmentA=panel_16, FragmentB=join_9, FragmentC="};")
merge_22 = Merge(Data1=panel_16, Data2=concat_24, Data3="};")
panel_18 = Panel(merge_22)

panel_19 = Panel(merge_19)
