# Grasshopper definition restart-07.gh (Grasshopper 1.0.5)
# plug-ins: MeshEdit Components, MeshMachine, PlanktonGh

rectangle = Rectangle(Plane=PlaneXY(0, 0, 0), XSize=Slider(50, range=0..100), YSize=Slider(50, range=0..100), Radius=0)  # -> Rectangle, Length
explode = Explode(Curve=rectangle.Rectangle, Recursive=True)  # -> Segments, Vertices
item = ListItem(List=explode.Segments, Index=0, Wrap=True)  # -> Item, Item1, Item2, Item3
number_slider = Slider(10, range=0..100)
flip = FlipCurve(Curve=item.Item)  # -> Curve, Flag
flip_2 = FlipCurve(Curve=item.Item1)  # -> Curve, Flag
merge = Merge(Data1=flip.Curve, Data2=item.Item2)
merge_2 = Merge(Data1=flip_2.Curve, Data2=item.Item3)
divide = DivideCurve(Curve=reparameterize(merge_2), Count=number_slider, Kinks=False)  # -> Points, Tangents, Parameters
pi = Pi(Factor=Slider(3, range=0..10))
pi_2 = Pi(Factor=Slider(4, range=0..10))
divide_2 = DivideCurve(Curve=reparameterize(merge), Count=number_slider, Kinks=False)  # -> Points, Tangents, Parameters
multiplication = Multiplication(A=divide.Parameters, B=pi_2)
multiplication_2 = Multiplication(A=divide.Parameters, B=pi)
pi_3 = Pi(Factor=Slider(4, range=0..10))
pi_4 = Pi(Factor=Slider(1, range=0..10))
sin = Sine(Value=multiplication)
sin_2 = Sine(Value=multiplication_2)
multiplication_3 = Multiplication(A=divide_2.Parameters, B=pi_4)
multiplication_4 = Multiplication(A=divide_2.Parameters, B=pi_3)
multiplication_5 = Multiplication(A=sin, B=Slider(2, range=0..10))
multiplication_6 = Multiplication(A=sin_2, B=Slider(3, range=0..10))
sin_3 = Sine(Value=multiplication_4)
sin_4 = Sine(Value=multiplication_3)
addition = Addition(A=multiplication_6, B=multiplication_5)
X = UnitX(Factor=addition)
multiplication_7 = Multiplication(A=sin_3, B=Slider(2, range=0..10))
multiplication_8 = Multiplication(A=sin_4, B=Slider(6, range=0..10))
move = Move(Geometry=divide.Points, Motion=X)  # -> Geometry, Transform
addition_2 = Addition(A=multiplication_8, B=multiplication_7)
Y = UnitY(Factor=addition_2)
move_2 = Move(Geometry=divide_2.Points, Motion=Y)  # -> Geometry, Transform
pline = PolyLine(Vertices=move.Geometry, Closed=False)  # -> flatten(Polyline)
pline_2 = PolyLine(Vertices=move_2.Geometry, Closed=False)  # -> flatten(Polyline)
data = Data(pline)
data_2 = Data(pline_2)

data_3 = Data(data)
data_4 = Data(data_2)
item_2 = ListItem(List=data_4, Index=0, Wrap=True)  # -> Item1, Item
item_3 = ListItem(List=data_3, Index=0, Wrap=True)  # -> Item1, Item
data_5 = Data(item_2.Item1)
data_6 = Data(item_3.Item)
explode_2 = Explode(Curve=data_6, Recursive=True)  # -> Segments, Vertices
explode_3 = Explode(Curve=data_5, Recursive=True)  # -> Segments, Vertices
split = SplitList(List=explode_2.Vertices, Index=1)  # -> ListA, ListB
split_2 = SplitList(List=explode_3.Vertices, Index=1)  # -> ListA, ListB
data_7 = Data(split.ListB)
data_8 = Data(split.ListA)
data_9 = Data(split_2.ListB)

data_10 = Data(data)
data_11 = Data(data_2)
item_4 = ListItem(List=data_11, Index=0, Wrap=True)  # -> Item1, Item
item_5 = ListItem(List=data_10, Index=0, Wrap=True)  # -> Item1, Item
data_12 = Data(item_4.Item)
data_13 = Data(item_5.Item1)
explode_4 = Explode(Curve=data_12, Recursive=True)  # -> Segments, Vertices
explode_5 = Explode(Curve=data_13, Recursive=True)  # -> Segments, Vertices
split_3 = SplitList(List=explode_5.Vertices, Index=1)  # -> ListA, ListB
split_4 = SplitList(List=explode_4.Vertices, Index=1)  # -> ListA, ListB
split_5 = SplitList(List=reverse(split_3.ListB), Index=1)  # -> ListA, reverse(ListB)
data_14 = Data(split_5.ListA)
data_15 = Data(split_3.ListB)
data_16 = Data(data_14)
data_17 = Data(split_4.ListB)

data_18 = Data(data)  # disabled
data_19 = Data(data_2)  # disabled
merge_3 = Merge(Data1=data_19, Data2=data_18)
data_20 = Data(merge_3)
join = JoinCurves(Curves=data_20, Preserve=False)
explode_6 = Explode(Curve=join, Recursive=True)  # -> Segments, Vertices
srf = Surface(join)
data_21 = Data(data_20)
split_6 = SplitList(List=reverse(explode_6.Vertices), Index=1)  # -> ListA, reverse(ListB)
timer = Timer(TimerInterval=20, Target=meshmachine)  # disabled
meshmachine = MeshMachine(
    Geometry=srf,
    Length=Slider(5.88, range=0..10),
    FixCurves=data_21,
    FixVertices=split_6.ListB,
    Flip=1,
    PullStrength=Slider(1, range=0..1),
    CurvatureAdaptivity=0,
    Reset=Toggle(False))
pmesh = PlanktonMesh(meshmachine)
demesh = DeconstructMesh(Mesh=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)  # -> Vertices, Faces, Colours, Normals
conmesh = ConstructMesh(Vertices=demesh.Vertices, Faces=demesh.Faces)
weldvertices = MeshWeldVertices(Mesh=conmesh, Tolerance=0.01)  # -> RuntimeMessage, Mesh
mesh = Mesh(weldvertices.Mesh)

mesh_2 = Mesh(mesh)
data_22 = Data(data_7)
data_23 = Data(data_8)
data_24 = Data(data_9)
demesh_2 = DeconstructMesh(Mesh=mesh_2)  # -> Vertices, Faces, Colours, Normals
data_25 = Data(data_15)
data_26 = Data(data_16)
data_27 = Data(data_17)
data_28 = Data(data_27)
data_29 = Data(data_25)
data_30 = Data(data_26)
data_31 = Data(data_24)
data_32 = Data(data_22)
data_33 = Data(data_23)
cp = ClosestPoint(Point=data_33, Cloud=demesh_2.Vertices)  # -> ClosestPoint, CPIndex, Distance
cp_2 = ClosestPoint(Point=data_32, Cloud=demesh_2.Vertices)  # -> ClosestPoint, CPIndex, Distance
cp_3 = ClosestPoint(Point=data_31, Cloud=demesh_2.Vertices)  # -> ClosestPoint, CPIndex, Distance
cp_4 = ClosestPoint(Point=data_30, Cloud=demesh_2.Vertices)  # -> ClosestPoint, CPIndex, Distance
cp_5 = ClosestPoint(Point=data_29, Cloud=demesh_2.Vertices)  # -> ClosestPoint, CPIndex, Distance
cp_6 = ClosestPoint(Point=data_28, Cloud=demesh_2.Vertices)  # -> ClosestPoint, CPIndex, Distance
merge_4 = Merge(Data1=cp_4.CPIndex, Data2=cp_5.CPIndex, Data3=cp_6.CPIndex)
merge_5 = Merge(Data1=cp.CPIndex, Data2=cp_2.CPIndex, Data3=cp_3.CPIndex)  # -> flatten(Result)
deface = DeconstructFace(Face=demesh_2.Faces)  # -> CornerA, CornerB, CornerC, CornerD
merge_6 = Merge(Data1=graft(deface.CornerA), Data2=graft(deface.CornerB), Data3=graft(deface.CornerC))  # -> flatten(Result)
replace = ReplaceItems(List=demesh_2.Vertices, Indices=merge_5, Wrap=False)
replace_2 = ReplaceMembers(Set=merge_6, Find=flatten(merge_5), Replace=flatten(merge_4))
cset = CreateSet(List=replace_2)  # -> Set, Map
lng = ListLength(List=merge_6)
vec = VectorXYZ(XComponent=0, YComponent=0, ZComponent=0)  # -> Vector, Length
clean = CleanTree(RemoveNulls=True, RemoveInvalid=True, RemoveEmpty=False, Tree=replace)
X_2 = UnitX(Factor=1)
Y_2 = UnitY(Factor=1)
mindex = MemberIndex(Set=merge_6, Member=cp_3.CPIndex)  # -> flatten(Index), Count
mindex_2 = MemberIndex(Set=merge_6, Member=cp.CPIndex)  # -> flatten(Index), Count
mindex_3 = MemberIndex(Set=merge_6, Member=cp_2.CPIndex)  # -> flatten(Index), Count
lng_2 = ListLength(List=cset.Set)
repeat = RepeatData(Data=vec.Vector, Length=lng)
sort = SortList(Keys=flatten(cset.Set), ValuesA=flatten(cset.Set))  # -> Keys, ValuesA
series = Series(Start=0, Step=1, Count=lng_2)
addition_3 = Addition(A=Y_2, B=X_2)
mindex_4 = MemberIndex(Set=replace_2, Member=sort.ValuesA)  # -> Index, Count
replace_3 = ReplaceItems(List=repeat, Item=addition_3, Indices=mindex_2.Index, Wrap=False)
repeat_2 = RepeatData(Data=graft(series), Length=graft(mindex_4.Count))  # -> flatten(Data)
X_3 = UnitX(Factor=1)
replace_4 = ReplaceItems(List=replace_3, Item=X_3, Indices=mindex_3.Index, Wrap=False)
Y_3 = UnitY(Factor=1)
sort_2 = SortList(Keys=flatten(mindex_4.Index), ValuesA=flatten(repeat_2))  # -> Keys, ValuesA
replace_5 = ReplaceItems(List=replace_4, Item=Y_3, Indices=mindex.Index, Wrap=False)
triangleindexes = Integer(sort_2.ValuesA)
triangleoffsets = Vector(replace_5)
uniquepoints = Point(clean)

facen = FaceNormals(Mesh=mesh)  # -> Centers, Normals
uniquecenters = Integer(facen.Centers)
triangleindexes_2 = Integer(triangleindexes)
triangleoffsets_2 = Vector(triangleoffsets)
uniquepoints_2 = Point(uniquepoints)

# ----
# Base Mesh
item_6 = ListItem(List=uniquepoints_2, Index=triangleindexes_2, Wrap=True)
multiplication_9 = Multiplication(A=triangleoffsets_2, B=Slider(50, range=0..100))
move_3 = Move(Geometry=item_6, Motion=multiplication_9)  # -> Geometry, Transform
partition = PartitionList(List=move_3.Geometry, Size=3)
pline_3 = PolyLine(Vertices=partition, Closed=True)

triangles = Integer(triangleindexes)
offsets = Vector(triangleoffsets)
points = Point(uniquepoints)
centers = Data(facen.Centers)

triangles_2 = Integer(triangles)
offsets_2 = Vector(offsets)
centers_2 = Data(centers)
points_2 = Point(points)

nestingamount = Data(Slider(4, range=0..10))

triangles_3 = Integer(triangles)
points_3 = Point(points)
offsets_3 = Vector(offsets)

nestingamount_2 = Data(nestingamount)
gridsize = Data(Slider(50, range=0..100))
# InnerMeshScaleInfo
one_over_x = OneOverX(Value=nestingamount_2)
addition_4 = Addition(A=nestingamount_2, B=2)
multiplication_10 = Multiplication(A=gridsize, B=one_over_x)
series_2 = Series(Start=0, Step=gridsize, Count=addition_4)
vec_2 = VectorXYZ(XComponent=multiplication_10, YComponent=multiplication_10, ZComponent=0)  # -> Vector, Length
vec_3 = VectorXYZ(XComponent=series_2, YComponent=graft(series_2), ZComponent=0)  # -> flatten(Vector), Length
series_3 = Series(Start=0, Step=Slider(1, range=0..100), Count=addition_4)
neg = Negative(Value=vec_2.Vector)
int = Integer(series_3)
concat = Concatenate(FragmentA=int, FragmentB=",", FragmentC=graft(int))  # -> flatten(Result)
secondlayeroffset = Data(neg)
celloffsets = Data(vec_3.Vector)
cellids = Data(concat)

triangles_4 = Integer(triangles_3)

offsets_4 = Vector(offsets_3)
# Triangles
triangles_5 = Integer(triangles_3)
points_4 = Point(points_3)
multiplication_11 = Multiplication(A=offsets_4, B=Slider(50, range=0..100))
item_7 = ListItem(List=points_4, Index=triangles_5, Wrap=True)
move_4 = Move(Geometry=item_7, Motion=multiplication_11)  # -> Geometry, Transform
partition_2 = PartitionList(List=move_4.Geometry, Size=3)
triangles_6 = Data(partition_2)

# ----
# PointIndexes
lng_3 = ListLength(List=points_3)
# RepeatPointsAndCenters
series_4 = Series(Start=0, Step=1, Count=lng_3)
pointindexes = Integer(series_4)

nestingamount_3 = Data(nestingamount)
centers_3 = Data(centers)
points_5 = Point(points)
celloffsets_2 = Data(vec_3.Vector)
move_5 = Move(Geometry=centers_3, Motion=graft(celloffsets_2))  # -> Geometry, Transform
move_6 = Move(Geometry=points_5, Motion=graft(celloffsets_2))  # -> Geometry, Transform
one_over_x_2 = OneOverX(Value=nestingamount_3)
scale = Scale(Geometry=move_5.Geometry, Center=Point(0, 0, 0), Factor=one_over_x_2)  # -> Geometry, Transform
scale_2 = Scale(Geometry=move_6.Geometry, Center=Point(0, 0, 0), Factor=one_over_x_2)  # -> Geometry, Transform
move_7 = Move(Geometry=scale_2.Geometry, Motion=secondlayeroffset)  # -> flatten(Geometry), Transform
move_8 = Move(Geometry=scale.Geometry, Motion=secondlayeroffset)  # -> flatten(Geometry), Transform
movedpoints = Data(move_7.Geometry)
movedcenters = Data(move_8.Geometry)

celloffsets_3 = Data(celloffsets)
cellids_2 = Data(cellids)
movedpoints_2 = Data(movedpoints)
movedcenters_2 = Data(movedcenters)

# ----
# AllTriangleIndexes
triangles_7 = Integer(triangles_4)
movedcenters_3 = Data(movedcenters_2)
lng_4 = ListLength(List=triangles_7)
division = Division(A=lng_4, B=3)
lng_5 = ListLength(List=movedcenters_3)
int_2 = Integer(division)
series_5 = Series(Start=0, Step=1, Count=int_2)
int_3 = Integer(series_5)
repeat_3 = RepeatData(Data=int_3, Length=lng_5)
triangleindexes_3 = Data(repeat_3)

# ----
# All Points Indexes
pointindexes_2 = Integer(pointindexes)
celloffsets_4 = Data(celloffsets_3)
lng_6 = ListLength(List=flatten(celloffsets_4))
lng_7 = ListLength(List=pointindexes_2)
multiplication_12 = Multiplication(A=lng_7, B=lng_6)
repeat_4 = RepeatData(Data=pointindexes_2, Length=multiplication_12)  # -> flatten(Data)
nestedpointindexes = Data(repeat_4)

# ----
# TriangleMesh
quad = MeshQuad(CornerA=0, CornerB=1, CornerC=2, CornerD=2)
conmesh_2 = ConstructMesh(Vertices=triangles_6, Faces=quad)

movedcenters_4 = Data(movedcenters)
movedpoints_3 = Data(movedpoints)

centers_4 = Data(centers_2)
points_6 = Point(points_2)
triangles_8 = Integer(triangles_2)
offsets_5 = Vector(offsets_2)

# ----
# All Centers Offsets
_2doffsets = Data(cellids_2)
points_7 = Point(centers_4)
lng_8 = ListLength(List=points_7)
repeat_5 = RepeatData(Data=graft(_2doffsets), Length=lng_8)  # -> flatten(Data)
_2doffsets_2 = Data(repeat_5)

# ----
# All Points Offsets
_2doffsets_3 = Data(cellids_2)
points_8 = Point(points_6)
lng_9 = ListLength(List=points_8)
repeat_6 = RepeatData(Data=graft(_2doffsets_3), Length=lng_9)  # -> flatten(Data)
_2doffsets_4 = Data(repeat_6)

triangles_9 = Integer(triangles_8)
centers_5 = Data(centers_4)
offsets_6 = Vector(offsets_5)
points_9 = Point(points_6)

offsets_7 = Vector(offsets_6)
centers_6 = Data(centers_5)
triangles_10 = Integer(triangles_9)
points_10 = Point(points_9)

# ----
# TriangleCenterOffsets
pt = Point(Point(0, 0, 0))
trianglecenters = Data(centers_6)
lng_10 = ListLength(List=trianglecenters)
repeat_7 = RepeatData(Data=pt, Length=lng_10)
data_34 = Data(repeat_7)
trianglecenteroffsets = Data(data_34)

triangles_11 = Data(triangles_10)
offsets_8 = Data(offsets_7)

trianglecenteroffsets_2 = Data(trianglecenteroffsets)
trianglecenters_2 = Data(centers_6)

T = Motion(Vector(1, 1, 0))
multiplication_13 = Multiplication(A=T, B=Slider(12.5, range=0..100))

# ----
# Points And Centers Within Cells
movedpoints_4 = Data(movedpoints_2)
triangles_12 = Data(triangles_6)
movedcenters_5 = Data(movedcenters_2)
number_slider_2 = Slider(1000, range=0..1000)
pline_4 = PolyLine(Vertices=triangles_12, Closed=True)  # -> flatten(Polyline)

# ---- group: scaleForAccuracy
scale_3 = Scale(Geometry=pline_4, Center=Point(0, 0, 0), Factor=number_slider_2)  # -> Geometry, Transform
scale_4 = Scale(Geometry=movedpoints_4, Center=Point(0, 0, 0), Factor=number_slider_2)  # -> Geometry, Transform
scale_5 = Scale(Geometry=movedcenters_5, Center=Point(0, 0, 0), Factor=number_slider_2)  # -> Geometry, Transform

# ----
lng_11 = ListLength(List=scale_3.Geometry)
series_6 = Series(Start=0, Step=1, Count=lng_11)
incurves = PointInCurves(Point=scale_5.Geometry, Curves=scale_3.Geometry)  # -> Relationship, Index, Point
incurves_2 = PointInCurves(Point=scale_4.Geometry, Curves=scale_3.Geometry)  # -> Relationship, Index, Point
int_4 = Integer(series_6)
mindex_5 = MemberIndex(Set=incurves_2.Index, Member=int_4)  # -> Index, Count
mindex_6 = MemberIndex(Set=incurves.Index, Member=int_4)  # -> Index, Count
centerswithincells = Data(mindex_6.Index)
pointswithincells = Data(mindex_5.Index)

# ----
# Nested Offsets And Points
mappedpoints = Data(pointswithincells)
_2doffsets_5 = Data(_2doffsets_4)
nestedpointindexes_2 = Data(nestedpointindexes)
movedpoints_5 = Data(movedpoints_3)
item_8 = ListItem(List=nestedpointindexes_2, Index=mappedpoints, Wrap=True)
item_9 = ListItem(List=_2doffsets_5, Index=mappedpoints, Wrap=True)
item_10 = ListItem(List=movedpoints_5, Index=mappedpoints, Wrap=True)
culled2doffsets = Data(item_9)
culledindexes = Data(item_8)
culledpoints = Data(item_10)

# ----
# Nested Offsets And Triangles
mappedcells = Data(centerswithincells)
_2doffsets_6 = Data(_2doffsets_2)
nestedtriangleindexes = Data(triangleindexes_3)
movedcenters_6 = Data(movedcenters_4)
item_11 = ListItem(List=nestedtriangleindexes, Index=mappedcells, Wrap=True)
item_12 = ListItem(List=_2doffsets_6, Index=mappedcells, Wrap=True)
item_13 = ListItem(List=movedcenters_6, Index=mappedcells, Wrap=True)
culled2doffsets_2 = Data(item_12)
culledindexes_2 = Data(item_11)
culledcenters = Data(item_13)

# ----
# Barycenters!
meshtriangles = Data(conmesh_2)
culledpoints_2 = Data(culledpoints)
meshcp = MeshClosestPoint(Point=culledpoints_2, Mesh=meshtriangles)  # -> Point, Index, Parameter
data_35 = Data(meshcp.Parameter)
split_7 = TextSplit(Text=data_35, Separators="[];")
item_14 = ListItem(List=split_7, Index=0, Wrap=True)  # -> Item, Item1, Item2, Item3, Item4
pt_2 = ConstructPoint(XCoordinate=item_14.Item3, YCoordinate=item_14.Item2, ZCoordinate=item_14.Item1)
points_11 = Point(pt_2)

positions = Data(points_10)
barycentriccoordinates = Data(points_11)

culled2dtriangleoffsets = Data(culled2doffsets_2)
culledtriangleindexes = Data(culledindexes_2)

culled2dpointoffsets = Data(culled2doffsets)
culledpointindexes = Data(culledindexes)

# ----
# Nested Triangles Working Proof
culled2dtriangleoffsets_2 = Data(culled2dtriangleoffsets)
culledtriangleindexes_2 = Data(culledtriangleindexes)
triangles_13 = Data(triangles_11)
offsets_9 = Data(offsets_8)
points_12 = Data(positions)
split_8 = TextSplit(Text=culled2dtriangleoffsets_2, Separators=",")
multiplication_14 = Multiplication(A=culledtriangleindexes_2, B=3)
multiplication_15 = Multiplication(A=culledtriangleindexes_2, B=3)
item_15 = ListItem(List=split_8, Index=0, Wrap=True)  # -> Item, Item1
item_16 = ListItem(List=offsets_9, Index=multiplication_14, Wrap=True)  # -> Item, Item1, Item2
item_17 = ListItem(List=triangles_13, Index=multiplication_15, Wrap=True)  # -> Item, Item1, Item2
int_5 = Integer(item_15.Item1)
int_6 = Integer(item_15.Item)
merge_7 = Merge(Data1=graft(item_16.Item), Data2=graft(item_16.Item1), Data3=graft(item_16.Item2))
merge_8 = Merge(Data1=graft(item_17.Item), Data2=graft(item_17.Item1), Data3=graft(item_17.Item2))
vec_4 = VectorXYZ(XComponent=int_6, YComponent=int_5, ZComponent=0)  # -> Vector, Length
multiplication_16 = Multiplication(A=vec_4.Vector, B=Slider(50, range=0..100))
multiplication_17 = Multiplication(A=merge_7, B=Slider(50, range=0..100))
item_18 = ListItem(List=points_12, Index=merge_8, Wrap=True)
trim = TrimTree(Tree=multiplication_16, Depth=1)
triangle = MeshTriangle(CornerA=0, CornerB=1, CornerC=2)
move_9 = Move(Geometry=item_18, Motion=multiplication_17)  # -> Geometry, Transform
conmesh_3 = ConstructMesh(Vertices=move_9.Geometry, Faces=triangle)
trim_2 = TrimTree(Tree=conmesh_3, Depth=1)
move_10 = Move(Geometry=trim_2, Motion=trim)  # -> Geometry, Transform
mjoin = MeshJoin(Meshes=move_10.Geometry)  # -> flatten(Mesh)
lng_12 = ListLength(List=mjoin)  # -> flatten(Length)
series_7 = Series(Start=0, Step=1, Count=lng_12)
gradient = Gradient(
    LowerLimit=0,
    UpperLimit=expr("x-1", lng_12),
    Parameter=series_7,
    stops=[0: RGB(243, 57, 0), 0.1: RGB(236, 27, 60), 0.2: RGB(210, 0, 118), 0.3: RGB(103, 0, 120), 0.4: RGB(39, 72, 161), 0.5: RGB(1, 192, 229), 0.6: RGB(18, 178, 90), 0.7: RGB(79, 186, 8), 0.8: RGB(220, 237, 32), 0.9: RGB(247, 159, 20), 1: RGB(243, 57, 0)])
jitter = Jitter(List=mjoin, Jitter=1, Seed=2)  # -> Values, Indices
preview = CustomPreview(Geometry=jitter.Values, Material=gradient)

# ----
# Base Mesh
triangleindexes_4 = Integer(triangles_11)
triangleoffsets_3 = Vector(offsets_8)
uniquepoints_3 = Point(positions)
item_19 = ListItem(List=uniquepoints_3, Index=triangleindexes_4, Wrap=True)
multiplication_18 = Multiplication(A=triangleoffsets_3, B=Slider(50, range=0..100))
move_11 = Move(Geometry=item_19, Motion=multiplication_18)  # -> Geometry, Transform
partition_3 = PartitionList(List=move_11.Geometry, Size=3)
quad_2 = MeshQuad(CornerA=0, CornerB=1, CornerC=2, CornerD=2)
conmesh_4 = ConstructMesh(Vertices=partition_3, Faces=quad_2)  # -> flatten(Mesh)

# ----
# Nested Points Working Proof
culled2doffsets_3 = Data(culled2dpointoffsets)
culledindexes_3 = Data(culledpointindexes)
points_13 = Point(positions)
item_20 = ListItem(List=points_13, Index=culledindexes_3, Wrap=True)
split_9 = TextSplit(Text=culled2doffsets_3, Separators=",")
item_21 = ListItem(List=split_9, Index=0, Wrap=True)  # -> Item, Item1
int_7 = Integer(item_21.Item1)
int_8 = Integer(item_21.Item)
vec_5 = VectorXYZ(XComponent=int_8, YComponent=int_7, ZComponent=0)  # -> Vector, Length
multiplication_19 = Multiplication(A=vec_5.Vector, B=Slider(50, range=0..100))
trim_3 = TrimTree(Tree=multiplication_19, Depth=1)
move_12 = Move(Geometry=item_20, Motion=trim_3)  # -> Geometry, Transform

move_13 = Move(Geometry=conmesh_4, Motion=multiplication_13)  # -> Geometry, Transform
scale_6 = Scale(Geometry=move_13.Geometry, Center=Point(0, 0, 0), Factor=Slider(4, range=0..100))  # -> Geometry, Transform
