# Grasshopper definition restart-10.gh (Grasshopper 1.0.5)
# plug-ins: MeshEdit Components, MeshMachine, PlanktonGh, Starling, AureconGrasshopper

rectangle = Rectangle(Plane=PlaneXY(0, 0, 0), XSize=Slider(50, range=0..100), YSize=Slider(50, range=0..100), Radius=0)  # -> Rectangle, Length
explode = Explode(Curve=rectangle.Rectangle, Recursive=True)  # -> Segments, Vertices
item = ListItem(List=explode.Segments, Index=0, Wrap=True)  # -> Item, Item1, Item2, Item3
number_slider = Slider(20, range=0..100)
flip = FlipCurve(Curve=item.Item)  # -> Curve, Flag
flip_2 = FlipCurve(Curve=item.Item1)  # -> Curve, Flag
merge = Merge(Data1=flip.Curve, Data2=item.Item2)
merge_2 = Merge(Data1=flip_2.Curve, Data2=item.Item3)
divide = DivideCurve(Curve=reparameterize(merge_2), Count=number_slider, Kinks=False)  # -> Points, Tangents, Parameters
pi = Pi(Factor=Slider(3, range=0..10))
pi_2 = Pi(Factor=Slider(4, range=0..10))
divide_2 = DivideCurve(Curve=reparameterize(merge), Count=number_slider, Kinks=False)  # -> Points, Tangents, Parameters
multiplication = Multiplication(A=divide.Parameters, B=pi_2)
multiplication_2 = Multiplication(A=divide.Parameters, B=pi)
pi_3 = Pi(Factor=Slider(4, range=0..10))
pi_4 = Pi(Factor=Slider(1, range=0..10))
sin = Sine(Value=multiplication)
sin_2 = Sine(Value=multiplication_2)
multiplication_3 = Multiplication(A=divide_2.Parameters, B=pi_4)
multiplication_4 = Multiplication(A=divide_2.Parameters, B=pi_3)
multiplication_5 = Multiplication(A=sin, B=Slider(2, range=0..10))
multiplication_6 = Multiplication(A=sin_2, B=Slider(3, range=0..10))
sin_3 = Sine(Value=multiplication_4)
sin_4 = Sine(Value=multiplication_3)
addition = Addition(A=multiplication_6, B=multiplication_5)
X = UnitX(Factor=addition)
multiplication_7 = Multiplication(A=sin_3, B=Slider(2, range=0..10))
multiplication_8 = Multiplication(A=sin_4, B=Slider(6, range=0..10))
move = Move(Geometry=divide.Points, Motion=X)  # -> Geometry, Transform
addition_2 = Addition(A=multiplication_8, B=multiplication_7)
Y = UnitY(Factor=addition_2)
move_2 = Move(Geometry=divide_2.Points, Motion=Y)  # -> Geometry, Transform
pline = PolyLine(Vertices=move.Geometry, Closed=False)  # -> flatten(Polyline)
pline_2 = PolyLine(Vertices=move_2.Geometry, Closed=False)  # -> flatten(Polyline)
data = Data(pline)
data_2 = Data(pline_2)

data_3 = Data(data)
data_4 = Data(data_2)
item_2 = ListItem(List=data_4, Index=0, Wrap=True)  # -> Item1, Item
item_3 = ListItem(List=data_3, Index=0, Wrap=True)  # -> Item1, Item
data_5 = Data(item_2.Item1)
data_6 = Data(item_3.Item)
explode_2 = Explode(Curve=data_6, Recursive=True)  # -> Segments, Vertices
explode_3 = Explode(Curve=data_5, Recursive=True)  # -> Segments, Vertices
split = SplitList(List=explode_2.Vertices, Index=1)  # -> ListA, ListB
split_2 = SplitList(List=explode_3.Vertices, Index=1)  # -> ListA, ListB
data_7 = Data(split.ListB)
data_8 = Data(split.ListA)
data_9 = Data(split_2.ListB)

data_10 = Data(data)
data_11 = Data(data_2)
item_4 = ListItem(List=data_11, Index=0, Wrap=True)  # -> Item1, Item
item_5 = ListItem(List=data_10, Index=0, Wrap=True)  # -> Item1, Item
data_12 = Data(item_4.Item)
data_13 = Data(item_5.Item1)
explode_4 = Explode(Curve=data_12, Recursive=True)  # -> Segments, Vertices
explode_5 = Explode(Curve=data_13, Recursive=True)  # -> Segments, Vertices
split_3 = SplitList(List=explode_5.Vertices, Index=1)  # -> ListA, ListB
split_4 = SplitList(List=explode_4.Vertices, Index=1)  # -> ListA, ListB
split_5 = SplitList(List=reverse(split_3.ListB), Index=1)  # -> ListA, reverse(ListB)
data_14 = Data(split_5.ListA)
data_15 = Data(split_3.ListB)
data_16 = Data(data_14)
data_17 = Data(split_4.ListB)

data_18 = Data(data_2)  # disabled
data_19 = Data(data)  # disabled
merge_3 = Merge(Data1=data_18, Data2=data_19)
data_20 = Data(merge_3)
join = JoinCurves(Curves=data_20, Preserve=False)
explode_6 = Explode(Curve=join, Recursive=True)  # -> Segments, Vertices
srf = Surface(join)
data_21 = Data(data_20)
split_6 = SplitList(List=reverse(explode_6.Vertices), Index=1)  # -> ListA, reverse(ListB)
timer = Timer(TimerInterval=20, Target=meshmachine)  # disabled
meshmachine = MeshMachine(
    Geometry=srf,
    Length=Slider(2.59, range=0..10),
    FixCurves=data_21,
    FixVertices=split_6.ListB,
    Flip=1,
    PullStrength=Slider(1, range=0..1),
    CurvatureAdaptivity=0,
    Reset=Toggle(False))
pmesh = PlanktonMesh(meshmachine)
demesh = DeconstructMesh(Mesh=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)  # -> Vertices, Faces, Colours, Normals
conmesh = ConstructMesh(Vertices=demesh.Vertices, Faces=demesh.Faces)
weldvertices = MeshWeldVertices(Mesh=conmesh, Tolerance=0.01)  # -> RuntimeMessage, Mesh
mesh = Mesh(weldvertices.Mesh)

mesh_2 = Mesh(mesh)
data_22 = Data(data_7)
data_23 = Data(data_8)
data_24 = Data(data_9)
demesh_2 = DeconstructMesh(Mesh=mesh_2)  # -> Vertices, Faces, Colours, Normals
data_25 = Data(data_15)
data_26 = Data(data_16)
data_27 = Data(data_17)
data_28 = Data(data_27)
data_29 = Data(data_25)
data_30 = Data(data_26)
data_31 = Data(data_24)
data_32 = Data(data_22)
data_33 = Data(data_23)
cp = ClosestPoint(Point=data_33, Cloud=demesh_2.Vertices)  # -> ClosestPoint, CPIndex, Distance
cp_2 = ClosestPoint(Point=data_32, Cloud=demesh_2.Vertices)  # -> ClosestPoint, CPIndex, Distance
cp_3 = ClosestPoint(Point=data_31, Cloud=demesh_2.Vertices)  # -> ClosestPoint, CPIndex, Distance
cp_4 = ClosestPoint(Point=data_30, Cloud=demesh_2.Vertices)  # -> ClosestPoint, CPIndex, Distance
cp_5 = ClosestPoint(Point=data_29, Cloud=demesh_2.Vertices)  # -> ClosestPoint, CPIndex, Distance
cp_6 = ClosestPoint(Point=data_28, Cloud=demesh_2.Vertices)  # -> ClosestPoint, CPIndex, Distance
merge_4 = Merge(Data1=cp_4.CPIndex, Data2=cp_5.CPIndex, Data3=cp_6.CPIndex)
merge_5 = Merge(Data1=cp.CPIndex, Data2=cp_2.CPIndex, Data3=cp_3.CPIndex)  # -> flatten(Result)
deface = DeconstructFace(Face=demesh_2.Faces)  # -> CornerA, CornerB, CornerC, CornerD
merge_6 = Merge(Data1=graft(deface.CornerA), Data2=graft(deface.CornerB), Data3=graft(deface.CornerC))  # -> flatten(Result)
replace = ReplaceItems(List=demesh_2.Vertices, Indices=merge_5, Wrap=False)
replace_2 = ReplaceMembers(Set=merge_6, Find=flatten(merge_5), Replace=flatten(merge_4))
cset = CreateSet(List=replace_2)  # -> Set, Map
lng = ListLength(List=merge_6)
vec = VectorXYZ(XComponent=0, YComponent=0, ZComponent=0)  # -> Vector, Length
clean = CleanTree(RemoveNulls=True, RemoveInvalid=True, RemoveEmpty=False, Tree=replace)
X_2 = UnitX(Factor=1)
Y_2 = UnitY(Factor=1)
mindex = MemberIndex(Set=merge_6, Member=cp_3.CPIndex)  # -> flatten(Index), Count
mindex_2 = MemberIndex(Set=merge_6, Member=cp.CPIndex)  # -> flatten(Index), Count
mindex_3 = MemberIndex(Set=merge_6, Member=cp_2.CPIndex)  # -> flatten(Index), Count
lng_2 = ListLength(List=cset.Set)
repeat = RepeatData(Data=vec.Vector, Length=lng)
sort = SortList(Keys=flatten(cset.Set), ValuesA=flatten(cset.Set))  # -> Keys, ValuesA
series = Series(Start=0, Step=1, Count=lng_2)
addition_3 = Addition(A=Y_2, B=X_2)
mindex_4 = MemberIndex(Set=replace_2, Member=sort.ValuesA)  # -> Index, Count
replace_3 = ReplaceItems(List=repeat, Item=addition_3, Indices=mindex_2.Index, Wrap=False)
repeat_2 = RepeatData(Data=graft(series), Length=graft(mindex_4.Count))  # -> flatten(Data)
X_3 = UnitX(Factor=1)
replace_4 = ReplaceItems(List=replace_3, Item=X_3, Indices=mindex_3.Index, Wrap=False)
Y_3 = UnitY(Factor=1)
sort_2 = SortList(Keys=flatten(mindex_4.Index), ValuesA=flatten(repeat_2))  # -> Keys, ValuesA
replace_5 = ReplaceItems(List=replace_4, Item=Y_3, Indices=mindex.Index, Wrap=False)
triangleindexes = Integer(sort_2.ValuesA)
triangleoffsets = Vector(replace_5)
uniquepoints = Point(clean)

facen = FaceNormals(Mesh=mesh)  # -> Centers, Normals
uniquecenters = Integer(facen.Centers)
triangleindexes_2 = Integer(triangleindexes)
triangleoffsets_2 = Vector(triangleoffsets)
uniquepoints_2 = Point(uniquepoints)

triangles = Integer(triangleindexes)
offsets = Vector(triangleoffsets)
points = Point(uniquepoints)
centers = Data(facen.Centers)

# ----
# Base Mesh
item_6 = ListItem(List=uniquepoints_2, Index=triangleindexes_2, Wrap=True)
multiplication_9 = Multiplication(A=triangleoffsets_2, B=Slider(50, range=0..100))
move_3 = Move(Geometry=item_6, Motion=multiplication_9)  # -> Geometry, Transform
partition = PartitionList(List=move_3.Geometry, Size=3)
pline_3 = PolyLine(Vertices=partition, Closed=True)

dam = DataDam(DataA=triangles, DataB=offsets, DataC=points, DataD=centers, BufferDelay=10000000, BufferMode=0)  # -> DataA, DataB, DataC, DataD

triangles_2 = Integer(dam.DataA)
centers_2 = Data(dam.DataD)
offsets_2 = Vector(dam.DataB)
points_2 = Point(dam.DataC)

triangles_3 = Integer(triangles_2)
centers_3 = Data(centers_2)
offsets_3 = Vector(offsets_2)
points_3 = Point(points_2)

nestingamount = Data(Slider(5, range=0..10))

triangles_4 = Integer(triangles_2)
points_4 = Point(points_2)
offsets_4 = Vector(offsets_2)

nestingamount_2 = Data(nestingamount)
gridsize = Data(Slider(50, range=0..100))
# InnerMeshScaleInfo
one_over_x = OneOverX(Value=nestingamount_2)
addition_4 = Addition(A=nestingamount_2, B=2)
multiplication_10 = Multiplication(A=gridsize, B=one_over_x)
series_2 = Series(Start=0, Step=gridsize, Count=addition_4)
vec_2 = VectorXYZ(XComponent=multiplication_10, YComponent=multiplication_10, ZComponent=0)  # -> Vector, Length
vec_3 = VectorXYZ(XComponent=series_2, YComponent=graft(series_2), ZComponent=0)  # -> flatten(Vector), Length
series_3 = Series(Start=0, Step=Slider(1, range=0..100), Count=addition_4)
neg = Negative(Value=vec_2.Vector)
int = Integer(series_3)
concat = Concatenate(FragmentA=int, FragmentB=",", FragmentC=graft(int))  # -> flatten(Result)
secondlayeroffset = Data(neg)
celloffsets = Data(vec_3.Vector)
cellids = Data(concat)

triangles_5 = Integer(triangles_4)

offsets_5 = Vector(offsets_4)
# Triangles
triangles_6 = Integer(triangles_4)
points_5 = Point(points_4)
multiplication_11 = Multiplication(A=offsets_5, B=Slider(50, range=0..100))
item_7 = ListItem(List=points_5, Index=triangles_6, Wrap=True)
move_4 = Move(Geometry=item_7, Motion=multiplication_11)  # -> Geometry, Transform
partition_2 = PartitionList(List=move_4.Geometry, Size=3)
triangles_7 = Data(partition_2)

# ----
# PointIndexes
lng_3 = ListLength(List=points_4)
# RepeatPointsAndCenters
series_4 = Series(Start=0, Step=1, Count=lng_3)
pointindexes = Integer(series_4)

nestingamount_3 = Data(nestingamount)
centers_4 = Data(centers_2)
celloffsets_2 = Data(vec_3.Vector)
points_6 = Point(points_2)
move_5 = Move(Geometry=centers_4, Motion=graft(celloffsets_2))  # -> Geometry, Transform
move_6 = Move(Geometry=points_6, Motion=graft(celloffsets_2))  # -> Geometry, Transform
one_over_x_2 = OneOverX(Value=nestingamount_3)
scale = Scale(Geometry=move_5.Geometry, Center=Point(0, 0, 0), Factor=one_over_x_2)  # -> Geometry, Transform
scale_2 = Scale(Geometry=move_6.Geometry, Center=Point(0, 0, 0), Factor=one_over_x_2)  # -> Geometry, Transform
move_7 = Move(Geometry=scale_2.Geometry, Motion=secondlayeroffset)  # -> flatten(Geometry), Transform
move_8 = Move(Geometry=scale.Geometry, Motion=secondlayeroffset)  # -> flatten(Geometry), Transform
movedpoints = Data(move_7.Geometry)
movedcenters = Data(move_8.Geometry)

celloffsets_3 = Data(celloffsets)
cellids_2 = Data(cellids)
movedpoints_2 = Data(movedpoints)
movedcenters_2 = Data(movedcenters)

# ----
# AllTriangleIndexes
triangles_8 = Integer(triangles_5)
movedcenters_3 = Data(movedcenters_2)
lng_4 = ListLength(List=triangles_8)
division = Division(A=lng_4, B=3)
lng_5 = ListLength(List=movedcenters_3)
int_2 = Integer(division)
series_5 = Series(Start=0, Step=1, Count=int_2)
int_3 = Integer(series_5)
repeat_3 = RepeatData(Data=int_3, Length=lng_5)
triangleindexes_3 = Data(repeat_3)

# ----
# All Points Indexes
celloffsets_4 = Data(celloffsets_3)
pointindexes_2 = Integer(pointindexes)
lng_6 = ListLength(List=flatten(celloffsets_4))
lng_7 = ListLength(List=pointindexes_2)
multiplication_12 = Multiplication(A=lng_7, B=lng_6)
repeat_4 = RepeatData(Data=pointindexes_2, Length=multiplication_12)  # -> flatten(Data)
nestedpointindexes = Data(repeat_4)

# ----
# TriangleMesh
quad = MeshQuad(CornerA=0, CornerB=1, CornerC=2, CornerD=2)
conmesh_2 = ConstructMesh(Vertices=triangles_7, Faces=quad)

data_34 = Data(conmesh_2)
# BarycentricHubs
demesh_3 = DeconstructMesh(Mesh=data_34)  # -> Vertices, Faces, Colours, Normals
item_8 = ListItem(List=demesh_3.Vertices, Index=0, Wrap=True)  # -> Item, Item1, Item2
facen_2 = FaceNormals(Mesh=data_34)  # -> Centers, Normals
merge_7 = Merge(Data1=item_8.Item2, Data2=item_8.Item)
merge_8 = Merge(Data1=item_8.Item1, Data2=item_8.Item2)
merge_9 = Merge(Data1=item_8.Item, Data2=item_8.Item1)
avr = Average(Input=merge_8)
avr_2 = Average(Input=merge_9)
avr_3 = Average(Input=merge_7)
series_6 = Series(Start=0, Step=1, Count=6)
shift = ShiftList(List=series_6, Shift=1, Wrap=True)
merge_10 = Merge(Data1=item_8.Item, Data2=avr_2, Data3=item_8.Item1, Data4=avr, Data5=item_8.Item2, Data6=avr_3, Data7=facen_2.Centers)
triangle = MeshTriangle(CornerA=series_6, CornerB=shift, CornerC=Slider(6, range=0..10))
conmesh_3 = ConstructMesh(Vertices=merge_10, Faces=triangle)

movedcenters_4 = Data(movedcenters)
movedpoints_3 = Data(movedpoints)

centers_5 = Data(centers_3)
points_7 = Point(points_3)
triangles_9 = Integer(triangles_3)
offsets_6 = Vector(offsets_3)

T = Motion(Vector(1, 1, 0))
multiplication_13 = Multiplication(A=T, B=Slider(10, range=0..100))
move_9 = Move(Geometry=conmesh_3, Motion=multiplication_13)  # -> Geometry, Transform

# ----
# All Centers Offsets
_2doffsets = Data(cellids_2)
points_8 = Point(centers_5)
lng_8 = ListLength(List=points_8)
repeat_5 = RepeatData(Data=graft(_2doffsets), Length=lng_8)  # -> flatten(Data)
_2doffsets_2 = Data(repeat_5)

# ----
# All Points Offsets
_2doffsets_3 = Data(cellids_2)
points_9 = Point(points_7)
lng_9 = ListLength(List=points_9)
repeat_6 = RepeatData(Data=graft(_2doffsets_3), Length=lng_9)  # -> flatten(Data)
_2doffsets_4 = Data(repeat_6)

scale_3 = Scale(Geometry=move_9.Geometry, Center=Point(0, 0, 0), Factor=Slider(5, range=0..10))  # -> Geometry, Transform
item_9 = ListItem(List=points_8, Index=0, Wrap=True)

triangles_10 = Integer(triangles_9)
offsets_7 = Vector(offsets_6)
centers_6 = Data(centers_5)
points_10 = Point(points_7)

triangles_11 = Integer(triangles_10)
offsets_8 = Vector(offsets_7)
centers_7 = Data(centers_6)
points_11 = Point(points_10)

index = ItemIndex()

# ----
# TriangleCenterOffsets
pt = Point(Point(0, 0, 0))
trianglecenters = Data(centers_7)
lng_10 = ListLength(List=trianglecenters)
repeat_7 = RepeatData(Data=pt, Length=lng_10)
data_35 = Data(repeat_7)
trianglecenteroffsets = Data(data_35)

triangles_12 = Data(triangles_11)
offsets_9 = Data(offsets_8)

positions = Data(points_11)

trianglecenteroffsets_2 = Data(trianglecenteroffsets)
trianglecenters_2 = Data(centers_7)

triangles_13 = Data(triangles_12)
offsets_10 = Data(offsets_9)

positions_2 = Data(positions)

trianglecenters_3 = Data(trianglecenters_2)
trianglecenteroffsets_3 = Data(trianglecenteroffsets_2)

# ----
# Base Mesh
triangleoffsets_3 = Vector(offsets_9)
uniquepoints_3 = Point(positions)
triangleindexes_4 = Integer(triangles_12)
item_10 = ListItem(List=uniquepoints_3, Index=triangleindexes_4, Wrap=True)
multiplication_14 = Multiplication(A=triangleoffsets_3, B=Slider(50, range=0..100))
move_10 = Move(Geometry=item_10, Motion=multiplication_14)  # -> Geometry, Transform
partition_3 = PartitionList(List=move_10.Geometry, Size=3)
quad_2 = MeshQuad(CornerA=0, CornerB=1, CornerC=2, CornerD=2)
conmesh_4 = ConstructMesh(Vertices=partition_3, Faces=quad_2)  # -> flatten(Mesh)

T_2 = Motion(Vector(1, 1, 0))
multiplication_15 = Multiplication(A=T_2, B=Slider(10, range=0..100))
move_11 = Move(Geometry=conmesh_4, Motion=multiplication_15)  # -> Geometry, Transform
scale_4 = Scale(Geometry=move_11.Geometry, Center=Point(0, 0, 0), Factor=Slider(5, range=0..100))  # -> Geometry, Transform
pline_4 = PolyLine(
    Vertices=[Point(-33.3247457, 106.0673939, 0), Point(-45.60333906, 149.9726671, 0), Point(-140.1113, 174.1577752, 0), Point(-147.1807932, 110.5323369, 0), Point(-130.8093354, 59.92964918, 0), Point(-74.25339022, 22.72179054, 0), Point(0.534405665, 30.16336227, 0)],
    Closed=True)
slsourcemesh = SlSourceMesh(Polyline=pline_4)

# ----
# Points And Centers Within Cells
triangles_14 = Data(triangles_7)
movedpoints_4 = Data(movedpoints_2)
movedcenters_5 = Data(movedcenters_2)
number_slider_2 = Slider(1000, range=0..1000)
pline_5 = PolyLine(Vertices=triangles_14, Closed=True)  # -> flatten(Polyline)

# ---- group: scaleForAccuracy
scale_5 = Scale(Geometry=pline_5, Center=Point(0, 0, 0), Factor=number_slider_2)  # -> Geometry, Transform
scale_6 = Scale(Geometry=movedpoints_4, Center=Point(0, 0, 0), Factor=number_slider_2)  # -> Geometry, Transform
scale_7 = Scale(Geometry=movedcenters_5, Center=Point(0, 0, 0), Factor=number_slider_2)  # -> Geometry, Transform

# ----
lng_11 = ListLength(List=scale_5.Geometry)
series_7 = Series(Start=0, Step=1, Count=lng_11)
incurves = PointInCurves(Point=scale_7.Geometry, Curves=scale_5.Geometry)  # -> Relationship, Index, Point
incurves_2 = PointInCurves(Point=scale_6.Geometry, Curves=scale_5.Geometry)  # -> Relationship, Index, Point
int_4 = Integer(series_7)
mindex_5 = MemberIndex(Set=incurves_2.Index, Member=int_4)  # -> Index, Count
mindex_6 = MemberIndex(Set=incurves.Index, Member=int_4)  # -> Index, Count
centerswithincells = Data(mindex_6.Index)
pointswithincells = Data(mindex_5.Index)

# ----
# Nested Offsets And Points
mappedpoints = Data(pointswithincells)
movedpoints_5 = Data(movedpoints_3)
_2doffsets_5 = Data(_2doffsets_4)
nestedpointindexes_2 = Data(nestedpointindexes)
item_11 = ListItem(List=nestedpointindexes_2, Index=mappedpoints, Wrap=True)
item_12 = ListItem(List=_2doffsets_5, Index=mappedpoints, Wrap=True)
item_13 = ListItem(List=movedpoints_5, Index=mappedpoints, Wrap=True)
culled2doffsets = Data(item_12)
culledindexes = Data(item_11)
culledpoints = Data(item_13)

nestedtriangleindexes = Data(triangleindexes_3)
movedcenters_6 = Data(movedcenters_4)
# Nested Offsets And Triangles
mappedcells = Data(centerswithincells)
_2doffsets_6 = Data(_2doffsets_2)
item_14 = ListItem(List=nestedtriangleindexes, Index=mappedcells, Wrap=True)
item_15 = ListItem(List=_2doffsets_6, Index=mappedcells, Wrap=True)
item_16 = ListItem(List=movedcenters_6, Index=mappedcells, Wrap=True)
culled2doffsets_2 = Data(item_15)
culledindexes_2 = Data(item_14)
culledcenters = Data(item_16)

# ----
# InnerBarycenters
meshtriangles = Data(conmesh_3)
culledpoints_2 = Data(culledpoints)
meshcp = MeshClosestPoint(Point=culledpoints_2, Mesh=meshtriangles)  # -> Point, Index, Parameter
split_7 = TextSplit(Text=meshcp.Parameter, Separators="[];")
item_17 = ListItem(List=split_7, Index=0, Wrap=True)  # -> Item, Item1, Item2, Item3, Item4
pt_2 = ConstructPoint(XCoordinate=item_17.Item3, YCoordinate=item_17.Item2, ZCoordinate=item_17.Item1)
trim = TrimTree(Tree=pt_2, Depth=1)
trim_2 = TrimTree(Tree=item_17.Item, Depth=1)
internalbarycentricindices = Data(trim_2)
internalbarycenters = Data(trim)

culled2dtriangleoffsets = Data(culled2doffsets_2)
culledtriangleindexes = Data(culledindexes_2)

culled2dpointoffsets = Data(culled2doffsets)
culledpointindexes = Data(culledindexes)

culledpointindexes_2 = Data(culledpointindexes)
culled2dpointoffsets_2 = Data(culled2dpointoffsets)

culled2dtriangleoffsets_2 = Data(culled2dtriangleoffsets)
culledtriangleindexes_2 = Data(culledtriangleindexes)

join_2 = TextJoin(Text=culled2dtriangleoffsets_2, Join=",")
join_3 = TextJoin(Text=culledtriangleindexes_2, Join=",")
join_4 = TextJoin(Text=culled2dpointoffsets_2, Join=",")
join_5 = TextJoin(Text=culledpointindexes_2, Join=",")
culled2dtriangleoffsets_3 = Data(flatten(join_2))
culledtriangleindexes_3 = Data(flatten(join_3))
culled2dpointoffsets_3 = Data(flatten(join_4))
culledpointindexes_3 = Data(flatten(join_5))

# ----
# Nested Triangles Working Proof
culled2dtriangleoffsets_4 = Data(culled2dtriangleoffsets)
offsets_11 = Data(offsets_9)
points_12 = Data(positions)
culledtriangleindexes_4 = Data(culledtriangleindexes)
triangles_15 = Data(triangles_12)
split_8 = TextSplit(Text=culled2dtriangleoffsets_4, Separators=",")
multiplication_16 = Multiplication(A=culledtriangleindexes_4, B=3)
multiplication_17 = Multiplication(A=culledtriangleindexes_4, B=3)
item_18 = ListItem(List=split_8, Index=0, Wrap=True)  # -> Item, Item1
item_19 = ListItem(List=offsets_11, Index=multiplication_16, Wrap=True)  # -> Item, Item1, Item2
item_20 = ListItem(List=triangles_15, Index=multiplication_17, Wrap=True)  # -> Item, Item1, Item2
int_5 = Integer(item_18.Item1)
int_6 = Integer(item_18.Item)
merge_11 = Merge(Data1=graft(item_19.Item), Data2=graft(item_19.Item1), Data3=graft(item_19.Item2))
merge_12 = Merge(Data1=graft(item_20.Item), Data2=graft(item_20.Item1), Data3=graft(item_20.Item2))
vec_4 = VectorXYZ(XComponent=int_6, YComponent=int_5, ZComponent=0)  # -> Vector, Length
multiplication_18 = Multiplication(A=vec_4.Vector, B=Slider(50, range=0..100))
multiplication_19 = Multiplication(A=merge_11, B=Slider(50, range=0..100))
item_21 = ListItem(List=points_12, Index=merge_12, Wrap=True)
trim_3 = TrimTree(Tree=multiplication_18, Depth=1)
triangle_2 = MeshTriangle(CornerA=0, CornerB=1, CornerC=2)
move_12 = Move(Geometry=item_21, Motion=multiplication_19)  # -> Geometry, Transform
conmesh_5 = ConstructMesh(Vertices=move_12.Geometry, Faces=triangle_2)
trim_4 = TrimTree(Tree=conmesh_5, Depth=1)
move_13 = Move(Geometry=trim_4, Motion=trim_3)  # -> Geometry, Transform
mjoin = MeshJoin(Meshes=move_13.Geometry)  # -> flatten(Mesh)
lng_12 = ListLength(List=mjoin)  # -> flatten(Length)
series_8 = Series(Start=0, Step=1, Count=lng_12)
gradient = Gradient(
    LowerLimit=0,
    UpperLimit=expr("x-1", lng_12),
    Parameter=series_8,
    stops=[0: RGB(243, 57, 0), 0.1: RGB(236, 27, 60), 0.2: RGB(210, 0, 118), 0.3: RGB(103, 0, 120), 0.4: RGB(39, 72, 161), 0.5: RGB(1, 192, 229), 0.6: RGB(18, 178, 90), 0.7: RGB(79, 186, 8), 0.8: RGB(220, 237, 32), 0.9: RGB(247, 159, 20), 1: RGB(243, 57, 0)])
jitter = Jitter(List=mjoin, Jitter=1, Seed=2)  # -> Values, Indices
preview = CustomPreview(Geometry=jitter.Values, Material=gradient)

# ----
# Nested Points Working Proof
culledindexes_3 = Data(culledpointindexes)
culled2doffsets_3 = Data(culled2dpointoffsets)
points_13 = Point(positions)
item_22 = ListItem(List=points_13, Index=culledindexes_3, Wrap=True)
split_9 = TextSplit(Text=culled2doffsets_3, Separators=",")
item_23 = ListItem(List=split_9, Index=0, Wrap=True)  # -> Item, Item1
int_7 = Integer(item_23.Item1)
int_8 = Integer(item_23.Item)
vec_5 = VectorXYZ(XComponent=int_8, YComponent=int_7, ZComponent=0)  # -> Vector, Length
multiplication_20 = Multiplication(A=vec_5.Vector, B=Slider(50, range=0..100))
trim_5 = TrimTree(Tree=multiplication_20, Depth=1)
move_14 = Move(Geometry=item_22, Motion=trim_5)  # -> Geometry, Transform

mjoin_2 = MeshJoin(Meshes=mjoin)  # -> flatten(Mesh)
faceb = FaceBoundaries(Mesh=mjoin_2)
pmdual = PmDual(Polylines=faceb, Type=1)

# ----
# Barycenters!
meshtriangles_2 = Data(conmesh_2)
culledpoints_3 = Data(culledpoints)
meshcp_2 = MeshClosestPoint(Point=culledpoints_3, Mesh=meshtriangles_2)  # -> Point, Index, Parameter
data_36 = Data(meshcp_2.Parameter)
split_10 = TextSplit(Text=data_36, Separators="[];")
item_24 = ListItem(List=split_10, Index=0, Wrap=True)  # -> Item, Item1, Item2, Item3, Item4
pt_3 = ConstructPoint(XCoordinate=item_24.Item3, YCoordinate=item_24.Item2, ZCoordinate=item_24.Item1)

trim_6 = TrimTree(Tree=pt_3, Depth=1)

points_14 = Point(trim_6)

barycentriccoordinates = Data(points_14)
internalbarycenters_2 = Data(internalbarycenters)
internalbarycentricindices_2 = Data(internalbarycentricindices)

barycentriccoordinates_2 = Data(barycentriccoordinates)
innerbarycentriccoordinates = Point(internalbarycenters_2)
internalbarycentricindices_3 = Data(internalbarycentricindices_2)

pdecon = Deconstruct(Point=innerbarycentriccoordinates)  # -> XComponent, YComponent, ZComponent
merge_13 = Merge(Data1=pdecon.XComponent, Data2=pdecon.YComponent, Data3=pdecon.ZComponent)
join_6 = TextJoin(Text=merge_13, Join=",")

pdecon_2 = Deconstruct(Point=barycentriccoordinates_2)  # -> XComponent, YComponent, ZComponent
merge_14 = Merge(Data1=pdecon_2.XComponent, Data2=pdecon_2.YComponent, Data3=pdecon_2.ZComponent)
join_7 = TextJoin(Text=merge_14, Join=",")

internalbarycentricindices_4 = Data(internalbarycentricindices_3)
join_8 = TextJoin(Text=internalbarycentricindices_4, Join=",")
innerbarycentriccoordinates_2 = Data(flatten(join_6))
internalbarycentricindices_5 = Data(flatten(join_8))
barycentriccoordinates_3 = Data(flatten(join_7))

mesh_tile_data = CSharpScript(
    triangles=triangles_13,
    offsets=offsets_10,
    positions=positions_2,
    triangleCenters=trianglecenters_3,
    triangleCenterOffsets=trianglecenteroffsets_3,
    culled2dTriangleOffsets=culled2dtriangleoffsets_3,
    culledTriangleIndexes=culledtriangleindexes_3,
    culled2dPointOffsets=culled2dpointoffsets_3,
    culledPointIndexes=culledpointindexes_3,
    barycentricCoordinates=barycentriccoordinates_3,
    innerBarycentricCoordinates=innerbarycentriccoordinates_2,
    innerBarycentricIndices=internalbarycentricindices_5)  # -> out, A; inputs triangles: list of Int32, offsets: list of Point3d, positions: list of Point3d, triangleCenters: list of Point3d, triangleCenterOffsets: list of Point3d, culled2dTriangleOffsets: list of String, culledTriangleIndexes: list of String, culled2dPointOffsets: list of String, culledPointIndexes: list of String, barycentricCoordinates: list of String, innerBarycentricCoordinates: list of String, innerBarycentricIndices: list of String
# ---------- mesh_tile_data: C# ----------
  var dataStructure = new{
  triangles = triangles,
  offsets = FlattenPointListToInt(offsets),
  positions = FlattenPointListToFloat(positions),
  triangleCenters = FlattenPointListToFloat(triangleCenters),
  triangleCenterOffsets = FlattenPointListToInt(triangleCenterOffsets),
  culled2dTriangleOffsets = culled2dTriangleOffsets.Select(x => x.Split(',').Select(y => Int32.Parse(y)).ToArray()).ToArray(),
  culledTriangleIndexes = culledTriangleIndexes.Select(x => x.Split(',').Select(y => Int32.Parse(y)).ToArray()).ToArray(),
  culled2dPointOffsets = culled2dPointOffsets.Select(x => x.Split(',').Select(y => Int32.Parse(y)).ToArray()).ToArray(),
  culledPointIndexes = culledPointIndexes.Select(x => x.Split(',').Select(y => Int32.Parse(y)).ToArray()).ToArray(),
  barycentricCoordinates = barycentricCoordinates.Select(x => x.Split(',').Select(y => float.Parse(y)).ToArray()).ToArray(),
  innerBarycentricCoordinates = innerBarycentricCoordinates.Select(x => x.Split(',').Select(y => float.Parse(y)).ToArray()).ToArray(),
  innerBarycentricIndices = innerBarycentricIndices.Select(x => x.Split(',').Select(y => Int32.Parse(y)).ToArray()).ToArray(),
  };

  //var serializer = new System.Runtime.Serialization.Json.DataContractJsonSerializer();
  //var output = serializer.Serialize(dataStructure);

  A = dataStructure;
# ---------- mesh_tile_data: C# additional code ----------
  List<int> FlattenPointListToInt(List<Point3d> list){

    var offsetsFlat = new List<int>();

    for (int i = 0; i < list.Count; i++)
    {
      offsetsFlat.Add((int) list[i].X);
      offsetsFlat.Add((int) list[i].Y);

    }
    return     offsetsFlat;
  }

  List<float> FlattenPointListToFloat(List<Point3d> list){

    var offsetsFlat = new List<float>();

    for (int i = 0; i < list.Count; i++)
    {
      offsetsFlat.Add((float) list[i].X);
      offsetsFlat.Add((float) list[i].Y);

    }
    return     offsetsFlat;
  }
# ---------- end mesh_tile_data ----------
serialise = SerialiseToJSON(File=mesh_tile_data.A)
writetofile = CSharpScript(text=serialise, directory="E:\User Files\Projects\Building Generator\Assets\Import\", fileName="data.meshTile.JSON")  # inputs text: String, directory: String, fileName: String
# ---------- writetofile: C# ----------
    System.IO.File.WriteAllText(directory + fileName, text);
# ---------- end writetofile ----------
