# Grasshopper definition restart.gh (Grasshopper 1.0.5)
# plug-ins: MeshEdit Components, MeshMachine, PlanktonGh, TT Toolbox

rectangle = Rectangle(Plane=PlaneXY(0, 0, 0), XSize=Slider(50, range=0..100), YSize=Slider(50, range=0..100), Radius=0)  # -> Rectangle, Length
explode = Explode(Curve=rectangle.Rectangle, Recursive=True)  # -> Segments, Vertices
item = ListItem(List=explode.Segments, Index=0, Wrap=True)  # -> Item, Item1, Item2, Item3
number_slider = Slider(10, range=0..100)
flip = FlipCurve(Curve=item.Item)  # -> Curve, Flag
flip_2 = FlipCurve(Curve=item.Item1)  # -> Curve, Flag
merge = Merge(Data1=flip.Curve, Data2=item.Item2)
merge_2 = Merge(Data1=flip_2.Curve, Data2=item.Item3)
divide = DivideCurve(Curve=reparameterize(merge_2), Count=number_slider, Kinks=False)  # -> Points, Tangents, Parameters
pi = Pi(Factor=Slider(3, range=0..10))
pi_2 = Pi(Factor=Slider(4, range=0..10))
divide_2 = DivideCurve(Curve=reparameterize(merge), Count=number_slider, Kinks=False)  # -> Points, Tangents, Parameters
multiplication = Multiplication(A=divide.Parameters, B=pi_2)
multiplication_2 = Multiplication(A=divide.Parameters, B=pi)
pi_3 = Pi(Factor=Slider(4, range=0..10))
pi_4 = Pi(Factor=Slider(1, range=0..10))
sin = Sine(Value=multiplication)
sin_2 = Sine(Value=multiplication_2)
multiplication_3 = Multiplication(A=divide_2.Parameters, B=pi_4)
multiplication_4 = Multiplication(A=divide_2.Parameters, B=pi_3)
multiplication_5 = Multiplication(A=sin, B=Slider(2, range=0..10))
multiplication_6 = Multiplication(A=sin_2, B=Slider(3, range=0..10))
sin_3 = Sine(Value=multiplication_4)
sin_4 = Sine(Value=multiplication_3)
addition = Addition(A=multiplication_6, B=multiplication_5)
X = UnitX(Factor=addition)
multiplication_7 = Multiplication(A=sin_3, B=Slider(2, range=0..10))
multiplication_8 = Multiplication(A=sin_4, B=Slider(6, range=0..10))
move = Move(Geometry=divide.Points, Motion=X)  # -> Geometry, Transform
addition_2 = Addition(A=multiplication_8, B=multiplication_7)
Y = UnitY(Factor=addition_2)
move_2 = Move(Geometry=divide_2.Points, Motion=Y)  # -> Geometry, Transform
pline = PolyLine(Vertices=move.Geometry, Closed=False)  # -> flatten(Polyline)
pline_2 = PolyLine(Vertices=move_2.Geometry, Closed=False)  # -> flatten(Polyline)
data = Data(pline)
data_2 = Data(pline_2)

data_3 = Data(data)
data_4 = Data(data_2)
item_2 = ListItem(List=data_4, Index=0, Wrap=True)  # -> Item1, Item
item_3 = ListItem(List=data_3, Index=0, Wrap=True)  # -> Item1, Item
data_5 = Data(item_2.Item1)
data_6 = Data(item_3.Item)
explode_2 = Explode(Curve=data_6, Recursive=True)  # -> Segments, Vertices
explode_3 = Explode(Curve=data_5, Recursive=True)  # -> Segments, Vertices
split = SplitList(List=explode_2.Vertices, Index=1)  # -> ListA, ListB
split_2 = SplitList(List=explode_3.Vertices, Index=1)  # -> ListA, ListB
data_7 = Data(split.ListB)
data_8 = Data(split.ListA)
data_9 = Data(split_2.ListB)

data_10 = Data(data)
data_11 = Data(data_2)
merge_3 = Merge(Data1=data_11, Data2=data_10)
data_12 = Data(merge_3)
join = JoinCurves(Curves=data_12, Preserve=False)
explode_4 = Explode(Curve=join, Recursive=True)  # -> Segments, Vertices
srf = Surface(join)
data_13 = Data(data_12)
split_3 = SplitList(List=reverse(explode_4.Vertices), Index=1)  # -> ListA, reverse(ListB)
timer = Timer(TimerInterval=20, Target=meshmachine)  # disabled
meshmachine = MeshMachine(
    Geometry=srf,
    Length=Slider(5.65, range=0..10),
    FixCurves=data_13,
    FixVertices=split_3.ListB,
    Flip=1,
    PullStrength=0.8,
    CurvatureAdaptivity=0,
    Reset=Toggle(False))
pmesh = PlanktonMesh(meshmachine)
demesh = DeconstructMesh(Mesh=pmesh)  # -> Vertices, Faces, Colours, Normals
conmesh = ConstructMesh(Vertices=demesh.Vertices, Faces=demesh.Faces)
weldvertices = MeshWeldVertices(Mesh=conmesh, Tolerance=0.01)  # -> RuntimeMessage, Mesh
mesh = Mesh(weldvertices.Mesh)

data_14 = Data(data)
data_15 = Data(data_2)
item_4 = ListItem(List=data_15, Index=0, Wrap=True)  # -> Item1, Item
item_5 = ListItem(List=data_14, Index=0, Wrap=True)  # -> Item1, Item
data_16 = Data(item_4.Item)
data_17 = Data(item_5.Item1)
explode_5 = Explode(Curve=data_16, Recursive=True)  # -> Segments, Vertices
explode_6 = Explode(Curve=data_17, Recursive=True)  # -> Segments, Vertices
split_4 = SplitList(List=explode_6.Vertices, Index=1)  # -> ListA, ListB
split_5 = SplitList(List=explode_5.Vertices, Index=1)  # -> ListA, ListB
split_6 = SplitList(List=reverse(split_4.ListB), Index=1)  # -> ListA, reverse(ListB)
data_18 = Data(split_6.ListA)
data_19 = Data(split_4.ListB)
data_20 = Data(data_18)
data_21 = Data(split_5.ListB)

data_22 = Data(data_7)
data_23 = Data(data_8)
data_24 = Data(data_9)
data_25 = Data(data_19)
data_26 = Data(data_20)
data_27 = Data(data_21)
data_28 = Data(data_27)
data_29 = Data(data_25)
data_30 = Data(data_26)
data_31 = Data(data_24)
data_32 = Data(data_22)
data_33 = Data(data_23)
demesh_2 = DeconstructMesh(Mesh=mesh)  # -> Vertices, Faces, Colours, Normals
cp = ClosestPoint(Point=data_33, Cloud=demesh_2.Vertices)  # -> ClosestPoint, CPIndex, Distance
cp_2 = ClosestPoint(Point=data_32, Cloud=demesh_2.Vertices)  # -> ClosestPoint, CPIndex, Distance
cp_3 = ClosestPoint(Point=data_31, Cloud=demesh_2.Vertices)  # -> ClosestPoint, CPIndex, Distance
cp_4 = ClosestPoint(Point=data_30, Cloud=demesh_2.Vertices)  # -> ClosestPoint, CPIndex, Distance
cp_5 = ClosestPoint(Point=data_29, Cloud=demesh_2.Vertices)  # -> ClosestPoint, CPIndex, Distance
cp_6 = ClosestPoint(Point=data_28, Cloud=demesh_2.Vertices)  # -> ClosestPoint, CPIndex, Distance
deface = DeconstructFace(Face=demesh_2.Faces)  # -> CornerA, CornerB, CornerC, CornerD
Y_2 = UnitY(Factor=1)
vec = VectorXYZ(XComponent=0, YComponent=0, ZComponent=0)  # -> Vector, Length
X_2 = UnitX(Factor=1)
split_7 = SplitList(List=demesh_2.Vertices, Index=Slider(14, range=0..100))  # -> ListA, ListB
lng = ListLength(List=cp_2.CPIndex)
merge_4 = Merge(Data1=cp_4.CPIndex, Data2=cp_5.CPIndex, Data3=cp_6.CPIndex)
lng_2 = ListLength(List=cp_3.CPIndex)
lng_3 = ListLength(List=demesh_2.Vertices)
merge_5 = Merge(Data1=cp.CPIndex, Data2=cp_2.CPIndex, Data3=cp_3.CPIndex)  # -> flatten(Result)
merge_6 = Merge(Data1=graft(deface.CornerA), Data2=graft(deface.CornerB), Data3=graft(deface.CornerC))  # -> flatten(Result)
repeat = RepeatData(Data=X_2, Length=lng)
lng_4 = ListLength(List=merge_6)
repeat_2 = RepeatData(Data=Y_2, Length=lng_2)
data_34 = Data(demesh_2.Vertices)
data_35 = Data(split_7.ListA)
series = Series(Start=0, Step=1, Count=lng_3)
replace = ReplaceItems(List=demesh_2.Vertices, Indices=merge_5, Wrap=False)
clean = CleanTree(RemoveNulls=True, RemoveInvalid=True, RemoveEmpty=False, Tree=replace)
repeat_3 = RepeatData(Data=vec.Vector, Length=lng_4)
series_2 = Series(Start=0, Step=1, Count=Slider(119, range=0..1000))
X_3 = UnitX(Factor=1)
int = Integer(series)
Y_3 = UnitY(Factor=1)
mindex = MemberIndex(Set=merge_6, Member=cp_3.CPIndex)  # -> flatten(Index), Count
mindex_2 = MemberIndex(Set=merge_6, Member=cp.CPIndex)  # -> flatten(Index), Count
mindex_3 = MemberIndex(Set=merge_6, Member=cp_2.CPIndex)  # -> flatten(Index), Count
int_2 = Integer(series_2)
replace_2 = ReplaceMembers(Set=merge_6, Find=flatten(merge_5), Replace=flatten(merge_4))
cset = CreateSet(List=replace_2)  # -> Set, Map
replace_3 = ReplaceMembers(Set=int, Find=flatten(merge_5), Replace=flatten(merge_4))
data_36 = Data(clean)
addition_3 = Addition(A=Y_3, B=X_3)
sort = SortList(Keys=flatten(cset.Set), ValuesA=flatten(cset.Set))  # -> Keys, ValuesA
cset_2 = CreateSet(List=replace_3)  # -> Set, Map
lng_5 = ListLength(List=cset.Set)
replace_4 = ReplaceItems(List=repeat_3, Item=addition_3, Indices=mindex_2.Index, Wrap=False)
sort_2 = SortList(Keys=flatten(cset_2.Set), ValuesA=flatten(cset_2.Set))  # -> Keys, ValuesA
mindex_4 = MemberIndex(Set=replace_2, Member=sort.ValuesA)  # -> Index, Count
series_3 = Series(Start=0, Step=1, Count=lng_5)
replace_5 = ReplaceItems(List=replace_4, Item=X_2, Indices=mindex_3.Index, Wrap=False)
mindex_5 = MemberIndex(Set=replace_3, Member=sort_2.ValuesA)  # -> Index, Count
int_3 = Integer(series_3)
repeat_4 = RepeatData(Data=graft(int_3), Length=graft(mindex_4.Count))  # -> flatten(Data)
replace_6 = ReplaceItems(List=replace_5, Item=Y_2, Indices=mindex.Index, Wrap=False)
item_6 = ListItem(List=int_2, Index=mindex_5.Index, Wrap=False)  # -> flatten(Item)
data_37 = Data(flatten(mindex_5.Index))
multiplication_9 = Multiplication(A=replace_6, B=Slider(50, range=0..100))
item_7 = ListItem(List=int_3, Index=mindex_4.Index, Wrap=True)
sort_3 = SortList(Keys=flatten(mindex_4.Index), ValuesA=flatten(repeat_4))  # -> Keys, ValuesA
replace_7 = ReplaceItems(List=data_37, Item=int_2, Indices=int_2, Wrap=False)
replace_8 = ReplaceMembers(Set=data_37, Find=sort_2.ValuesA, Replace=int_2)
item_8 = ListItem(List=data_36, Index=sort_3.ValuesA, Wrap=False)
facen = FaceNormals(Mesh=mesh)  # -> Centers, Normals
move_3 = Move(Geometry=item_8, Motion=multiplication_9)  # -> Geometry, Transform
pt = Point(clean)  # disabled
int_4 = Integer(sort_3.ValuesA)  # disabled
vec_2 = Vector(replace_6)  # disabled
int_5 = Integer(replace_8)
multiplication_10 = Multiplication(A=vec_2, B=Slider(50, range=0..100))
item_9 = ListItem(List=pt, Index=int_4, Wrap=True)
move_4 = Move(Geometry=item_9, Motion=multiplication_10)  # -> Geometry, Transform
pt_2 = Point(Point(0, 0, 0))
lng_6 = ListLength(List=facen.Centers)
repeat_5 = RepeatData(Data=pt_2, Length=lng_6)
partition = PartitionList(List=move_4.Geometry, Size=3)
pline_3 = PolyLine(Vertices=partition, Closed=True)
data_38 = Data(vec_2)
data_39 = Data(pt)
lng_7 = ListLength(List=data_39)
data_40 = Data(facen.Centers)
data_41 = Data(repeat_5)
pdecon = Deconstruct(Point=data_39)  # -> XComponent, YComponent, ZComponent
data_42 = Data(int_4)
pdecon_2 = Deconstruct(Point=data_38)  # -> XComponent, YComponent, ZComponent
repeat_6 = RepeatData(Data=",", Length=expr("x-1", lng_7))
lng_8 = ListLength(List=data_38)
concat = Concatenate(
    FragmentA="new Vector3(",
    FragmentB=pdecon.XComponent,
    FragmentC="f,",
    FragmentD=pdecon.YComponent,
    FragmentE="f,",
    FragmentF=pdecon.ZComponent,
    FragmentG="f)")
int_6 = Integer(pdecon_2.XComponent)
lng_9 = ListLength(List=data_42)
int_7 = Integer(pdecon_2.YComponent)
lng_10 = ListLength(List=data_40)
lng_11 = ListLength(List=data_41)
panel = Panel("f)")
merge_7 = Merge(Data1=flatten(repeat_6), Data2=flatten("};"))
pdecon_3 = Deconstruct(Point=data_40)  # -> XComponent, YComponent, ZComponent
pdecon_4 = Deconstruct(Point=data_41)  # -> XComponent, YComponent, ZComponent
repeat_7 = RepeatData(Data=",", Length=expr("x-1", lng_8))
repeat_8 = RepeatData(Data=",", Length=expr("x-1", lng_9))
int_8 = Integer(pdecon_4.XComponent)
int_9 = Integer(pdecon_4.YComponent)
repeat_9 = RepeatData(Data=",", Length=expr("x-1", lng_10))
concat_2 = Concatenate(FragmentA="new Vector2Int(", FragmentB=int_6, FragmentC=",", FragmentD=int_7, FragmentG=")")
repeat_10 = RepeatData(Data=",", Length=expr("x-1", lng_11))
concat_3 = Concatenate(FragmentA=data_42)
merge_8 = Merge(Data1=flatten(repeat_7), Data2=flatten("};"))
concat_4 = Concatenate(
    FragmentA="new Vector3(",
    FragmentB=pdecon_3.XComponent,
    FragmentC="f,",
    FragmentD=pdecon_3.YComponent,
    FragmentE="f,",
    FragmentF=pdecon_3.ZComponent,
    FragmentG="f)")
concat_5 = Concatenate(FragmentA=concat, FragmentB=merge_7)
concat_6 = Concatenate(FragmentA="new Vector2Int(", FragmentB=int_8, FragmentC=",", FragmentD=int_9, FragmentG=")")
merge_9 = Merge(Data1=flatten(repeat_8), Data2=flatten("};"))
split_8 = SplitList(List=concat_5, Index=1)  # -> ListA, ListB
merge_10 = Merge(Data1=flatten(repeat_9), Data2=flatten("};"))
merge_11 = Merge(Data1=flatten(repeat_10), Data2=flatten("};"))
concat_7 = Concatenate(FragmentA="var pts = Vector3[]{", FragmentB=split_8.ListA)
concat_8 = Concatenate(FragmentA=concat_2, FragmentB=merge_8)
split_9 = SplitList(List=concat_8, Index=1)  # -> ListA, ListB
concat_9 = Concatenate(FragmentA=concat_3, FragmentB=merge_9)
split_10 = SplitList(List=concat_9, Index=1)  # -> ListA, ListB
merge_12 = Merge(Data1=concat_7, Data2=split_8.ListB)
concat_10 = Concatenate(FragmentA=concat_4, FragmentB=merge_10)
concat_11 = Concatenate(FragmentA=concat_6, FragmentB=merge_11)
split_11 = SplitList(List=concat_10, Index=1)  # -> ListA, ListB
split_12 = SplitList(List=concat_11, Index=1)  # -> ListA, ListB
concat_12 = Concatenate(FragmentA="var pts = Vector3[]{", FragmentB=split_9.ListA)
concat_13 = Concatenate(FragmentA="var indexes = new int[]{", FragmentB=split_10.ListA)
concat_14 = Concatenate(FragmentA="Centers = Vector3[]{", FragmentB=split_11.ListA)
concat_15 = Concatenate(FragmentA="Offsets = Vector2Int[]{", FragmentB=split_12.ListA)
merge_13 = Merge(Data1=concat_12, Data2=split_9.ListB)
merge_14 = Merge(Data1=concat_13, Data2=split_10.ListB)
merge_15 = Merge(Data1=concat_14, Data2=split_11.ListB)
merge_16 = Merge(Data1=concat_15, Data2=split_12.ListB)
panel_2 = Panel(merge_12)
join_2 = TextJoin(Text=merge_14)
panel_3 = Panel(merge_13)
panel_4 = Panel(join_2)
panel_5 = Panel(merge_15)
panel_6 = Panel(merge_16)
number_slider_2 = Slider(50, range=0..100)
number_slider_3 = Slider(4, range=0..10)
pt_3 = Point(pt)
int_10 = Integer(int_4)
vec_3 = Vector(vec_2)
centers = Data(facen.Centers)
lng_12 = ListLength(List=int_10)
lng_13 = ListLength(List=pt_3)
multiplication_11 = Multiplication(A=vec_3, B=Slider(50, range=0..100))
addition_4 = Addition(A=number_slider_3, B=2)
one_over_x = OneOverX(Value=number_slider_3)
division = Division(A=lng_12, B=3)
one_over_x_2 = OneOverX(Value=number_slider_3)
item_10 = ListItem(List=pt_3, Index=int_10, Wrap=True)
int_11 = Integer(division)
series_4 = Series(Start=0, Step=1, Count=int_11)
int_12 = Integer(series_4)
multiplication_12 = Multiplication(A=number_slider_2, B=one_over_x_2)
series_5 = Series(Start=0, Step=number_slider_2, Count=addition_4)
move_5 = Move(Geometry=item_10, Motion=multiplication_11)  # -> Geometry, Transform
vec_4 = VectorXYZ(XComponent=multiplication_12, YComponent=multiplication_12, ZComponent=0)  # -> Vector, Length
lng_14 = ListLength(List=pt_3)
randlist = RandomListLength(R=Domain(-1, 1), L=move_5.Geometry, S=2)
vec_5 = VectorXYZ(XComponent=series_5, YComponent=graft(series_5), ZComponent=0)  # -> flatten(Vector), Length
series_6 = Series(Start=0, Step=Slider(1, range=0..100), Count=addition_4)
partition_2 = PartitionList(List=move_5.Geometry, Size=3)
neg = Negative(Value=vec_4.Vector)
series_7 = Series(Start=0, Step=1, Count=lng_13)
vec_6 = VectorXYZ(XComponent=randlist, YComponent=reverse(randlist), ZComponent=0)  # -> Vector, Length
int_13 = Integer(series_6)
move_6 = Move(Geometry=centers, Motion=graft(vec_5.Vector))  # -> Geometry, Transform
move_7 = Move(Geometry=pt_3, Motion=graft(vec_5.Vector))  # -> Geometry, Transform
pline_4 = PolyLine(Vertices=partition_2, Closed=True)  # -> flatten(Polyline)
concat_16 = Concatenate(FragmentA=int_13, FragmentB=",", FragmentC=graft(int_13))  # -> flatten(Result)
repeat_11 = RepeatData(Data=graft(concat_16), Length=int_11)  # -> flatten(Data)
multiplication_13 = Multiplication(A=vec_6.Vector, B=Slider(0.5, range=0..1))
move_8 = Move(Geometry=move_5.Geometry, Motion=multiplication_13)  # -> Geometry, Transform
tag = TextTag(Location=move_8.Geometry, Text=int_10)
int_14 = Integer(series_7)
scale = Scale(Geometry=move_6.Geometry, Center=Point(0, 0, 0), Factor=one_over_x)  # -> Geometry, Transform
scale_2 = Scale(Geometry=move_7.Geometry, Center=Point(0, 0, 0), Factor=one_over_x)  # -> Geometry, Transform
lng_15 = ListLength(List=int_14)
number_slider_4 = Slider(1000, range=0..1000)
lng_16 = ListLength(List=flatten(vec_5.Vector))
move_9 = Move(Geometry=scale_2.Geometry, Motion=neg)  # -> flatten(Geometry), Transform
move_10 = Move(Geometry=scale.Geometry, Motion=neg)  # -> flatten(Geometry), Transform
quad = MeshQuad(CornerA=0, CornerB=1, CornerC=2, CornerD=2)
scale_3 = Scale(Geometry=repeat_11, Center=Point(0, 0, 0), Factor=number_slider_4)  # -> Geometry, Transform
multiplication_14 = Multiplication(A=lng_15, B=lng_16)
lng_17 = ListLength(List=move_10.Geometry)
repeat_12 = RepeatData(Data=int_12, Length=lng_17)
conmesh_2 = ConstructMesh(Vertices=partition_2, Faces=quad)
repeat_13 = RepeatData(Data=graft(concat_16), Length=lng_14)  # -> flatten(Data)
repeat_14 = RepeatData(Data=graft(concat_16), Length=lng_14)  # -> flatten(Data)
scale_4 = Scale(Geometry=pline_4, Center=Point(0, 0, 0), Factor=number_slider_4)  # -> Geometry, Transform
number_slider_5 = Slider(3, range=0..10)
repeat_15 = RepeatData(Data=int_14, Length=multiplication_14)  # -> flatten(Data)
scale_5 = Scale(Geometry=move_9.Geometry, Center=Point(0, 0, 0), Factor=number_slider_4)  # -> Geometry, Transform
scale_6 = Scale(Geometry=move_10.Geometry, Center=Point(0, 0, 0), Factor=number_slider_4)  # -> Geometry, Transform
lng_18 = ListLength(List=scale_4.Geometry)
series_8 = Series(Start=0, Step=1, Count=lng_18)  # disabled
incurves = PointInCurves(Point=scale_5.Geometry, Curves=scale_4.Geometry)  # -> Relationship, Index, Point; disabled
incurves_2 = PointInCurves(Point=scale_6.Geometry, Curves=scale_4.Geometry)  # -> Relationship, Index, Point; disabled
int_15 = Integer(series_8)  # disabled
lng_19 = ListLength(List=repeat_14)  # disabled
mindex_6 = MemberIndex(Set=incurves.Index, Member=int_15)  # -> Index, Count; disabled
mindex_7 = MemberIndex(Set=incurves_2.Index, Member=int_15)  # -> Index, Count; disabled
data_43 = Data(data_38)  # disabled
item_11 = ListItem(List=move_10.Geometry, Index=mindex_7.Index, Wrap=True)  # disabled
item_12 = ListItem(List=repeat_14, Index=mindex_6.Index, Wrap=True)  # disabled
split_13 = TextSplit(Text=item_12, Separators=",")  # disabled
repeat_16 = RepeatData(Data=data_43, Length=lng_19)  # disabled
item_13 = ListItem(List=repeat_16, Index=mindex_6.Index, Wrap=True)  # disabled
item_14 = ListItem(List=repeat_14, Index=mindex_6.Index, Wrap=True)  # disabled
item_15 = ListItem(List=repeat_13, Index=mindex_6.Index, Wrap=True)  # disabled
int_16 = Integer(split_13)  # disabled
item_16 = ListItem(List=repeat_15, Index=mindex_6.Index, Wrap=True)  # disabled
item_17 = ListItem(List=move_9.Geometry, Index=mindex_6.Index, Wrap=True)  # disabled
partition_3 = PartitionList(List=int_10, Size=3)  # disabled
pdecon_5 = Deconstruct(Point=item_13)  # -> XComponent, YComponent, ZComponent; disabled
item_18 = ListItem(List=int_16, Index=0, Wrap=True)  # -> Item, Item1; disabled
item_19 = ListItem(List=repeat_14, Index=mindex_6.Index, Wrap=True)  # disabled
panel_7 = Panel(")")  # disabled
match = MatchTreeStructure(DataList=flatten(pdecon_5.YComponent), TreeMask=item_18.Item)  # disabled
number_slider_6 = Slider(50, range=0..100)  # disabled
match_2 = MatchTreeStructure(DataList=flatten(pdecon_5.XComponent), TreeMask=item_18.Item)  # disabled
panel_8 = Panel(pdecon_5.YComponent)  # disabled
split_14 = TextSplit(Text=item_19, Separators=", ")  # disabled
panel_9 = Panel("new Vector3(")  # disabled
addition_5 = Addition(A=match, B=item_18.Item1)  # disabled
panel_10 = Panel("f)")  # disabled
addition_6 = Addition(A=match_2, B=item_18.Item)  # disabled
meshcp = MeshClosestPoint(Point=item_11, Mesh=conmesh_2)  # -> Point, Index, Parameter; disabled
meshcp_2 = MeshClosestPoint(Point=item_17, Mesh=conmesh_2)  # -> Point, Index, Parameter; disabled
data_44 = Data(meshcp_2.Parameter)  # disabled
split_15 = TextSplit(Text=data_44, Separators="[];")  # disabled
item_20 = ListItem(List=split_15, Index=0, Wrap=True)  # -> Item, Item1, Item2, Item3, Item4; disabled
merge_17 = Merge(Data1=item_20.Item3, Data2=item_20.Item2, Data3=item_20.Item1)  # disabled
join_3 = TextJoin(Text=merge_17, Join="f,")  # disabled
int_17 = Integer(addition_5)  # disabled
int_18 = Integer(addition_6)  # disabled
panel_11 = Panel(",")  # disabled
multiplication_15 = Multiplication(A=split_14, B=number_slider_6)  # disabled
item_21 = ListItem(List=multiplication_15, Index=0, Wrap=True)  # -> Item, Item1; disabled
data_45 = Data(meshcp_2.Parameter)  # disabled
concat_17 = Concatenate(FragmentA=panel_9, FragmentB=join_3, FragmentC=panel_10)  # disabled
vec_7 = VectorXYZ(XComponent=item_21.Item, YComponent=item_21.Item1, ZComponent=0)  # -> Vector, Length; disabled
concat_18 = Concatenate(FragmentA=int_18, FragmentC=panel_11, FragmentB=int_17)  # disabled
panel_12 = Panel("new Vector2Int(")  # disabled
concat_19 = Concatenate(FragmentA=panel_12, FragmentB=item_12, FragmentC=panel_7)  # disabled
data_46 = Data(concat_19)  # disabled
panel_13 = Panel("new Vector2Int[]{")  # disabled
trim = TrimTree(Tree=concat_17, Depth=1)  # disabled
lng_20 = ListLength(List=data_46)  # disabled
split_16 = TextSplit(Text=data_45, Separators="[];")  # disabled
data_47 = Data(trim)  # disabled
trim_2 = TrimTree(Tree=concat_18, Depth=1)  # disabled
panel_14 = Panel("new Vector3[]{")  # disabled
trim_3 = TrimTree(Tree=vec_7.Vector, Depth=1)  # disabled
lng_21 = ListLength(List=data_47)  # disabled
lng_22 = ListLength(List=lng_20)  # disabled
panel_15 = Panel("var relationships= new Vector2Int[][]{")  # disabled
panel_16 = Panel(item_12)  # disabled
panel_17 = Panel("}")  # disabled
item_22 = ListItem(List=split_16, Index=0, Wrap=True)  # -> Item, Item1, Item2, Item3, Item4; disabled
panel_18 = Panel("};")  # disabled
lng_23 = ListLength(List=lng_21)  # disabled
panel_19 = Panel("Barycenters = new Vector3[][]{")  # disabled
panel_20 = Panel("f)")  # disabled
panel_21 = Panel("}")  # disabled
move_11 = Move(Motion=trim_3)  # -> Geometry, Transform; disabled
panel_22 = Panel("};")  # disabled
panel_23 = Panel(",")  # disabled
repeat_17 = RepeatData(Data=panel_23, Length=expr("x-1", lng_20))  # disabled
merge_18 = Merge(Data1=item_22.Item3, Data2=item_22.Item2, Data3=item_22.Item1)  # disabled
data_48 = Data(merge_18)  # disabled
trim_4 = TrimTree(Tree=data_48, Depth=1)  # disabled
lng_24 = ListLength(List=trim_4)  # disabled
repeat_18 = RepeatData(Data=partition_3, Length=lng_24)  # disabled
trim_5 = TrimTree(Tree=repeat_18, Depth=1)  # disabled
partition_4 = PartitionList(List=trim_5, Size=3)  # disabled
sort_4 = SortList(Keys=data_48, ValuesA=partition_4)  # -> Keys, ValuesA; disabled
item_23 = ListItem(List=sort_4.ValuesA, Index=0, Wrap=True)  # disabled
trim_6 = TrimTree(Tree=item_23, Depth=1)  # -> flatten(Tree); disabled
mindex_8 = MemberIndex(Set=trim_6, Member=int_14)  # -> Index, Count; disabled
item_24 = ListItem(List=repeat_12, Index=mindex_8.Index, Wrap=True)  # disabled
concat_20 = Concatenate(FragmentA=item_24)  # disabled
number_slider_7 = Slider(0.25, range=0..1)  # disabled
repeat_19 = RepeatData(Data=panel_17, Length=expr("x", lng_22))  # disabled
panel_24 = Panel(trim_2)  # disabled
repeat_20 = RepeatData(Data=panel_13, Length=expr("x", lng_22))  # disabled
panel_26 = Panel(",")  # disabled
join_4 = TextJoin(Text=data_46, Join=",")  # disabled
repeat_21 = RepeatData(Data=panel_26, Length=expr("x-1", lng_21))  # disabled
item_25 = ListItem(List=repeat_14, Index=mindex_6.Index, Wrap=True)  # disabled
panel_27 = Panel("};")  # disabled
repeat_22 = RepeatData(Data=panel_21, Length=expr("x", lng_23))  # disabled
repeat_23 = RepeatData(Data=panel_14, Length=expr("x", lng_23))  # disabled
join_5 = TextJoin(Join=",")  # disabled
concat_21 = Concatenate()  # disabled
join_6 = TextJoin(Text=data_47, Join=",")  # disabled
panel_28 = Panel("};")  # disabled
merge_19 = Merge(Data1=flatten(repeat_20), Data2=flatten(panel_27))  # disabled
panel_29 = Panel(",")  # disabled
concat_22 = Concatenate()  # disabled
scale_7 = Scale(Geometry=move_11.Geometry, Center=Point(0, 0, 0), Factor=number_slider_7)  # -> Geometry, Transform; disabled
panel_30 = Panel("}")  # disabled
merge_20 = Merge(Data1=flatten(repeat_23), Data2=flatten(panel_28))  # disabled
panel_31 = Panel(join_5)  # disabled
panel_32 = Panel(",")  # disabled
panel_33 = Panel("new int[]{")  # disabled
concat_23 = Concatenate(FragmentA=repeat_20, FragmentC=join_4, FragmentB=repeat_19, FragmentD=panel_29)  # -> flatten(Result); disabled
concat_24 = Concatenate(FragmentA=concat_21, FragmentB=merge_19)  # disabled
split_17 = SplitList(List=concat_24, Index=1)  # -> ListA, ListB; disabled
concat_25 = Concatenate(FragmentA=repeat_23, FragmentC=join_6, FragmentB=repeat_22, FragmentD=panel_32)  # -> flatten(Result); disabled
concat_26 = Concatenate(FragmentA=concat_22, FragmentB=merge_20)  # disabled
split_18 = SplitList(List=concat_26, Index=1)  # -> ListA, ListB; disabled
concat_27 = Concatenate(FragmentA=panel_33, FragmentB=join_5, FragmentC=panel_30)  # disabled
join_7 = TextJoin(Text=concat_23, Join=", ")  # disabled
concat_28 = Concatenate(FragmentA=panel_15, FragmentB=join_7, FragmentC=panel_18)  # disabled
panel_34 = Panel(item_24)  # disabled
join_8 = TextJoin(Text=concat_25, Join=", ")  # disabled
concat_29 = Concatenate(FragmentA=panel_19, FragmentB=join_8, FragmentC=panel_22)  # disabled
data_49 = Data(concat_27)  # disabled
panel_35 = Panel("new Vector2Int[]{")  # disabled
merge_21 = Merge(Data1=panel_15, Data2=concat_23, Data3=panel_18)  # disabled
merge_22 = Merge(Data1=panel_19, Data2=concat_25, Data3=panel_22)  # disabled
panel_36 = Panel(merge_21)  # disabled
panel_37 = Panel("var relationships= int[][]{")  # disabled
panel_38 = Panel("};")  # disabled
join_9 = TextJoin(Text=flatten(data_49), Join=",")  # disabled
panel_40 = Panel(merge_22)  # disabled
panel_41 = Panel(",")  # disabled
join_10 = TextJoin(Text=join_9, Join=", ")  # disabled
concat_30 = Concatenate(FragmentA=panel_37, FragmentB=flatten(join_9), FragmentC=panel_38)  # disabled
merge_23 = Merge(Data1=panel_37, Data2=join_10, Data3=panel_38)  # disabled
panel_42 = Panel(merge_23)  # disabled

# ==== cluster RandomListLength
L = ClusterInput()
lng = ListLength(List=L)
R = ClusterInput()
S = ClusterInput()
random = Random(Range=R, Number=lng, Seed=S)
R_2 = ClusterOutput(random)
