# Grasshopper definition serialise.gh (Grasshopper 1.0.5)
# plug-ins: AureconGrasshopper

series = Series(Start=0, Step=1, Count=10)
series_2 = Series(Start=0, Step=1, Count=10)
series_3 = Series(Start=0, Step=1, Count=10)
c_script = CSharpScript(x=series, y=series_3, z=series_2)  # -> out, A; inputs x: list, y: list, z: list
# ---------- c_script: C# ----------
A = new {
a = x,
        b = y,
  c = z
};
# ---------- end c_script ----------
serialise = SerialiseToJSON(File=c_script.A)
deserialise = DeserialiseFromJSON(JSON=serialise)  # -> Keys, Values
panel = Panel(serialise)
