# Grasshopper definition sixty -duff-stuff- cleaned out.gh (Grasshopper 0.9.76)
# plug-ins: MeshEdit Components

rectangle = Rectangle(Plane=PlaneXY(0, 0, 0), XSize=Slider(50, range=0..100), YSize=Slider(50, range=0..100), Radius=0)  # -> Rectangle, Length
explode = Explode(Curve=rectangle.Rectangle, Recursive=True)  # -> Segments, Vertices
item = ListItem(List=explode.Segments, Index=0, Wrap=True)  # -> Item, Item1, Item2, Item3
number_slider = Slider(10, range=0..100)
flip = FlipCurve(Curve=item.Item)  # -> Curve, Flag
flip_2 = FlipCurve(Curve=item.Item1)  # -> Curve, Flag
merge = Merge(Data1=flip.Curve, Data2=item.Item2)
merge_2 = Merge(Data1=flip_2.Curve, Data2=item.Item3)
divide = DivideCurve(Curve=reparameterize(merge_2), Count=number_slider, Kinks=False)  # -> Points, Tangents, Parameters
pi = Pi(Factor=Slider(3, range=0..10))
pi_2 = Pi(Factor=Slider(6, range=0..10))
divide_2 = DivideCurve(Curve=reparameterize(merge), Count=number_slider, Kinks=False)  # -> Points, Tangents, Parameters
multiplication = Multiplication(A=divide.Parameters, B=pi)
multiplication_2 = Multiplication(A=divide.Parameters, B=pi_2)
pi_3 = Pi(Factor=Slider(5, range=0..10))
pi_4 = Pi(Factor=Slider(1, range=0..10))
sin = Sine(Value=multiplication_2)
sin_2 = Sine(Value=multiplication)
multiplication_3 = Multiplication(A=divide_2.Parameters, B=pi_4)
multiplication_4 = Multiplication(A=divide_2.Parameters, B=pi_3)
multiplication_5 = Multiplication(A=sin_2, B=Slider(3, range=0..10))
multiplication_6 = Multiplication(A=sin, B=Slider(2, range=0..10))
sin_3 = Sine(Value=multiplication_4)
sin_4 = Sine(Value=multiplication_3)
addition = Addition(A=multiplication_5, B=multiplication_6)
X = UnitX(Factor=addition)
multiplication_7 = Multiplication(A=sin_4, B=Slider(6, range=0..10))
multiplication_8 = Multiplication(A=sin_3, B=Slider(2, range=0..10))
move = Move(Geometry=divide.Points, Motion=X)  # -> Geometry, Transform
addition_2 = Addition(A=multiplication_7, B=multiplication_8)
Y = UnitY(Factor=addition_2)
move_2 = Move(Geometry=divide_2.Points, Motion=Y)  # -> Geometry, Transform
pline = PolyLine(Vertices=move.Geometry, Closed=False)  # -> flatten(Polyline)
pline_2 = PolyLine(Vertices=move_2.Geometry, Closed=False)  # -> flatten(Polyline)
item_2 = ListItem(List=pline_2, Index=0, Wrap=True)  # -> Item1, Item
item_3 = ListItem(List=pline, Index=0, Wrap=True)  # -> Item1, Item
item_4 = ListItem(List=pline_2, Index=0, Wrap=True)  # -> Item1, Item
item_5 = ListItem(List=pline, Index=0, Wrap=True)  # -> Item1, Item
merge_3 = Merge(Data1=pline_2, Data2=pline)
data = Data(item_2.Item1)
data_2 = Data(item_4.Item)
data_3 = Data(item_3.Item)
data_4 = Data(item_5.Item1)
join = JoinCurves(Curves=merge_3, Preserve=False)
neg = Negative(Value=Slider(2.8633, range=0..10))
join_2 = JoinCurves(Curves=[data, data_3], Preserve=False)
join_3 = JoinCurves(Curves=[data_2, data_4], Preserve=False)
explode_2 = Explode(Curve=data, Recursive=True)  # -> Segments, Vertices
explode_3 = Explode(Curve=data_2, Recursive=True)  # -> Segments, Vertices
explode_4 = Explode(Curve=join, Recursive=True)  # -> Segments, Vertices
data_5 = Data(join)
offset = Offset(Curve=join, Distance=neg, Plane=PlaneXY(0, 0, 0), Corners=1)
explode_5 = Explode(Curve=data_3, Recursive=True)  # -> Segments, Vertices
explode_6 = Explode(Curve=data_4, Recursive=True)  # -> Segments, Vertices
split = SplitList(List=explode_2.Vertices, Index=1)  # -> ListA, ListB
split_2 = SplitList(List=explode_3.Vertices, Index=1)  # -> ListA, ListB
srf = Surface(offset)
split_3 = SplitList(List=explode_6.Vertices, Index=1)  # -> ListA, ListB
split_4 = SplitList(List=explode_5.Vertices, Index=1)  # -> ListA, ListB
split_5 = SplitList(List=reverse(split_2.ListB), Index=1)  # -> ListA, reverse(ListB)
split_6 = SplitList(List=explode_4.Vertices, Index=1)  # -> ListA, ListB
split_7 = SplitList(List=reverse(split_3.ListB), Index=1)  # -> ListA, reverse(ListB)
popgeo = PopulateGeometry(Geometry=srf, Count=Slider(100, range=0..1000), Seed=Slider(22, range=0..100))
split_8 = SplitList(List=reverse(split.ListB), Index=1)  # -> ListA, reverse(ListB)
merge_4 = Merge(Data1=split_6.ListB, Data2=popgeo)
split_9 = SplitList(List=reverse(split_5.ListB), Index=1)  # -> ListA, reverse(ListB)
split_10 = SplitList(List=reverse(split_4.ListB), Index=1)  # -> ListA, reverse(ListB)
split_11 = SplitList(List=reverse(split_7.ListB), Index=1)  # -> ListA, reverse(ListB)
del = DelaunayMesh(Points=merge_4, Plane=PlaneXY(0, 0, 0))
data_6 = Data(split_4.ListB)
split_12 = SplitList(List=split_8.ListB, Index=1)  # -> ListA, reverse(ListB)
data_7 = Data(split_7.ListA)
facen = FaceNormals(Mesh=del)  # -> Centers, Normals
incurve = PointInCurve(Point=facen.Centers, Curve=data_5)  # -> Relationship, Point
data_8 = Data(split_4.ListA)
demesh = DeconstructMesh(Mesh=del)  # -> Vertices, Faces, Colours, Normals
data_9 = Data(split.ListB)
data_10 = Data(data_6)
data_11 = Data(data_8)
number_slider_2 = Slider(12.5, range=0..100)
dispatch = Dispatch(List=demesh.Faces, DispatchPattern=incurve.Relationship)  # -> ListA, ListB
conmesh = ConstructMesh(Vertices=demesh.Vertices, Faces=dispatch.ListA)
data_12 = Data(split_2.ListB)
data_13 = Data(split_3.ListB)
data_14 = Data(data_7)
pt = ConstructPoint(XCoordinate=number_slider_2, YCoordinate=number_slider_2, ZCoordinate=0)
weldvertices = MeshWeldVertices(Mesh=conmesh, Tolerance=0.01)  # -> RuntimeMessage, Mesh
demesh_2 = DeconstructMesh(Mesh=weldvertices.Mesh)  # -> Vertices, Faces, Colours, Normals
cp = ClosestPoint(Point=data_11, Cloud=demesh_2.Vertices)  # -> ClosestPoint, CPIndex, Distance
cp_2 = ClosestPoint(Point=data_10, Cloud=demesh_2.Vertices)  # -> ClosestPoint, CPIndex, Distance
cp_3 = ClosestPoint(Point=data_9, Cloud=demesh_2.Vertices)  # -> ClosestPoint, CPIndex, Distance
cp_4 = ClosestPoint(Point=data_14, Cloud=demesh_2.Vertices)  # -> ClosestPoint, CPIndex, Distance
cp_5 = ClosestPoint(Point=data_13, Cloud=demesh_2.Vertices)  # -> ClosestPoint, CPIndex, Distance
cp_6 = ClosestPoint(Point=data_12, Cloud=demesh_2.Vertices)  # -> ClosestPoint, CPIndex, Distance
move_3 = Move(Geometry=weldvertices.Mesh, Motion=pt)  # -> Geometry, Transform
deface = DeconstructFace(Face=demesh_2.Faces)  # -> CornerA, CornerB, CornerC, CornerD
lng = ListLength(List=demesh_2.Vertices)
merge_5 = Merge(Data1=cp_4.CPIndex, Data2=cp_5.CPIndex, Data3=cp_6.CPIndex)  # -> flatten(Result)
merge_6 = Merge(Data1=cp.CPIndex, Data2=cp_2.CPIndex, Data3=cp_3.CPIndex)  # -> flatten(Result)
vec = VectorXYZ(XComponent=0, YComponent=0, ZComponent=0)  # -> Vector, Length
series = Series(Start=0, Step=1, Count=lng)
merge_7 = Merge(Data1=graft(deface.CornerA), Data2=graft(deface.CornerB), Data3=graft(deface.CornerC))  # -> flatten(Result)
lng_2 = ListLength(List=merge_7)
int = Integer(series)
repeat = RepeatData(Data=vec.Vector, Length=lng_2)
replace = ReplaceItems(List=demesh_2.Vertices, Indices=merge_6, Wrap=False)
replace_2 = ReplaceMembers(Set=int, Find=merge_6, Replace=merge_5)
X_2 = UnitX(Factor=1)
Y_2 = UnitY(Factor=1)
mindex = MemberIndex(Set=merge_7, Member=cp_3.CPIndex)  # -> flatten(Index), Count
mindex_2 = MemberIndex(Set=merge_7, Member=cp.CPIndex)  # -> flatten(Index), Count
series_2 = Series(Start=0, Step=1, Count=Slider(119, range=0..1000))
mindex_3 = MemberIndex(Set=merge_7, Member=cp_2.CPIndex)  # -> flatten(Index), Count
clean = CleanTree(RemoveNulls=True, RemoveInvalid=True, RemoveEmpty=False, Tree=replace)
cset = CreateSet(List=replace_2)  # -> Set, Map
addition_3 = Addition(A=Y_2, B=X_2)
int_2 = Integer(series_2)
replace_3 = ReplaceItems(List=repeat, Item=addition_3, Indices=mindex_2.Index, Wrap=False)
X_3 = UnitX(Factor=1)
item_6 = ListItem(List=cset.Map, Index=merge_7, Wrap=True)
Y_3 = UnitY(Factor=1)
replace_4 = ReplaceItems(List=replace_3, Item=X_3, Indices=mindex_3.Index, Wrap=False)
item_7 = ListItem(List=clean, Index=item_6, Wrap=False)
replace_5 = ReplaceItems(List=replace_4, Item=Y_3, Indices=mindex.Index, Wrap=False)
pt_2 = Point(clean)
multiplication_9 = Multiplication(A=replace_5, B=Slider(50, range=0..100))
move_4 = Move(Geometry=item_7, Motion=multiplication_9)  # -> Geometry, Transform
partition = PartitionList(List=move_4.Geometry, Size=Slider(3, range=0..10))
pline_3 = PolyLine(Vertices=partition, Closed=False)
vec_2 = Vector(replace_5)
multiplication_10 = Multiplication(A=vec_2, B=Slider(50, range=0..100))
data_15 = Data(vec_2)
data_16 = Data(cset.Map)
number_slider_3 = Slider(4, range=0..10)
number_slider_4 = Slider(50, range=0..100)
one_over_x = OneOverX(Value=number_slider_3)
one_over_x_2 = OneOverX(Value=number_slider_3)
addition_4 = Addition(A=number_slider_3, B=2)
multiplication_11 = Multiplication(A=number_slider_4, B=one_over_x_2)
series_3 = Series(Start=0, Step=number_slider_4, Count=addition_4)
vec_3 = VectorXYZ(XComponent=multiplication_11, YComponent=multiplication_11, ZComponent=0)  # -> Vector, Length
vec_4 = VectorXYZ(XComponent=series_3, YComponent=graft(series_3), ZComponent=0)  # -> flatten(Vector), Length
series_4 = Series(Start=0, Step=Slider(1, range=0..100), Count=addition_4)
int_3 = Integer(data_16)
neg_2 = Negative(Value=vec_3.Vector)
int_4 = Integer(series_4)
move_5 = Move(Geometry=pt_2, Motion=graft(vec_4.Vector))  # -> Geometry, Transform
concat = Concatenate(FragmentA=int_4, FragmentB=",", FragmentC=graft(int_4))  # -> flatten(Result)
scale = Scale(Geometry=move_5.Geometry, Center=Point(0, 0, 0), Factor=one_over_x)  # -> Geometry, Transform
move_6 = Move(Geometry=scale.Geometry, Motion=neg_2)  # -> flatten(Geometry), Transform
lng_3 = ListLength(List=int_3)
number_slider_5 = Slider(1000, range=0..1000)
lng_4 = ListLength(List=scale.Geometry)
multiplication_12 = Multiplication(A=lng_3, B=lng_4)
repeat_2 = RepeatData(Data=graft(concat), Length=Slider(119, range=0..1000))  # -> flatten(Data)
scale_2 = Scale(Geometry=weldvertices.Mesh, Center=Point(0, 0, 0), Factor=number_slider_5)  # -> Geometry, Transform
repeat_3 = RepeatData(Data=int_3, Length=multiplication_12)  # -> flatten(Data)
scale_3 = Scale(Geometry=move_6.Geometry, Center=Point(0, 0, 0), Factor=number_slider_5)  # -> Geometry, Transform
faceb = FaceBoundaries(Mesh=scale_2.Geometry)
lng_5 = ListLength(List=faceb)
incurves = PointInCurves(Point=scale_3.Geometry, Curves=faceb)  # -> Relationship, Index, Point
series_5 = Series(Start=0, Step=1, Count=lng_5)
int_5 = Integer(series_5)
mindex_4 = MemberIndex(Set=incurves.Index, Member=int_5)  # -> Index, Count
item_8 = ListItem(List=move_6.Geometry, Index=mindex_4.Index, Wrap=True)
item_9 = ListItem(List=repeat_3, Index=mindex_4.Index, Wrap=True)
item_10 = ListItem(List=multiplication_10, Index=mindex_4.Index, Wrap=True)
item_11 = ListItem(List=repeat_2, Index=mindex_4.Index, Wrap=True)
item_12 = ListItem(List=pt_2, Index=item_9, Wrap=True)
split_13 = TextSplit(Text=item_11, Separators=", ")
multiplication_13 = Multiplication(A=split_13, B=Slider(50, range=0..100))
item_13 = ListItem(List=multiplication_13, Index=0, Wrap=True)  # -> Item, Item1
vec_5 = VectorXYZ(XComponent=item_13.Item, YComponent=item_13.Item1, ZComponent=0)  # -> Vector, Length
addition_5 = Addition(A=graft(item_10), B=vec_5.Vector)
trim = TrimTree(Tree=addition_5, Depth=1)
neg_3 = Negative(Value=Slider(50, range=0..100))
move_7 = Move(Geometry=item_12, Motion=trim)  # -> Geometry, Transform
vec_6 = VectorXYZ(XComponent=neg_3, YComponent=neg_3, ZComponent=0)  # -> Vector, Length
move_8 = Move(Geometry=move_7.Geometry, Motion=vec_6.Vector)  # -> Geometry, Transform
scale_4 = Scale(Geometry=move_8.Geometry, Center=Point(0, 0, 0), Factor=Slider(0.25, range=0..1))  # -> Geometry, Transform
