# Grasshopper definition testingEternalCoordinates.gh (Grasshopper 1.0.5)

number_slider = Slider(1000, range=0..1000)
pop2d = Populate2D(
    Region={Plane=PlaneXY(39.50376847, 32.18287924, 0), Size=Domain2(u=-94.45513848..94.45513848, v=-82.98083469..82.98083469)},
    Count=Slider(2000, range=0..10000),
    Seed=1)
pt = Point([Point(41.43342268, 46.67473569, 0), Point(0.1803898291, 33.02570316, 0), Point(29.44796999, 25.9948484, 0)])
item = ListItem(List=pt, Index=0, Wrap=True)  # -> Item, Item1, Item2
pt_2 = Point(pop2d)
avr = Average(Input=pt)
c_script = CSharpScript(p=pt_2, a=item.Item, b=item.Item1, c=item.Item2)  # -> out, A; inputs p: Vector3d, a: Vector3d, b: Vector3d, c: Vector3d
# ---------- c_script: C# ----------
    Vector3d v0 = b - a, v1 = c - a, v2 = p - a;

    double d00 = Dot(v0, v0);
    double d01 = Dot(v0, v1);
    double d11 = Dot(v1, v1);
    double d20 = Dot(v2, v0);
    double d21 = Dot(v2, v1);
    double denom = d00 * d11 - d01 * d01;
    var v = (d11 * d20 - d01 * d21) / denom;
    var w = (d00 * d21 - d01 * d20) / denom;
    var u = 1.0f - v - w;

    Console.WriteLine("v");

    A = new Vector3d(u, v, w);
# ---------- c_script: C# additional code ----------
  private double Dot(Vector3d v0, Vector3d v1){

    return (v0.X * v1.X) + (v0.Y * v1.Y) + (v0.Z * v1.Z);

  }
# ---------- end c_script ----------
pline = PolyLine(Vertices=pt, Closed=True)
devec = DeconstructVector(Vector=c_script.A)  # -> XComponent, YComponent, ZComponent
dprod = DotProduct(Unitize=False)
frgb = ColourRGBF(Alpha=1, Red=devec.XComponent, Green=devec.YComponent, Blue=devec.ZComponent)
dots = DotDisplay(Point=pt_2, Colour=frgb, Size=Slider(5, range=0..10))
